# Dynamo graph script.dyn "430_1_Создать задание на отв" (Dynamo 2.6.1.8786)
# packages: bimorphNodes 3.0.3, Clockwork for Dynamo 2.x 2.3.0, Genius Loci 2021.9.29, archi-lab.net 2021.25.2521

# group: ВК/ОВК. Задание на отверстия в перекрытиях.
# note: Created by: Babuh.AP
# Modified by: Babuh.AP
# Version: 2
# Revit Version: 2021.1.1
# Date: 22.08.2022
# Last Change: 22.08.2022
# Company: LIST Project (Tyumen, Russia)
# note: Описание скрипта
# Ver. 2
# Создание экземпляров семейства
#  "(Отв_Задание)_Стены_Прямоугольное";
# "(Отв_Задание)_Перекрытия_Прямоугольное";
# в точках пересечения перекрытий из связевого файла  осями воздуховодов, труб и лотков в текущем файле. С заданием габаритов отверстия. С записью параметров: подразделения, получающего задание; подразделения, выдавшего задание; текущей даты, версии создаваемого задания

# group: параметр вводной
string = StringInput("Минимальный диаметр трубопровода для учета пересечений")
boolean = BoolSelector(true)
string_2 = StringInput("30")

string_3 = StringInput("Q:\4. Семейства\430_Отверстия_задания\(Отв_Задание)_Перекрытия_Прямоугольное.rfa")
string_4 = StringInput("Q:\4. Семейства\430_Отверстия_задания\(Отв_Задание)_Стены_Прямоугольное.rfa")
list_create = List.Create(item0=string_3, item1=string_4)
python_script = Python(IN[0]=list_create)
# ---------- python_script.python (19 lines) ----------
import clr

clr.AddReference("RevitAPI")
from Autodesk.Revit.DB import *
clr.AddReference("RevitServices")
import RevitServices
from RevitServices.Persistence import DocumentManager
from RevitServices.Transactions import TransactionManager
clr.AddReference("RevitNodes")
doc = DocumentManager.Instance.CurrentDBDocument
x=IN[0]
TransactionManager.Instance.EnsureInTransaction(doc)
if isinstance(x, list) == True:
	family= [doc.LoadFamily(i) for i in x]
else:
	family = doc.LoadFamily(x)
#doc.LoadFamily(FamilyPath)
TransactionManager.Instance.TransactionTaskDone()
OUT=family
# ----------------------------------------
code_block = CodeBlock(x=python_script) { x; "30"; }
python_script_2 = Python(IN[0]=string, IN[1]=code_block.out1, IN[2]=boolean)
# ---------- python_script_2.python (18 lines) ----------
#Copyright (c) mostafa el ayoubi ,  2018
#Data-Shapes www.data-shapes.net , elayoubi.mostafa@gmail.com

class uitext():

    def __init__(self,inputname,defaultvalue,_isnum):
        self.inputname = inputname
        self._isnum = _isnum
        if _isnum: self.defaultvalue = defaultvalue.replace(',','.')
        else: self.defaultvalue = defaultvalue

    def __repr__(self):
        return 'UI.Textbox input'
        
x = uitext(IN[0],IN[1],IN[2])


OUT = x
# ----------------------------------------

# group: Вводной параметр
string_5 = StringInput("Минимальная длина учитываемого участка")
string_6 = StringInput("50")
boolean_2 = BoolSelector(true)

python_script_3 = Python(IN[0]=string_5, IN[1]=string_6, IN[2]=boolean_2)  # same code as python_script_2

# group: Вводной параметр
string_7 = StringInput("""Расстояние между гранями
 трупопровода и отверстия""")
string_8 = StringInput("50")
boolean_3 = BoolSelector(true)

python_script_4 = Python(IN[0]=string_7, IN[1]=string_8, IN[2]=boolean_3)  # same code as python_script_2

# group: Вводной параметр
string_9 = StringInput("Округление размеров отверстия")
string_10 = StringInput("10")
boolean_4 = BoolSelector(true)

python_script_5 = Python(IN[0]=string_9, IN[1]=string_10, IN[2]=boolean_4)  # same code as python_script_2

# group: Вводной параметр
string_11 = StringInput("Внешняя связь для заданий АР/КЖ")
string_12 = StringInput("КЖ")
boolean_5 = BoolSelector(false)

python_script_6 = Python(IN[0]=string_11, IN[1]=string_12, IN[2]=boolean_5)  # same code as python_script_2

# group: Вводной параметр
string_13 = StringInput("Напоминание:")
string_14 = StringInput("Запускать с разреза, фасада, 3д вида")
boolean_6 = BoolSelector(false)

python_script_7 = Python(IN[0]=string_13, IN[1]=string_14, IN[2]=boolean_6)  # same code as python_script_2
list_create_2 = List.Create(item0=python_script_2, item1=python_script_3, item2=python_script_4, item3=python_script_5, item4=python_script_6, item5=python_script_7)

# group: Интерфейс
string_15 = StringInput("Запуск")
boolean_7 = BoolSelector(true)
string_16 = StringInput("Создание заданий на отверстия")
string_17 = StringInput("Отмена")
code_block_2 = CodeBlock { 600; 800; 300; }

string_18 = StringInput("Q:\5. Скрипты Автоматизация\430_Отверстия\logo.png")
code_block_3 = CodeBlock { null; }
python_script_8 = Python(IN[0]=list_create_2, IN[1]=string_15, IN[2]=boolean_7, IN[3]=string_16, IN[4]=string_18, IN[5]=code_block_3, IN[6]=string_17, IN[7]=code_block_2.out0, IN[8]=code_block_2.out1, IN[9]=code_block_2.out2)
# ---------- python_script_8.python (2730 lines) ----------
#Copyright (c) Data Shapes,  2020
#Data-Shapes www.data-shapes.io , elayoubi.mostafa@data-shapes.io @data_shapes
	
import clr
import sys
pyt_path = r'C:\Program Files (x86)\IronPython 2.7\Lib'
sys.path.append(pyt_path)
import os
import webbrowser
import unicodedata
import io
import tempfile
import System
	
try:
	clr.AddReference('System.Windows.Forms')
	clr.AddReference('System.Drawing')
	clr.AddReference('System.Windows.Forms.DataVisualization')
	
	from System.Drawing import Point , Size , Graphics, Bitmap, Image, Font, FontStyle, Icon, Color, Region , Rectangle , ContentAlignment , SystemFonts, FontFamily
	from System.Windows.Forms import Application, DockStyle, Button, Form, Label, TrackBar , ToolTip, ColumnHeader, TextBox, CheckBox, FolderBrowserDialog, OpenFileDialog, DialogResult, ComboBox, FormBorderStyle, FormStartPosition, ListView, ListViewItem , SortOrder, Panel, ImageLayout, GroupBox, RadioButton, BorderStyle, PictureBox, PictureBoxSizeMode, LinkLabel, CheckState, ColumnHeaderStyle , ImageList, VScrollBar, DataGridView, DataGridViewSelectionMode, DataGridViewAutoSizeColumnsMode , DataGridViewClipboardCopyMode , TreeView , TreeNode , TreeNodeCollection , AutoScaleMode , Screen, Padding
	from System.Windows.Forms.DataVisualization.Charting import *#Chart , SeriesChartType
	from System.Collections.Generic import *
	from System.Collections.Generic import List as iList
	from System.Windows.Forms import View as vi
	clr.AddReference('System')
	from System import IntPtr , Char
	from System import Type as SType, IO
	from System import Array
	from System.ComponentModel import Container
	clr.AddReference('System.Data')
	from System.Data import DataTable , DataView

	try: #try to import All Revit dependencies
		clr.AddReference('RevitAPIUI')
		from  Autodesk.Revit.UI import Selection , TaskDialog 
		from  Autodesk.Revit.UI.Selection import ISelectionFilter
		clr.AddReference('RevitNodes')
		import Revit
		clr.ImportExtensions(Revit.Elements)
		clr.ImportExtensions(Revit.GeometryConversion)
		
		clr.AddReference('RevitServices')
		from RevitServices.Persistence import DocumentManager
		doc = DocumentManager.Instance.CurrentDBDocument
		uidoc = DocumentManager.Instance.CurrentUIApplication.ActiveUIDocument
	
		clr.AddReference('RevitAPI')
		try:
			from Autodesk.Revit.DB import ImageImportOptions	
		except:
			from Autodesk.Revit.DB import ImageTypeOptions , ImageType, ImagePlacementOptions , ImageInstance
		from Autodesk.Revit.DB import FilteredElementCollector , Transaction, View , ViewType , ViewFamily, ViewDrafting, ViewFamilyType, Element, ElementId , FamilyInstance , Document , XYZ, BoxPlacement, UnitUtils
		
		try:
			from Autodesk.Revit.DB import  UnitType
		except:
			from Autodesk.Revit.DB import SpecTypeId

		dbviews = [v for v in FilteredElementCollector(doc).OfClass(View).ToElements() if (v.ViewType == ViewType.FloorPlan or v.ViewType == ViewType.CeilingPlan or v.ViewType == ViewType.Section or v.ViewType == ViewType.Elevation or v.ViewType == ViewType.ThreeD)]
		viewindex = 0
		try:
			UIunit = Document.GetUnits(doc).GetFormatOptions(UnitType.UT_Length).DisplayUnits
		except:
			UIunit = Document.GetUnits(doc).GetFormatOptions(SpecTypeId.Length).GetUnitTypeId()
			
		class selectionfilter(ISelectionFilter):
			def __init__(self,category):
				self.category = category
			def AllowElement(self,element):
				if element.Category.Name in [c.Name for c in self.category]:
					return True
				else:
					return False
			def AllowReference(reference,point):
				return False


			
	except: #in case we are in the Sandbox, Formit or Civil 3D environment
		pass
	
	importcolorselection = 0
	
	try:
		from  Autodesk.Revit.UI import ColorSelectionDialog
	except:
		importcolorselection = 1
	

	
	clr.AddReference('ProtoGeometry')
	from Autodesk.DesignScript.Geometry import Point as dsPoint

	from System.Reflection import Assembly
	import xml.etree.ElementTree as et
	

	
	import re	
	def regexEndNum(input):
		try:
			return 	re.search('(\d+)$', input).group(0)
		except:
			return ""

	def iterateThroughNodes(collection,li):
		if hasattr(collection,'Nodes'):
			ntest = collection.Nodes
			if len(ntest) > 0:
				for i in ntest:
					iterateThroughNodes(i,li)
			else:
				if collection.Checked:
					li.append(collection.Tag)
		return li
		

	
	class MultiTextBoxForm(Form):
		
	    def __init__(self):
	        self.Text = 'strana developer'
	        self.output = []
	        self.values = []
	        self.cancelled = False
	
	    def setclose(self, sender, event):
	    	cbindexread = 0
	    	if sender.Name != "Cancel":
	    		for f in self.output:
	    			if f.GetType() == myTextBox:
	    				if f._isNum :
	    					val = float(f.Text)
	    				else:
	    					val = f.Text
	    				self.values.append(val)
	    			if f.GetType() == CheckBox:
	    				self.values.append(f.Checked)
	    			if f.GetType() == Button:
	    				if isinstance(f.Tag ,list):
	    					try:
	    						self.values.append([e for e in f.Tag if e.__class__.__name__ != "Category"])	    					
	    					except:
	    						self.values.append(f.Tag)	    					
	    				else:
	    					try:	    				
	    						if f.Tag.__class__.__name__ != "Category":
	    							self.values.append(f.Tag)
	    						else:
    								self.values.append([])
	    					except:
	    						self.values.append(f.Tag)	
	    			if f.GetType() == ComboBox:
	    				try:
	    					key = f.Text
	    					self.values.append(f.Tag[key])
	    				except:
	    					self.values.append(None)
	    			if f.GetType() == mylistview:
	    				self.values.append([f.Values[i.Text] for i in f.CheckedItems])
	    			if f.GetType() == mytrackbar:
	    				self.values.append(f.startval+f.Value*f.step)
	    			if f.GetType() == mygroupbox:
	    				try:
	    					key = [j.Text for j in f.Controls if j.Checked == True][0]
	    					self.values.append(f.Tag[key])
	    				except:
	    					self.values.append(None)
	    			if f.GetType() == myDataGridView:
	    				f.EndEdit()
	    				dsrc = f.DataSource
	    				out = []
	    				colcount = f.ColumnCount
	    				rowcount = f.RowCount - 1
	    				if f.Tag:
		    				l = []
	    					for i in range(colcount):	    						
	    						l.append(dsrc.Columns[i].ColumnName)
	    					out.append(l)	    						
		    				for r in range(rowcount):
		    					l = []
		    					for i in range(colcount):
		    						l.append(dsrc.DefaultView[r].Row[i])
		    					out.append(l)
	    				else: 
		    				for r in range(rowcount):
		    					l = []
		    					for i in range(colcount):
		    						l.append(dsrc.DefaultView[r].Row[i])
		    					out.append(l)
	    				self.values.append(out)
	    			if f.GetType() == TreeView:
	    				ls = []
	    				nds = f.Nodes[0]
	    				iterateThroughNodes(nds,ls)
	    				self.values.append(ls)
	    			if f.GetType() == GroupBox:
	    				rb = [c for c in f.Controls if c.GetType() == RadioButton and c.Checked][0]
	    				self.values.append(rb.Text)
	    				f.Controls.Remove(rb)
	    	else:
	    		self.values = None
	    		self.cancelled = True
	    	self.Close()
	
	    def reset(self, sender, event):
			pass
	
	    def openfile(self, sender, event):
			ofd = OpenFileDialog()
			dr = ofd.ShowDialog()
			if dr == DialogResult.OK:
				sender.Text = ofd.FileName
				sender.Tag = ofd.FileName

	    def exportToExcel(self, sender, event):
	    	#importing Excel IronPython libraries
	    	clr.AddReferenceByName('Microsoft.Office.Interop.Excel, Version=11.0.0.0, Culture=neutral, PublicKeyToken=71e9bce111e9429c')
	    	from Microsoft.Office.Interop import Excel
	    	ex = Excel.ApplicationClass()
	    	ex.Visible = sender.Tag[1]
	    	ex.DisplayAlerts = False
	    	fbd = FolderBrowserDialog()
	    	fbd.SelectedPath = sender.Text
	    	parent = sender.Parent
	    	fptextbox = parent.GetChildAtPoint(Point(parent.Location.X,sender.Location.Y+5*yRatio))
	    	dataGrid = parent.GetChildAtPoint(Point(parent.Location.X,parent.Location.Y+23*xRatio))
	    	dataTable = dataGrid.DataSource
	    	fptext = fptextbox.Text
	    	titletext = parent.GetChildAtPoint(Point(0,0)).Text
	    	dr = fbd.ShowDialog()
	    	frstRwTtle = sender.Tag[0]
	    	if frstRwTtle:
	    		_header = Excel.XlYesNoGuess.xlYes
	    	else:
	    		_header = Excel.XlYesNoGuess.xlNo
	    	if dr == DialogResult.OK:
	    		workbk = ex.Workbooks.Add()
	    		worksheet = workbk.Worksheets.Add()
	    		#Writing title and doc info
	    		if sender.Tag[2]:
		    		titleCell = worksheet.Cells[1,1]
		    		worksheet.Cells[2,1].Value2 = sender.Tag[3]
		    		titleCell.Value2 = titletext
		    		titleCell.Font.Size = 18
		    		titleCell.Font.Bold = True
		    		startR = 3
		    		endR = 3
		    	else:
		    		startR = 1
		    		endR = 0	
		    	if frstRwTtle:
		    		for j in range(0,dataTable.Columns.Count):
		    			worksheet.Cells[startR,j+1] = dataTable.Columns[j].ColumnName		    	
		    		for i in range(0,dataTable.Rows.Count):
		    			for j in range(0,dataTable.Columns.Count):
			    			worksheet.Cells[i+startR+1,j+1] = dataTable.DefaultView[i].Row[j].ToString()
		    		xlrange = ex.get_Range(worksheet.Cells[startR,1],worksheet.Cells[dataTable.Rows.Count+endR+1,dataTable.Columns.Count])			    			
		    	else :
		    		for i in range(0,dataTable.Rows.Count):
		    			for j in range(0,dataTable.Columns.Count):
			    			worksheet.Cells[i+startR,j+1] = dataTable.DefaultView[i].Row[j].ToString()		    	
		    		xlrange = ex.get_Range(worksheet.Cells[startR,1],worksheet.Cells[dataTable.Rows.Count+endR,dataTable.Columns.Count])
		    	xlrange.Columns.AutoFit()
		    	worksheet.ListObjects.Add(Excel.XlListObjectSourceType.xlSrcRange, xlrange, SType.Missing, _header, SType.Missing).Name = "DataShapesTable"
		    	worksheet.ListObjects["DataShapesTable"].TableStyle =  "TableStyleMedium16"
	    		workbk.SaveAs(fbd.SelectedPath + "\\" + fptext)
	    		if not sender.Tag[1]:
	    			workbk.Close()
	    			ex.Quit()

	    def startCell(self, sender, event ):
			sender.startcell["X"] = event.ColumnIndex
			sender.startcell["Y"] = event.RowIndex	

	    def endCell(self, sender, event ):
	    	try:
				sender.endcell["X"] = event.ColumnIndex
				sender.endcell["Y"] = event.RowIndex 
				startval = sender.Rows[sender.startcell["Y"]].Cells[sender.startcell["X"]].Value
				endNum = regexEndNum(startval)
				if endNum != "":
					if sender.endcell["Y"] == sender.startcell["Y"]:
						for e,i in enumerate(range(sender.startcell["X"],sender.endcell["X"] + 1)):
							sender.Rows[sender.startcell["Y"]].Cells[i].Value = startval[:-len(endNum)] + str(int(endNum) + e)
					elif sender.endcell["X"] == sender.startcell["X"]:
						for e,i in enumerate(range(sender.startcell["Y"],sender.endcell["Y"] + 1)):
							sender.Rows[i].Cells[sender.endcell["X"]].Value = startval[:-len(endNum)] + str(int(endNum) + e)
				else:				
					if sender.endcell["Y"] == sender.startcell["Y"]:
						for i in range(sender.startcell["X"],sender.endcell["X"] + 1):
							sender.Rows[sender.startcell["Y"]].Cells[i].Value = startval
					elif sender.endcell["X"] == sender.startcell["X"]:
						for i in range(sender.startcell["Y"],sender.endcell["Y"] + 1):
							sender.Rows[i].Cells[sender.endcell["X"]].Value = startval
	    	except:
	    		pass
	    		    	
	    def startRowDrag(self, sender, event ):
	    	shmak
			
	    def opendirectory(self, sender, event):
			fbd = FolderBrowserDialog()
			fbd.SelectedPath = sender.Text
			dr = fbd.ShowDialog()
			if dr == DialogResult.OK:
				sender.Text = fbd.SelectedPath
				sender.Tag = fbd.SelectedPath
	
	    def pickobjects(self, sender, event):   
			for c in self.Controls:
				c.Enabled = False
			try:
				sel = uidoc.Selection.PickObjects(Selection.ObjectType.Element,'')
				selelem = [doc.GetElement(s.ElementId) for s in sel]
				sender.Tag = (selelem)
			except:
				pass
			for c in self.Controls:
				c.Enabled = True
		#THIS METHOD IS FOR CIVIL 3D EVIRONMENT
	    def pickautocadobjects(self, sender, event):   
			selelem = []	
			for c in self.Controls:
				c.Enabled = False
			try:
				acadDoc = System.Runtime.InteropServices.Marshal.GetActiveObject("Autocad.Application").ActiveDocument
				acadDoc.Activate()
				acadUser = acadDoc.GetVariable("users5")	
				acadDoc.SendCommand("(and(princ\042"+ sender.Text + "\042)(setq ss(ssget))(setvar\042users5\042\042LinkDWGUIOK\042)(command\042_.Select\042ss\042\042)) ")
				selection_ = acadDoc.ActiveSelectionSet
				acadDoc.SendCommand("(setq ss nil) ")
				if acadDoc.GetVariable("users5") == "LinkDWGUIOK" and selection_ != None:
					for sel in selection_:				
						selelem.append(sel)		
					acadDoc.SetVariable("users5", acadUser)
				sender.Tag = list(selelem)		
			except:
				pass
			for c in self.Controls:
				c.Enabled = True	

	    def pickautocadobject(self, sender, event):   
			selelem = None	
			for c in self.Controls:
				c.Enabled = False
			try:
				acadDoc = System.Runtime.InteropServices.Marshal.GetActiveObject("Autocad.Application").ActiveDocument
				acadUser = acadDoc.GetVariable("users5")
				acadPickBox = acadDoc.GetVariable("pickbox")
				acadDoc.SetVariable("pickbox", 5)
				acadDoc.Activate()
				acadDoc.SendCommand("(setq obj(car(entsel\042" + sender.Text + "\042))) ")
				acadDoc.SendCommand("(and obj(setvar\042users5\042(cdr(assoc 5(entget obj))))(setq obj nil)) ")		
				selection_ = acadDoc.GetVariable("users5")
				acadDoc.SetVariable("pickbox", acadPickBox)
				acadDoc.SetVariable("users5", acadUser)
				selelem = acadDoc.HandleToObject(selection_)
				sender.Tag = selelem		
			except:
				pass
			for c in self.Controls:
				c.Enabled = True	

	    def pickobjectsordered(self, sender, event):
			for c in self.Controls:
				c.Enabled = False
			output = []
			test = True
			TaskDialog.Show("Data|Shapes", 'Pick elements in order, then hit ESC to exit.')
			while test:
				try:
					sel = doc.GetElement(uidoc.Selection.PickObject(Selection.ObjectType.Element, 'Pick elements in order').ElementId)
					output.append(sel.ToDSType(True))
				except : 
					test = False
				sender.Tag = output
			for c in self.Controls:
				c.Enabled = True
	    
	    def pickobjectsofcatordered(self, sender, event):
			for c in self.Controls:
				c.Enabled = False
			output = []
			test = True
			if isinstance(sender.Tag,list):			
				category = UnwrapElement(sender.Tag)
			else:
				category = [UnwrapElement(sender.Tag)]
			TaskDialog.Show("Data|Shapes", 'Select %s in order, then press ESC to exit.' %(', '.join([c.Name for c in category])))
			while test:
				try:
					selfilt = selectionfilter(category)
					sel = doc.GetElement(uidoc.Selection.PickObject(Selection.ObjectType.Element,selfilt, 'Select %s' %(', '.join([c.Name for c in category]))).ElementId)				
					output.append(sel.ToDSType(True))
				except : 
					test = False
				sender.Tag = (output)
			for c in self.Controls:
				c.Enabled = True
			
	    def picklinkedobjects(self, sender, event):
			#This part was made easier by Dimitar Venkov's work
			for c in self.Controls:
				c.Enabled = False
			try:
				linkref = uidoc.Selection.PickObject(Selection.ObjectType.Element,'Select the link instance.')
				link = doc.GetElement(linkref.ElementId).GetLinkDocument()
				td = TaskDialog.Show('Data-Shapes','Select the linked elements and press Finish.')
				sel = uidoc.Selection.PickObjects(Selection.ObjectType.LinkedElement,'Select the linked elements and press Finish.')
				selelem = [link.GetElement(s.LinkedElementId) for s in sel]
				sender.Tag = (selelem)
			except:
				pass
			for c in self.Controls:
				c.Enabled = True		

	    def pickobject(self, sender, event):
			for c in self.Controls:
				c.Enabled = False
			try:
				sel = uidoc.Selection.PickObject(Selection.ObjectType.Element,'')
				selelem = doc.GetElement(sel.ElementId) 
				sender.Tag = (selelem)
			except:
				pass
			for c in self.Controls:
				c.Enabled = True
			
	    def picklinkedobject(self, sender, event):
			#This part was made easier by Dimitar Venkov's work
			for c in self.Controls:
				c.Enabled = False
			try:
				linkref = uidoc.Selection.PickObject(Selection.ObjectType.Element,'Select the link instance.')
				link = doc.GetElement(linkref.ElementId).GetLinkDocument()
				td = TaskDialog.Show('Data-Shapes','Select the linked element.')
				sel = uidoc.Selection.PickObject(Selection.ObjectType.LinkedElement,'Select the linked element.')
				selelem = link.GetElement(sel.LinkedElementId)
				sender.Tag = (selelem)
			except:
				pass				
			for c in self.Controls:
				c.Enabled = True
			
	    def pickobjectsofcat(self, sender, event):
			for c in self.Controls:
				c.Enabled = False
			if isinstance(sender.Tag,list):	    
				category = UnwrapElement(sender.Tag)
			else:
				category = [UnwrapElement(sender.Tag)]
			try:
				selfilt = selectionfilter(category)
				sel = uidoc.Selection.PickObjects(Selection.ObjectType.Element,selfilt,'Select %s' %(', '.join([c.Name for c in category])))
				selelem = [doc.GetElement(s.ElementId) for s in sel]
				sender.Tag = (selelem)
			except:
				pass
			for c in self.Controls:
				c.Enabled = True

	    def pickobjectofcat(self, sender, event):
			for c in self.Controls:
				c.Enabled = False
			if isinstance(sender.Tag,list):	    
				category = UnwrapElement(sender.Tag)
			else:
				category = [UnwrapElement(sender.Tag)]
			try:
				selfilt = selectionfilter(category)
				sel = uidoc.Selection.PickObject(Selection.ObjectType.Element,selfilt,'Select %s' %(', '.join([c.Name for c in category])))
				selelem = doc.GetElement(sel.ElementId) 
				sender.Tag = (selelem)
			except:
				pass
			for c in self.Controls:
				c.Enabled = True
			
	    def pickfaces(self, sender, event):
			faces = []	    	
			for c in self.Controls:
				c.Enabled = False
			try:
				selface = uidoc.Selection.PickObjects(Selection.ObjectType.Face,'')
				for s in selface:
					f = uidoc.Document.GetElement(s).GetGeometryObjectFromReference(s).ToProtoType(True)
					[i.Tags.AddTag("RevitFaceReference", s) for i in f]
					faces.append(f)
				sender.Tag = [i for j in faces for i in j]
			except:
				pass
			for c in self.Controls:
				c.Enabled = True
				
	    def pickpointsonface(self, sender, event):
			faces = []	    	
			for c in self.Controls:
				c.Enabled = False
			selpoints = uidoc.Selection.PickObjects(Selection.ObjectType.PointOnElement,'')
			points = []
			for s in selpoints:
				pt = s.GlobalPoint
				points.append(dsPoint.ByCoordinates(UnitUtils.ConvertFromInternalUnits(pt.X,UIunit),UnitUtils.ConvertFromInternalUnits(pt.Y,UIunit),UnitUtils.ConvertFromInternalUnits(pt.Z,UIunit)))
			sender.Tag = points
			for c in self.Controls:
				c.Enabled = True
				
	    def pickedges(self, sender, event):
			edges = []
			for c in self.Controls:
				c.Enabled = False	
			try:				
				seledge = uidoc.Selection.PickObjects(Selection.ObjectType.Edge,'')
				for s in seledge:
					e = uidoc.Document.GetElement(s).GetGeometryObjectFromReference(s).AsCurve().ToProtoType(True)
					e.Tags.AddTag("RevitFaceReference", s)
					edges.append(e)
				sender.Tag = edges
			except:
				pass
			for c in self.Controls:
				c.Enabled = True

	    def colorpicker(self, sender, event):
			dialog = ColorSelectionDialog()
			selection = ColorSelectionDialog.Show(dialog)
			selected = dialog.SelectedColor
			sender.Tag = selected
			sender.BackColor = Color.FromArgb(selected.Red,selected.Green,selected.Blue)
			sender.ForeColor = Color.FromArgb(selected.Red,selected.Green,selected.Blue)
	
	    def topmost(self):
			self.TopMost = True
	
	    def lvadd(self, sender, event):
			sender.Tag = [i for i in sender.CheckedItems]
			
	    def scroll(self, sender, event):
			parent = sender.Parent
			child = parent.GetChildAtPoint(Point(0,5*yRatio))
			child.Text = str(sender.startval+sender.Value*sender.step)

	    def openurl(self, sender, event):
			webbrowser.open(sender.Tag)
	
	    def selectall(self, sender, event):
			if sender.Checked:
				parent = sender.Parent
				listview = parent.GetChildAtPoint(Point(0,0))
				for i in listview.Items:
					i.Checked = True
			else:
				pass
				
	    def selectnone(self, sender, event):
			if sender.Checked:
				parent = sender.Parent
				listview = parent.GetChildAtPoint(Point(0,0))
				for i in listview.Items:
					i.Checked = False
			else:
				pass		

	    def updateallnone(self, sender, event):
	    	try:
	    		parent = sender.Parent
	    		rball = parent.GetChildAtPoint(Point(0,sender.Height + 5*yRatio))
	    		rbnone = parent.GetChildAtPoint(Point(80 * xRatio,sender.Height + 5*yRatio))
	    		if sender.CheckedItems.Count == 0 and event.NewValue == CheckState.Unchecked:
	    			rbnone.Checked = False
	    			rball.Checked = False
	    		elif sender.CheckedItems.Count == sender.Items.Count and event.NewValue == CheckState.Unchecked:
	    			rball.Checked = False
	    			rbnone.Checked = False
	    		elif sender.CheckedItems.Count == sender.Items.Count-1 and event.NewValue == CheckState.Checked:
	    			rball.Checked = True
	    			rbnone.Checked = False
	    		elif sender.CheckedItems.Count == 1 and event.NewValue == CheckState.Unchecked:
	    			rball.Checked = False
	    			rbnone.Checked = True	    	
	    		else :
	    			rball.Checked = False
	    			rbnone.Checked = False
	    	except:
	    		pass

	    def zoomcenter(self, sender, event ):
			if event.X > 15:	    
				try:
					element = doc.GetElement(uidoc.Selection.GetElementIds()[0])
					uidoc.ShowElements(element)
				except:
					pass
			else:
				pass
				
			
	    def setviewforelement(self, sender, event ):    
			if event.X > 15*xRatio:	    		
				try:
					item = sender.GetItemAt(event.X,event.Y).Text
					element = UnwrapElement(sender.Values[item])
					try:
						viewsforelement = [v for v in dbviews if (not v.IsTemplate) and (element.Id in [e.Id for e in FilteredElementCollector(doc,v.Id).OfClass(element.__class__).ToElements()])]
					except:
						viewsforelement = [v for v in dbviews if (not v.IsTemplate) and (element.Id in [e.Id for e in FilteredElementCollector(doc,v.Id).OfClass(FamilyInstance).ToElements()])]
					global viewindex
					dbView = viewsforelement[viewindex]
					id = [element.Id]
					icollection = iList[ElementId](id)
					uidoc.Selection.SetElementIds(icollection)
				except:
					pass
			else:	    
				pass


	    def CheckChildren(self, sender, event ):
			evNode = event.Node	    
			checkState = evNode.Checked	
			for n in event.Node.Nodes:	   	
				n.Checked = checkState			
				
	    def ActivateOption(self, sender, event ):
	    	parent = sender.Parent
	    	associatedControls = [p for p in parent.Controls if p.Name == sender.Text and p.GetType() == Panel][0]
	    	restofcontrols = [p for p in parent.Controls if p.Name != sender.Text and p.GetType() == Panel]
	    	if sender.Checked:
	    		associatedControls.Enabled = True
	    		for c in restofcontrols:
	    			c.Enabled = False
	    		parent.Tag = sender.Text
	    		
	    def showtooltip(self, sender, event ):
	    	ttp = ToolTip()
	    	ttp.AutoPopDelay = 10000
	    	ttp.SetToolTip(sender , sender.Tag)	

	    def numsOnly(self, sender, event ):
	    	if Char.IsDigit(event.KeyChar)==False and event.KeyChar != "." and Char.IsControl(event.KeyChar)==False:
	    		event.Handled = True
	    
	    def chart_showLabels(self, sender, event):
			cb = sender
			panelcht = sender.Parent
			chart1 = panelcht.GetChildAtPoint(Point(0,0))
			for s in chart1.Series:
				if s.ChartType == SeriesChartType.Pie:
					if cb.Checked:
						s["PieLabelStyle"] = "Inside"
					else:
						s["PieLabelStyle"] = "Disabled"
				else:
					if cb.Checked:
						s.IsValueShownAsLabel = True
					else:
						s.IsValueShownAsLabel = False
	    		
	    def imageexport(self, sender, event):
	    	import datetime
	    	from datetime import datetime
	    	from RevitServices.Transactions import TransactionManager
	    	#Modify resolution before the render
	    	fontFam = FontFamily("Segoe UI Symbol")
	    	originalFont = Font(fontFam,8)
	    	panelcht = sender.Parent
	    	chart1 = panelcht.GetChildAtPoint(Point(0,0))
	    	originalTitleFont = chart1.Titles[0].Font
	    	originalWidth = chart1.Width
	    	originalHeight = chart1.Height
	    	chart1.Visible = False
	    	chart1.Dock = DockStyle.None
	    	chart1.Width = 2100 * 0.8
	    	chart1.Height = 1500 * 0.8
	    	chart1.ChartAreas[0].AxisX.LabelAutoFitStyle = LabelAutoFitStyles.None
	    	chart1.ChartAreas[0].AxisY.LabelAutoFitStyle = LabelAutoFitStyles.None
	    	chart1.ChartAreas[0].AxisX.LabelStyle.Font = Font(fontFam, 30)
	    	chart1.ChartAreas[0].AxisY.LabelStyle.Font = Font(fontFam, 30)
	    	chart1.ChartAreas[0].AxisX.TitleFont = Font(fontFam, 30)
	    	chart1.ChartAreas[0].AxisY.TitleFont = Font(fontFam, 30)
	    	chart1.TextAntiAliasingQuality = TextAntiAliasingQuality.High
	    	chart1.BackColor = Color.White
	    	chart1.Titles[0].Font = Font(fontFam, 32, FontStyle.Bold)
	    	chart1.ChartAreas[0].BackColor = Color.White
	    	for serie in chart1.Series:
	    		serie.Font = Font(fontFam, 30)
		    	for p in serie.Points:
		    		p.Font = Font(fontFam, 30)
		    		p.MarkerSize = 15
	    	for legend in chart1.Legends:
	    		legend.Font = Font(fontFam, 30)
	    		legend.BackColor = Color.White
	    	chart1.Invalidate()
	    	chart1.SaveImage(tempfile.gettempdir() + "\\chartImage.bmp", ChartImageFormat.Bmp)
	    	#Get back to original settings
	    	chart1.Width = originalWidth
	    	chart1.Height = originalHeight
	    	chart1.BackColor = Color.Transparent
	    	chart1.ChartAreas[0].BackColor = Color.Transparent
	    	chart1.ChartAreas[0].AxisX.LabelStyle.Font = originalFont
	    	chart1.ChartAreas[0].AxisY.LabelStyle.Font = originalFont
	    	chart1.ChartAreas[0].AxisX.TitleFont = originalFont
	    	chart1.ChartAreas[0].AxisY.TitleFont = originalFont
	    	chart1.Titles[0].Font = originalTitleFont
	    	for serie in chart1.Series:
	    		serie.Font = originalFont
	    		for p in serie.Points:
	    			p.Font = originalFont
		    		p.MarkerSize = 8
	    	for legend in chart1.Legends:
	    		legend.Font = originalFont
	    		legend.BackColor = Color.Transparent
	    	chart1.Invalidate()
	    	chart1.Visible = True
	    	#Import the picture in a Drafting View
	    	#Import the picture in a Drafting View // The try catch if for handling the fact that ImageImportOptions was deprecated in 2020 and is obsolete in 2021	    	
	    	try:
	    		importOptions = ImageImportOptions()	
	    		importOptions.Resolution = 72
	    		importOptions.Placement = BoxPlacement.TopLeft	    		
	    	except:
	    		imageTypeOption = ImageTypeOptions()	
	    		imageTypeOption.Resolution = 72

	    	collector = FilteredElementCollector(doc).OfClass(ViewFamilyType)
	    	viewFamilyTypes = []
	    	for c in collector:
	    		if c.ViewFamily == ViewFamily.Drafting:
	    			viewFamilyTypes.append(c)
	    	viewFamilyType = viewFamilyTypes[0]
	    	TransactionManager.Instance.EnsureInTransaction(doc)
	    	draftView = ViewDrafting.Create(doc,viewFamilyType.Id)
	    	draftView.Name = chart1.Titles[0].Text + datetime.now().strftime(" (%m/%d/%Y, %H.%M.%S)")
	    	imagePath = tempfile.gettempdir() + "\\chartImage.bmp"
	    	newElement = clr.StrongBox[Element]()
	    	try:
	    		doc.Import(imagePath,importOptions,draftView,newElement)	    	
	    	except:
	    		imageTypeOption.SetPath(imagePath)
	    		imageType = ImageType.Create(doc,imageTypeOption)
	    		placementOptions = ImagePlacementOptions(XYZ(0,0,0),BoxPlacement.TopLeft)
	    		ImageInstance.Create(doc,draftView,imageType.Id,placementOptions)	    		
	    	TransactionManager.Instance.TransactionTaskDone()
	    		    	
	    def chart_showLegend(self, sender, event ):
	    	cb = sender
	    	panelcht = sender.Parent
	    	chart1 = panelcht.GetChildAtPoint(Point(0,0))
	    	if len(chart1.Legends) <= 1:
	    		for legend in chart1.Legends:
	    			if cb.Checked:
	    				legend.Enabled = True
	    			else:
	    				legend.Enabled = False
	    	else:
	    		if cb.Checked:
	    			chart1.Legends[1].Enabled = True
	    		else:
	    			chart1.Legends[1].Enabled = False
		    		

	class mylistview(ListView):
	
		def __init__(self):
			self.Values = []

	class mytrackbar(TrackBar):
	
		def __init__(self,startval,step):
			self.startval = startval
			self.step = step

	class myDataGridView(DataGridView):
	
		def __init__(self):
			self.startcell = {}
			self.endcell = {}
			
	class mygroupbox(GroupBox):
	
		def __init__(self):
			self.Values = []
			
	class myTextBox(TextBox):
	
		def __init__(self):
			self._isNum = False
	
			
	#Form initialization
	
	form = MultiTextBoxForm()
	xRatio = Screen.PrimaryScreen.Bounds.Width/1920
	if xRatio == 0:
		xRatio = 1
	yRatio = Screen.PrimaryScreen.Bounds.Height/1080
	if yRatio == 0:
		yRatio = 1
	form.topmost()	
	form.ControlBox = True
	xlabel = 25 * xRatio
	xinput = 150 * xRatio
	formy = 10 * yRatio
	if IN[8] * xRatio > (350 * xRatio):	formwidth = IN[8] * xRatio
	else: formwidth = 350 * xRatio
	fields = []
	error = 0
	
	#Description 
	
	if IN[3] != "":
		des = Label()
		des.Location = Point(xlabel,formy)
		des.Font = Font("Arial", 15,FontStyle.Bold)		
		des.AutoSize = True
		des.MaximumSize = Size(formwidth - (2 * xlabel)*xRatio,0)
		des.Text = IN[3]
		form.Controls.Add(des)
		formy = des.Bottom + (15*xRatio)
	formheaderheight = formy
	
	#Input form
	
	# Create a container panel for all inputs
	body = Panel()
	body.Location = Point(0,formy)
	body.Width = formwidth - 15*xRatio
	
	
	# Process form inputs
	if isinstance(IN[0],list):
		inputtypes = IN[0]
	else:
		inputtypes = [IN[0]]
	# This definition is to handle the sorting of special characters
	def remove_accents(input_str):
	    nfkd_form = unicodedata.normalize('NFKD', input_str)
	    only_ascii = nfkd_form.encode('ASCII', 'ignore')
	    return only_ascii	

	#Adding Logo 
	#default logo in case no input	
	def getImageByName(ImName):
		dynamo = Assembly.Load('DynamoCore')
		version = str(dynamo.GetName().Version)[:3]		
		dynPath = os.getenv('APPDATA')+"\\Dynamo\Dynamo Revit\\" + version 
		root = et.parse(dynPath + "\DynamoSettings.xml").getroot()
		logopaths = []
		for child in root:
			if child.tag == "CustomPackageFolders":
				for path in child:
					logopaths.append(path.text + "\packages\Data-Shapes\extra\\" + ImName)
					logopaths.append(path.text + "\Data-Shapes\extra\\" + ImName)
		deflogopath = ""
		for path in logopaths:
			if deflogopath == "":
				if os.path.isfile(path):
					deflogopath = path
					try:
						ima = Image.FromFile(deflogopath)
						bmp = Bitmap.FromFile(deflogopath)
						return ima,bmp
					except: 
						pass
						
	try:
		if IN[4] != '':
			try:
				ima = Image.FromFile(IN[4])
				bmp = Bitmap.FromFile(IN[4])
			except:
				ima = IN[4]
				bmp = IN[4]

		else :
			_ims = getImageByName("a.png")
			ima = _ims[0]
			bmp = _ims[1]
			
		logo = Panel()
		if IN[6] == None:
			xlogo = 20 * xRatio
			ylogo = formy+ 10*yRatio
		else:
			xlogo = 30 * xRatio
			ylogo = formy
		size = 110 * xRatio
		logo = PictureBox()
		ratio = (ima.Height)/(ima.Width)
		h = float(ima.Height)
		w = float(ima.Width)
		ratio = h/w
		logo.Size = Size(size,size*ratio)
		scaledimage = Bitmap(size,size*ratio)
		gr = Graphics.FromImage(scaledimage)
		gr.DrawImage(ima,0,0,size,size*ratio)
		logo.Image = ima
		logo.SizeMode = PictureBoxSizeMode.Zoom
		form.Controls.Add(logo)
		logo.Location = Point(xlogo,ylogo)
		
		
		#Setting icon 
		thumb = bmp.GetThumbnailImage(64, 64, bmp.GetThumbnailImageAbort,IntPtr.Zero)
		thumb.MakeTransparent();
		icon = Icon.FromHandle(thumb.GetHicon())
		form.Icon = icon

	except :
		logo = Panel()
		logo.Width = 110 * xRatio
		logo.Height = 110 * yRatio
	
	def addinput(formbody,inputs,starty,xinput,rightmargin,labelsize,importcolorselection):
		y = starty
		for j in inputs:
			label = Label()
			label.Location = Point(xlabel,y+4*yRatio)
			label.AutoSize = True
			label.MaximumSize = Size(labelsize,0)
			if j.__class__.__name__ == 'listview' and j.element_count > 0:
				label.Text = j.inputname + '\n(' + str(j.element_count) + ' element' + ("s" if j.element_count > 1 else "") + ')'
			else:
				try:
					label.Text = j.inputname
				except:
					pass
			formbody.Controls.Add(label)
	
			if j.__class__.__name__ == 'dropdown':
				cb = ComboBox()
				if j.inputname != "":
					cb.Width = formwidth - rightmargin - xinput
					cb.Location = Point(xinput,y)
				else:
					cb.Width = formwidth - rightmargin - xlabel
					cb.Location = Point(xlabel,y)
				cb.Sorted = j._sorted
				[cb.Items.Add(i) for i in j.keys() if not (i == 'inputname' or i == 'height' or i == 'defaultvalue' or i == 'highlight' or i == '_sorted' )]
				cb.Tag = j
				if j.defaultvalue != None:
					defindex = [i for i in cb.Items].index([i for i in j.keys() if not (i == 'inputname' or i == 'height' or i == 'defaultvalue' or i == 'highlight' or i == '_sorted' )][j.defaultvalue])
					cb.SelectedIndex = defindex
				formbody.Controls.Add(cb)
				form.output.append(cb)
				y = label.Bottom + 25 * yRatio
			#CHARTS 
			if j.__class__.__name__ == 'uipiechart':					
				labels = j.xseries
				inputcolors = j.inputcolors
				pyList = []
				xseries = [j.xseries]
				yseries = [j.yseries]
				nbOfSeries = 1
				if inputcolors is not None:
					colorBool = True
					for color in inputcolors:
						pyList.append(Color.FromArgb(color.Red,color.Green,color.Blue))
					wfColor = Array[Color](pyList)
				else:
					colorBool = False
				#Set a global Font code
				fontFam = FontFamily("Segoe UI Symbol")
				originalFont = Font(fontFam,8)
				#Chart created and Panel to host the chart
				chart1 = Chart()
				panelChart = Panel()
				panelChart.Name = "panelChart"
				#Panels colors
				chart1.BackColor = formbody.BackColor
				panelChart.BackColor = Color.Transparent
				#PanelChart location
				panelChart.Width = formwidth  - rightmargin - xlabel
				panelChart.Location = Point(xlabel,y + 30)
				#Chart colors palette
				chart1.Palette =  ChartColorPalette.None
				if colorBool:
					chart1.PaletteCustomColors = wfColor
				else:
					chart1.Palette =  ChartColorPalette.None
				chart1.Series.Clear()
				#Series created
				label = SmartLabelStyle()
				def createSeries(seriesName,_keys,_values):
					srs = Series()
					srs["PieLabelStyle"] = "Inside"
					srs.Name = seriesName
					srs.ChartType = SeriesChartType.Pie
					srs.ToolTip = "Percent: #PERCENT"
					srs.IsValueShownAsLabel = True
					for i,j in zip(_keys,_values):
						srs.Points.AddXY(i,j)
					return srs
				#Create series
				series = []
				for i in range(0,len(xseries)):
					series.append(createSeries(labels[i],xseries[i],yseries[i]))
				#Add series to chart
				for s in series:
					chart1.Series.Add(s)
				#Legend text of the points
				for s in series:
					for p in s.Points: 
						p.Font = originalFont
				#Refresh the Chart
				chart1.Invalidate()
				#Create a ChartArea and add it to the chart
				chartArea1 = ChartArea()
				chartArea1.BackColor = formbody.BackColor
				chartArea1.Name = "ChartArea1"
				chart1.ChartAreas.Add(chartArea1)				
				#Create a Legend and add it to the chart
				legend1 = Legend()
				legend1.BackColor = formbody.BackColor
				legend1.Font = originalFont
				legend1.Name = "Legend1"
				legend1.IsTextAutoFit = True
				legend1.LegendStyle = LegendStyle.Column
				chart1.Legends.Add(legend1)
				#Initialize the chart and its properties
				chart1.BeginInit()
				chart1.Size = Size(panelChart.Width,panelChart.Width)
				chart1.AntiAliasing = AntiAliasingStyles.All
				fontFam = FontFamily("Segoe UI Symbol")
				titleFont = Font(fontFam,10,FontStyle.Bold)
				title = Title()
				title.Text = j.chartname
				title.Alignment = ContentAlignment.TopLeft
				title.Font = titleFont
				chart1.Titles.Add(title)
				#Add a button to push on view
				bt = Button()
				bt.Tag = "Push the chart on a view in Revit"
				bt.Text = "Push on a draft view"
				bt.Height = 20 * yRatio
				bt.Width = 140 * yRatio				
				panelChart.Controls.Add(bt)
				bt.BringToFront()
				bt.Font = originalFont
				bt.Click += form.imageexport
				#Add a checkBox to show/hide legend
				checkBox1 = CheckBox()
				checkBox1.AutoCheck = True
				checkBox1.Name = "checkBox1"
				checkBox1.Text = "Legend"
				panelChart.Controls.Add(checkBox1)
				checkBox1.BringToFront()
				checkBox1.Checked = True
				checkBox1.Font = originalFont
				checkBox1.AutoSize = True
				checkBox1.Click += form.chart_showLegend
				#Add a checkBox to show/hide labels
				checkBox2 = CheckBox()
				checkBox2.AutoCheck = True
				checkBox2.Name = "checkBox2"
				checkBox2.Text = "Labels"
				panelChart.Controls.Add(checkBox2)
				checkBox2.BringToFront()
				checkBox2.Checked = True
				checkBox2.Font = originalFont
				checkBox2.AutoSize = True
				checkBox2.Click += form.chart_showLabels
				
				panelChart.Size = Size(panelChart.Width, panelChart.Width + checkBox2.Height + 30)
				#Add chart to panel
				panelChart.Controls.Add(chart1)
				chart1.Location = Point(0,0)
				bt.Location = Point(panelChart.Width - bt.Width, panelChart.Width + 15)
				checkBox1.Location = Point(panelChart.Width - bt.Width - 80, panelChart.Width + 15)
				checkBox2.Location = Point(panelChart.Width - bt.Width - 160, panelChart.Width + 15)
				formbody.Controls.Add(panelChart)
				
				y = panelChart.Bottom + 25 * yRatio
				
			elif j.__class__.__name__ == 'uibarchart':
				if isinstance(j.labels,list):
					labels = j.labels
				else:
					labels = [j.labels]
				inputcolors = j.inputcolors
				horizont = j.ishorizontal
				pyList = []
				if isinstance(j.xseries[0],list) and isinstance(j.yseries[0],list):
					nbOfSeries = len(j.xseries)
					xseries = j.xseries
					yseries = j.yseries
				elif isinstance(j.xseries[0],list) == False and isinstance(j.yseries[0],list):
					nbOfSeries = len(j.yseries)
					xseries = []
					i = 1
					while i <= nbOfSeries:
						xseries.append(j.xseries)
						i = i + 1
					yseries = j.yseries
				elif isinstance(j.yseries[0],list) == False and isinstance(j.xseries[0],list):
					nbOfSeries = len(j.xseries)
					yseries = []
					i = 1
					while i <= nbOfSeries:
						yseries.append(j.yseries)
						i = i + 1
					xseries = j.xseries
				else:
					xseries = [j.xseries]
					yseries = [j.yseries]
					nbOfSeries = 1
				if inputcolors is not None:
					colorBool = True
					for color in inputcolors:
						pyList.append(Color.FromArgb(color.Red,color.Green,color.Blue))
					wfColor = Array[Color](pyList)
				else:
					colorBool = False
				#Set a global Font code
				fontFam = FontFamily("Segoe UI Symbol")
				originalFont = Font(fontFam,8)
				#Chart created and Panel to host the chart
				chart1 = Chart()
				panelChart = Panel()
				panelChart.Name = "panelChart"
				#Panels colors
				chart1.BackColor = formbody.BackColor
				panelChart.BackColor = Color.Transparent
				#PanelChart location
				panelChart.Width = formwidth  - rightmargin - xlabel
				panelChart.Location = Point(xlabel,y + 30)				
				#Chart colors palette
				chart1.Palette =  ChartColorPalette.None
				if colorBool:
					chart1.PaletteCustomColors = wfColor
				else:
					chart1.Palette =  ChartColorPalette.None
				chart1.Series.Clear()
				#Series created
				def createSeries(seriesName,_keys,_values,_horizont):
					srs = Series()
					srs.Name = seriesName
					if _horizont:
						srs.ChartType = SeriesChartType.Bar
					else:
						srs.ChartType = SeriesChartType.Column
					srs.ToolTip = "Percent: #PERCENT"
					srs.IsValueShownAsLabel = True
					srs.Font = originalFont
					for i,j in zip(_keys,_values):
						srs.Points.AddXY(i,j)
					return srs
				#Create series
				series = []
				for i in range(0,nbOfSeries):
					series.append(createSeries(labels[i],xseries[i],yseries[i],horizont))
				#Add series to chart
				for s in series:
					chart1.Series.Add(s)
				#Refresh the Chart
				chart1.Invalidate()
				#Create a ChartArea and add it to the chart
				chartArea1 = ChartArea()
				chartArea1.BackColor = formbody.BackColor
				chartArea1.Name = "ChartArea1"
				chartArea1.AxisX.Title = j.xaxislabel
				chartArea1.AxisY.Title = j.yaxislabel
				chart1.ChartAreas.Add(chartArea1)
				#Create a Legend and add it to the chart
				legend1 = Legend()
				legend1.BackColor = formbody.BackColor
				legend1.Font = originalFont
				legend1.Name = "Legend1"
				legend1.Docking = Docking.Right
				chart1.Legends.Add(legend1) 
				#Initialize the chart and its properties
				chart1.BeginInit()
				chart1.Size = Size(panelChart.Width,panelChart.Width)
				chart1.AntiAliasing = AntiAliasingStyles.All
				fontFam = FontFamily("Segoe UI Symbol")
				titleFont = Font(fontFam,10,FontStyle.Bold)
				title = Title()
				title.Text = j.chartname
				title.Alignment = ContentAlignment.TopLeft
				title.Font = titleFont
				chart1.Titles.Add(title)
				#Add a button to push on view
				bt = Button()
				bt.Tag = "Push the chart on a view in Revit"
				bt.Text = "Push on a draft view"
				bt.Height = 20 * yRatio
				bt.Width = 140 * yRatio			
				panelChart.Controls.Add(bt)
				bt.BringToFront()
				bt.Click += form.imageexport
				#Add a checkBox to show/hide legend
				checkBox1 = CheckBox()
				checkBox1.AutoCheck = True
				checkBox1.Name = "checkBox1"
				checkBox1.Text = "Legend"
				panelChart.Controls.Add(checkBox1)
				checkBox1.BringToFront()
				checkBox1.Checked = True
				checkBox1.Font = originalFont
				checkBox1.AutoSize = True
				checkBox1.Click += form.chart_showLegend
				#Add a checkBox to show/hide labels
				checkBox2 = CheckBox()
				checkBox2.AutoCheck = True
				checkBox2.Name = "checkBox2"
				checkBox2.Text = "Labels"
				panelChart.Controls.Add(checkBox2)
				checkBox2.BringToFront()
				checkBox2.Checked = True
				checkBox2.Font = originalFont
				checkBox2.AutoSize = True
				checkBox2.Click += form.chart_showLabels
				
				panelChart.Size = Size(panelChart.Width, panelChart.Width + checkBox2.Height + 20)
				#Add chart to panel
				panelChart.Controls.Add(chart1)
				chart1.Location = Point(0,0)
				bt.Location = Point(panelChart.Width - bt.Width, panelChart.Width + 15)
				checkBox1.Location = Point(panelChart.Width - bt.Width - 80, panelChart.Width + 15)
				checkBox2.Location = Point(panelChart.Width - bt.Width - 160, panelChart.Width + 15)
				formbody.Controls.Add(panelChart)
				
				y = panelChart.Bottom + 25 * yRatio
				
			elif j.__class__.__name__ == 'uiradarchart':
				if isinstance(j.labels,list):
					labels = j.labels
				else:
					labels = [j.labels]
				inputcolors = j.inputcolors
				pyList = []
				if isinstance(j.xseries[0],list) and isinstance(j.yseries[0],list):
					nbOfSeries = len(j.xseries)
					xseries = j.xseries
					yseries = j.yseries
				elif isinstance(j.xseries[0],list) == False and isinstance(j.yseries[0],list):
					nbOfSeries = len(j.yseries)
					xseries = []
					i = 1
					while i <= nbOfSeries:
						xseries.append(j.xseries)
						i = i + 1
					yseries = j.yseries
				elif isinstance(j.yseries[0],list) == False and isinstance(j.xseries[0],list):
					nbOfSeries = len(j.xseries)
					yseries = []
					i = 1
					while i <= nbOfSeries:
						yseries.append(j.yseries)
						i = i + 1
					xseries = j.xseries
				else:
					xseries = [j.xseries]
					yseries = [j.yseries]
					nbOfSeries = 1
				if inputcolors is not None:
					colorBool = True
					for color in inputcolors:
						pyList.append(Color.FromArgb(color.Red,color.Green,color.Blue))
					wfColor = Array[Color](pyList)
				else:
					colorBool = False
				#Set a global Font code
				fontFam = FontFamily("Segoe UI Symbol")
				originalFont = Font(fontFam,8)
				#Chart created and Panel to host the chart
				chart1 = Chart()
				panelChart = Panel()
				panelChart.Name = "panelChart"
				#Create a panel for buttons
				panelCtrls = Panel()
				#Panels colors
				chart1.BackColor = formbody.BackColor
				panelChart.BackColor = Color.Transparent
				panelCtrls.BackColor = Color.Transparent
				#PanelChart location
				panelChart.Width = formwidth  - rightmargin - xlabel
				panelChart.Location = Point(xlabel,y + 30)				
				autoheight = 250 * yRatio			
				panelChart.Height = autoheight + 73 * yRatio
				ratio = (panelChart.Height)/(panelChart.Width)
				h = float(panelChart.Height)
				w = float(panelChart.Width)
				ratio = h/w
				chart_maxsize = formwidth - xlabel - rightmargin
				panelChart.Size = Size(chart_maxsize,chart_maxsize*ratio)				
				#Chart colors palette
				chart1.Palette =  ChartColorPalette.None
				if colorBool:
					chart1.PaletteCustomColors = wfColor
				else:
					chart1.Palette =  ChartColorPalette.None
				chart1.Series.Clear()
				#Series created
				def createSeries(seriesName,_keys,_values):
					srs = Series()
					srs.Name = seriesName
					srs.ChartType = SeriesChartType.Radar
					srs.ToolTip = "Percent: #PERCENT"
					srs.IsValueShownAsLabel = True
					srs.Font = originalFont
					srs.BorderWidth = 4
					for i,j in zip(_keys,_values):
						srs.Points.AddXY(i,j)
					return srs
				#Create series
				series = []
				for i in range(0,nbOfSeries):
					series.append(createSeries(labels[i],xseries[i],yseries[i]))
				#Add series to chart
				for s in series:
					chart1.Series.Add(s)
				#Refresh the Chart
				chart1.Invalidate()
				#Create a ChartArea and add it to the chart
				chartArea1 = ChartArea()
				chartArea1.BackColor = formbody.BackColor
				chartArea1.Name = "ChartArea1"
				chartArea1.AxisX.Title = j.xaxislabel
				chartArea1.AxisY.Title = j.yaxislabel
				chart1.ChartAreas.Add(chartArea1)
				#Create a Legend and add it to the chart
				legend1 = Legend()
				legend1.BackColor = formbody.BackColor
				legend1.Font = originalFont
				legend1.Name = "Legend1"
				chart1.Legends.Add(legend1) 
				#Initialize the chart and its properties
				chart1.BeginInit()
				chart1.Dock = DockStyle.Fill
				chart1.AntiAliasing = AntiAliasingStyles.All
				fontFam = FontFamily("Segoe UI Symbol")
				titleFont = Font(fontFam,10,FontStyle.Bold)
				title = Title()
				title.Text = j.chartname
				title.Alignment = ContentAlignment.TopLeft
				title.Font = titleFont
				chart1.Titles.Add(title)
				#Add a button to push on view
				bt = Button()
				bt.Tag = "Push the chart on a view in Revit"
				bt.Text = "Push on a draft view"
				bt.Height = 20 * yRatio
				bt.Width = 140 * yRatio				
				panelCtrls.Controls.Add(bt)
				bt.BringToFront()
				bt.Click += form.imageexport
				#Add a checkBox to show/hide legend
				checkBox1 = CheckBox()
				checkBox1.AutoCheck = True
				checkBox1.Name = "checkBox1"
				checkBox1.Text = "Show/Hide legend"
				panelCtrls.Controls.Add(checkBox1)
				checkBox1.BringToFront()
				checkBox1.Checked = True
				checkBox1.AutoSize = True
				checkBox1.Click += form.chart_showLegend
				
				#Add a checkBox to show/hide labels
				checkBox2 = CheckBox()
				checkBox2.AutoCheck = True
				checkBox2.Name = "checkBox2"
				checkBox2.Text = "Show/Hide labels"
				panelCtrls.Controls.Add(checkBox2)
				checkBox2.BringToFront()
				checkBox2.Checked = True
				checkBox2.Font = originalFont
				checkBox2.AutoSize = True
				checkBox2.Click += form.chart_showLabels
				
				panelChart.Size = Size(panelChart.Width, panelChart.Width + checkBox2.Height + 20)
				#Add chart to panel
				panelChart.Controls.Add(chart1)
				chart1.Location = Point(0,0)
				bt.Location = Point(panelChart.Width - bt.Width, panelChart.Width + 15)
				checkBox1.Location = Point(panelChart.Width - bt.Width - 80, panelChart.Width + 15)
				checkBox2.Location = Point(panelChart.Width - bt.Width - 160, panelChart.Width + 15)
				formbody.Controls.Add(panelChart)
				
				y = panelChart.Bottom + 25 * yRatio
				
			elif j.__class__.__name__ == 'uipointchart':
				if isinstance(j.labels,list):
					labels = j.labels
				else:
					labels = [j.labels]
				inputcolors = j.inputcolors
				pyList = []
				if isinstance(j.xseries[0],list) and isinstance(j.yseries[0],list):
					nbOfSeries = len(j.xseries)
					xseries = j.xseries
					yseries = j.yseries
				elif isinstance(j.xseries[0],list) == False and isinstance(j.yseries[0],list):
					nbOfSeries = len(j.yseries)
					xseries = []
					i = 1
					while i <= nbOfSeries:
						xseries.append(j.xseries)
						i = i + 1
					yseries = j.yseries
				elif isinstance(j.yseries[0],list) == False and isinstance(j.xseries[0],list):
					nbOfSeries = len(j.xseries)
					yseries = []
					i = 1
					while i <= nbOfSeries:
						yseries.append(j.yseries)
						i = i + 1
					xseries = j.xseries
				else:
					xseries = [j.xseries]
					yseries = [j.yseries]
					nbOfSeries = 1
				if inputcolors is not None:
					colorBool = True
					for color in inputcolors:
						pyList.append(Color.FromArgb(color.Red,color.Green,color.Blue))
					wfColor = Array[Color](pyList)
				else:
					colorBool = False
				#Set a global Font code
				fontFam = FontFamily("Segoe UI Symbol")
				originalFont = Font(fontFam,8)
				#Chart created and Panel to host the chart
				chart1 = Chart()
				panelChart = Panel()
				panelChart.Name = "panelChart"
				#Panels colors
				chart1.BackColor = formbody.BackColor
				panelChart.BackColor = Color.Transparent
				#PanelChart location
				panelChart.Width = formwidth  - rightmargin - xlabel
				panelChart.Location = Point(xlabel,y + 30)				
				#Chart colors palette
				chart1.Palette =  ChartColorPalette.None
				if colorBool:
					chart1.PaletteCustomColors = wfColor
				else:
					chart1.Palette =  ChartColorPalette.None
				chart1.Series.Clear()
				#Series created
				def createSeries(seriesName,_keys,_values):
					srs = Series()
					srs.Name = seriesName
					srs.ChartType = SeriesChartType.Point
					srs.ToolTip = "Percent: #PERCENT"
					srs.IsValueShownAsLabel = True
					srs.Font = originalFont
					for i,j in zip(_keys,_values):
						srs.Points.AddXY(i,j)
					return srs
				#Create series
				series = []
				for i in range(0,nbOfSeries):
					series.append(createSeries(labels[i],xseries[i],yseries[i]))
				#Add series to chart
				for s in series:
					chart1.Series.Add(s)
				#Change marker size
				originalMarkerSize = 8
				for s in series:
					for p in s.Points:
						p.MarkerSize = originalMarkerSize
				#Refresh the Chart
				chart1.Invalidate()
				#Create a ChartArea and add it to the chart
				chartArea1 = ChartArea()
				chartArea1.BackColor = formbody.BackColor
				chartArea1.Name = "ChartArea1"
				chartArea1.AxisX.Title = j.xaxislabel
				chartArea1.AxisY.Title = j.yaxislabel
				chart1.ChartAreas.Add(chartArea1)
				chartArea1 = chart1.ChartAreas[0]
				#Create a Legend and add it to the chart
				legend1 = Legend()
				legend2 = Legend()
				#Add legends to charts
				chart1.Legends.Add(legend1)
				chart1.Legends.Add(legend2)
				#Create Custom legend
				customevent = CustomizeLegendEventArgs(legend2.CustomItems)
				for s in series:
					legend2.CustomItems.Add(LegendItem(s.Name.ToString(),s.Color,""))					
				def chart_CustomizeLegend(sender, customevent ):
					chart1 = sender
					#legend1.Enabled = False
					legend2.Name = "Legend2"
					for s,it in zip(series,legend2.CustomItems):
						it.ImageStyle = LegendImageStyle.Marker
						it.MarkerStyle = s.MarkerStyle
						it.MarkerColor = s.Color
						it.BorderColor = Color.Transparent
						it.MarkerSize *= 1.3
				legend1.Enabled = False
				legend2.Font = originalFont
				legend2.IsTextAutoFit = True
				legend2.BackColor = formbody.BackColor			
				chart1.CustomizeLegend += chart_CustomizeLegend
				#Initialize the chart and its properties
				chart1.BeginInit()
				chart1.Size = Size(panelChart.Width,panelChart.Width)
				chart1.AntiAliasing = AntiAliasingStyles.All
				fontFam = FontFamily("Segoe UI Symbol")
				titleFont = Font(fontFam,10,FontStyle.Bold)
				title = Title()
				title.Text = j.chartname
				title.Alignment = ContentAlignment.TopLeft
				title.Font = titleFont
				chart1.Titles.Add(title)
				#Add a button to push on view
				bt = Button()
				bt.Tag = "Push the chart on a view in Revit"
				bt.Text = "Push on a draft view"
				bt.Height = 20 * yRatio
				bt.Width = 140 * yRatio				
				panelChart.Controls.Add(bt)
				bt.BringToFront()
				bt.Click += form.imageexport
				#Add a checkBox to show/hide legend
				checkBox1 = CheckBox()
				checkBox1.AutoCheck = True
				checkBox1.Name = "checkBox1"
				checkBox1.Text = "Legend"
				panelChart.Controls.Add(checkBox1)
				checkBox1.BringToFront()
				checkBox1.Checked = True
				checkBox1.AutoSize = True
				checkBox1.Click += form.chart_showLegend
				
				#Add a checkBox to show/hide labels
				checkBox2 = CheckBox()
				checkBox2.AutoCheck = True
				checkBox2.Name = "checkBox2"
				checkBox2.Text = "Labels"
				panelChart.Controls.Add(checkBox2)
				checkBox2.BringToFront()
				checkBox2.Checked = True
				checkBox2.Font = originalFont
				checkBox2.AutoSize = True
				checkBox2.Click += form.chart_showLabels
				
				panelChart.Size = Size(panelChart.Width, panelChart.Width + checkBox2.Height + 20)
				#Add chart to panel
				panelChart.Controls.Add(chart1)
				chart1.Location = Point(0,0)
				bt.Location = Point(panelChart.Width - bt.Width, panelChart.Width + 15)
				checkBox1.Location = Point(panelChart.Width - bt.Width - 80, panelChart.Width + 15)
				checkBox2.Location = Point(panelChart.Width - bt.Width - 160, panelChart.Width + 15)
				formbody.Controls.Add(panelChart)
				
				y = panelChart.Bottom + 25 * yRatio
								
			elif j.__class__.__name__ == 'uilinechart':
				if isinstance(j.labels,list):
					labels = j.labels
				else:
					labels = [j.labels]
				inputcolors = j.inputcolors
				pyList = []
				if isinstance(j.xseries[0],list) and isinstance(j.yseries[0],list):
					nbOfSeries = len(j.xseries)
					xseries = j.xseries
					yseries = j.yseries
				elif isinstance(j.xseries[0],list) == False and isinstance(j.yseries[0],list):
					nbOfSeries = len(j.yseries)
					xseries = []
					i = 1
					while i <= nbOfSeries:
						xseries.append(j.xseries)
						i = i + 1
					yseries = j.yseries
				elif isinstance(j.yseries[0],list) == False and isinstance(j.xseries[0],list):
					nbOfSeries = len(j.xseries)
					yseries = []
					i = 1
					while i <= nbOfSeries:
						yseries.append(j.yseries)
						i = i + 1
					xseries = j.xseries
				else:
					xseries = [j.xseries]
					yseries = [j.yseries]
					nbOfSeries = 1
				if inputcolors is not None:
					colorBool = True
					for color in inputcolors:
						pyList.append(Color.FromArgb(color.Red,color.Green,color.Blue))
					wfColor = Array[Color](pyList)
				else:
					colorBool = False
				#Set a global Font code
				fontFam = FontFamily("Segoe UI Symbol")
				originalFont = Font(fontFam,8)
				#Chart created and Panel to host the chart
				chart1 = Chart()
				panelChart = Panel()
				panelChart.Name = "panelChart"
				#Panels colors
				chart1.BackColor = formbody.BackColor
				panelChart.BackColor = Color.Transparent
				#PanelChart location
				panelChart.Width = formwidth  - rightmargin - xlabel
				panelChart.Location = Point(xlabel,y + 30)				
				#Chart colors palette
				chart1.Palette =  ChartColorPalette.None
				if colorBool:
					chart1.PaletteCustomColors = wfColor
				else:
					chart1.Palette =  ChartColorPalette.None
				chart1.Series.Clear()
				#Series created
				def createSeries(seriesName,_keys,_values):
					srs = Series()
					srs.Name = seriesName
					srs.ChartType = SeriesChartType.Line
					srs.ToolTip = "Percent: #PERCENT"
					srs.IsValueShownAsLabel = True
					srs.Font = originalFont
					srs.BorderWidth = 4
					for i,j in zip(_keys,_values):
						srs.Points.AddXY(i,j)
					return srs
				#Create series
				series = []
				for i in range(0,nbOfSeries):
					series.append(createSeries(labels[i],xseries[i],yseries[i]))
				#Add series to chart
				for s in series:
					chart1.Series.Add(s)
				#Refresh the Chart
				chart1.Invalidate()
				#Create a ChartArea and add it to the chart
				chartArea1 = ChartArea()
				chartArea1.BackColor = formbody.BackColor
				chartArea1.Name = "ChartArea1"
				chartArea1.AxisX.Title = j.xaxislabel
				chartArea1.AxisY.Title = j.yaxislabel
				chart1.ChartAreas.Add(chartArea1)
				#Create a Legend and add it to the chart
				legend1 = Legend()
				legend1.BackColor = formbody.BackColor
				legend1.Font = originalFont
				legend1.Name = "Legend1"
				chart1.Legends.Add(legend1) 
				#Initialize the chart and its properties
				chart1.BeginInit()
				chart1.Size = Size(panelChart.Width,panelChart.Width)
				chart1.AntiAliasing = AntiAliasingStyles.All
				fontFam = FontFamily("Segoe UI Symbol")
				titleFont = Font(fontFam,10,FontStyle.Bold)
				title = Title()
				title.Text = j.chartname
				title.Alignment = ContentAlignment.TopLeft
				title.Font = titleFont
				chart1.Titles.Add(title)
				#Add a button to push on view
				bt = Button()
				bt.Tag = "Push the chart on a view in Revit"
				bt.Text = "Push on a draft view"
				bt.Height = 20 * yRatio
				bt.Width = 140 * yRatio				
				panelChart.Controls.Add(bt)
				bt.BringToFront()
				bt.Click += form.imageexport
				#Add a checkBox to show/hide legend
				checkBox1 = CheckBox()
				checkBox1.AutoCheck = True
				checkBox1.Name = "checkBox1"
				checkBox1.Text = "Legend"
				panelChart.Controls.Add(checkBox1)
				checkBox1.BringToFront()
				checkBox1.Checked = True
				checkBox1.AutoSize = True
				checkBox1.Click += form.chart_showLegend
				
				#Add a checkBox to show/hide labels
				checkBox2 = CheckBox()
				checkBox2.AutoCheck = True
				checkBox2.Name = "checkBox2"
				checkBox2.Text = "Labels"
				panelChart.Controls.Add(checkBox2)
				checkBox2.BringToFront()
				checkBox2.Checked = True
				checkBox2.Font = originalFont
				checkBox2.AutoSize = True
				checkBox2.Click += form.chart_showLabels
				
				panelChart.Size = Size(panelChart.Width, panelChart.Width + checkBox2.Height + 20)
				#Add chart to panel
				panelChart.Controls.Add(chart1)
				chart1.Location = Point(0,0)
				bt.Location = Point(panelChart.Width - bt.Width, panelChart.Width + 15)
				checkBox1.Location = Point(panelChart.Width - bt.Width - 80, panelChart.Width + 15)
				checkBox2.Location = Point(panelChart.Width - bt.Width - 160, panelChart.Width + 15)
				formbody.Controls.Add(panelChart)
				
				y = panelChart.Bottom + 25 * yRatio
			
			elif j.__class__.__name__ == 'uisplinechart':
				if isinstance(j.labels,list):
					labels = j.labels
				else:
					labels = [j.labels]
				inputcolors = j.inputcolors
				pyList = []
				if isinstance(j.xseries[0],list) and isinstance(j.yseries[0],list):
					nbOfSeries = len(j.xseries)
					xseries = j.xseries
					yseries = j.yseries
				elif isinstance(j.xseries[0],list) == False and isinstance(j.yseries[0],list):
					nbOfSeries = len(j.yseries)
					xseries = []
					i = 1
					while i <= nbOfSeries:
						xseries.append(j.xseries)
						i = i + 1
					yseries = j.yseries
				elif isinstance(j.yseries[0],list) == False and isinstance(j.xseries[0],list):
					nbOfSeries = len(j.xseries)
					yseries = []
					i = 1
					while i <= nbOfSeries:
						yseries.append(j.yseries)
						i = i + 1
					xseries = j.xseries
				else:
					xseries = [j.xseries]
					yseries = [j.yseries]
					nbOfSeries = 1
				if inputcolors is not None:
					colorBool = True
					for color in inputcolors:
						pyList.append(Color.FromArgb(color.Red,color.Green,color.Blue))
					wfColor = Array[Color](pyList)
				else:
					colorBool = False
				#Set a global Font code
				fontFam = FontFamily("Segoe UI Symbol")
				originalFont = Font(fontFam,8)
				#Chart created and Panel to host the chart
				chart1 = Chart()
				panelChart = Panel()
				panelChart.Name = "panelChart"
				#Panels colors
				chart1.BackColor = formbody.BackColor
				panelChart.BackColor = Color.Transparent
				#PanelChart location
				panelChart.Width = formwidth  - rightmargin - xlabel
				panelChart.Location = Point(xlabel,y + 30)				
				#Chart colors palette
				chart1.Palette =  ChartColorPalette.None
				if colorBool:
					chart1.PaletteCustomColors = wfColor
				else:
					chart1.Palette =  ChartColorPalette.None
				chart1.Series.Clear()
				#Series created
				def createSeries(seriesName,_keys,_values):
					srs = Series()
					srs.Name = seriesName
					srs.ChartType = SeriesChartType.Spline
					srs.ToolTip = "Percent: #PERCENT"
					srs.IsValueShownAsLabel = True
					srs.Font = originalFont
					srs.BorderWidth = 4
					for i,j in zip(_keys,_values):
						srs.Points.AddXY(i,j)
					return srs
				#Create series
				series = []
				for i in range(0,nbOfSeries):
					series.append(createSeries(labels[i],xseries[i],yseries[i]))
				#Add series to chart
				for s in series:
					chart1.Series.Add(s)
				#Refresh the Chart
				chart1.Invalidate()
				#Create a ChartArea and add it to the chart
				chartArea1 = ChartArea()
				chartArea1.BackColor = formbody.BackColor
				chartArea1.Name = "ChartArea1"
				chartArea1.AxisX.Title = j.xaxislabel
				chartArea1.AxisY.Title = j.yaxislabel
				chart1.ChartAreas.Add(chartArea1)
				#Create a Legend and add it to the chart
				legend1 = Legend()
				legend1.BackColor = formbody.BackColor
				legend1.Font = originalFont
				legend1.Name = "Legend1"
				chart1.Legends.Add(legend1) 
				#Initialize the chart and its properties
				chart1.BeginInit()
				chart1.Size = Size(panelChart.Width,panelChart.Width)
				chart1.AntiAliasing = AntiAliasingStyles.All
				fontFam = FontFamily("Segoe UI Symbol")
				titleFont = Font(fontFam,10,FontStyle.Bold)
				title = Title()
				title.Text = j.chartname
				title.Alignment = ContentAlignment.TopLeft
				title.Font = titleFont
				chart1.Titles.Add(title)
				#Add a button to push on view
				bt = Button()
				bt.Tag = "Push the chart on a view in Revit"
				bt.Text = "Push on a draft view"
				bt.Height = 20 * yRatio
				bt.Width = 140 * yRatio			
				panelChart.Controls.Add(bt)
				bt.BringToFront()
				bt.Click += form.imageexport
				#Add a checkBox to show/hide legend
				checkBox1 = CheckBox()
				checkBox1.AutoCheck = True
				checkBox1.Name = "checkBox1"
				checkBox1.Text = "Legend"
				panelChart.Controls.Add(checkBox1)
				checkBox1.BringToFront()
				checkBox1.Checked = True
				checkBox1.AutoSize = True
				checkBox1.Click += form.chart_showLegend
				
				#Add a checkBox to show/hide labels
				checkBox2 = CheckBox()
				checkBox2.AutoCheck = True
				checkBox2.Name = "checkBox2"
				checkBox2.Text = "Labels"
				panelChart.Controls.Add(checkBox2)
				checkBox2.BringToFront()
				checkBox2.Checked = True
				checkBox2.Font = originalFont
				checkBox2.AutoSize = True
				checkBox2.Click += form.chart_showLabels
				
				panelChart.Size = Size(panelChart.Width, panelChart.Width + checkBox2.Height + 20)
				#Add chart to panel
				panelChart.Controls.Add(chart1)
				chart1.Location = Point(0,0)
				bt.Location = Point(panelChart.Width - bt.Width, panelChart.Width + 15)
				checkBox1.Location = Point(panelChart.Width - bt.Width - 80, panelChart.Width + 15)
				checkBox2.Location = Point(panelChart.Width - bt.Width - 160, panelChart.Width + 15)
				formbody.Controls.Add(panelChart)
				
				y = panelChart.Bottom + 25 * yRatio
				
			elif j.__class__.__name__ == 'uibubblechart':
				if isinstance(j.labels,list):
					labels = j.labels
				else:
					labels = [j.labels]
				inputcolors = j.inputcolors
				pyList = []
				if isinstance(j.xseries[0],list) and isinstance(j.yseries[0],list):
					nbOfSeries = len(j.xseries)
					xseries = j.xseries
					yseries = j.yseries
				elif isinstance(j.xseries[0],list) == False and isinstance(j.yseries[0],list):
					nbOfSeries = len(j.yseries)
					xseries = []
					i = 1
					while i <= nbOfSeries:
						xseries.append(j.xseries)
						i = i + 1
					yseries = j.yseries
				elif isinstance(j.yseries[0],list) == False and isinstance(j.xseries[0],list):
					nbOfSeries = len(j.xseries)
					yseries = []
					i = 1
					while i <= nbOfSeries:
						yseries.append(j.yseries)
						i = i + 1
					xseries = j.xseries
				else:
					xseries = [j.xseries]
					yseries = [j.yseries]
					nbOfSeries = 1
				if inputcolors is not None:
					colorBool = True
					for color in inputcolors:
						pyList.append(Color.FromArgb(color.Red,color.Green,color.Blue))
					wfColor = Array[Color](pyList)
				else:
					colorBool = False
				#Set a global Font code
				fontFam = FontFamily("Segoe UI Symbol")
				originalFont = Font(fontFam,8)
				#Chart created and Panel to host the chart
				chart1 = Chart()
				panelChart = Panel()
				#panelChart.Padding = Padding(1) To create a black border
				chart1.BackColor = formbody.BackColor
				panelChart.BackColor = Color.Transparent
				#PanelChart location
				panelChart.Width = formwidth  - rightmargin - xlabel
				panelChart.Location = Point(xlabel,y + 30)				
				autoheight = 250 * yRatio			
				panelChart.Height = autoheight + 73 * yRatio
				ratio = (panelChart.Height)/(panelChart.Width)
				h = float(panelChart.Height)
				w = float(panelChart.Width)
				ratio = h/w
				chart_maxsize = formwidth - xlabel - rightmargin
				panelChart.Size = Size(chart_maxsize,chart_maxsize*ratio)				
				#Chart colors palette
				chart1.Palette =  ChartColorPalette.None
				if colorBool:
					chart1.PaletteCustomColors = wfColor
				else:
					chart1.Palette =  ChartColorPalette.None
				chart1.Series.Clear()
				#Series created
				def createSeries(seriesName,_keys,_values):
					srs = Series()
					srs.Name = seriesName
					srs.ChartType = SeriesChartType.Bubble
					srs.ToolTip = "Percent: #PERCENT"
					srs.Font = originalFont
					for i,j in zip(_keys,_values):
						srs.Points.AddXY(i,j)
					return srs
				#Create series
				series = []
				for i in range(0,nbOfSeries):
					series.append(createSeries(labels[i],xseries[i],yseries[i]))
				#Add series to chart
				for s in series:
					chart1.Series.Add(s)
				#Refresh the Chart
				chart1.Invalidate()
				#Create a ChartArea and add it to the chart
				chartArea1 = ChartArea()
				chartArea1.BackColor = formbody.BackColor
				chartArea1.Name = "ChartArea1"
				chartArea1.AxisX.Title = j.xaxislabel
				chartArea1.AxisY.Title = j.yaxislabel
				chart1.ChartAreas.Add(chartArea1)
				#Create a Legend and add it to the chart
				legend1 = Legend()
				legend1.BackColor = formbody.BackColor
				legend1.Font = originalFont
				legend1.Name = "Legend1"
				chart1.Legends.Add(legend1) 
				#Initialize the chart and its properties
				chart1.BeginInit()
				chart1.Dock = DockStyle.Fill
				chart1.AntiAliasing = AntiAliasingStyles.All
				fontFam = FontFamily("Segoe UI Symbol")
				titleFont = Font(fontFam,10,FontStyle.Bold)
				title = Title()
				title.Text = j.chartname
				title.Alignment = ContentAlignment.TopLeft
				title.Font = titleFont
				chart1.Titles.Add(title)
				#Add a button to push on view
				bt = Button()
				bt.Tag = "Push the chart on a view in Revit"
				bt.Text = "Push on a draft view"
				bt.Height = 20 * yRatio
				bt.Width = 140 * yRatio			
				panelChart.Controls.Add(bt)
				bt.BringToFront()
				bt.Click += form.imageexport
				#Add a checkBox to show/hide legend
				checkBox1 = CheckBox()
				checkBox1.AutoCheck = True
				checkBox1.Name = "checkBox1"
				checkBox1.Text = "Show/Hide legend"
				panelChart.Controls.Add(checkBox1)
				checkBox1.BringToFront()
				checkBox1.Checked = True
				checkBox1.Click += form.chart_showLegend
				#Add chart to panel
				panelChart.Size = Size(panelChart.Width, panelChart.Width + checkBox2.Height + 20)
				#Add chart to panel
				panelChart.Controls.Add(chart1)
				chart1.Location = Point(0,0)
				bt.Location = Point(panelChart.Width - bt.Width, panelChart.Width + 15)
				checkBox1.Location = Point(panelChart.Width - bt.Width - 80, panelChart.Width + 15)
				checkBox2.Location = Point(panelChart.Width - bt.Width - 160, panelChart.Width + 15)
				formbody.Controls.Add(panelChart)
				
				y = panelChart.Bottom + 25 * yRatio

			elif j.__class__.__name__ == 'uitreeview':
				tv = TreeView()
				tv.CheckBoxes = True
				titles = j._hastitles
				if j.inputname != "":
					tv.Width = formwidth - rightmargin - xinput
					tv.Location = Point(xinput,y)
				else:
					tv.Width = formwidth - rightmargin - xlabel
					tv.Location = Point(xlabel,y)
				tv.Height = j._height
				def treeIterationTitle(control, input):
					if isinstance(input,list):
						try:
							currentNode = TreeNode(remove_accents(input[0].ToString()))
							currentNode.Tag = ""
							input.pop(0)
						except:
							currentNode = TreeNode(control.Text +"."+ str(len(control.Nodes)+1))
							currentNode.Tag = ""
						control.Nodes.Add(currentNode)
						for i in input:
							treeIterationTitle(currentNode, i)
					else:
						item = TreeNode(remove_accents(input.ToString()))
						item.Tag = input
						control.Nodes.Add(item)	
				def treeIteration(control, input):
					if isinstance(input,list):
						currentNode = TreeNode(control.Text +"."+ str(len(control.Nodes)+1))
						currentNode.Tag = input
						control.Nodes.Add(currentNode)
						for i in input:
							treeIteration(currentNode, i)
					else:
						item = TreeNode(remove_accents(input.ToString()))
						item.Tag = input
						control.Nodes.Add(item)
				currentNode = TreeNode("List1")
				currentNode.Expand()				
				if titles:
					tv.Nodes.Add(currentNode)								
					for dl in j.datalist:
						treeIterationTitle(currentNode,dl)	
				else:
					tv.Nodes.Add(currentNode)								
					for dl in j.datalist:
						treeIteration(currentNode,dl)
				tv.AfterCheck += form.CheckChildren						
				formbody.Controls.Add(tv)
				form.output.append(tv)
				y = tv.Bottom + 25 * yRatio
			elif j.__class__.__name__ == 'listview':
				lvp = Panel()
				if j.inputname != "":
					lvp.Location = Point(xinput,y)
					lvp.Width = formwidth - rightmargin - xinput				
				elif j.inputname == "" and j.element_count != 0:
					lvp.Location = Point(xlabel,y+35*yRatio)
					lvp.Width = formwidth - rightmargin - xlabel
				else : 
					lvp.Location = Point(xlabel,y)
					lvp.Width = formwidth - rightmargin - xlabel				
				lvp.Height = j.height * yRatio + 25 * yRatio
				#Creating the listview box
				lv = mylistview()
				lv.Scrollable = True
				dummyheader = ColumnHeader()
				dummyheader.Text = ""
				dummyheader.Name = ""
				dummyheader.Width = -2 * xRatio
				lv.HeaderStyle = ColumnHeaderStyle.None
				lv.Columns.Add(dummyheader)
				lv.Values = j
				if not j.display_mode:
					lv.CheckBoxes = True
				lv.View = vi.Details
				lvItems =  [i for i in j.keys() if not (i == 'inputname' or i == 'height' or i == 'highlight' or i == 'display_mode' or i == 'element_count' or i == 'default_values' or i == 'sorted' or i == 'showId')]
				if j.sorted :
					lvItems = sorted(lvItems,key = remove_accents)
				else:
					pass
				[lv.Items.Add(i) for i in lvItems]
				lv.Location = Point(0,0)
				if j.inputname != "" and j.element_count != 0:
					lv.Width = formwidth - rightmargin - xinput
				elif j.inputname != "" and j.element_count == 0:
					lv.Width = formwidth - rightmargin - xinput
				else:
					lv.Width = formwidth - rightmargin - xlabel
				lv.Height = j.height * yRatio
				lv.Scrollable = True
				lv.ItemCheck += form.updateallnone
				for i in j.default_values:
					defInd = lvItems.index([x for x in j.keys() if not (x == 'inputname' or x == 'height' or x == 'highlight' or x == 'display_mode' or x == 'element_count' or x == 'default_values' or x == 'sorted' or x == 'showId')][i])
					lv.Items[defInd].Checked = True
				#Click listview items to hilight and center in appropriate view
				if j.highlight :
					lv.MouseDown += form.setviewforelement
					lv.MouseUp += form.zoomcenter
					items = list(lv.Items)
					lv.FullRowSelect = True
					del items[::2]
					for item in items:
						item.BackColor = Color.FromArgb(230,243,255)
				#Creating select all and select none radiobuttons
				if not j.display_mode:
					rball = RadioButton()
					rball.Location = Point(0,(j.height+5)*yRatio)
					rball.Width = 100 * xRatio
					rball.Height = 20 * yRatio
					rball.Font = SystemFonts.DefaultFont
					rball.Text = "Select all"
					rball.Click += form.selectall
					rbnone = RadioButton()
					rbnone.Location = Point(105 * xRatio,(j.height+5)*yRatio)
					rbnone.Width = 100 * xRatio
					rbnone.Height = 20 * yRatio
					rbnone.Font = SystemFonts.DefaultFont
					rbnone.Text = "Select none"			
					rbnone.Click += form.selectnone			
				#Adding controls to panel
				lvp.Controls.Add(lv)
				if not j.display_mode:
					lvp.Controls.Add(rball)
					lvp.Controls.Add(rbnone)
				formbody.Controls.Add(lvp)
				if not j.display_mode:
					form.output.append(lv)
				y = lvp.Bottom + 25 * yRatio
			elif j.__class__.__name__ == 'uitext':
				tb = myTextBox()
				tb.Text = j.defaultvalue
				if j.inputname != "":
					tb.Width = formwidth  - rightmargin - xinput
					tb.Location = Point(xinput,y)
				else:
					tb.Width = formwidth - rightmargin - xlabel
					tb.Location = Point(xlabel,y)
				if j._isnum:
					tb._isNum = True
					tb.KeyPress += form.numsOnly
				formbody.Controls.Add(tb)
				formbody.Controls.Add(label)
				form.output.append(tb)
				y = label.Bottom + 25 * yRatio
			elif j.__class__.__name__ == 'uimultilinetext':
				tb = myTextBox()
				tb.Text = j.defaultvalue
				tb.Multiline  = True
				tb.Height = j._height * yRatio
				if j.inputname != "":
					tb.Width = formwidth  - rightmargin - xinput
					tb.Location = Point(xinput,y)
				else:
					tb.Width = formwidth - rightmargin - xlabel
					tb.Location = Point(xlabel,y)
				if j._isnum:
					tb._isNum = True
					tb.KeyPress += form.numsOnly
				formbody.Controls.Add(tb)
				formbody.Controls.Add(label)
				form.output.append(tb)
				y = tb.Bottom + 25 * yRatio								
			elif j.__class__.__name__ == 'tableview':
				#Creating grouping panel
				tvp = Panel()
				tvp.Location = Point(xlabel,y)
				tvp.Width = formwidth - rightmargin - xlabel
				if (50 + len(j.dataList) * 15) * yRatio > 800 * yRatio:
					autoheight = 800 * yRatio
				else:
					autoheight = (50 + len(j.dataList) * 15	) * yRatio			
				tvp.Height = autoheight + 73 * yRatio
				#Creating title
				titlep = Label()
				titlep.Text = j._tabletitle
				titlep.Width = formwidth - rightmargin - xlabel
				titlep.BackColor = Color.FromArgb(153,180,209)
				titlep.Font = Font("Arial", 11, FontStyle.Bold)
				titlep.TextAlign = ContentAlignment.MiddleLeft
				titlep.BorderStyle = BorderStyle.FixedSingle
				titlep.Location = Point(0,0)
				tvp.Controls.Add(titlep)
				#Creating data structure
				dg = myDataGridView()
				#dg.SelectionMode = DataGridViewSelectionMode.CellSelect
				dg.EnableHeadersVisualStyles = False				
				dt = DataTable()
				dl = j.dataList
				for i in range(len(dl[0])):
					if j._hasTitle:
						dt.Columns.Add(remove_accents(dl[0][i].ToString()))
						rngstart = 1
					else:
						dt.Columns.Add("Column " + str(i))
						rngstart = 0						
				for rindex in range(rngstart,len(dl)):
					row = dt.NewRow()
					for i in range(len(dl[rindex])):
						row[i] = dl[rindex][i]
					dt.Rows.Add(row)						
				dg.Tag = j._hasTitle				
				dg.DataSource = dt
				dg.ClipboardCopyMode = DataGridViewClipboardCopyMode.EnableWithAutoHeaderText
				dg.AutoSizeColumnsMode = DataGridViewAutoSizeColumnsMode.AllCells
				dg.Width = formwidth - rightmargin - xlabel
				dg.Location = Point(0,23 * yRatio)
				dg.Height = autoheight
				#Creatin Excel like drag copy functionalities
				dg.CellMouseDown += form.startCell
				dg.CellMouseUp += form.endCell
				#dg.MouseDown += form.startRowDrag
				#dg.MouseUp = 			
				tvp.Controls.Add(dg)			
				y = tvp.Bottom + 15 * yRatio
				#Adding export to excel button
				ex = Button()
				ex.Tag = [j._hasTitle , j._openExcel , j._showinfo , j._fileInfo]
				try:
					expImage = getImageByName("exp.png")[0]
					ex.BackgroundImage = expImage
				except:
					ex.Text = "Export"					
				ex.Width = 60 * xRatio
				ex.Height = 30 * yRatio
				ex.Location = Point(formwidth - 125 * xRatio ,dg.Bottom + 15 * yRatio)					
				tvp.Controls.Add(ex)
				ex.Click += form.exportToExcel
				#Adding filepath export textbox
				filepathtb = TextBox()
				filepathtb.Text = "ExportFileName"
				filepathtb.Location = Point(0 ,dg.Bottom + 20 * yRatio)
				filepathtb.Width = formwidth - xlabel - 125 * xRatio
				tvp.Controls.Add(filepathtb)
				#Adding copy to clipboard button
				cb = Button()
				#Adding panel to form
				formbody.Controls.Add(tvp)
				form.output.append(dg)
				y = tvp.Bottom + 25 * yRatio
				form.topmost()
			elif j.__class__.__name__ == 'uitextnote':
				gb = GroupBox()
				gb.Text = j.title
				gb.Parent = form
				gb.SendToBack()
				gb.BackColor = Color.Transparent
				gb.Location = Point(xlabel, y)
				tn = Label()
				tn.Location = Point(xlabel,18 * yRatio)
				tn.AutoSize = True
				tn.MaximumSize = Size(formwidth - rightmargin - 50 * xRatio,0)
				tn.Text = j.textnote
				tn.BringToFront()
				gb.Controls.Add(tn)
				gb.Size = Size(formwidth  - rightmargin - 25 * xRatio, tn.Bottom-tn.Top+25 * yRatio)  
				y = gb.Bottom + 25 * xRatio
				formbody.Controls.Add(gb)
			elif j.__class__.__name__ == 'uibool':
				yn = CheckBox()
				yn.Width = formwidth - xinput - rightmargin + 10 * xRatio
				yn.Location = Point(xinput,y)
				yn.Text = j.booltext
				g = yn.CreateGraphics()
				sizetext = g.MeasureString(yn.Text,yn.Font, formwidth - xinput - rightmargin -20 * xRatio)
				heighttext = sizetext.Height
				yn.Height = heighttext + 15 * yRatio
				yn.Checked = j.defaultvalue
				formbody.Controls.Add(yn)
				form.output.append(yn)
				y = yn.Bottom + 25 * yRatio
			elif j.__class__.__name__ == 'uiradio':
				yrb = 20 * yRatio
				rbs = []
				rbgroup = mygroupbox()
				if j.inputname != "":
					rbgroup.Width = formwidth - xinput - rightmargin
					rbgroup.Location = Point(xinput,y)
				else:
					rbgroup.Width = formwidth - xlabel - rightmargin
					rbgroup.Location = Point(xlabel,y)					
				rbgroup.Tag = j
				rbcounter = 0
				for key in j.keys():
					if key != 'inputname' and key != 'defaultvalue':
						rb = RadioButton()
						rb.Text = key 
						if j.inputname != "":
							rb.Width = formwidth - xinput - rightmargin - 35 * xRatio
						else:
							rb.Width = formwidth - xlabel - rightmargin - 35 * xRatio
						rb.Location = Point(20 * xRatio,yrb)
						if rbcounter == j.defaultvalue:
							rb.Checked = True
						rbgroup.Controls.Add(rb)
						g = rb.CreateGraphics()
						sizetext = g.MeasureString(key,rb.Font, formwidth - xinput - 90*xRatio)
						heighttext = sizetext.Height
						rb.Height = heighttext + 15 * yRatio
						ybot = rb.Bottom
						yrb += heighttext + 12 * yRatio
						rbcounter += 1
					else:
						pass
				rbgroup.Height = ybot + 20 * yRatio
				[rbgroup.Controls.Add(rb) for rb in rbs]
				formbody.Controls.Add(rbgroup)
				form.output.append(rbgroup)
				y = rbgroup.Bottom + 25 * yRatio
			elif j.__class__.__name__  == 'uifilepath':
				fp = Button()
				if j.inputname != "":
					fp.Width = formwidth - xinput - rightmargin
					fp.Location = Point(xinput,y)
				else:
					fp.Width = formwidth - xlabel - rightmargin		
					fp.Location = Point(xlabel,y)					
				fp.Tag = j.defaultvalue
				if not j.defaultvalue == "FilePath":
					fp.Tag = j.defaultvalue
					fp.MouseHover += form.showtooltip	
				fp.Text = j.buttontext
				fp.Height = 20 * yRatio				
				formbody.Controls.Add(fp)
				fp.Click += form.openfile
				form.output.append(fp)
				y = label.Bottom + 25 * yRatio
			elif j.__class__.__name__ == 'uidirectorypath':
				dp = Button()
				if j.inputname != "":
					dp.Width = formwidth - xinput - rightmargin
					dp.Location = Point(xinput,y)
				else:
					dp.Width = formwidth - xlabel - rightmargin		
					dp.Location = Point(xlabel,y)				
				dp.Tag = j.defaultvalue
				dp.Text = j.buttontext
				if not j.defaultvalue == "DirectoryPath":
					dp.Tag = j.defaultvalue
					dp.MouseHover += form.showtooltip
				dp.Text = j.buttontext	
				dp.Height = 20 * yRatio				
				formbody.Controls.Add(dp)
				dp.Click += form.opendirectory
				form.output.append(dp)
				y = label.Bottom + 25 * yRatio
			elif j.__class__.__name__ == 'uiselectelements':
				se = Button()
				if j.inputname != "":
					se.Width = formwidth - xinput - rightmargin
					se.Location = Point(xinput,y)
				else:
					se.Width = formwidth - xlabel - rightmargin		
					se.Location = Point(xlabel,y)
				se.Text = j.buttontext
				se.Height = 20 * yRatio
				formbody.Controls.Add(se)
				if j.multi == False:
					se.Click += form.pickobjects
				else:
					se.Click  += form.pickobject
				form.output.append(se)
				y = label.Bottom + 25 * yRatio
			elif j.__class__.__name__ == 'uiselectautocadelements':
				se = Button()
				if j.inputname != "":
					se.Width = formwidth - xinput - rightmargin
					se.Location = Point(xinput,y)
				else:
					se.Width = formwidth - xlabel - rightmargin		
					se.Location = Point(xlabel,y)
				se.Text = j.buttontext
				se.Height = 20 * yRatio
				formbody.Controls.Add(se)
				if j.multi == False:
					se.Click += form.pickautocadobjects
				else:
					se.Click += form.pickautocadobject								
				form.output.append(se)
				y = label.Bottom + 25 * yRatio				
			elif j.__class__.__name__ == 'uiselectOrderedelements':
				se = Button()
				if j.inputname != "":
					se.Width = formwidth - xinput - rightmargin
					se.Location = Point(xinput,y)
				else:
					se.Width = formwidth - xlabel - rightmargin		
					se.Location = Point(xlabel,y)
				se.Text = j.buttontext
				se.Height = 20 * yRatio				
				formbody.Controls.Add(se)
				se.Click  += form.pickobjectsordered
				form.output.append(se)
				y = label.Bottom + 25 * yRatio
			elif j.__class__.__name__ == 'uiselectlinkedelements':
				se = Button()
				if j.inputname != "":
					se.Width = formwidth - xinput - rightmargin
					se.Location = Point(xinput,y)
				else:
					se.Width = formwidth - xlabel - rightmargin		
					se.Location = Point(xlabel,y)
				se.Text = j.buttontext
				se.Height = 20 * yRatio				
				formbody.Controls.Add(se)
				if j.multi == False:
					se.Click += form.picklinkedobjects
				else:
					se.Click  += form.picklinkedobject
				form.output.append(se)

				y = label.Bottom + 25 * yRatio
			elif j.__class__.__name__ == 'uiselectlinkedelementsofcat':
				sec = Button()
				if j.inputname != "":
					sec.Width = formwidth - xinput - rightmargin
					sec.Location = Point(xinput,y)
				else:
					sec.Width = formwidth - xlabel - rightmargin		
					sec.Location = Point(xlabel,y)
				sec.Text = j.buttontext
				sec.Tag = j.category
				sec.Height = 20 * yRatio
				formbody.Controls.Add(sec)
				if j.multi == False:
					sec.Click += form.picklinkedobjectsofcat
				else:
					sec.Click += form.picklinkedobjectofcat
				form.output.append(sec)
				y = label.Bottom + 25 * yRatio
			elif j.__class__.__name__ == 'uiselectelementsofcat':
				sec = Button()
				if j.inputname != "":
					sec.Width = formwidth - xinput - rightmargin
					sec.Location = Point(xinput,y)
				else:
					sec.Width = formwidth - xlabel - rightmargin		
					sec.Location = Point(xlabel,y)
				sec.Text = j.buttontext
				sec.Tag = j.category
				sec.Height = 20 * yRatio
				formbody.Controls.Add(sec)
				if j.multi == False:
					sec.Click += form.pickobjectsofcat
				else:
					sec.Click += form.pickobjectofcat
				form.output.append(sec)
				y = label.Bottom + 25 * yRatio
			elif j.__class__.__name__ == 'uiselectOrderedelementsofcat':
				sec = Button()
				if j.inputname != "":
					sec.Width = formwidth - xinput - rightmargin
					sec.Location = Point(xinput,y)
				else:
					sec.Width = formwidth - xlabel - rightmargin		
					sec.Location = Point(xlabel,y)
				sec.Text = j.buttontext
				sec.Tag = j.category
				sec.Height = 20 * yRatio
				formbody.Controls.Add(sec)
				sec.Click += form.pickobjectsofcatordered
				form.output.append(sec)
				y = label.Bottom + 25 * yRatio
			elif j.__class__.__name__ == 'uiselectfaces':
				sf = Button()
				if j.inputname != "":
					sf.Width = formwidth - xinput - rightmargin
					sf.Location = Point(xinput,y)
				else:
					sf.Width = formwidth - xlabel - rightmargin		
					sf.Location = Point(xlabel,y)
				sf.Text = j.buttontext
				sf.Height = 20 * yRatio
				formbody.Controls.Add(sf)
				sf.Click += form.pickfaces
				form.output.append(sf)
				y = label.Bottom + 25 * yRatio
			elif j.__class__.__name__ == 'uiselectpointsonface':
				spf = Button()
				if j.inputname != "":
					spf.Width = formwidth - xinput - rightmargin
					spf.Location = Point(xinput,y)
				else:
					spf.Width = formwidth - xlabel - rightmargin		
					spf.Location = Point(xlabel,y)
				spf.Text = j.buttontext
				spf.Height = 20 * yRatio
				formbody.Controls.Add(spf)
				spf.Click += form.pickpointsonface
				form.output.append(spf)
				y = label.Bottom + 25 * yRatio
			elif j.__class__.__name__ == 'uiselectedges':
				sed = Button()
				if j.inputname != "":
					sed.Width = formwidth - xinput - rightmargin
					sed.Location = Point(xinput,y)
				else:
					sed.Width = formwidth - xlabel - rightmargin		
					sed.Location = Point(xlabel,y)
				sed.Text = j.buttontext
				sed.Height = 20 * yRatio
				formbody.Controls.Add(sed)
				sed.Click += form.pickedges
				form.output.append(sed)
				y = label.Bottom + 25 * yRatio
				
			elif j.__class__.__name__ == 'uislider':
				gb = Panel()
				if j.defaultvalue == '':
					defval = j.minimum
				else:
					defval = j.defaultvalue
				sl = mytrackbar(j.minimum,j.step)
				if j.inputname != "":
					gb.Width = formwidth - xinput - rightmargin
					gb.Location = Point(xinput,y)
				else:
					gb.Width = formwidth - xlabel - rightmargin		
					gb.Location = Point(xlabel,y)
				gb.Height = 40 * yRatio
				sl.Minimum = 0
				sl.Maximum = (j.maximum-j.minimum)/j.step
				sl.Value = (defval - j.minimum) / j.step
				sl.TickFrequency = (j.maximum-j.minimum)/j.step/10
				sl.Location = Point(40 * xRatio,0)
				if j.inputname != "":
					sl.Width = formwidth - xinput - rightmargin - 35 * xRatio
				else:
					sl.Width = formwidth - xlabel -rightmargin - 35 * xRatio
				gb.Controls.Add(sl)
				form.output.append(sl)
				displabel = Label()
				displabel.Width = 50 * xRatio
				displabel.Location = Point(0,5 * yRatio)
				displabel.Text = str(defval)
				displabel.Height = 30 * yRatio
				displabel.BringToFront()
				gb.Controls.Add(displabel)	
				formbody.Controls.Add(gb)			
				sl.Scroll += form.scroll
				y = label.Bottom + 25 * yRatio
			elif j.__class__.__name__ == 'uiimage':
				pic = Image.FromFile(j.image)
				im = PictureBox()
				if j.showborder:
					im.BorderStyle = BorderStyle.Fixed3D
				else:
					im.BorderStyle = BorderStyle.None
				ratio = (pic.Height)/(pic.Width)
				h = float(pic.Height)
				w = float(pic.Width)
				ratio = h/w
				image_maxsize = formwidth - xlabel - rightmargin
				im.Size = Size(image_maxsize,image_maxsize*ratio)
				scaledimage = Bitmap(image_maxsize,image_maxsize*ratio)
				gr = Graphics.FromImage(scaledimage)
				gr.DrawImage(pic,0,0,image_maxsize,image_maxsize*ratio)
				im.Image = pic
				im.SizeMode = PictureBoxSizeMode.Zoom
				formbody.Controls.Add(im)
				im.Location = Point(25 * xRatio,y+25*yRatio)
				y = im.Bottom + 25 * yRatio
		
			elif j.__class__.__name__ == 'uicolorpick' and importcolorselection == 0:
				cp = Button()
				if j.inputname != "":
					cp.Width = formwidth - xinput - rightmargin
					cp.Location = Point(xinput,y)
				else:
					cp.Width = formwidth - xlabel - rightmargin		
					cp.Location = Point(xlabel,y)
				cp.Text = j.buttontext
				cp.Height = 30 * yRatio
				formbody.Controls.Add(cp)
				cp.Click += form.colorpicker
				form.output.append(cp)
				y = label.Bottom + 25 * yRatio	
			elif j.__class__.__name__ == 'uicolorpick' and importcolorselection == 1:
				importcolorselection = 2
			elif j.__class__.__name__ == 'uigroup':
				grouppanel = GroupBox()
				grouppanel.Text = j.groupname
				grouppanel.Location = Point(xlabel,y)
				grouppanel.Width = formwidth - 65 * xRatio
				#recursive implementation of the definition to process grouped inputs
				addinput(grouppanel,j.inputgroup,25*yRatio,xinput-25*xRatio,80 * xRatio,90 * xRatio,importcolorselection)
				formbody.Controls.Add(grouppanel)
				y = grouppanel.Bottom + 25 * yRatio
			elif j.__class__.__name__ == 'uiconditional':
				grouppanelcond = GroupBox()
				grouppanelcond.Location = Point(xlabel,y)
				grouppanelcond.Width = formwidth - 65 * xRatio	
				form.output.append(grouppanelcond)				
				#recursive implementation of the definition to process conditional groups of inputs
				panlist = []
				rblist = []
				yp = 25 * yRatio
				xrb = 25 * xRatio
				for i,d in zip(j._Conditions,j._GroupedInputs):	
					rb = RadioButton()
					rb.CheckedChanged += form.ActivateOption
					rb.Text = i
					rb.Location	= Point(xrb,10*yRatio)
					rb.Width = 95 * xRatio
					rblist.append(rb)					
					grouppanelcond.Controls.Add(rb)				
					condition_pannel = Panel()
					condition_pannel.Name = i
					condition_pannel.Top = yp
					condition_pannel.Width = formwidth - 65 * xRatio
					condition_pannel.BackColor = Color.Transparent
					condition_pannel.BringToFront()					
					addinput(condition_pannel,d,25*yRatio,xinput-25*xRatio,80*xRatio,90*xRatio,importcolorselection)
					panlist.append(condition_pannel)
					yp = condition_pannel.Bottom - 25*yRatio
					xrb += 100 * xRatio
				for pan in panlist:
					grouppanelcond.Controls.Add(pan)
				for e,pan in enumerate(panlist):
					if e != j._defaultOptionIndex:
						pan.Enabled = False
					else:
						continue
				rblist[j._defaultOptionIndex].Checked = True
				grouppanelcond.Height = sum([p.Height for p in panlist]) - (len(panlist)-2)*25 * yRatio
				grouppanelcond.BackColor = Color.Transparent				
				formbody.Controls.Add(grouppanelcond)
				form.output.append([grouppanelcond.Tag])				
				y = grouppanelcond.Bottom + 25*yRatio
			formbody.Height = y


	# process input lists 
	addinput(body,inputtypes,0,IN[9],40 * xRatio ,IN[9] * xRatio,importcolorselection)
	
	#add the formbody panel to the form
	form.Controls.Add(body)		
	

	if IN[6] != None:
		if IN[8] > 400 * yRatio:
			formy += 50 * yRatio
			xinput = 270 * yRatio
		else:
			formy = logo.Bottom + 20 * yRatio
	else:
		formy += 50 * yRatio



	#Adding validation button
	
	button = Button()
	button.Text = IN[1]
	button.Width = formwidth - xinput - 40 * xRatio
	button.Height = 20 * yRatio
	button.Location = Point (xinput,formy)
	button.Click += form.setclose
	form.Controls.Add(button)
	form.MaximizeBox = False
	form.MinimizeBox = False
	form.FormBorderStyle = FormBorderStyle.FixedSingle
	
	#Adding Cancel button
	if IN[6] != None:
		cancelbutton = Button()
		cancelbutton.Text = IN[6]
		cancelbutton.Width = 120 * xRatio
		cancelbutton.Height = 20 * xRatio
		cancelbutton.Name = "Cancel"
		cancelbutton.Location = Point (xinput -120 * xRatio ,formy)
		cancelbutton.Click += form.setclose
		form.Controls.Add(cancelbutton)
		form.CancelButton = cancelbutton
	
	#Adding link to help
	
	if IN[5] != None :
		helplink = LinkLabel()
		helplink.Text = "Help"
		helplink.Tag = IN[5]
		helplink.Click += form.openurl
		helplink.Location = Point(formwidth - 65 * xRatio ,formy+30 * yRatio)
		form.Controls.Add(helplink)
	else:
		pass	
			
	form.ShowIcon = True
	form.Width = formwidth
	form.Height = formy + 120 * yRatio
	formfooterheight = form.Height - formheaderheight
	
	# Make formbody scrollable
	
	# if the form is longer than its maximum height, do the following:
	# modify the form height
	# make the formbody panel scrollable
	if form.Height + body.Height > IN[7] * yRatio and IN[7] * yRatio > 0:
		formbody_calculatedheight = IN[7] * yRatio - form.Height
		# make sure the formbody is at least 100 px high
		if formbody_calculatedheight < 100 * yRatio: formbody_calculatedheight = 100 * yRatio
		body.Height = formbody_calculatedheight
		form.Height = form.Height + formbody_calculatedheight
		# this (and apparently only this) will implement a vertical AutoScroll *only*
		# http://stackoverflow.com/a/28583501
		body.HorizontalScroll.Maximum = 0
		body.AutoScroll = False
		body.VerticalScroll.Visible = False
		body.AutoScroll = True
		body.BorderStyle = BorderStyle.Fixed3D
	else:
		form.Height = form.Height + body.Height
	# Move footer elements
	logo.Location = Point(logo.Location.X, logo.Location.Y + body.Height)
	button.Location = Point(button.Location.X, button.Location.Y + body.Height)
	if IN[6] != None: cancelbutton.Location = Point(cancelbutton.Location.X, cancelbutton.Location.Y + body.Height)
	if IN[5] != None: helplink.Location = Point(helplink.Location.X, helplink.Location.Y + body.Height)

	#Positionning the form at top left of current view
	#In The revit environment
	try:
		uiviews = uidoc.GetOpenUIViews()
		if doc.ActiveView.IsValidType(doc.ActiveView.GetTypeId()):
			activeviewid = doc.ActiveView.Id
			activeUIView = [v for v in uiviews if v.ViewId == activeviewid][0]
		else:
			activeUIView = uiviews[0]
		rect = activeUIView.GetWindowRectangle()
		form.StartPosition = FormStartPosition.Manual
		form.Location = Point(rect.Left-7 * xRatio,rect.Top)
	except:
		pass
	
		
	if IN[2]:
		if importcolorselection != 2:
			Application.Run(form)
			result = form.values
			OUT = result,True, form.cancelled 
		else:
			OUT = ['ColorSelection input is only available With Revit 2017'] , False, False
	else :
		OUT = ['Set toggle to true!'] , False, False
except:
	import traceback
	OUT = traceback.format_exc() , "error", "error"
# ----------------------------------------
code_block_4 = CodeBlock(x=python_script_8) { x[0]; }
watch = Watch(code_block_4)
code_block_5 = CodeBlock(x=watch) { x[4]; }

# group: отбираем только нужные внешние ссылки
element_types = ElementTypes("RevitLinkInstance")
all_elements_of_type = ElementsOfType(element_type=element_types)
elementType = Element.ElementType(element=all_elements_of_type)
name = Element.Name(element=elementType)
коды_ссылок_для_анализа = CodeBlock(NameFile=code_block_5)
# ---------- коды_ссылок_для_анализа.designscript (3 lines) ----------
[
NameFile
];
# ----------------------------------------
contains = String.Contains(str=name, searchFor=коды_ссылок_для_анализа, lacing=CrossProduct)
allFalse = List.AllFalse(list=contains@L2)
filterByBoolMask = List.FilterByBoolMask(list=all_elements_of_type, mask=allFalse)

# group: получаем стены из всех ссылок
categories = Categories("OST_Walls")
ofCategory = Revit.LinkElement.OfCategory(linkInstance=filterByBoolMask.out, Category=categories)
flatten = List.Flatten(list=ofCategory)
element = Revit.LinkElement.Element(linkElement=flatten)
elementType_2 = Custom[Element.ElementType+](element=element)  # package Clockwork for Dynamo 2.x; Gets the family type of a given element (if applicable). Unlike the OOTB node, it also works for elements in linked models.
name_2 = Element.Name(element=elementType_2)
code_block_6 = CodeBlock(str=name_2) { str==null?"Вн_О":str; }
code_block_7 = CodeBlock(l=flatten, m=code_block_6) { DSCore.List.FilterByBoolMask(l,DSCore.String.Contains(m,"Вн_О")||DSCore.String.Contains(m,"Нр_О"))["out"]; }

# group: Исключение нулевых геометрий
solids = Revit.LinkElement.Solids(linkElement=code_block_7)
isEmpty = List.IsEmpty(list=solids@L2)
code_block_8 = CodeBlock(x=isEmpty) { !x; }
filterByBoolMask_2 = List.FilterByBoolMask(list=code_block_7, mask=code_block_8)
boundingBox = Revit.LinkElement.BoundingBox(linkElement=filterByBoolMask_2.in)

code_block_9 = CodeBlock(x=watch) { x[0]; }

# group: получаем воздуховоды и трубы, лотки
categories_2 = Categories("OST_CableTray")
all_elements_of_category = ElementsOfCategory(Category=categories_2)
categories_3 = Categories("OST_DuctCurves")
all_elements_of_category_2 = ElementsOfCategory(Category=categories_3)
categories_4 = Categories("OST_PipeCurves")
all_elements_of_category_3 = ElementsOfCategory(Category=categories_4)
code_block_10 = CodeBlock { "Диаметр"; }
getParameterValueByName = Element.GetParameterValueByName(element=all_elements_of_category_3, parameterName=code_block_10)
code_block_11 = CodeBlock(l=all_elements_of_category_3, m=getParameterValueByName, D=code_block_9) { DSCore.List.FilterByBoolMask(l,m>=D)["in"]; }
join = List.Join(list0=all_elements_of_category, list1=all_elements_of_category_2, list2=[code_block_11, code_block_11])

code_block_12 = CodeBlock(x=watch) { x[1]; }

# group: Исключаем короткие участки труб и вздуховодов
getLocation = Element.GetLocation(element=join)
length = Curve.Length(curve=getLocation)
code_block_13 = CodeBlock(l=join, ln=length, lnmin=code_block_12) { DSCore.List.FilterByBoolMask(l,ln>lnmin)["in"]; }

# group: фильтруем по габаритам и находим пересечения
getElementsIntersect = Revit.BoundingBox.GetElementsIntersect(boundingBox=boundingBox, elements=code_block_13)
isEmpty_2 = List.IsEmpty(list=getElementsIntersect@L2)
code_block_14 = CodeBlock(l=filterByBoolMask_2.in, m=isEmpty_2) { DSCore.List.FilterByBoolMask(l,m)["out"]; }
code_block_15 = CodeBlock(l=getElementsIntersect, m=isEmpty_2) { DSCore.List.FilterByBoolMask(l,m)["out"]; }
getLocation_2 = Element.GetLocation(element=code_block_15)

# group: фильтруем воздуховоды без пересечек
totalTransform = Revit.LinkElement.TotalTransform(linkElement=code_block_14)
py_пересечение_функциями_ревита = Python(IN[0]=code_block_14, IN[1]=getLocation_2, IN[2]=totalTransform)
# ---------- py_пересечение_функциями_ревита.python (64 lines) ----------
import clr
clr.AddReference("RevitAPI")
clr.AddReference("RevitAPIUI")

from Autodesk.Revit.DB import * 

# Import DocumentManager
clr.AddReference("RevitServices")
import RevitServices
from RevitServices.Persistence import DocumentManager
from RevitServices.Transactions import TransactionManager

clr.AddReference("RevitNodes")
import Revit
clr.ImportExtensions(Revit.Elements)
clr.ImportExtensions(Revit.GeometryConversion)

doc = DocumentManager.Instance.CurrentDBDocument
uiapp = DocumentManager.Instance.CurrentUIApplication
app = uiapp.Application

fs = UnwrapElement(IN[0])
op = Options()
op.View = doc.ActiveView

OUT=[]

lines = IN[1]
css = IN[2]

TEST=list()

for i, f in enumerate(fs):
	
	ge = [list(f.get_Geometry(op))[-1]]
	
	#TEST.append(ge)
	
	for g in ge:
		s = SolidUtils.CreateTransformed(g,css[i].ToTransform())
		group=[]
		
		for c in lines[i]:
			try:		
				res = s.IntersectWithCurve(c.ToRevitType(),SolidCurveIntersectionOptions())
				
				if res.SegmentCount>0:
					group.Add(res.GetCurveSegment(0).ToProtoType())
				else:
					group.Add(None)
			except:
				group.Add(None)
				pass
				
	OUT.Add(group)

#OUT.Add(ge)
#TransactionManager.Instance.EnsureInTransaction(doc)

	
	
	
	
#TransactionManager.Instance.TransactionTaskDone()
# ----------------------------------------
isNull = Object.IsNull(obj=py_пересечение_функциями_ревита)
filterByBoolMask_3 = List.FilterByBoolMask(list=py_пересечение_функциями_ревита, mask=isNull)
isEmpty_3 = List.IsEmpty(list=filterByBoolMask_3.out@L2)
filterByBoolMask_4 = List.FilterByBoolMask(list=filterByBoolMask_3.out, mask=isEmpty_3)
filterByBoolMask_5 = List.FilterByBoolMask(list=code_block_15, mask=isNull)
isEmpty_4 = List.IsEmpty(list=filterByBoolMask_5.out@L2)
filterByBoolMask_6 = List.FilterByBoolMask(list=filterByBoolMask_5.out, mask=isEmpty_4)
filterByBoolMask_7 = List.FilterByBoolMask(list=code_block_14, mask=isEmpty_3)

# group: получаем список воздуховодов, их пересечений и стен, их создавших
watch_2 = Watch(filterByBoolMask_4.out)
watch_3 = Watch(filterByBoolMask_6.out)
watch_4 = Watch(filterByBoolMask_7.out)
direction = Line.Direction(line=watch_2)

# group: Получаем точку центра кубика
code_block_16 = CodeBlock { 0.5; }
pointAtParameter = Curve.PointAtParameter(curve=watch_2, param=code_block_16)

watch_5 = Watch(code_block_4)
code_block_17 = CodeBlock(x=watch_5) { x[3]; x[2]; }
round = CodeBlock(x=code_block_17.out0) { x; }
грань_труба = CodeBlock(x=code_block_17.out1) { x; }

# group: получаем габариты воздуховодов
code_block_18 = CodeBlock { "Ширина"; "Высота"; "Диаметр"; }
getParameterValueByName_2 = Element.GetParameterValueByName(element=watch_3, parameterName=code_block_18.out2)
getParameterValueByName_3 = Element.GetParameterValueByName(element=watch_3, parameterName=code_block_18.out0)
code_block_19 = CodeBlock(d=getParameterValueByName_2, x=getParameterValueByName_3) { Math.Round(d!=""?d:x); }
getParameterValueByName_4 = Element.GetParameterValueByName(element=watch_3, parameterName=code_block_18.out1)
code_block_20 = CodeBlock(delta=грань_труба, d=getParameterValueByName_2, x=getParameterValueByName_4) { delta; Math.Round(d!=""?d:x)+delta; }
полная_высота = CodeBlock(round=round, x=code_block_20.out1) { round; Math.Ceiling(x/round)*round; }

# group: вычисляем угол поворота кубика
location = Revit.LinkElement.Location(linkElement=watch_4)
direction_2 = Line.Direction(line=location)
XAxis = Vector.XAxis()
ZAxis = Vector.ZAxis()
angleAboutAxis = Vector.AngleAboutAxis(vector=XAxis, otherVector=direction_2, rotationAxis=ZAxis)

# group: получаем минимальный угол между осями стены и перпендикуляром воздуховода
code_block_21 = CodeBlock(v=direction_2) { Vector.ByCoordinates(v.X,v.Y,0); }
code_block_22 = CodeBlock(v=direction) { Vector.ByCoordinates(v.X,v.Y,0); }
angleWithVector = Vector.AngleWithVector(vector=code_block_21, otherVector=code_block_22)
острый_угол_между_стеной_и = CodeBlock(a=angleWithVector) { ar=Math.Round(a,1); 90-(ar>90?180-ar:ar); }  # "острый угол между стеной и перпендикуляром возд."

острый_угол_между_стеной_и_2 = CodeBlock(ar=острый_угол_между_стеной_и.out1) { (ar>45?90-ar:ar); }  # "острый угол между стеной и перпендикуляром возд."

# group: получаем толщину стен
python_script_9 = Python(IN[0]=filterByBoolMask_7.out)
# ---------- python_script_9.python (4 lines) ----------
import clr

walls = UnwrapElement(IN[0])
OUT = map(lambda x: x.WallType.Width*304.8,walls)
# ----------------------------------------
code_block_23 = CodeBlock(x=python_script_9) { Math.Round(x+60); }

# group: решаем большой и малый треугольники и получаем полную ширину
большой_треугольник = CodeBlock(w=code_block_19, A=острый_угол_между_стеной_и_2) { (w*0.5)/Math.Cos(A); }
малый_треугольник = CodeBlock(b=python_script_9, A=острый_угол_между_стеной_и_2) { (b*0.5)*Math.Tan(A); }
полная_ширина = CodeBlock(round=round, delta=грань_труба, bt=большой_треугольник, mt=малый_треугольник) { round; delta; x=(bt+mt)*2+delta; Math.Ceiling(x/round)*round; }

round_2 = Math.Round(number=angleAboutAxis)

# group: Создание строки описывающей отверстия
точность_выставления_задания_по = CodeBlock { 10; }  # "Точность выставления задания по координатам, мм"
разделитель = CodeBlock { "|"; ",000000"; ""; }
count = List.Count(list=полная_высота.out1@L2)
ofRepeatedItem = List.OfRepeatedItem(item=code_block_23@L1, amount=count@L1)
ofRepeatedItem_2 = List.OfRepeatedItem(item=round_2@L1, amount=count@L1)
code_block_24 = CodeBlock(tochnoct=точность_выставления_задания_по, razdelitel=разделитель.out0, x=pointAtParameter, Shirina=полная_ширина.out3, Visota=полная_высота.out1, Glubina=ofRepeatedItem, Ygol=ofRepeatedItem_2)
# ---------- code_block_24.designscript (11 lines) ----------
a=tochnoct;
r=razdelitel;


Math.Round(Point.X(x)/a)*a+r+
Math.Round(Point.Y(x)/a)*a+r+
Math.Round(Point.Z(x)/a)*a+r+
Shirina+r+
Visota+r+
Glubina+r+
Ygol;
# ----------------------------------------
flatten_2 = List.Flatten(list=[code_block_24.out2, code_block_24.out2])
replace = String.Replace(str=flatten_2, searchFor=разделитель.out1, replaceWith=разделитель.out2)

python_script_10 = Python(IN[0]=replace)
# ---------- python_script_10.python (17 lines) ----------
# Загрузить стандартную библиотеку Python и библиотеку DesignScript
import sys
import clr
clr.AddReference('ProtoGeometry')
from Autodesk.DesignScript.Geometry import *

# Введенные в этом узле данные сохраняется в виде списка в переменных IN.


try:
	if len(IN[0])==0:
		OUT = IN[0]
	if len(IN[0])>0:
		OUT = IN[0]
	
except:
	OUT =[""]
# ----------------------------------------

# group: Получение существующих отверстий КЖ стены
categories_5 = Categories("OST_GenericModel")
ofCategory_2 = Revit.LinkElement.OfCategory(linkInstance=filterByBoolMask.out, Category=categories_5)
flatten_3 = List.Flatten(list=ofCategory_2)
element_2 = Revit.LinkElement.Element(linkElement=flatten_3)
getFamily = FamilyInstance.GetFamily(familyInstance=element_2)
name_3 = Element.Name(element=getFamily)
code_block_25 = CodeBlock(l=flatten_3, n=name_3) { DSCore.List.FilterByBoolMask(l,n=="(Отверстие) Стена")["in"]; }

code_block_26 = CodeBlock(l=flatten_3, n=name_3) { DSCore.List.FilterByBoolMask(l,n=="(Отверстие) Стена_Глубина")["in"]; }
join_2 = List.Join(list0=code_block_26, list1=code_block_25)
watch_6 = Watch(join_2)
location_2 = Revit.LinkElement.Location(linkElement=watch_6)

# group: Получение угла поворота системы кординат элемента
XAxis_2 = Vector.XAxis()
totalTransform_2 = Revit.LinkElement.TotalTransform(linkElement=watch_6)
code_block_27 = CodeBlock(x=totalTransform_2) { x.XAxis; }
ZAxis_2 = Vector.ZAxis()
angleAboutAxis_2 = Vector.AngleAboutAxis(vector=XAxis_2, otherVector=code_block_27, rotationAxis=ZAxis_2)

code_block_28 = CodeBlock(x=flatten) { x; }

# group: Solid стен
element_host = Custom[Element Host](element=watch_6)  # package Genius Loci; Gets the host of the element. Unlike the OOTB node FamilyInstance.GetHost, it also works for elements hosted by a linked document, wall sweeps, foundations, railings and builing pads. Based on a Clockwork's node
id = Element.Id(element=element_host)
python_script_11 = Python(IN[0]=code_block_28, IN[1]=id)  # unwired: IN[2]
# ---------- python_script_11.python (35 lines) ----------
import clr
clr.AddReference("RevitAPI")
clr.AddReference("RevitAPIUI")

from Autodesk.Revit.DB import * 

# Import DocumentManager
clr.AddReference("RevitServices")
import RevitServices
from RevitServices.Persistence import DocumentManager
from RevitServices.Transactions import TransactionManager

clr.AddReference("RevitNodes")
import Revit
clr.ImportExtensions(Revit.Elements)
clr.ImportExtensions(Revit.GeometryConversion)
# Введенные в этом узле данные сохраняется в виде списка в переменных IN.
link_walls = IN[0]
walls = UnwrapElement(IN[0])
idwalls =IN[1]

allid= []
OUT =[]
for wall in walls:
	allid.Add(str(wall.Id))
	
# Разместите код под этой строкой
for wallId in idwalls:
	wallId = str(wallId)
	elementId = allid.index(wallId)
	OUT.Add(link_walls[elementId])


			
# Назначьте вывод переменной OUT.
# ----------------------------------------

# group: получаем толщину стен
python_script_12 = Python(IN[0]=python_script_11)  # same code as python_script_9

element_3 = Revit.LinkElement.Element(linkElement=join_2)
getFamily_2 = FamilyInstance.GetFamily(familyInstance=element_3)
name_4 = Element.Name(element=getFamily_2)
python_script_13 = Python(IN[0]=watch_6, IN[1]=location_2, IN[2]=angleAboutAxis_2, IN[3]=python_script_12, IN[4]=name_4)
# ---------- python_script_13.python (182 lines) ----------
# Загрузить стандартную библиотеку Python и библиотеку DesignScript
import sys
import clr
clr.AddReference('ProtoGeometry')
clr.AddReference('RevitAPI')
import Autodesk
from Autodesk.Revit.DB import *
from Autodesk.DesignScript.Geometry import *

clr.AddReference('RevitServices')
import RevitServices
from RevitServices.Persistence import DocumentManager
from RevitServices.Transactions import TransactionManager
import math
doc = DocumentManager.Instance.CurrentDBDocument
# Введенные в этом узле данные сохраняется в виде списка в переменных IN.

otvs= UnwrapElement(IN[0])
otv_locs1 = IN[1]
delta = 50
otv_ccs_angle = IN[2]
otv_depth = IN[3]
otv_families =IN[4]

otv_locs = []
otv_rot =[]
otv_width =[]
otv_lenth =[]
otv_hight =[]

OUT=[]





# созданные функции

def get_parameters_elements(otvs, strr):	
	out_list1=[]
	out_list=[]
	otv_lenth =[]
	for model in otvs:
		out_list.append(model.Name)
			
	elUnwrap = UnwrapElement(otvs)
	sum=0
	for i in elUnwrap:
		if out_list[sum] == -1:
			out_list1.append(-1)
			sum+=1
		else:
			sum+=1
			Db = i.GetParameters(strr)
			
			for i in Db:
				out_list1.append(i.AsValueString())
				
	for i in out_list1:
		otv_lenth.Add(i)
	return otv_lenth


def surfase(pO, angle, width, len, delta,Ez, el):
	OE = float(width)/2 
	OF = float(len)/2 
	point_list = []

	Ex = pO.X * 304.8 + (OE+delta)*math.cos(math.radians(float(angle))) 
	Ey = pO.Y * 304.8 + (OE+delta)*math.sin(math.radians(float(angle)))
	
	Gx = pO.X * 304.8 - (OE+delta)*math.cos(math.radians(float(angle)))
	Gy = pO.Y * 304.8 - (OE+delta)*math.sin(math.radians(float(angle)))	
	
	Ax = Gx
	Ay = Gy
	Az = pO.Z * 304.8+(OF+delta)
	
	Bx = Ex
	By = Ey
	Bz = pO.Z * 304.8+(OF+delta)
	
	Dx = Gx
	Dy = Gy
	Dz = pO.Z * 304.8-(OF+delta)
	
	Cx = Ex
	Cy = Ey
	Cz = pO.Z * 304.8-(OF+delta)
	
	point_list.append(Point.ByCoordinates(Ax, Ay, Az))
	point_list.append(Point.ByCoordinates(Bx, By, Bz))
	point_list.append(Point.ByCoordinates(Cx, Cy, Cz))
	point_list.append(Point.ByCoordinates(Dx,Dy,Dz))
	surface = Surface.ByPerimeterPoints(point_list)
	
	return surface
	
def surfaces(elements, locs_list, rot_list, width_list, lenth_list, delta, tz_depth):
	test =[]
	sufraces_list = []
	for i, el in enumerate(elements):
		test.Add(i)
		pO = locs_list[i]
		angle = rot_list[i]
		width = width_list[i]
		len = lenth_list[i]
		
		depth = float(tz_depth[i]) - 60
		Ez = pO.Z * 304.8 + depth/2
			
		
		sufraces_list.Add(surfase(pO, angle, width, len, delta,Ez,el))
	return sufraces_list

def solid_from_surface(surface, centrP, depth):
	delta = depth/2
	centrP = Point.ByCoordinates(centrP.X*304.8,centrP.Y*304.8,centrP.Z*304.8)
	norkvector = Surface.NormalAtParameter(surface)
	norkvector = Vector.ByCoordinates(norkvector.X*delta, norkvector.Y*delta, norkvector.Z*delta)
	StartPoint = Point.Add(centrP,norkvector)
	EndPoint = Point.Subtract(centrP,norkvector)
	
	line = Line.ByStartPointEndPoint(StartPoint,EndPoint)
	line1 = Line.ByStartPointEndPoint(EndPoint,centrP)
	line2 = Line.ByStartPointEndPoint(centrP,StartPoint)
	StartSurface = Surface.Offset(surface, depth)
	
	
	
	perimetrlines = Surface.PerimeterCurves(surface)
	perimetrcurve = Curve.Join(perimetrlines[0],perimetrlines[1:])
	solid1 = Solid.BySweep(perimetrcurve,line1)
	solid2 = Solid.BySweep(perimetrcurve,line2)
	sol = Solid.ByUnion([solid1,solid2])
	
	return sol


def solids_from_surfaces(surfaces, centrPs, depth):
	solids = []
	for i, surf in enumerate(surfaces):
		sol = solid_from_surface(surf, centrPs[i], depth[i])
		solids.Add(sol)
	return solids


# Разместите код под этой строкой


otv_lenth = get_parameters_elements(otvs, ":H отверстия")
otv_width = get_parameters_elements(otvs, ":B отверстия")

for i, otv in enumerate(otv_locs1):
	
	if otv_families[i] == "(Отверстие) Стена":
		pO = Point.ByCoordinates(otv.X/304.8,otv.Y/304.8,otv.Z/304.8)
	
	elif otv_families[i] == "(Отверстие) Стена_Глубина":
		pO = Point.ByCoordinates(otv.X/304.8,otv.Y/304.8,otv.Z/304.8+float(otv_lenth[i])/2/304.8)
	
	else:
		pO = Point.ByCoordinates(otv.X/304.8,otv.Y/304.8,otv.Z/304.8)	
		
	otv_locs.Add(pO)

for i,otv in enumerate(otvs):
	otv_rot.Add(math.degrees(otv.Location.Rotation) + otv_ccs_angle[i])
	



otv_surfaces= surfaces(otvs,otv_locs,otv_rot,otv_width,otv_lenth, delta,otv_depth)
solids=solids_from_surfaces(otv_surfaces, otv_locs, otv_depth)
OUT.Add(solids)




#OUT.Add(otv_surfaces)

# Назначьте вывод переменной OUT.
# ----------------------------------------

# group: Solid отверстия
python_script_14 = Python(IN[0]=watch_6, IN[1]=location_2, IN[2]=angleAboutAxis_2, IN[3]=python_script_12, IN[4]=name_4)
# ---------- python_script_14.python (182 lines) ----------
# Загрузить стандартную библиотеку Python и библиотеку DesignScript
import sys
import clr
clr.AddReference('ProtoGeometry')
clr.AddReference('RevitAPI')
import Autodesk
from Autodesk.Revit.DB import *
from Autodesk.DesignScript.Geometry import *

clr.AddReference('RevitServices')
import RevitServices
from RevitServices.Persistence import DocumentManager
from RevitServices.Transactions import TransactionManager
import math
doc = DocumentManager.Instance.CurrentDBDocument
# Введенные в этом узле данные сохраняется в виде списка в переменных IN.

otvs= UnwrapElement(IN[0])
otv_locs1 = IN[1]
delta = 0
otv_ccs_angle = IN[2]
otv_depth = IN[3]
otv_families =IN[4]

otv_locs = []
otv_rot =[]
otv_width =[]
otv_lenth =[]
otv_hight =[]

OUT=[]





# созданные функции

def get_parameters_elements(otvs, strr):	
	out_list1=[]
	out_list=[]
	otv_lenth =[]
	for model in otvs:
		out_list.append(model.Name)
			
	elUnwrap = UnwrapElement(otvs)
	sum=0
	for i in elUnwrap:
		if out_list[sum] == -1:
			out_list1.append(-1)
			sum+=1
		else:
			sum+=1
			Db = i.GetParameters(strr)
			
			for i in Db:
				out_list1.append(i.AsValueString())
				
	for i in out_list1:
		otv_lenth.Add(i)
	return otv_lenth


def surfase(pO, angle, width, len, delta,Ez, el):
	OE = float(width)/2 
	OF = float(len)/2 
	point_list = []

	Ex = pO.X * 304.8 + (OE+delta)*math.cos(math.radians(float(angle))) 
	Ey = pO.Y * 304.8 + (OE+delta)*math.sin(math.radians(float(angle)))
	
	Gx = pO.X * 304.8 - (OE+delta)*math.cos(math.radians(float(angle)))
	Gy = pO.Y * 304.8 - (OE+delta)*math.sin(math.radians(float(angle)))	
	
	Ax = Gx
	Ay = Gy
	Az = pO.Z * 304.8+(OF+delta)
	
	Bx = Ex
	By = Ey
	Bz = pO.Z * 304.8+(OF+delta)
	
	Dx = Gx
	Dy = Gy
	Dz = pO.Z * 304.8-(OF+delta)
	
	Cx = Ex
	Cy = Ey
	Cz = pO.Z * 304.8-(OF+delta)
	
	point_list.append(Point.ByCoordinates(Ax, Ay, Az))
	point_list.append(Point.ByCoordinates(Bx, By, Bz))
	point_list.append(Point.ByCoordinates(Cx, Cy, Cz))
	point_list.append(Point.ByCoordinates(Dx,Dy,Dz))
	surface = Surface.ByPerimeterPoints(point_list)
	
	return surface
	
def surfaces(elements, locs_list, rot_list, width_list, lenth_list, delta, tz_depth):
	test =[]
	sufraces_list = []
	for i, el in enumerate(elements):
		test.Add(i)
		pO = locs_list[i]
		angle = rot_list[i]
		width = width_list[i]
		len = lenth_list[i]
		
		depth = float(tz_depth[i]) - 60
		Ez = pO.Z * 304.8 + depth/2
			
		
		sufraces_list.Add(surfase(pO, angle, width, len, delta,Ez,el))
	return sufraces_list

def solid_from_surface(surface, centrP, depth):
	delta = depth/2
	centrP = Point.ByCoordinates(centrP.X*304.8,centrP.Y*304.8,centrP.Z*304.8)
	norkvector = Surface.NormalAtParameter(surface)
	norkvector = Vector.ByCoordinates(norkvector.X*delta, norkvector.Y*delta, norkvector.Z*delta)
	StartPoint = Point.Add(centrP,norkvector)
	EndPoint = Point.Subtract(centrP,norkvector)
	
	line = Line.ByStartPointEndPoint(StartPoint,EndPoint)
	line1 = Line.ByStartPointEndPoint(EndPoint,centrP)
	line2 = Line.ByStartPointEndPoint(centrP,StartPoint)
	StartSurface = Surface.Offset(surface, depth)
	
	
	
	perimetrlines = Surface.PerimeterCurves(surface)
	perimetrcurve = Curve.Join(perimetrlines[0],perimetrlines[1:])
	solid1 = Solid.BySweep(perimetrcurve,line1)
	solid2 = Solid.BySweep(perimetrcurve,line2)
	sol = Solid.ByUnion([solid1,solid2])
	
	return sol


def solids_from_surfaces(surfaces, centrPs, depth):
	solids = []
	for i, surf in enumerate(surfaces):
		sol = solid_from_surface(surf, centrPs[i], depth[i])
		solids.Add(sol)
	return solids


# Разместите код под этой строкой


otv_lenth = get_parameters_elements(otvs, ":H отверстия")
otv_width = get_parameters_elements(otvs, ":B отверстия")

for i, otv in enumerate(otv_locs1):
	
	if otv_families[i] == "(Отверстие) Стена":
		pO = Point.ByCoordinates(otv.X/304.8,otv.Y/304.8,otv.Z/304.8)
	
	elif otv_families[i] == "(Отверстие) Стена_Глубина":
		pO = Point.ByCoordinates(otv.X/304.8,otv.Y/304.8,otv.Z/304.8+float(otv_lenth[i])/2/304.8)
	
	else:
		pO = Point.ByCoordinates(otv.X/304.8,otv.Y/304.8,otv.Z/304.8)	
		
	otv_locs.Add(pO)

for i,otv in enumerate(otvs):
	otv_rot.Add(math.degrees(otv.Location.Rotation) + otv_ccs_angle[i])
	



otv_surfaces= surfaces(otvs,otv_locs,otv_rot,otv_width,otv_lenth, delta,otv_depth)
solids=solids_from_surfaces(otv_surfaces, otv_locs, otv_depth)
OUT.Add(solids)




#OUT.Add(otv_surfaces)

# Назначьте вывод переменной OUT.
# ----------------------------------------

# group: Получили все трубопроводы(исключены короткие участки
watch_7 = Watch(code_block_13)

# group: Получили все трубопроводы(исключены короткие участки
watch_8 = Watch(watch_7)

# group: Вектор пересечения трубопровода и отверстия
intersectsSolid = Revit.Element.IntersectsSolid(solids=python_script_14, elements=watch_8)
getLocation_3 = Element.GetLocation(element=intersectsSolid.Element)
solidIntersection = Curve.SolidIntersection(solid=python_script_13, curves=getLocation_3)

flatten_4 = List.Flatten(list=solidIntersection.Curve)
round_3 = CodeBlock(x=code_block_17.out0) { x; }
грань_труба_2 = CodeBlock(x=code_block_17.out1) { x; }
flatten_5 = List.Flatten(list=intersectsSolid.Element)
code_block_29 = CodeBlock(x=code_block_28) { x; }
python_script_15 = Python(IN[0]=solidIntersection.Curve, IN[1]=watch_6)
# ---------- python_script_15.python (19 lines) ----------
# Загрузить стандартную библиотеку Python и библиотеку DesignScript
import sys
import clr
clr.AddReference('ProtoGeometry')
from Autodesk.DesignScript.Geometry import *

# Введенные в этом узле данные сохраняется в виде списка в переменных IN.
window_bool_list =IN[0][0]
windows=IN[1]
OUT=[]
# Разместите код под этой строкой
# каждый window_list это лист для каждого окна в котором перечисленны трубопроводы которые его пересекают
for i, window_list in enumerate(window_bool_list):
	list_len = len(window_list)
	for  j in range(list_len):
		OUT.Add(windows[i]) 


# Назначьте вывод переменной OUT.
# ----------------------------------------

# group: выбор стен по отверстиям
element_host_2 = Custom[Element Host](element=python_script_15)
id_2 = Element.Id(element=element_host_2)
python_script_16 = Python(IN[0]=code_block_29, IN[1]=id_2)  # unwired: IN[2]
# ---------- python_script_16.python (35 lines) ----------
import clr
clr.AddReference("RevitAPI")
clr.AddReference("RevitAPIUI")

from Autodesk.Revit.DB import * 

# Import DocumentManager
clr.AddReference("RevitServices")
import RevitServices
from RevitServices.Persistence import DocumentManager
from RevitServices.Transactions import TransactionManager

clr.AddReference("RevitNodes")
import Revit
clr.ImportExtensions(Revit.Elements)
clr.ImportExtensions(Revit.GeometryConversion)
# Введенные в этом узле данные сохраняется в виде списка в переменных IN.
link_walls = IN[0]
walls = UnwrapElement(IN[0])
idwalls =IN[1]
link_walls_angle = IN[2]
allid= []
OUT =[]
for wall in walls:
	allid.Add(str(wall.Id))
OUT1=[]	
# Разместите код под этой строкой
for wallId in idwalls:
	wallId = str(wallId)
	elementId = allid.index(wallId)
	OUT1.Add(link_walls[elementId])

OUT = OUT1
			
# Назначьте вывод переменной OUT.
# ----------------------------------------

# group: вычисляем угол поворота кубика
location_3 = Revit.LinkElement.Location(linkElement=python_script_16@L1)
direction_3 = Line.Direction(line=location_3)
XAxis_3 = Vector.XAxis()
ZAxis_3 = Vector.ZAxis()
angleAboutAxis_3 = Vector.AngleAboutAxis(vector=XAxis_3, otherVector=direction_3, rotationAxis=ZAxis_3)

# group: получаем толщину стен
python_script_17 = Python(IN[0]=python_script_16)
# ---------- python_script_17.python (5 lines) ----------
import clr
OUT =[]
walls = UnwrapElement(IN[0])
for wall in walls:
	OUT.Add(wall.WallType.Width*304.8)
# ----------------------------------------
code_block_30 = CodeBlock(x=python_script_17) { Math.Round(x+60); }

python_script_18 = Python(IN[0]=code_block_30)
# ---------- python_script_18.python (13 lines) ----------
# Загрузить стандартную библиотеку Python и библиотеку DesignScript
import sys
import clr
clr.AddReference('ProtoGeometry')
from Autodesk.DesignScript.Geometry import *

# Введенные в этом узле данные сохраняется в виде списка в переменных IN.


# Разместите код под этой строкой

# Назначьте вывод переменной OUT.
OUT = IN
# ----------------------------------------
round_4 = Math.Round(number=angleAboutAxis_3)
python_script_19 = Python(IN[0]=round_4)
# ---------- python_script_19.python (13 lines) ----------
# Загрузить стандартную библиотеку Python и библиотеку DesignScript
import sys
import clr
clr.AddReference('ProtoGeometry')
from Autodesk.DesignScript.Geometry import *

# Введенные в этом узле данные сохраняется в виде списка в переменных IN.
dataEnteringNode = IN

# Разместите код под этой строкой

# Назначьте вывод переменной OUT.
OUT = IN
# ----------------------------------------

# group: Получение существующих отверстий АР стены
categories_6 = Categories("OST_GenericModel")
ofCategory_3 = Revit.LinkElement.OfCategory(linkInstance=filterByBoolMask.out, Category=categories_6)
flatten_6 = List.Flatten(list=ofCategory_3)
element_4 = Revit.LinkElement.Element(linkElement=flatten_6)
getFamily_3 = FamilyInstance.GetFamily(familyInstance=element_4)
name_5 = Element.Name(element=getFamily_3)
code_block_31 = CodeBlock(l=flatten_6, n=name_5) { DSCore.List.FilterByBoolMask(l,n=="Отверстие в стене_Прямоугольное_Глубина")["in"]; }

code_block_32 = CodeBlock(l=flatten_6, n=name_5) { DSCore.List.FilterByBoolMask(l,n=="Отверстие в стене_Прямоугольное")["in"]; }
code_block_33 = CodeBlock(l=flatten_6, n=name_5) { DSCore.List.FilterByBoolMask(l,n=="Отверстие в стене_Прямоугольное1")["in"]; }
join_3 = List.Join(list0=code_block_32, list1=code_block_31, list2=code_block_33)
location_4 = Revit.LinkElement.Location(linkElement=join_3)

# group: Получение угла поворота системы кординат элемента
XAxis_4 = Vector.XAxis()
totalTransform_3 = Revit.LinkElement.TotalTransform(linkElement=join_3)
code_block_34 = CodeBlock(x=totalTransform_3) { x.XAxis; }
ZAxis_4 = Vector.ZAxis()
angleAboutAxis_4 = Vector.AngleAboutAxis(vector=XAxis_4, otherVector=code_block_34, rotationAxis=ZAxis_4)

# group: Solid стен
element_host_3 = Custom[Element Host](element=join_3)
id_3 = Element.Id(element=element_host_3)
python_script_20 = Python(IN[0]=code_block_28, IN[1]=id_3)  # unwired: IN[2]; same code as python_script_11

# group: получаем толщину стен
python_script_21 = Python(IN[0]=python_script_20)  # same code as python_script_9

# group: Solid отверстия
python_script_22 = Python(IN[0]=join_3, IN[1]=location_4, IN[2]=angleAboutAxis_4, IN[3]=python_script_21)
# ---------- python_script_22.python (172 lines) ----------
# Загрузить стандартную библиотеку Python и библиотеку DesignScript
import sys
import clr
clr.AddReference('ProtoGeometry')
clr.AddReference('RevitAPI')
import Autodesk
from Autodesk.Revit.DB import *
from Autodesk.DesignScript.Geometry import *

clr.AddReference('RevitServices')
import RevitServices
from RevitServices.Persistence import DocumentManager
from RevitServices.Transactions import TransactionManager
import math
doc = DocumentManager.Instance.CurrentDBDocument
# Введенные в этом узле данные сохраняется в виде списка в переменных IN.

otvs= UnwrapElement(IN[0])
otv_locs1 = IN[1]
delta = 50
otv_ccs_angle = IN[2]
otv_depth = IN[3]

otv_locs = []
otv_rot =[]
otv_width =[]
otv_lenth =[]
otv_hight =[]

OUT=[]





# созданные функции

def get_parameters_elements(otvs, strr):	
	out_list1=[]
	out_list=[]
	otv_lenth =[]
	for model in otvs:
		out_list.append(model.Name)
			
	elUnwrap = UnwrapElement(otvs)
	sum=0
	for i in elUnwrap:
		if out_list[sum] == -1:
			out_list1.append(-1)
			sum+=1
		else:
			sum+=1
			Db = i.GetParameters(strr)
			
			for i in Db:
				out_list1.append(i.AsValueString())
				
	for i in out_list1:
		otv_lenth.Add(i)
	return otv_lenth


def surfase(pO, angle, width, len, delta,Ez, el):
	OE = float(width)/2 
	OF = float(len)/2 
	point_list = []

	Ex = pO.X * 304.8 + (OE+delta)*math.cos(math.radians(float(angle))) 
	Ey = pO.Y * 304.8 + (OE+delta)*math.sin(math.radians(float(angle)))
	
	Gx = pO.X * 304.8 - (OE+delta)*math.cos(math.radians(float(angle)))
	Gy = pO.Y * 304.8 - (OE+delta)*math.sin(math.radians(float(angle)))	
	
	Ax = Gx
	Ay = Gy
	Az = pO.Z * 304.8+(OF+delta)
	
	Bx = Ex
	By = Ey
	Bz = pO.Z * 304.8+(OF+delta)
	
	Dx = Gx
	Dy = Gy
	Dz = pO.Z * 304.8-(OF+delta)
	
	Cx = Ex
	Cy = Ey
	Cz = pO.Z * 304.8-(OF+delta)
	
	point_list.append(Point.ByCoordinates(Ax, Ay, Az))
	point_list.append(Point.ByCoordinates(Bx, By, Bz))
	point_list.append(Point.ByCoordinates(Cx, Cy, Cz))
	point_list.append(Point.ByCoordinates(Dx,Dy,Dz))
	surface = Surface.ByPerimeterPoints(point_list)
	
	return surface
	
def surfaces(elements, locs_list, rot_list, width_list, lenth_list, delta, tz_depth):
	test =[]
	sufraces_list = []
	for i, el in enumerate(elements):
		test.Add(i)
		pO = locs_list[i]
		angle = rot_list[i]
		width = width_list[i]
		len = lenth_list[i]
		
		depth = float(tz_depth[i]) - 60
		Ez = pO.Z * 304.8 + depth/2
			
		
		sufraces_list.Add(surfase(pO, angle, width, len, delta,Ez,el))
	return sufraces_list

def solid_from_surface(surface, centrP, depth):
	delta = depth/2
	centrP = Point.ByCoordinates(centrP.X*304.8,centrP.Y*304.8,centrP.Z*304.8)
	norkvector = Surface.NormalAtParameter(surface)
	norkvector = Vector.ByCoordinates(norkvector.X*delta, norkvector.Y*delta, norkvector.Z*delta)
	StartPoint = Point.Add(centrP,norkvector)
	EndPoint = Point.Subtract(centrP,norkvector)
	
	line = Line.ByStartPointEndPoint(StartPoint,EndPoint)
	line1 = Line.ByStartPointEndPoint(EndPoint,centrP)
	line2 = Line.ByStartPointEndPoint(centrP,StartPoint)
	StartSurface = Surface.Offset(surface, depth)
	
	
	
	perimetrlines = Surface.PerimeterCurves(surface)
	perimetrcurve = Curve.Join(perimetrlines[0],perimetrlines[1:])
	solid1 = Solid.BySweep(perimetrcurve,line1)
	solid2 = Solid.BySweep(perimetrcurve,line2)
	sol = Solid.ByUnion([solid1,solid2])
	
	return sol


def solids_from_surfaces(surfaces, centrPs, depth):
	solids = []
	for i, surf in enumerate(surfaces):
		sol = solid_from_surface(surf, centrPs[i], depth[i])
		solids.Add(sol)
	return solids


# Разместите код под этой строкой

otv_hight = get_parameters_elements(otvs, "ADSK_Отверстие_Отметка от нуля")
otv_lenth = get_parameters_elements(otvs, "ADSK_Отверстие_Высота")
otv_width = get_parameters_elements(otvs, "ADSK_Отверстие_Ширина")

for i, otv in enumerate(otv_locs1):
	pO = Point.ByCoordinates(otv.X/304.8,otv.Y/304.8,otv.Z/304.8+float(otv_hight[i])/304.8+float(otv_lenth[i])/304.8/2)
	otv_locs.Add(pO)

for i,otv in enumerate(otvs):
	otv_rot.Add(math.degrees(otv.Location.Rotation) + otv_ccs_angle[i])
	



otv_surfaces= surfaces(otvs,otv_locs,otv_rot,otv_width,otv_lenth, delta,otv_depth)
solids=solids_from_surfaces(otv_surfaces, otv_locs, otv_depth)
OUT.Add(solids)




#OUT.Add(otv_surfaces)

# Назначьте вывод переменной OUT.
# ----------------------------------------

# group: Solid отверстия
python_script_23 = Python(IN[0]=join_3, IN[1]=location_4, IN[2]=angleAboutAxis_4, IN[3]=python_script_21)
# ---------- python_script_23.python (172 lines) ----------
# Загрузить стандартную библиотеку Python и библиотеку DesignScript
import sys
import clr
clr.AddReference('ProtoGeometry')
clr.AddReference('RevitAPI')
import Autodesk
from Autodesk.Revit.DB import *
from Autodesk.DesignScript.Geometry import *

clr.AddReference('RevitServices')
import RevitServices
from RevitServices.Persistence import DocumentManager
from RevitServices.Transactions import TransactionManager
import math
doc = DocumentManager.Instance.CurrentDBDocument
# Введенные в этом узле данные сохраняется в виде списка в переменных IN.

otvs= UnwrapElement(IN[0])
otv_locs1 = IN[1]
delta = 0
otv_ccs_angle = IN[2]
otv_depth = IN[3]

otv_locs = []
otv_rot =[]
otv_width =[]
otv_lenth =[]
otv_hight =[]

OUT=[]





# созданные функции

def get_parameters_elements(otvs, strr):	
	out_list1=[]
	out_list=[]
	otv_lenth =[]
	for model in otvs:
		out_list.append(model.Name)
			
	elUnwrap = UnwrapElement(otvs)
	sum=0
	for i in elUnwrap:
		if out_list[sum] == -1:
			out_list1.append(-1)
			sum+=1
		else:
			sum+=1
			Db = i.GetParameters(strr)
			
			for i in Db:
				out_list1.append(i.AsValueString())
				
	for i in out_list1:
		otv_lenth.Add(i)
	return otv_lenth


def surfase(pO, angle, width, len, delta,Ez, el):
	OE = float(width)/2 
	OF = float(len)/2 
	point_list = []

	Ex = pO.X * 304.8 + (OE+delta)*math.cos(math.radians(float(angle))) 
	Ey = pO.Y * 304.8 + (OE+delta)*math.sin(math.radians(float(angle)))
	
	Gx = pO.X * 304.8 - (OE+delta)*math.cos(math.radians(float(angle)))
	Gy = pO.Y * 304.8 - (OE+delta)*math.sin(math.radians(float(angle)))	
	
	Ax = Gx
	Ay = Gy
	Az = pO.Z * 304.8+(OF+delta)
	
	Bx = Ex
	By = Ey
	Bz = pO.Z * 304.8+(OF+delta)
	
	Dx = Gx
	Dy = Gy
	Dz = pO.Z * 304.8-(OF+delta)
	
	Cx = Ex
	Cy = Ey
	Cz = pO.Z * 304.8-(OF+delta)
	
	point_list.append(Point.ByCoordinates(Ax, Ay, Az))
	point_list.append(Point.ByCoordinates(Bx, By, Bz))
	point_list.append(Point.ByCoordinates(Cx, Cy, Cz))
	point_list.append(Point.ByCoordinates(Dx,Dy,Dz))
	surface = Surface.ByPerimeterPoints(point_list)
	
	return surface
	
def surfaces(elements, locs_list, rot_list, width_list, lenth_list, delta, tz_depth):
	test =[]
	sufraces_list = []
	for i, el in enumerate(elements):
		test.Add(i)
		pO = locs_list[i]
		angle = rot_list[i]
		width = width_list[i]
		len = lenth_list[i]
		
		depth = float(tz_depth[i]) - 60
		Ez = pO.Z * 304.8 + depth/2
			
		
		sufraces_list.Add(surfase(pO, angle, width, len, delta,Ez,el))
	return sufraces_list

def solid_from_surface(surface, centrP, depth):
	delta = depth/2
	centrP = Point.ByCoordinates(centrP.X*304.8,centrP.Y*304.8,centrP.Z*304.8)
	norkvector = Surface.NormalAtParameter(surface)
	norkvector = Vector.ByCoordinates(norkvector.X*delta, norkvector.Y*delta, norkvector.Z*delta)
	StartPoint = Point.Add(centrP,norkvector)
	EndPoint = Point.Subtract(centrP,norkvector)
	
	line = Line.ByStartPointEndPoint(StartPoint,EndPoint)
	line1 = Line.ByStartPointEndPoint(EndPoint,centrP)
	line2 = Line.ByStartPointEndPoint(centrP,StartPoint)
	StartSurface = Surface.Offset(surface, depth)
	
	
	
	perimetrlines = Surface.PerimeterCurves(surface)
	perimetrcurve = Curve.Join(perimetrlines[0],perimetrlines[1:])
	solid1 = Solid.BySweep(perimetrcurve,line1)
	solid2 = Solid.BySweep(perimetrcurve,line2)
	sol = Solid.ByUnion([solid1,solid2])
	
	return sol


def solids_from_surfaces(surfaces, centrPs, depth):
	solids = []
	for i, surf in enumerate(surfaces):
		sol = solid_from_surface(surf, centrPs[i], depth[i])
		solids.Add(sol)
	return solids


# Разместите код под этой строкой

otv_hight = get_parameters_elements(otvs, "ADSK_Отверстие_Отметка от нуля")
otv_lenth = get_parameters_elements(otvs, "ADSK_Отверстие_Высота")
otv_width = get_parameters_elements(otvs, "ADSK_Отверстие_Ширина")

for i, otv in enumerate(otv_locs1):
	pO = Point.ByCoordinates(otv.X/304.8,otv.Y/304.8,otv.Z/304.8+float(otv_hight[i])/304.8+float(otv_lenth[i])/304.8/2)
	otv_locs.Add(pO)

for i,otv in enumerate(otvs):
	otv_rot.Add(math.degrees(otv.Location.Rotation) + otv_ccs_angle[i])
	



otv_surfaces= surfaces(otvs,otv_locs,otv_rot,otv_width,otv_lenth, delta,otv_depth)
solids=solids_from_surfaces(otv_surfaces, otv_locs, otv_depth)
OUT.Add(solids)




#OUT.Add(otv_surfaces)

# Назначьте вывод переменной OUT.
# ----------------------------------------

# group: Получили все трубопроводы(исключены короткие участки
watch_9 = Watch(watch_7)

# group: Вектор пересечения трубопровода и отверстия
intersectsSolid_2 = Revit.Element.IntersectsSolid(solids=python_script_23, elements=watch_9)
getLocation_4 = Element.GetLocation(element=intersectsSolid_2.Element)
solidIntersection_2 = Curve.SolidIntersection(solid=python_script_22, curves=getLocation_4)

flatten_7 = List.Flatten(list=solidIntersection_2.Curve)
round_5 = CodeBlock(x=code_block_17.out0) { x; }
грань_труба_3 = CodeBlock(x=code_block_17.out1) { x; }
flatten_8 = List.Flatten(list=intersectsSolid_2.Element)
code_block_35 = CodeBlock(x=code_block_28) { x; }
python_script_24 = Python(IN[0]=solidIntersection_2.Curve, IN[1]=join_3)  # same code as python_script_15

# group: выбор стен по отверстиям
element_host_4 = Custom[Element Host](element=python_script_24)
id_4 = Element.Id(element=element_host_4)
python_script_25 = Python(IN[0]=code_block_35, IN[1]=id_4)  # unwired: IN[2]; same code as python_script_16

# group: вычисляем угол поворота кубика
location_5 = Revit.LinkElement.Location(linkElement=python_script_25@L1)
direction_4 = Line.Direction(line=location_5)
XAxis_5 = Vector.XAxis()
ZAxis_5 = Vector.ZAxis()
angleAboutAxis_5 = Vector.AngleAboutAxis(vector=XAxis_5, otherVector=direction_4, rotationAxis=ZAxis_5)

# group: получаем толщину стен
python_script_26 = Python(IN[0]=python_script_25)  # same code as python_script_17
code_block_36 = CodeBlock(x=python_script_26) { Math.Round(x+60); }

python_script_27 = Python(IN[0]=code_block_36)  # same code as python_script_18
round_6 = Math.Round(number=angleAboutAxis_5)
python_script_28 = Python(IN[0]=round_6)  # same code as python_script_19

# group: Выбор всех заданий стены
наименование_типа_семейства = CodeBlock { "(Отв_Задание)_Стены_Прямоугольное"; }
byName = FamilyType.ByName(name=наименование_типа_семейства)
all_elements_of_family_type = ElementsOfFamilyType(Family_Type=byName)

python_script_29 = Python(IN[0]=all_elements_of_family_type)
# ---------- python_script_29.python (19 lines) ----------
import clr
clr.AddReference('RevitAPI')
from Autodesk.Revit.DB import *

def GetSuperComponent(item):
	if hasattr(item, "SuperComponent"): 
		sc = item.SuperComponent
		if sc: return item
		else: return BeamSystem.BeamBelongsTo(item)
	if hasattr(item, "HostRailingId"): return item
	elif hasattr(item, "GetStairs"): return item
	else: return ""

items = UnwrapElement(IN[0])

if isinstance(IN[0], list): OUT = [GetSuperComponent(x) for x in items]
else: OUT = GetSuperComponent(items)

OUT = filter(None, OUT)
# ----------------------------------------
code_block_37 = CodeBlock { "SD_Версия задания"; }
getParameterValueByName_5 = Element.GetParameterValueByName(element=python_script_29, parameterName=code_block_37)
python_script_30 = Python(IN[0]=python_script_29, IN[1]=getParameterValueByName_5)
# ---------- python_script_30.python (216 lines) ----------
# Загрузить стандартную библиотеку Python и библиотеку DesignScript
import sys
import clr
clr.AddReference('ProtoGeometry')
clr.AddReference('RevitAPI')
import Autodesk
from Autodesk.Revit.DB import *
from Autodesk.DesignScript.Geometry import *

clr.AddReference('RevitServices')
import RevitServices
from RevitServices.Persistence import DocumentManager
from RevitServices.Transactions import TransactionManager
import math
import re
doc = DocumentManager.Instance.CurrentDBDocument
# Введенные в этом узле данные сохраняется в виде списка в переменных IN.

otvs= IN[0]
otv_rot =[]
otv_loc = []



def angle(angles):
	 
	OUT = []
	list=[]
	OUT1 =[]
	# Разместите код под этой строкой
	for angle in angles:
		if 315<=angle<=360:
			angle-=315
		elif 270<=angle<315:
			angle-=270
		elif 225<=angle<=270:
			angle-=225
		elif 180<=angle<=225:
			angle-=180
			
		elif 135<=angle<=180:
			angle-=135
			
		elif 90<=angle<=135:
			angle-=90
		
		elif 45<=angle<=90:
			angle-=45
			
		elif 45<=angle<=0:
			angle-=0
		else:
			angle=angle
		list.Add(round(angle,2))
		
	for angle in list:
		if angle >= 22.5:
			if angle>=33.4:
				angle = 45-angle
			else:
				angle = angle-22.5		
		elif angle < 22.5:
			angle=angle
		OUT1.Add(angle)
		
	return OUT1


def split_string(source,separators):
    return re.split('[{0}]'.format(re.escape(separators)),source)




# созданные функции

def get_parameters_elements(otvs, strr):	
	out_list1=[]
	out_list=[]
	otv_lenth =[]
	for model in otvs:
		out_list.append(model.Name)
			
	elUnwrap = UnwrapElement(otvs)
	sum=0
	for i in elUnwrap:
		if out_list[sum] == -1:
			out_list1.append(-1)
			sum+=1
		else:
			sum+=1
			Db = i.GetParameters(strr)
			
			for i in Db:
				out_list1.append(i.AsValueString())
				
	for i in out_list1:
		x = round(int(i)/10)*10
		otv_lenth.Add(x)
	return otv_lenth

def get_parameters_elements5_round(otvs, strr):	
	out_list1=[]
	out_list=[]
	otv_lenth =[]
	for model in otvs:
		out_list.append(model.Name)
			
	elUnwrap = UnwrapElement(otvs)
	sum=0
	for i in elUnwrap:
		if out_list[sum] == -1:
			out_list1.append(-1)
			sum+=1
		else:
			sum+=1
			Db = i.GetParameters(strr)
			
			for i in Db:
				out_list1.append(i.AsValueString())
				
	for i in out_list1:
		x = round(int(i)/5)*5
		otv_lenth.Add(x)
	return otv_lenth



for i,otv in enumerate(UnwrapElement(otvs)):
	rot = math.degrees(otv.Location.Rotation)
	
	otv_rot.Add(rot)

for i,otv in enumerate(otvs):
	otv_loc.Add(otv.Location)

otv_rot=(otv_rot)

lenth = get_parameters_elements(otvs, "Ширина")
depth = get_parameters_elements5_round(otvs, "Глубина")
width = get_parameters_elements(otvs, "Высота")

OUT = []
str_list = []
pereneseno =[]
ver_list = []
for i, el in enumerate(otvs):
	strrr = str(int(round(float(otv_loc[i].X)/10)*10)) + '|' + str(int(round(float(otv_loc[i].Y)/10)*10)) + '|' + str(int(round(float(otv_loc[i].Z)/10)*10)) + '|' + str(int(lenth[i])) + '|' + str(int(width[i]))+ '|' + str(int(depth[i])) + '|' + str((otv_rot[i]))
	str_list.Add(strrr)


for i, sd in enumerate(IN[1]):
	split_list = split_string(sd,'|')
	new_str=''
	if len(sd) == 8:
		ver = split_list.pop(1)
		#for i in split_list:
			#x+=i
		#if x == str_list[i]:
			#pereneseno.Add(0)
		#else:
			#pereneseno.Add(1)
		newver = ver+str_list[i]
		
	if len(sd) == 9:
		ver = split_list.pop(0)
		
		x = ''
		#for i in split_list:
			#x+=i
		#if x == str_list[i]:
			#pereneseno.Add('Не перенесено')
		#else:
			#pereneseno.Add('Перенесено')			
		newver = ver+str_list[i]
		
	else:
		try:
			ver = split_list.pop(0)
			newver = ver+'|'+str_list[i]
		except:
		
			newver = 'V0|'+str_list[i]
		#pereneseno.Add('Не перенесено')
	ver_list.Add(newver)
	
	if str_list[i][:-4]	in sd or sd =='':
		pereneseno.Add('Не перенесено')
	else:
		pereneseno.Add('Перенесено')
		
		


cor_ver = []
for i,j in zip(IN[1],ver_list):
	if 'V' not in i:
		st = 'V0'
	else:
		st = ''
	i= split_string(i,'|')
	try:
		
		cor_ver.append(st+j+'|'+i[8])
	except:
		cor_ver.append(st+j)
	
cor_perenes = []

for i,j in zip(cor_ver,pereneseno):
	if 'V0' in i:
		cor_perenes.append('Не перенесено')
	else:
		cor_perenes.append(j)
	
OUT = [cor_ver, cor_perenes,str_list]	
# ----------------------------------------
code_block_38 = CodeBlock(x=python_script_30) { x[2]; }
code_block_39 = CodeBlock(x=code_block_38) { x; }

# group: Выбор всех заданий стены
наименование_типа_семейства_2 = CodeBlock { "(Отв_Задание)_Стены_Прямоугольное"; }
byName_2 = FamilyType.ByName(name=наименование_типа_семейства_2)
all_elements_of_family_type_2 = ElementsOfFamilyType(Family_Type=byName_2)

join_4 = List.Join(list0=all_elements_of_family_type_2)
code_block_40 = CodeBlock(elements=join_4) { elements; }
setDifference = List.SetDifference(list1=code_block_40, list2=python_script_29)
code_block_41 = CodeBlock { "SD_Версия задания"; }
getParameterValueByName_6 = Element.GetParameterValueByName(element=setDifference, parameterName=code_block_41)
categories_7 = Categories("OST_Levels")
all_elements_of_category_4 = ElementsOfCategory(Category=categories_7)
python_script_31 = Python(IN[0]=all_elements_of_category_4)
# ---------- python_script_31.python (23 lines) ----------
levels = IN[0]

elevation_list = []
OUT = []


for lvl in levels:
	elevation_list.append(lvl.Elevation)
	
sort_elevation_list = list(elevation_list)
sort_elevation_list.sort()

out_levels = []
index_list = []
for last_elevation, new_elevation,lvl in zip(elevation_list,sort_elevation_list,levels):
	index = elevation_list.index(new_elevation)
	index_list.append(index)


for i,indx in enumerate(index_list):
	elevation_list[i] = levels[indx]

OUT = elevation_list
# ----------------------------------------
bim_связанные_файлы = Watch(filterByBoolMask.out)

# group: получаем перекрытия из всех ссылок
categories_8 = Categories("OST_Floors")
ofCategory_4 = Revit.LinkElement.OfCategory(linkInstance=bim_связанные_файлы, Category=categories_8)
flatten_9 = List.Flatten(list=ofCategory_4)
element_5 = Revit.LinkElement.Element(linkElement=flatten_9)
elementType_3 = Custom[Element.ElementType+](element=element_5)
name_6 = Element.Name(element=elementType_3)
code_block_42 = CodeBlock(str=name_6) { str==null?"Вн_О":str; }
code_block_43 = CodeBlock(l=flatten_9, m=code_block_42) { DSCore.List.FilterByBoolMask(l,DSCore.String.Contains(m,"Вн_О")||DSCore.String.Contains(m,"Нр_О"))["out"]; }

# group: Исключение нулевых геометрий
solids_2 = Revit.LinkElement.Solids(linkElement=code_block_43)
isEmpty_5 = List.IsEmpty(list=solids_2@L2)
code_block_44 = CodeBlock(x=isEmpty_5) { !x; }
filterByBoolMask_8 = List.FilterByBoolMask(list=code_block_43, mask=code_block_44)
boundingBox_2 = Revit.LinkElement.BoundingBox(linkElement=filterByBoolMask_8.in)

# group: фильтруем по габаритам и находим пересечения
getElementsIntersect_2 = Revit.BoundingBox.GetElementsIntersect(boundingBox=boundingBox_2, elements=code_block_13)
isEmpty_6 = List.IsEmpty(list=getElementsIntersect_2@L2)
code_block_45 = CodeBlock(l=getElementsIntersect_2, m=isEmpty_6) { DSCore.List.FilterByBoolMask(l,m)["out"]; }
code_block_46 = CodeBlock(l=filterByBoolMask_8.in, m=isEmpty_6) { DSCore.List.FilterByBoolMask(l,m)["out"]; }
getLocation_5 = Element.GetLocation(element=code_block_45)

# group: фильтруем воздуховоды без пересечек
totalTransform_4 = Revit.LinkElement.TotalTransform(linkElement=code_block_46)
py_пересечение_функциями_ревита_2 = Python(IN[0]=code_block_46, IN[1]=getLocation_5, IN[2]=totalTransform_4)
# ---------- py_пересечение_функциями_ревита_2.python (62 lines) ----------
import clr
clr.AddReference("RevitAPI")
clr.AddReference("RevitAPIUI")

from Autodesk.Revit.DB import * 

# Import DocumentManager
clr.AddReference("RevitServices")
import RevitServices
from RevitServices.Persistence import DocumentManager
from RevitServices.Transactions import TransactionManager

clr.AddReference("RevitNodes")
import Revit
clr.ImportExtensions(Revit.Elements)
clr.ImportExtensions(Revit.GeometryConversion)

doc = DocumentManager.Instance.CurrentDBDocument
uiapp = DocumentManager.Instance.CurrentUIApplication
app = uiapp.Application

fs = UnwrapElement(IN[0])
op = Options()
op.View = doc.ActiveView

OUT=[]

lines = IN[1]
css = IN[2]

TEST=list()

for i, f in enumerate(fs):
	
	ge = [list(f.get_Geometry(op))[-1]]
	
	#TEST.append(ge)
	
	for g in ge:
		s = SolidUtils.CreateTransformed(g,css[i].ToTransform())
		group=[]
		for c in lines[i]:
			try:		
				res = s.IntersectWithCurve(c.ToRevitType(),SolidCurveIntersectionOptions())
				if res.SegmentCount>0:
					group.Add(res.GetCurveSegment(0).ToProtoType())
				else:
					group.Add(None)
			except:
				group.Add(None)
				pass
				
	OUT.Add(group)

#OUT.Add(ge)
#TransactionManager.Instance.EnsureInTransaction(doc)

	
	
	
	
#TransactionManager.Instance.TransactionTaskDone()
# ----------------------------------------
isNull_2 = Object.IsNull(obj=py_пересечение_функциями_ревита_2)
filterByBoolMask_9 = List.FilterByBoolMask(list=code_block_45, mask=isNull_2)
isEmpty_7 = List.IsEmpty(list=filterByBoolMask_9.out@L2)
filterByBoolMask_10 = List.FilterByBoolMask(list=filterByBoolMask_9.out, mask=isEmpty_7)
filterByBoolMask_11 = List.FilterByBoolMask(list=py_пересечение_функциями_ревита_2, mask=isNull_2)
isEmpty_8 = List.IsEmpty(list=filterByBoolMask_11.out@L2)
filterByBoolMask_12 = List.FilterByBoolMask(list=filterByBoolMask_11.out, mask=isEmpty_8)
filterByBoolMask_13 = List.FilterByBoolMask(list=code_block_46, mask=isEmpty_8)

# group: получаем список воздуховодов, их пересечений и перекрытий, их создавших
watch_10 = Watch(filterByBoolMask_11.out)
watch_11 = Watch(filterByBoolMask_9.out)
watch_12 = Watch(code_block_46)

# group: создаем кубики
code_block_47 = CodeBlock { 0.5; }
pointAtParameter_2 = Curve.PointAtParameter(curve=watch_10, param=code_block_47)

flatten_10 = List.Flatten(list=pointAtParameter_2)
round_7 = CodeBlock(x=code_block_17.out0) { x; }
грань_труба_4 = CodeBlock(x=code_block_17.out1) { x; }

# group: Получение габаритов трубопроводов и задание размеров задания
code_block_48 = CodeBlock { "Ширина"; "Высота"; "Диаметр"; }
getParameterValueByName_7 = Element.GetParameterValueByName(element=watch_11, parameterName=code_block_48.out2)
getParameterValueByName_8 = Element.GetParameterValueByName(element=watch_11, parameterName=code_block_48.out0)
code_block_49 = CodeBlock(delta=грань_труба_4, d=getParameterValueByName_7, x=getParameterValueByName_8) { delta; Math.Round(d!=""?d:x)+delta; }
полная_высота_2 = CodeBlock(round=round_7, x=code_block_49.out1) { round; Math.Ceiling(x/round)*round; }
getParameterValueByName_9 = Element.GetParameterValueByName(element=watch_11, parameterName=code_block_48.out1)
code_block_50 = CodeBlock(delta=грань_труба_4, d=getParameterValueByName_7, x=getParameterValueByName_9) { delta; Math.Round(d!=""?d:x)+delta; }
полная_высота_3 = CodeBlock(round=round_7, x=code_block_50.out1) { round; Math.Ceiling(x/round)*round; }

code_block_51 = CodeBlock { -2; }
flatten_11 = List.Flatten(list=полная_высота_2.out1, amt=code_block_51)

# group: получаем толщину перекрытий
python_script_32 = Python(IN[0]=watch_12)
# ---------- python_script_32.python (12 lines) ----------
import clr
clr.AddReference("RevitAPI")
from Autodesk.Revit.DB import Floor, Element

floors = UnwrapElement(IN[0])
OUT = []

for f in floors:
	if f.GetType() == Floor:
		OUT.Add(f.FloorType)
	else:
		OUT.Add(f.Symbol)
# ----------------------------------------
code_block_52 = CodeBlock { "Толщина"; }
getParameterValueByName_10 = Element.GetParameterValueByName(element=python_script_32, parameterName=code_block_52)
code_block_53 = CodeBlock(x=getParameterValueByName_10) { Math.Round(x+60); }

flatten_12 = List.Flatten(list=полная_высота_3.out1)

# group: узнаем угол поворота
XAxis_6 = Vector.XAxis()
python_script_33 = Python(IN[0]=watch_11)
# ---------- python_script_33.python (32 lines) ----------
import clr
clr.AddReference("RevitAPI")
clr.AddReference("RevitAPIUI")

from Autodesk.Revit.DB import * 

# Import DocumentManager
clr.AddReference("RevitServices")
import RevitServices
from RevitServices.Persistence import DocumentManager
from RevitServices.Transactions import TransactionManager

clr.AddReference("RevitNodes")
import Revit
clr.ImportExtensions(Revit.Elements)
clr.ImportExtensions(Revit.GeometryConversion)

doc = DocumentManager.Instance.CurrentDBDocument
uiapp = DocumentManager.Instance.CurrentUIApplication
app = uiapp.Application

ducts = UnwrapElement(IN[0])

OUT = []

for dg in ducts:
	og=[]
	for d in dg:
		for c in d.ConnectorManager.Connectors:
			og.Add(c.CoordinateSystem.BasisX.ToVector())
			break
	OUT.Add(og)
# ----------------------------------------
ZAxis_6 = Vector.ZAxis()
angleAboutAxis_6 = Vector.AngleAboutAxis(vector=XAxis_6, otherVector=python_script_33, rotationAxis=ZAxis_6)

code_block_54 = CodeBlock(x=angleAboutAxis_6)
# ---------- code_block_54.designscript (13 lines) ----------
(x>=-360)&&(x<-180)
	?
	x+360:
	(x>=-180)&&(x<0)
		?
		x+180:
			(x>=0)&&(x<180)
			?
			x:
				(x>=180)&&(x<360)
				?
				x-180:
				x-360;
# ----------------------------------------
code_block_55 = CodeBlock(x=code_block_54) { x; y=-x; }
flatten_13 = List.Flatten(list=code_block_55.x)

# group: Создание строки описывающей отверстия
точность_выставления_задания_по_2 = CodeBlock { 10; }  # "Точность выставления задания по координатам, мм"
разделитель_2 = CodeBlock { "|"; ",000000"; ""; }
count_2 = List.Count(list=полная_высота_2.out1@L2)
ofRepeatedItem_3 = List.OfRepeatedItem(item=code_block_53@L1, amount=count_2@L1)

flatten_14 = List.Flatten(list=ofRepeatedItem_3)

# group (continued): Создание строки описывающей отверстия
code_block_56 = CodeBlock(tochnoct=точность_выставления_задания_по_2, razdelitel=разделитель_2.out0, x=flatten_10, Shirina=flatten_11, Visota=flatten_14, Glubina=flatten_12, Ygol=flatten_13)  # same code as code_block_24
flatten_15 = List.Flatten(list=code_block_56.out2)
replace_2 = String.Replace(str=flatten_15, searchFor=разделитель_2.out1, replaceWith=разделитель_2.out2)

python_script_34 = Python(IN[0]=replace_2)  # same code as python_script_10

# group: Получение существующих отверстий
categories_9 = Categories("OST_GenericModel")
ofCategory_5 = Revit.LinkElement.OfCategory(linkInstance=bim_связанные_файлы, Category=categories_9)
flatten_16 = List.Flatten(list=ofCategory_5)
element_6 = Revit.LinkElement.Element(linkElement=flatten_16)
getFamily_4 = FamilyInstance.GetFamily(familyInstance=element_6)
name_7 = Element.Name(element=getFamily_4)
code_block_57 = CodeBlock(l=flatten_16, n=name_7) { DSCore.List.FilterByBoolMask(l,n=="(Отверстие) Перекрытие")["in"]; }

bim_отверстия_в_перекрытиях = Watch(code_block_57)
location_6 = Revit.LinkElement.Location(linkElement=bim_отверстия_в_перекрытиях)

# group: Получение угла поворота системы кординат элемента
XAxis_7 = Vector.XAxis()
totalTransform_5 = Revit.LinkElement.TotalTransform(linkElement=bim_отверстия_в_перекрытиях)
code_block_58 = CodeBlock(x=totalTransform_5) { x.XAxis; }
ZAxis_7 = Vector.ZAxis()
angleAboutAxis_7 = Vector.AngleAboutAxis(vector=XAxis_7, otherVector=code_block_58, rotationAxis=ZAxis_7)

code_block_59 = CodeBlock(x=flatten_9) { x; }

# group: Solid перекрытия
element_host_5 = Custom[Element Host](element=bim_отверстия_в_перекрытиях)
id_5 = Element.Id(element=element_host_5)
python_script_35 = Python(IN[0]=code_block_59, IN[1]=id_5)
# ---------- python_script_35.python (39 lines) ----------
import clr
clr.AddReference("RevitAPI")
clr.AddReference("RevitAPIUI")

from Autodesk.Revit.DB import * 

# Import DocumentManager
clr.AddReference("RevitServices")
import RevitServices
from RevitServices.Persistence import DocumentManager
from RevitServices.Transactions import TransactionManager

clr.AddReference("RevitNodes")
import Revit
clr.ImportExtensions(Revit.Elements)
clr.ImportExtensions(Revit.GeometryConversion)
# Введенные в этом узле данные сохраняется в виде списка в переменных IN.
link_walls = IN[0]
walls = UnwrapElement(IN[0])
idwalls =IN[1]

allid= []
OUT =[]
for wall in walls:
	allid.Add(str(wall.Id))
	
# Разместите код под этой строкой
for wallId in idwalls:
	wallId = str(wallId)
	
	try:
		elementId = allid.index(wallId)
		OUT.Add(link_walls[elementId])
	except:
		OUT.Add(link_walls[allid.index(str(idwalls[0]))])


			
# Назначьте вывод переменной OUT.
# ----------------------------------------

# group: получаем толщину перекрытий
python_script_36 = Python(IN[0]=python_script_35)  # same code as python_script_32
code_block_60 = CodeBlock { "Толщина"; }
getParameterValueByName_11 = Element.GetParameterValueByName(element=python_script_36, parameterName=code_block_60)

python_script_37 = Python(IN[0]=bim_отверстия_в_перекрытиях, IN[1]=location_6, IN[2]=angleAboutAxis_7, IN[3]=getParameterValueByName_11)
# ---------- python_script_37.python (190 lines) ----------
# Загрузить стандартную библиотеку Python и библиотеку DesignScript
import sys
import clr
clr.AddReference('ProtoGeometry')
clr.AddReference('RevitAPI')
import Autodesk
from Autodesk.Revit.DB import *
from Autodesk.DesignScript.Geometry import *

clr.AddReference('RevitServices')
import RevitServices
from RevitServices.Persistence import DocumentManager
from RevitServices.Transactions import TransactionManager
import math
doc = DocumentManager.Instance.CurrentDBDocument
# Введенные в этом узле данные сохраняется в виде списка в переменных IN.

otvs= UnwrapElement(IN[0])
otv_locs1 = IN[1]
delta = 1000
z_zapas = 100
otv_ccs_angle = IN[2]
otv_depth = IN[3]

otv_locs = []
otv_rot =[]
otv_width =[]
otv_lenth =[]
otv_depth = map(lambda x: x + z_zapas, otv_depth)

OUT=[]


for otv in otv_locs1:
	pO = Point.ByCoordinates(otv.X/304.8,otv.Y/304.8,otv.Z/304.8+(z_zapas/304.8)/2)
	otv_locs.Add(pO)



# созданные функции

def get_parameters_elements(otvs, strr):	
	out_list1=[]
	out_list=[]
	otv_lenth =[]
	for model in otvs:
		out_list.append(model.Name)
			
	elUnwrap = UnwrapElement(otvs)
	sum=0
	for i in elUnwrap:
		if out_list[sum] == -1:
			out_list1.append(-1)
			sum+=1
		else:
			sum+=1
			Db = i.GetParameters(strr)
			
			for i in Db:
				out_list1.append(i.AsValueString())
				
	for i in out_list1:
		otv_lenth.Add(i)
	return otv_lenth


def surfase(pO, angle, width, len, delta,Ez, el):
	OE = float(width)/2 
	OF = float(len)/2 
	point_list = []
	
	Ex = pO.X * 304.8 + (OE+delta)*math.cos(math.radians(float(angle))) 
	Ey = pO.Y * 304.8 + (OE+delta)*math.sin(math.radians(float(angle)))
	
	
	
	Tx = pO.X * 304.8 + (OF+delta)*math.sin(math.radians(float(angle)))
	Ty = pO.Y * 304.8 - (OF+delta)*math.cos(math.radians(float(angle)))
	
	Fx = pO.X * 304.8 - (OF+delta)*math.sin(math.radians(float(angle)))
	Fy = pO.Y * 304.8 + (OF+delta)*math.cos(math.radians(float(angle)))
	
	Gx = pO.X * 304.8 - (OE+delta)*math.cos(math.radians(float(angle)))
	Gy = pO.Y * 304.8 - (OE+delta)*math.sin(math.radians(float(angle)))
	
	
	
	Cx = round(Ex + (OF+delta)*math.sin(math.radians(float(angle))),3)
	Cy = round(Ey - (OF+delta)*math.cos(math.radians(float(angle))),3)
	
	Bx = round(Fx + (OE+delta)*math.cos(math.radians(float(angle))),3)
	By = round(Fy + (OE+delta)*math.sin(math.radians(float(angle))),3)
	
	Ax = round(Fx - (OE+delta)*math.cos(math.radians(float(angle))),3)
	Ay = round(Fy - (OE+delta)*math.sin(math.radians(float(angle))),3)
	
	Dx = round(Tx - (OE+delta)*math.cos(math.radians(float(angle))),3)
	Dy = round(Ty - (OE+delta)*math.sin(math.radians(float(angle))),3)
	
	
	point_list.append(Point.ByCoordinates(Ax,Ay,Ez))
	point_list.append(Point.ByCoordinates(Bx,By,Ez))
	point_list.append(Point.ByCoordinates(Cx,Cy,Ez))
	point_list.append(Point.ByCoordinates(Dx,Dy,Ez))
	surface = Surface.ByPerimeterPoints(point_list)
	
	return surface
	
def surfaces(elements, locs_list, rot_list, width_list, lenth_list, delta, tz_depth):
	test =[]
	sufraces_list = []
	for i, el in enumerate(elements):
		test.Add(i)
		pO = locs_list[i]
		angle = rot_list[i]
		width = width_list[i]
		len = lenth_list[i]
		if el.Name == "(Отв_Задание)_Перекрытия_Прямоугольное":
			depth = float(tz_depth[i])
			Ez = pO.Z * 304.8 + depth/2
			
		else:
			depth = 0
			Ez = pO.Z * 304.8
		sufraces_list.Add(surfase(pO, angle, width, len, delta,Ez,el))
	return sufraces_list

def solid_from_surface(surface, centrP, depth):
	delta = depth
	centrP = Point.ByCoordinates(centrP.X*304.8,centrP.Y*304.8,centrP.Z*304.8)
	norkvector = Surface.NormalAtParameter(surface)
	norkvector = Vector.ByCoordinates(norkvector.X*delta, norkvector.Y*delta, norkvector.Z*delta)
	StartPoint = Point.Add(centrP,norkvector)
	EndPoint = Point.Subtract(centrP,norkvector)
	
	line = Line.ByStartPointEndPoint(StartPoint,EndPoint)
	line1 = Line.ByStartPointEndPoint(centrP,EndPoint)
	line2 = Line.ByStartPointEndPoint(centrP,StartPoint)
	StartSurface = Surface.Offset(surface, depth)
	
	
	
	perimetrlines = Surface.PerimeterCurves(surface)
	perimetrcurve = Curve.Join(perimetrlines[0],perimetrlines[1:])
	solid1 = Solid.BySweep(perimetrcurve,line1)
	solid2 = Solid.BySweep(perimetrcurve,line2)
	sol = Solid.ByUnion([solid1,solid2])
	
	return solid2


def solids_from_surfaces(surfaces, centrPs, depth):
	solids = []
	for i, surf in enumerate(surfaces):
		sol = solid_from_surface(surf, centrPs[i], depth[i])
		solids.Add(sol)
	return solids


# Разместите код под этой строкой

for i,otv in enumerate(otvs):
	otv_rot.Add(math.degrees(otv.Location.Rotation) + otv_ccs_angle[i])
	otv_depth.Add(10)

otv_lenth = get_parameters_elements(otvs, ":H отверстия")
otv_width = get_parameters_elements(otvs, ":B отверстия")













otv_surfaces= surfaces(otvs,otv_locs,otv_rot,otv_width,otv_lenth, delta,otv_depth)
solids=solids_from_surfaces(otv_surfaces, otv_locs, otv_depth)
OUT.Add(solids)




#OUT.Add(otv_surfaces)

# Назначьте вывод переменной OUT.
# ----------------------------------------

# group: Solid отверстия
python_script_38 = Python(IN[0]=bim_отверстия_в_перекрытиях, IN[1]=location_6, IN[2]=angleAboutAxis_7, IN[3]=getParameterValueByName_11)
# ---------- python_script_38.python (189 lines) ----------
# Загрузить стандартную библиотеку Python и библиотеку DesignScript
import sys
import clr
clr.AddReference('ProtoGeometry')
clr.AddReference('RevitAPI')
import Autodesk
from Autodesk.Revit.DB import *
from Autodesk.DesignScript.Geometry import *

clr.AddReference('RevitServices')
import RevitServices
from RevitServices.Persistence import DocumentManager
from RevitServices.Transactions import TransactionManager
import math
doc = DocumentManager.Instance.CurrentDBDocument
# Введенные в этом узле данные сохраняется в виде списка в переменных IN.

otvs= UnwrapElement(IN[0])
otv_locs1 = IN[1]
delta = 0
otv_ccs_angle = IN[2]
otv_depth = IN[3]

otv_locs = []
otv_rot =[]
otv_width =[]
otv_lenth =[]


OUT=[]


for otv in otv_locs1:
	pO = Point.ByCoordinates(otv.X/304.8,otv.Y/304.8,otv.Z/304.8)
	otv_locs.Add(pO)



# созданные функции

def get_parameters_elements(otvs, strr):	
	out_list1=[]
	out_list=[]
	otv_lenth =[]
	for model in otvs:
		out_list.append(model.Name)
			
	elUnwrap = UnwrapElement(otvs)
	sum=0
	for i in elUnwrap:
		if out_list[sum] == -1:
			out_list1.append(-1)
			sum+=1
		else:
			sum+=1
			Db = i.GetParameters(strr)
			
			for i in Db:
				out_list1.append(i.AsValueString())
				
	for i in out_list1:
		otv_lenth.Add(i)
	return otv_lenth


def surfase(pO, angle, width, len, delta,Ez, el):
	OE = float(width)/2 
	OF = float(len)/2 
	point_list = []
	
	Ex = pO.X * 304.8 + (OE+delta)*math.cos(math.radians(float(angle))) 
	Ey = pO.Y * 304.8 + (OE+delta)*math.sin(math.radians(float(angle)))
	
	
	
	Tx = pO.X * 304.8 + (OF+delta)*math.sin(math.radians(float(angle)))
	Ty = pO.Y * 304.8 - (OF+delta)*math.cos(math.radians(float(angle)))
	
	Fx = pO.X * 304.8 - (OF+delta)*math.sin(math.radians(float(angle)))
	Fy = pO.Y * 304.8 + (OF+delta)*math.cos(math.radians(float(angle)))
	
	Gx = pO.X * 304.8 - (OE+delta)*math.cos(math.radians(float(angle)))
	Gy = pO.Y * 304.8 - (OE+delta)*math.sin(math.radians(float(angle)))
	
	
	
	Cx = round(Ex + (OF+delta)*math.sin(math.radians(float(angle))),3)
	Cy = round(Ey - (OF+delta)*math.cos(math.radians(float(angle))),3)
	
	Bx = round(Fx + (OE+delta)*math.cos(math.radians(float(angle))),3)
	By = round(Fy + (OE+delta)*math.sin(math.radians(float(angle))),3)
	
	Ax = round(Fx - (OE+delta)*math.cos(math.radians(float(angle))),3)
	Ay = round(Fy - (OE+delta)*math.sin(math.radians(float(angle))),3)
	
	Dx = round(Tx - (OE+delta)*math.cos(math.radians(float(angle))),3)
	Dy = round(Ty - (OE+delta)*math.sin(math.radians(float(angle))),3)
	
	
	point_list.append(Point.ByCoordinates(Ax,Ay,Ez))
	point_list.append(Point.ByCoordinates(Bx,By,Ez))
	point_list.append(Point.ByCoordinates(Cx,Cy,Ez))
	point_list.append(Point.ByCoordinates(Dx,Dy,Ez))
	surface = Surface.ByPerimeterPoints(point_list)
	
	return surface
	
def surfaces(elements, locs_list, rot_list, width_list, lenth_list, delta, tz_depth):
	test =[]
	sufraces_list = []
	for i, el in enumerate(elements):
		test.Add(i)
		pO = locs_list[i]
		angle = rot_list[i]
		width = width_list[i]
		len = lenth_list[i]
		if el.Name == "(Отв_Задание)_Перекрытия_Прямоугольное":
			depth = float(tz_depth[i])
			Ez = pO.Z * 304.8 + depth/2
			
		else:
			depth = 0
			Ez = pO.Z * 304.8
		sufraces_list.Add(surfase(pO, angle, width, len, delta,Ez,el))
	return sufraces_list

def solid_from_surface(surface, centrP, depth):
	delta = depth
	centrP = Point.ByCoordinates(centrP.X*304.8,centrP.Y*304.8,centrP.Z*304.8)
	norkvector = Surface.NormalAtParameter(surface)
	norkvector = Vector.ByCoordinates(norkvector.X*delta, norkvector.Y*delta, norkvector.Z*delta)
	StartPoint = Point.Add(centrP,norkvector)
	EndPoint = Point.Subtract(centrP,norkvector)
	
	line = Line.ByStartPointEndPoint(StartPoint,EndPoint)
	line1 = Line.ByStartPointEndPoint(centrP,EndPoint)
	line2 = Line.ByStartPointEndPoint(centrP,StartPoint)
	StartSurface = Surface.Offset(surface, depth)
	
	
	
	perimetrlines = Surface.PerimeterCurves(surface)
	perimetrcurve = Curve.Join(perimetrlines[0],perimetrlines[1:])
	solid1 = Solid.BySweep(perimetrcurve,line1)
	solid2 = Solid.BySweep(perimetrcurve,line2)
	sol = Solid.ByUnion([solid1,solid2])
	
	return solid2


def solids_from_surfaces(surfaces, centrPs, depth):
	solids = []
	for i, surf in enumerate(surfaces):
		sol = solid_from_surface(surf, centrPs[i], depth[i])
		solids.Add(sol)
	return solids


# Разместите код под этой строкой

for i,otv in enumerate(otvs):
	otv_rot.Add(math.degrees(otv.Location.Rotation) + otv_ccs_angle[i])
	otv_depth.Add(10)

otv_lenth = get_parameters_elements(otvs, ":H отверстия")
otv_width = get_parameters_elements(otvs, ":B отверстия")













otv_surfaces= surfaces(otvs,otv_locs,otv_rot,otv_width,otv_lenth, delta,otv_depth)
solids=solids_from_surfaces(otv_surfaces, otv_locs, otv_depth)
OUT.Add(solids)




#OUT.Add(otv_surfaces)

# Назначьте вывод переменной OUT.
# ----------------------------------------

# group: Получили все трубопроводы(исключены короткие участки
watch_13 = Watch(code_block_13)

# group: Вектор пересечения трубопровода и отверстия
intersectsSolid_3 = Revit.Element.IntersectsSolid(solids=python_script_38, elements=watch_13)
getLocation_6 = Element.GetLocation(element=intersectsSolid_3.Element)
solidIntersection_3 = Curve.SolidIntersection(solid=python_script_37, curves=getLocation_6)

round_8 = CodeBlock(x=code_block_17.out0) { x; }
грань_труба_5 = CodeBlock(x=code_block_17.out1) { x; }
watch_14 = Watch(code_block_59)

# group: Фильтр пересечений
isNull_3 = Object.IsNull(obj=solidIntersection_3.Curve)
filterByBoolMask_14 = List.FilterByBoolMask(list=solidIntersection_3.Curve, mask=isNull_3)
isEmpty_9 = List.IsEmpty(list=filterByBoolMask_14.out@L2)
filterByBoolMask_15 = List.FilterByBoolMask(list=bim_отверстия_в_перекрытиях, mask=isEmpty_9)

# group: получаем список воздуховодов, их пересечений и отверстий по которым они пересекаются
flatten_17 = List.Flatten(list=solidIntersection_3.Curve)
flatten_18 = List.Flatten(list=intersectsSolid_3.Element)
watch_15 = Watch(filterByBoolMask_15.out)

python_script_39 = Python(IN[0]=flatten_17)  # same code as python_script_19

# group: Получаем точку центра кубика
code_block_61 = CodeBlock { 0.5; }
pointAtParameter_3 = Curve.PointAtParameter(curve=python_script_39, param=code_block_61)

python_script_40 = Python(IN[0]=flatten_18)  # same code as python_script_19

# group: получаем габариты воздуховодов
code_block_62 = CodeBlock { "Ширина"; "Высота"; "Диаметр"; }
getParameterValueByName_12 = Element.GetParameterValueByName(element=python_script_40, parameterName=code_block_62.out2)
getParameterValueByName_13 = Element.GetParameterValueByName(element=python_script_40, parameterName=code_block_62.out0)
code_block_63 = CodeBlock(delta=грань_труба_5, d=getParameterValueByName_12, x=getParameterValueByName_13) { delta; Math.Round(d!=""?d:x)+delta; }
полная_высота_4 = CodeBlock(round=round_8, x=code_block_63.out1) { round; Math.Ceiling(x/round)*round; }
getParameterValueByName_14 = Element.GetParameterValueByName(element=python_script_40, parameterName=code_block_62.out1)
code_block_64 = CodeBlock(delta=грань_труба_5, d=getParameterValueByName_12, x=getParameterValueByName_14) { delta; Math.Round(d!=""?d:x)+delta; }
полная_высота_5 = CodeBlock(round=round_8, x=code_block_64.out1) { round; Math.Ceiling(x/round)*round; }

# group: выбор стен по отверстиям
element_host_6 = Custom[Element Host](element=watch_15)
id_6 = Element.Id(element=element_host_6)
python_script_41 = Python(IN[0]=watch_14, IN[1]=id_6)  # unwired: IN[2]
# ---------- python_script_41.python (35 lines) ----------
import clr
clr.AddReference("RevitAPI")
clr.AddReference("RevitAPIUI")

from Autodesk.Revit.DB import * 

# Import DocumentManager
clr.AddReference("RevitServices")
import RevitServices
from RevitServices.Persistence import DocumentManager
from RevitServices.Transactions import TransactionManager

clr.AddReference("RevitNodes")
import Revit
clr.ImportExtensions(Revit.Elements)
clr.ImportExtensions(Revit.GeometryConversion)
# Введенные в этом узле данные сохраняется в виде списка в переменных IN.
link_walls = IN[0]
walls = UnwrapElement(IN[0])
idwalls =IN[1]
link_walls_angle = IN[2]
allid= []
OUT =[]
for wall in walls:
	allid.Add(str(wall.Id))
	
# Разместите код под этой строкой
for wallId in idwalls:
	wallId = str(wallId)
	elementId = allid.index(wallId)
	OUT.Add(link_walls[elementId])


			
# Назначьте вывод переменной OUT.
# ----------------------------------------

# group: получаем толщину перекрытий
python_script_42 = Python(IN[0]=python_script_41)  # same code as python_script_32
code_block_65 = CodeBlock { "Толщина"; }
getParameterValueByName_15 = Element.GetParameterValueByName(element=python_script_42, parameterName=code_block_65)
code_block_66 = CodeBlock(x=getParameterValueByName_15) { Math.Round(x+60); }

# group: узнаем угол поворота
XAxis_8 = Vector.XAxis()
python_script_43 = Python(IN[0]=python_script_40)  # same code as python_script_33
ZAxis_8 = Vector.ZAxis()
angleAboutAxis_8 = Vector.AngleAboutAxis(vector=XAxis_8, otherVector=python_script_43, rotationAxis=ZAxis_8)

code_block_67 = CodeBlock(x=angleAboutAxis_8)  # same code as code_block_54
code_block_68 = CodeBlock(x=code_block_67) { x; y=-x; }

# group: Создание строки описывающей отверстия
точность_выставления_задания_по_3 = CodeBlock { 10; }  # "Точность выставления задания по координатам, мм"
разделитель_3 = CodeBlock { "|"; ",000000"; ""; }
count_3 = List.Count(list=полная_высота_4.out1@L2)
ofRepeatedItem_4 = List.OfRepeatedItem(item=code_block_66@L1, amount=count_3@L1)
code_block_69 = CodeBlock(tochnoct=точность_выставления_задания_по_3, razdelitel=разделитель_3.out0, x=pointAtParameter_3, Shirina=полная_высота_4.out1, Visota=ofRepeatedItem_4, Glubina=полная_высота_5.out1, Ygol=code_block_68.x)  # same code as code_block_24
flatten_19 = List.Flatten(list=code_block_69.out2)
replace_3 = String.Replace(str=flatten_19, searchFor=разделитель_3.out1, replaceWith=разделитель_3.out2)

python_script_44 = Python(IN[0]=replace_3)  # same code as python_script_10

# group: Выбор всех заданий полы
наименование_типа_семейства_3 = CodeBlock { "(Отв_Задание)_Перекрытия_Прямоугольное"; }
byName_3 = FamilyType.ByName(name=наименование_типа_семейства_3)
all_elements_of_family_type_3 = ElementsOfFamilyType(Family_Type=byName_3)

python_script_45 = Python(IN[0]=all_elements_of_family_type_3)  # same code as python_script_29
code_block_70 = CodeBlock { "SD_Версия задания"; }
getParameterValueByName_16 = Element.GetParameterValueByName(element=python_script_45, parameterName=code_block_70)
python_script_46 = Python(IN[0]=python_script_45, IN[1]=getParameterValueByName_16)
# ---------- python_script_46.python (216 lines) ----------
# Загрузить стандартную библиотеку Python и библиотеку DesignScript
import sys
import clr
clr.AddReference('ProtoGeometry')
clr.AddReference('RevitAPI')
import Autodesk
from Autodesk.Revit.DB import *
from Autodesk.DesignScript.Geometry import *

clr.AddReference('RevitServices')
import RevitServices
from RevitServices.Persistence import DocumentManager
from RevitServices.Transactions import TransactionManager
import math
import re
doc = DocumentManager.Instance.CurrentDBDocument
# Введенные в этом узле данные сохраняется в виде списка в переменных IN.

otvs= IN[0]
otv_rot =[]
otv_loc = []



def angle(angles):
	 
	OUT = []
	list=[]
	OUT1 =[]
	# Разместите код под этой строкой
	for angle in angles:
		if 315<=angle<=360:
			angle-=315
		elif 270<=angle<315:
			angle-=270
		elif 225<=angle<=270:
			angle-=225
		elif 180<=angle<=225:
			angle-=180
			
		elif 135<=angle<=180:
			angle-=135
			
		elif 90<=angle<=135:
			angle-=90
		
		elif 45<=angle<=90:
			angle-=45
			
		elif 45<=angle<=0:
			angle-=0
		else:
			angle=angle
		list.Add(round(angle,2))
		
	for angle in list:
		if angle >= 22.5:
			if angle>=33.4:
				angle = 45-angle
			else:
				angle = angle-22.5		
		elif angle < 22.5:
			angle=angle
		OUT1.Add(angle)
		
	return OUT1


def split_string(source,separators):
    return re.split('[{0}]'.format(re.escape(separators)),source)




# созданные функции

def get_parameters_elements(otvs, strr):	
	out_list1=[]
	out_list=[]
	otv_lenth =[]
	for model in otvs:
		out_list.append(model.Name)
			
	elUnwrap = UnwrapElement(otvs)
	sum=0
	for i in elUnwrap:
		if out_list[sum] == -1:
			out_list1.append(-1)
			sum+=1
		else:
			sum+=1
			Db = i.GetParameters(strr)
			
			for i in Db:
				out_list1.append(i.AsValueString())
				
	for i in out_list1:
		x = round(int(i)/1)*1
		otv_lenth.Add(x)
	return otv_lenth

def get_parameters_elements5_round(otvs, strr):	
	out_list1=[]
	out_list=[]
	otv_lenth =[]
	for model in otvs:
		out_list.append(model.Name)
			
	elUnwrap = UnwrapElement(otvs)
	sum=0
	for i in elUnwrap:
		if out_list[sum] == -1:
			out_list1.append(-1)
			sum+=1
		else:
			sum+=1
			Db = i.GetParameters(strr)
			
			for i in Db:
				out_list1.append(i.AsValueString())
				
	for i in out_list1:
		x = round(int(i)/1)*1
		otv_lenth.Add(x)
	return otv_lenth



for i,otv in enumerate(UnwrapElement(otvs)):
	rot = math.degrees(otv.Location.Rotation)
	rot = round(rot/1)*1
	otv_rot.Add(rot)

for i,otv in enumerate(otvs):
	otv_loc.Add(otv.Location)

otv_rot=(otv_rot)

lenth = get_parameters_elements(otvs, "Ширина")
depth = get_parameters_elements5_round(otvs, "Глубина")
width = get_parameters_elements(otvs, "Высота")

OUT = []
str_list = []
pereneseno =[]
ver_list = []
for i, el in enumerate(otvs):
	strrr = str(int(round(float(otv_loc[i].X)/1)*1)) + '|' + str(int(round(float(otv_loc[i].Y)/1)*1)) + '|' + str(int(round(float(otv_loc[i].Z)/1)*1)) + '|' + str(int(lenth[i])) + '|' + str(int(width[i]))+ '|' + str(int(depth[i])) + '|' + str(int(otv_rot[i]))
	str_list.Add(strrr)


for i, sd in enumerate(IN[1]):
	split_list = split_string(sd,'|')
	new_str=''
	if len(sd) == 8:
		ver = split_list.pop(1)
		#for i in split_list:
			#x+=i
		#if x == str_list[i]:
			#pereneseno.Add(0)
		#else:
			#pereneseno.Add(1)
		newver = ver+str_list[i]
		
	if len(sd) == 9:
		ver = split_list.pop(0)
		
		x = ''
		#for i in split_list:
			#x+=i
		#if x == str_list[i]:
			#pereneseno.Add('Не перенесено')
		#else:
			#pereneseno.Add('Перенесено')			
		newver = ver+str_list[i]
		
	else:
		try:
			ver = split_list.pop(0)
			newver = ver+'|'+str_list[i]
		except:
		
			newver = 'V0|'+str_list[i]
		#pereneseno.Add('Не перенесено')
	ver_list.Add(newver)
	
	if str_list[i][:-4]	in sd or sd =='':
		pereneseno.Add('Не перенесено')
	else:
		pereneseno.Add('Перенесено')
		
		


cor_ver = []
for i,j in zip(IN[1],ver_list):
	if 'V' not in i:
		st = 'V0'
	else:
		st = ''
	i= split_string(i,'|')
	try:
		
		cor_ver.append(st+j+'|'+i[8])
	except:
		cor_ver.append(st+j)
	
cor_perenes = []

for i,j in zip(cor_ver,pereneseno):
	if 'V0' in i:
		cor_perenes.append('Не перенесено')
	else:
		cor_perenes.append(j)
	
OUT = [cor_ver, cor_perenes,str_list]	
# ----------------------------------------
code_block_71 = CodeBlock(x=python_script_46) { x[2]; }
python_script_47 = Python(IN[0]=code_block_71)  # same code as python_script_10
code_block_72 = CodeBlock(x=python_script_47) { x; }
join_5 = List.Join(list0=python_script_34, list1=python_script_44, list2=code_block_72)
uniqueItems = List.UniqueItems(list=join_5)

# group: Выбор всех заданий полы
наименование_типа_семейства_4 = CodeBlock { "(Отв_Задание)_Перекрытия_Прямоугольное"; }
byName_4 = FamilyType.ByName(name=наименование_типа_семейства_4)
all_elements_of_family_type_4 = ElementsOfFamilyType(Family_Type=byName_4)

join_6 = List.Join(list0=all_elements_of_family_type_4)
code_block_73 = CodeBlock(elements=join_6) { elements; }
setDifference_2 = List.SetDifference(list1=code_block_73, list2=python_script_45)
code_block_74 = CodeBlock { "SD_Версия задания"; }
getParameterValueByName_17 = Element.GetParameterValueByName(element=setDifference_2, parameterName=code_block_74)

# group: поиск новых заданий и заданий на удаление
python_script_48 = Python(IN[0]=uniqueItems)
# ---------- python_script_48.python (25 lines) ----------
import sys
import clr
clr.AddReference('ProtoGeometry')
from Autodesk.DesignScript.Geometry import *
import re

def split_string(source,separators):
    return re.split('[{0}]'.format(re.escape(separators)),source)

OUT = []


for i in IN[0]:
	try:
		split_list = split_string(i,'|')
		depth = split_list.pop(5)
		width = split_list.pop(4)
		lenth = split_list.pop(3)
		if float(depth)<=5 or float(width)<=5 or float(lenth)<=5:
			pass
		else:
			OUT.Add(i)
	except:
		pass
	
# ----------------------------------------
python_script_49 = Python(IN[0]=python_script_48)
# ---------- python_script_49.python (33 lines) ----------
import sys
import clr
clr.AddReference('ProtoGeometry')
from Autodesk.DesignScript.Geometry import *
import re

def split_string(source,separators):
    return re.split('[{0}]'.format(re.escape(separators)),source)
OUT = []
# Введенные в этом узле данные сохраняется в виде списка в переменных IN.

for i in IN[0]:
	
	split_list = split_string(i,'|')
	lenn = len(split_list)
	
	if lenn > 6:
		try:
			split_list.pop(8)
		except:
			pass
		split_list.pop(6)
		strr = ''
		for i in split_list:
			strr+=i+'|'
		strr = strr[:-1]
	else:
		strr = i
	OUT.Add(strr)
	
	
	
	
# ----------------------------------------
python_script_50 = Python(IN[0]=getParameterValueByName_17)
# ---------- python_script_50.python (33 lines) ----------
import sys
import clr
clr.AddReference('ProtoGeometry')
from Autodesk.DesignScript.Geometry import *
import re

def split_string(source,separators):
    return re.split('[{0}]'.format(re.escape(separators)),source)
OUT = []
# Введенные в этом узле данные сохраняется в виде списка в переменных IN.

for i in IN[0]:
	
	split_list = split_string(i,'|')
	lenn = len(split_list)
	
	if lenn > 6:
		try:
			split_list.pop(8)
		except:
			pass
		split_list.pop(0)
		strr = ''
		for i in split_list:
			strr+=i+'|'
		strr = strr[:-1]
	else:
		strr = i
	OUT.Add(strr)
	
	
	
	
# ----------------------------------------
python_script_51 = Python(IN[0]=python_script_50)  # same code as python_script_49
setDifference_3 = List.SetDifference(list1=python_script_49, list2=python_script_51)
python_script_52 = Python(IN[0]=setDifference_3, IN[1]=python_script_48)
# ---------- python_script_52.python (21 lines) ----------
import re

all_past = str(IN[0])
OUT =[]
def split_string(source,separators):
    return re.split('[{0}]'.format(re.escape(separators)),source)

list =  []
for el in IN[1]:
	list.append(el)
for el,out in zip(IN[1],list):
	el = split_string(el,'|')
	el.pop(-1)
	strrr = ''
	
	for i in el:
		strrr+=i+'|'
	strrr=strrr[:-1]	
		
	if strrr in all_past:
		OUT.append(out)
# ----------------------------------------
count_4 = List.Count(list=setDifference_3)
n1_2_создано_новых_заданий = Watch(count_4)  # "1.2 Создано новых заданий (перекрытия):"; graph output

# group: Создаем и настраиваем кубики
наименование_типа_семейства_5 = CodeBlock { "(Отв_Задание)_Перекрытия_Прямоугольное"; }
byName_5 = FamilyType.ByName(name=наименование_типа_семейства_5)
code_block_75 = CodeBlock(x=python_script_52) { x; }
code_block_76 = CodeBlock { "|"; }
split = String.Split(str=code_block_75, separator0=code_block_76)
code_block_77 = CodeBlock { 0; 1; 2; 3; 4; 5; 6; }
getItemAtIndex = List.GetItemAtIndex(list=split@@L2, index=code_block_77.out0)
toNumber = String.ToNumber(str=getItemAtIndex)
getItemAtIndex_2 = List.GetItemAtIndex(list=split@@L2, index=code_block_77.out1)
toNumber_2 = String.ToNumber(str=getItemAtIndex_2)
getItemAtIndex_3 = List.GetItemAtIndex(list=split@@L2, index=code_block_77.out2)
toNumber_3 = String.ToNumber(str=getItemAtIndex_3)
getItemAtIndex_4 = List.GetItemAtIndex(list=split@@L2, index=code_block_77.out5)
toNumber_4 = String.ToNumber(str=getItemAtIndex_4)
code_block_78 = CodeBlock { "Ширина"; }
getItemAtIndex_5 = List.GetItemAtIndex(list=split@@L2, index=code_block_77.out3)
toNumber_5 = String.ToNumber(str=getItemAtIndex_5)
code_block_79 = CodeBlock { "Высота"; }
getItemAtIndex_6 = List.GetItemAtIndex(list=split@@L2, index=code_block_77.out4)
toNumber_6 = String.ToNumber(str=getItemAtIndex_6)
code_block_80 = CodeBlock { "SD_Версия задания"; }
code_block_81 = CodeBlock(x=code_block_75) { "V0|"+x; }
code_block_82 = CodeBlock { "Глубина"; }
code_block_83 = CodeBlock { "SD_Способ создания задания"; "СКРИПТ"; "ВРУЧНУЮ"; }
code_block_84 = CodeBlock { "SD_Перенесено задание"; "Не перенесено"; }
code_block_85 = CodeBlock { "SD_Позиции задания"; }
python_script_53 = Python(IN[0]=code_block_75)
# ---------- python_script_53.python (3 lines) ----------
OUT = []
for i in IN[0]:
	OUT.append(i+';')
# ----------------------------------------
getItemAtIndex_7 = List.GetItemAtIndex(list=split@@L2, index=code_block_77.out6)

categories_10 = Categories("OST_Levels")
all_elements_of_category_5 = ElementsOfCategory(Category=categories_10)
python_script_54 = Python(IN[0]=all_elements_of_category_5)  # same code as python_script_31
python_script_55 = Python(IN[0]=python_script_54, IN[1]=toNumber_3, IN[2]=toNumber_4)
# ---------- python_script_55.python (32 lines) ----------
OUT = []
levels = IN[0]
levels_elem = []

def el_level(z, levels):
	
	if z>= levels[-1].Elevation:
		return levels[-1]
	elif z<= levels[0].Elevation:
		return levels[0]
	else:
		for i in range(len(levels)):
			if levels[i].Elevation <= z < levels[i+1].Elevation:
				return levels[i]

			
		



for Z,Zglub in zip(IN[1],IN[2]):
	z = Z+Zglub/2
	x = el_level(z,levels)
	levels_elem.append(x)


Z_elevation_elements = []

for Z, level_el in zip(IN[1],levels_elem):
	Z_elevation_elements.append(Z-level_el.Elevation)
	
OUT = [levels_elem,Z_elevation_elements]
# ----------------------------------------
code_block_86 = CodeBlock(x=python_script_55) { x[0]; x[1]; }

# group (continued): Создаем и настраиваем кубики
byCoordinates = Point.ByCoordinates(x=toNumber, y=toNumber_2, z=code_block_86.out1)

byPointAndLevel = FamilyInstance.ByPointAndLevel(familyType=byName_5, point=byCoordinates, level=code_block_86.out0)

# group (continued): Создаем и настраиваем кубики
setParameterByName = Element.SetParameterByName(element=byPointAndLevel, parameterName=code_block_78, value=toNumber_5)
setParameterByName_2 = Element.SetParameterByName(element=byPointAndLevel, parameterName=code_block_79, value=toNumber_6)
setParameterByName_3 = Element.SetParameterByName(element=byPointAndLevel, parameterName=code_block_80, value=code_block_81)
setParameterByName_4 = Element.SetParameterByName(element=byPointAndLevel, parameterName=code_block_82, value=toNumber_4)
setParameterByName_5 = Element.SetParameterByName(element=byPointAndLevel, parameterName=code_block_84.out0, value=code_block_84.out1)
setParameterByName_6 = Element.SetParameterByName(element=byPointAndLevel, parameterName=code_block_85, value=python_script_53)

code_block_87 = CodeBlock { ":Назначение отверстия"; ":Примечание"; }

# group: Выбор раздела текущего открытого файла в ревит
current = Document.Current()
filePath = Document.FilePath(document=current)
string_19 = StringInput("\")
split_2 = String.Split(str=filePath, separator0=string_19)
lastItem = List.LastItem(list=split_2)
code_block_88 = CodeBlock { ".rvt"; ""; }
replace_4 = String.Replace(str=lastItem, searchFor=code_block_88.out0, replaceWith=code_block_88.out1)
string_20 = StringInput("_")
split_3 = String.Split(str=replace_4, separator0=string_20)
code_block_89 = CodeBlock { 2; }
getItemAtIndex_8 = List.GetItemAtIndex(list=split_3, index=code_block_89)

code_block_90 = CodeBlock { "Комментарии"; "dd/MM/yyyy"; }
today = DateTime.Today()
format = DateTime.Format(dateTime=today, format=code_block_90.out1)

# group: Фильтр пересечений
isNull_4 = Object.IsNull(obj=solidIntersection_2.Curve)
filterByBoolMask_16 = List.FilterByBoolMask(list=solidIntersection_2.Curve, mask=isNull_4)
isEmpty_10 = List.IsEmpty(list=filterByBoolMask_16.out@L2)
filterByBoolMask_17 = List.FilterByBoolMask(list=join_3, mask=isEmpty_10)

# group: получаем список воздуховодов, их пересечений и отверстий по которым они пересекаются
python_script_56 = Python(IN[0]=flatten_7)  # same code as python_script_19
python_script_57 = Python(IN[0]=flatten_8)  # same code as python_script_19
watch_16 = Watch(filterByBoolMask_17.out)

# group: Получаем точку центра кубика
code_block_91 = CodeBlock { 0.5; }
pointAtParameter_4 = Curve.PointAtParameter(curve=python_script_56, param=code_block_91)

# group: получаем габариты воздуховодов
code_block_92 = CodeBlock { "Ширина"; "Высота"; "Диаметр"; }
getParameterValueByName_18 = Element.GetParameterValueByName(element=python_script_57, parameterName=code_block_92.out2)
getParameterValueByName_19 = Element.GetParameterValueByName(element=python_script_57, parameterName=code_block_92.out0)
code_block_93 = CodeBlock(d=getParameterValueByName_18, x=getParameterValueByName_19) { Math.Round(d!=""?d:x); }
getParameterValueByName_20 = Element.GetParameterValueByName(element=python_script_57, parameterName=code_block_92.out1)
code_block_94 = CodeBlock(delta=грань_труба_3, d=getParameterValueByName_18, x=getParameterValueByName_20) { delta; Math.Round(d!=""?d:x)+delta; }
полная_высота_6 = CodeBlock(round=round_5, x=code_block_94.out1) { round; Math.Ceiling(x/round)*round; }

direction_5 = Line.Direction(line=python_script_56)

# group: получаем минимальный угол между осями отверстия и перпендикуляром воздуховода
code_block_95 = CodeBlock(v=direction_4) { Vector.ByCoordinates(v.X,v.Y,0); }
code_block_96 = CodeBlock(v=direction_5) { Vector.ByCoordinates(v.X,v.Y,0); }
angleWithVector_2 = Vector.AngleWithVector(vector=code_block_95, otherVector=code_block_96)
острый_угол_между_стеной_и_3 = CodeBlock(a=angleWithVector_2) { ar=Math.Round(a,1); 90-(ar>90?180-ar:ar); }  # "острый угол между стеной и перпендикуляром возд."

python_script_58 = Python(IN[0]=angleWithVector_2)
# ---------- python_script_58.python (49 lines) ----------
# Загрузить стандартную библиотеку Python и библиотеку DesignScript
import sys
import clr
clr.AddReference('ProtoGeometry')
from Autodesk.DesignScript.Geometry import *

# Введенные в этом узле данные сохраняется в виде списка в переменных IN.
angles = IN[0][0]
OUT = []
list=[]
OUT1 =[]
# Разместите код под этой строкой
for angle in angles:
	if 315<=angle<=360:
		angle-=315
	elif 270<=angle<315:
		angle-=270
	elif 225<=angle<=270:
		angle-=225
	elif 180<=angle<=225:
		angle-=180
		
	elif 135<=angle<=180:
		angle-=135
		
	elif 90<=angle<=135:
		angle-=90
	
	elif 45<=angle<=90:
		angle-=45
		
	elif 45<=angle<=0:
		angle-=0
	else:
		angle=angle
	list.Add(round(angle,2))
	
for angle in list:
	if angle >= 22.5:
		if angle>=33.4:
			angle = 45-angle
		else:
			angle = angle-22.5		
	elif angle < 22.5:
		angle=angle
	OUT1.Add(angle)
	
OUT.Add(OUT1)		
# Назначьте вывод переменной OUT.
# ----------------------------------------

# group: решаем большой и малый треугольники и получаем полную ширину
большой_треугольник_2 = CodeBlock(w=code_block_93, A=python_script_58) { (w*0.5)/Math.Cos(A); }
малый_треугольник_2 = CodeBlock(b=python_script_26, A=python_script_58) { (b*0.5)*Math.Tan(A); }
полная_ширина_2 = CodeBlock(round=round_5, delta=грань_труба_3, bt=большой_треугольник_2, mt=малый_треугольник_2) { round; delta; x=(bt+mt)*2+delta; Math.Ceiling(x/round)*round; }

# group: Создание строки описывающей отверстия
точность_выставления_задания_по_4 = CodeBlock { 10; }  # "Точность выставления задания по координатам, мм"
разделитель_4 = CodeBlock { "|"; ",000000"; ""; }
code_block_97 = CodeBlock(tochnoct=точность_выставления_задания_по_4, razdelitel=разделитель_4.out0, x=pointAtParameter_4, Shirina=полная_ширина_2.out3, Visota=полная_высота_6.out1, Glubina=python_script_27, Ygol=python_script_28)  # same code as code_block_24
flatten_20 = List.Flatten(list=code_block_97.out2)
replace_5 = String.Replace(str=flatten_20, searchFor=разделитель_4.out1, replaceWith=разделитель_4.out2)

python_script_59 = Python(IN[0]=replace_5)  # same code as python_script_10
code_block_98 = CodeBlock { "SD_Способ создания задания"; }
code_block_99 = CodeBlock { "SD_Версия задания"; }
code_block_100 = CodeBlock { ":Примечание"; }
python_script_60 = Python(IN[0]=getParameterValueByName_6, IN[1]=setDifference)
# ---------- python_script_60.python (10 lines) ----------
# Загрузить стандартную библиотеку Python и библиотеку DesignScript
ver_list = IN[0]
OUT =[]
for i,ver in enumerate(ver_list):
	if "ВРУЧНУЮ" in ver or ver=='':
		pass
	else:
		x=IN[1][i]
		OUT.append(x)
		
# ----------------------------------------
code_block_101 = CodeBlock { "SD_Версия задания"; }

# group: Фильтр пересечений
isNull_5 = Object.IsNull(obj=solidIntersection.Curve)
filterByBoolMask_18 = List.FilterByBoolMask(list=solidIntersection.Curve, mask=isNull_5)
isEmpty_11 = List.IsEmpty(list=filterByBoolMask_18.out@L2)
filterByBoolMask_19 = List.FilterByBoolMask(list=watch_6, mask=isEmpty_11)

# group: получаем список воздуховодов, их пересечений и отверстий по которым они пересекаются
python_script_61 = Python(IN[0]=flatten_4)  # same code as python_script_19
python_script_62 = Python(IN[0]=flatten_5)  # same code as python_script_19
watch_17 = Watch(filterByBoolMask_19.out)

# group: Получаем точку центра кубика
code_block_102 = CodeBlock { 0.5; }
pointAtParameter_5 = Curve.PointAtParameter(curve=python_script_61, param=code_block_102)

# group: получаем габариты воздуховодов
code_block_103 = CodeBlock { "Ширина"; "Высота"; "Диаметр"; }
getParameterValueByName_21 = Element.GetParameterValueByName(element=python_script_62, parameterName=code_block_103.out2)
getParameterValueByName_22 = Element.GetParameterValueByName(element=python_script_62, parameterName=code_block_103.out0)
code_block_104 = CodeBlock(d=getParameterValueByName_21, x=getParameterValueByName_22) { Math.Round(d!=""?d:x); }
getParameterValueByName_23 = Element.GetParameterValueByName(element=python_script_62, parameterName=code_block_103.out1)
code_block_105 = CodeBlock(delta=грань_труба_2, d=getParameterValueByName_21, x=getParameterValueByName_23) { delta; Math.Round(d!=""?d:x)+delta; }
полная_высота_7 = CodeBlock(round=round_3, x=code_block_105.out1) { round; Math.Ceiling(x/round)*round; }

direction_6 = Line.Direction(line=python_script_61)

# group: получаем минимальный угол между осями отверстия и перпендикуляром воздуховода
code_block_106 = CodeBlock(v=direction_3) { Vector.ByCoordinates(v.X,v.Y,0); }
code_block_107 = CodeBlock(v=direction_6) { Vector.ByCoordinates(v.X,v.Y,0); }
angleWithVector_3 = Vector.AngleWithVector(vector=code_block_106, otherVector=code_block_107)
острый_угол_между_стеной_и_4 = CodeBlock(a=angleWithVector_3) { ar=Math.Round(a,1); 90-(ar>90?180-ar:ar); }  # "острый угол между стеной и перпендикуляром возд."

python_script_63 = Python(IN[0]=angleWithVector_3)  # same code as python_script_58

# group: решаем большой и малый треугольники и получаем полную ширину
большой_треугольник_3 = CodeBlock(w=code_block_104, A=python_script_63) { (w*0.5)/Math.Cos(A); }
малый_треугольник_3 = CodeBlock(b=python_script_17, A=python_script_63) { (b*0.5)*Math.Tan(A); }
полная_ширина_3 = CodeBlock(round=round_3, delta=грань_труба_2, bt=большой_треугольник_3, mt=малый_треугольник_3) { round; delta; x=(bt+mt)*2+delta; Math.Ceiling(x/round)*round; }

# group: Создание строки описывающей отверстия
точность_выставления_задания_по_5 = CodeBlock { 10; }  # "Точность выставления задания по координатам, мм"
разделитель_5 = CodeBlock { "|"; ",000000"; ""; }
code_block_108 = CodeBlock(tochnoct=точность_выставления_задания_по_5, razdelitel=разделитель_5.out0, x=pointAtParameter_5, Shirina=полная_ширина_3.out3, Visota=полная_высота_7.out1, Glubina=python_script_18, Ygol=python_script_19)  # same code as code_block_24
flatten_21 = List.Flatten(list=code_block_108.out2)
replace_6 = String.Replace(str=flatten_21, searchFor=разделитель_5.out1, replaceWith=разделитель_5.out2)

python_script_64 = Python(IN[0]=replace_6)  # same code as python_script_10
join_7 = List.Join(list0=python_script_10, list1=python_script_64, list2=python_script_59, list3=code_block_39)
uniqueItems_2 = List.UniqueItems(list=join_7)

# group: поиск новых заданий и заданий на удаление
python_script_65 = Python(IN[0]=uniqueItems_2)  # same code as python_script_48
python_script_66 = Python(IN[0]=python_script_65)  # same code as python_script_49
python_script_67 = Python(IN[0]=getParameterValueByName_6)  # same code as python_script_50
python_script_68 = Python(IN[0]=python_script_67)  # same code as python_script_49
setDifference_4 = List.SetDifference(list1=python_script_66, list2=python_script_68)
python_script_69 = Python(IN[0]=setDifference_4, IN[1]=python_script_65)  # same code as python_script_52
count_5 = List.Count(list=setDifference_4)
n1_1_создано_новых_заданий_стены = Watch(count_5)  # "1.1 Создано новых заданий (стены):"; graph output

# group: Создаем и настраиваем кубики
наименование_типа_семейства_6 = CodeBlock { "(Отв_Задание)_Стены_Прямоугольное"; }
byName_6 = FamilyType.ByName(name=наименование_типа_семейства_6)
code_block_109 = CodeBlock(x=python_script_69) { x; }
code_block_110 = CodeBlock { "|"; }
split_4 = String.Split(str=code_block_109, separator0=code_block_110)
code_block_111 = CodeBlock { 0; 1; 2; 3; 4; 5; 6; }
getItemAtIndex_9 = List.GetItemAtIndex(list=split_4@@L2, index=code_block_111.out0)
toNumber_7 = String.ToNumber(str=getItemAtIndex_9)
getItemAtIndex_10 = List.GetItemAtIndex(list=split_4@@L2, index=code_block_111.out1)
toNumber_8 = String.ToNumber(str=getItemAtIndex_10)
getItemAtIndex_11 = List.GetItemAtIndex(list=split_4@@L2, index=code_block_111.out2)
toNumber_9 = String.ToNumber(str=getItemAtIndex_11)
getItemAtIndex_12 = List.GetItemAtIndex(list=split_4@@L2, index=code_block_111.out5)
toNumber_10 = String.ToNumber(str=getItemAtIndex_12)
code_block_112 = CodeBlock { "Ширина"; }
getItemAtIndex_13 = List.GetItemAtIndex(list=split_4@@L2, index=code_block_111.out3)
toNumber_11 = String.ToNumber(str=getItemAtIndex_13)
code_block_113 = CodeBlock { "Высота"; }
getItemAtIndex_14 = List.GetItemAtIndex(list=split_4@@L2, index=code_block_111.out4)
toNumber_12 = String.ToNumber(str=getItemAtIndex_14)
code_block_114 = CodeBlock { "Глубина"; }
code_block_115 = CodeBlock { "SD_Версия задания"; }
code_block_116 = CodeBlock(x=code_block_109) { "V0|"+x; }
code_block_117 = CodeBlock { "SD_Способ создания задания"; "СКРИПТ"; "ВРУЧНУЮ"; }
code_block_118 = CodeBlock { "SD_Перенесено задание"; "Не перенесено"; }
code_block_119 = CodeBlock { "SD_Позиции задания"; }
python_script_70 = Python(IN[0]=code_block_109)  # same code as python_script_53
getItemAtIndex_15 = List.GetItemAtIndex(list=split_4@@L2, index=code_block_111.out6)

python_script_71 = Python(IN[0]=python_script_31, IN[1]=toNumber_9, IN[2]=toNumber_10)  # same code as python_script_55
code_block_120 = CodeBlock(x=python_script_71) { x[0]; x[1]; }

# group (continued): Создаем и настраиваем кубики
byCoordinates_2 = Point.ByCoordinates(x=toNumber_7, y=toNumber_8, z=code_block_120.out1)

byPointAndLevel_2 = FamilyInstance.ByPointAndLevel(familyType=byName_6, point=byCoordinates_2, level=code_block_120.out0)
code_block_121 = CodeBlock(x=byPointAndLevel_2) { x; }

# group (continued): Создаем и настраиваем кубики
setParameterByName_7 = Element.SetParameterByName(element=code_block_121, parameterName=code_block_112, value=toNumber_11)
setParameterByName_8 = Element.SetParameterByName(element=code_block_121, parameterName=code_block_113, value=toNumber_12)
setParameterByName_9 = Element.SetParameterByName(element=code_block_121, parameterName=code_block_114, value=toNumber_10)
setParameterByName_10 = Element.SetParameterByName(element=code_block_121, parameterName=code_block_115, value=code_block_116)
setParameterByName_11 = Element.SetParameterByName(element=code_block_121, parameterName=code_block_118.out0, value=code_block_118.out1)
setParameterByName_12 = Element.SetParameterByName(element=code_block_121, parameterName=code_block_119, value=python_script_70)

list_create_3 = List.Create(item0=code_block_121, item1=byPointAndLevel)
setParameterByName_13 = Element.SetParameterByName(element=list_create_3, parameterName=code_block_87.out0, value=getItemAtIndex_8)
flatten_22 = List.Flatten(list=setParameterByName_13)
setParameterByName_14 = Element.SetParameterByName(element=list_create_3, parameterName=code_block_87.out1, value=code_block_5)
flatten_23 = List.Flatten(list=setParameterByName_14)
setParameterByName_15 = Element.SetParameterByName(element=list_create_3, parameterName=code_block_90.out0, value=format)
flatten_24 = List.Flatten(list=setParameterByName_15)
join_8 = List.Join(list0=flatten_22, list1=flatten_23, list2=flatten_24)
join_9 = List.Join(list0=python_script_68, list1=code_block_39)

# group: Удаление некорректных заданий
setDifference_5 = List.SetDifference(list1=join_9, list2=python_script_66)
eq = python_script_68 == setDifference_5  # lacing=CrossProduct
allFalse_2 = List.AllFalse(list=eq@L2)
code_block_122 = CodeBlock(el=setDifference, x=allFalse_2) { DSCore.List.FilterByBoolMask(el,!x)["in"]; }

getParameterValueByName_24 = Element.GetParameterValueByName(element=code_block_122, parameterName=code_block_98)
getParameterValueByName_25 = Element.GetParameterValueByName(element=code_block_122, parameterName=code_block_99)
python_script_72 = Python(IN[0]=getParameterValueByName_24, IN[1]=code_block_122, IN[2]=getParameterValueByName_25)
# ---------- python_script_72.python (12 lines) ----------
import re
def split_string(source,separators):
    return re.split('[{0}]'.format(re.escape(separators)),source)

OUT = []
for par1,par2, elem in zip(IN[0],IN[2],IN[1]):
	
	if str(par1) == "СКРИПТ" and 'V0' in par2:
	
		OUT.append(elem)
	 
	
# ----------------------------------------
getParameterValueByName_26 = Element.GetParameterValueByName(element=python_script_72, parameterName=code_block_100)
python_script_73 = Python(IN[0]=python_script_72, IN[1]=getParameterValueByName_26, IN[2]=code_block_5)
# ---------- python_script_73.python (10 lines) ----------
razdel = IN[2]
elements = IN[0]
elem_primech = IN[1]

OUT= []
for elem,prim in zip(elements,elem_primech):
	if prim == razdel:
		OUT.append(elem)
	else:
		pass
# ----------------------------------------
delete = archilab.Revit.Elements.Elements.Delete(element=python_script_73)

# group: Задания от версии, которые не актуальны(Удалить)
code_block_123 = CodeBlock(el=python_script_60, str=getParameterValueByName_6)  # unwired: all_pastDSCore
# ---------- code_block_123.designscript (6 lines) ----------
all_pastDSCore.List.FilterByBoolMask(el,
		DSCore.String.ToNumber(
		DSCore.String.Substring(str,1,1)
						)
						>0)
["in"];
# ----------------------------------------
getParameterValueByName_27 = Element.GetParameterValueByName(element=code_block_123, parameterName=code_block_101)
python_script_74 = Python(IN[0]=getParameterValueByName_27)
# ---------- python_script_74.python (30 lines) ----------
import sys
import clr
clr.AddReference('ProtoGeometry')
from Autodesk.DesignScript.Geometry import *
import re

def split_string(source,separators):
    return re.split('[{0}]'.format(re.escape(separators)),source)
OUT = []
# Введенные в этом узле данные сохраняется в виде списка в переменных IN.

for i in IN[0]:
	
	split_list = split_string(i,'|')
	lenn = len(split_list)
	
	if lenn > 6:
		split_list.pop(8)
		split_list.pop(0)
		strr = ''
		for i in split_list:
			strr+=i+'|'
		strr = strr[:-1]
	else:
		strr = i
	OUT.Add(strr)
	
	
	
	
# ----------------------------------------

# group (continued): Задания от версии, которые не актуальны(Удалить)
setDifference_6 = List.SetDifference(list1=python_script_74, list2=python_script_65)
eq_2 = python_script_74 == setDifference_6  # lacing=CrossProduct
allFalse_3 = List.AllFalse(list=eq_2@L2)
code_block_124 = CodeBlock(el=code_block_123, x=allFalse_3) { DSCore.List.FilterByBoolMask(el,!x)["in"]; DSCore.List.FilterByBoolMask(el,!x)["out"]; }

# group: Запись и удаление предупреждений.
code_block_125 = CodeBlock()
# ---------- code_block_125.designscript (6 lines) ----------
//Параметр;
"SD_Версия задания";
//Текст предупреждения;
"|Удалено";
//Текст предупреждения;
"";
# ----------------------------------------
getParameterValueByName_28 = Element.GetParameterValueByName(element=code_block_124.out1, parameterName=code_block_125.out0)
replace_7 = String.Replace(str=getParameterValueByName_28, searchFor=code_block_125.out1, replaceWith=code_block_125.out2)
setParameterByName_16 = Element.SetParameterByName(element=code_block_124.out1, parameterName=code_block_125.out0, value=replace_7)
getParameterValueByName_29 = Element.GetParameterValueByName(element=code_block_124.out0, parameterName=code_block_125.out0)

code_block_126 = CodeBlock(el=code_block_124.out0, str=getParameterValueByName_29, tex=code_block_125.out2) { DSCore.List.FilterByBoolMask(el,DSCore.String.Contains(str,tex))["out"]; }
getParameterValueByName_30 = Element.GetParameterValueByName(element=code_block_126, parameterName=code_block_125.out0)
code_block_127 = CodeBlock(x=getParameterValueByName_30, Предупреждение=code_block_125.out1) { x+Предупреждение; }

# group (continued): Запись и удаление предупреждений.
setParameterByName_17 = Element.SetParameterByName(element=code_block_124.out0, parameterName=code_block_125.out0, value=code_block_127)

обработка_вручную_созданных = Python(IN[0]=getParameterValueByName_29)
# ---------- обработка_вручную_созданных.python (39 lines) ----------
import sys
import clr
clr.AddReference('ProtoGeometry')
from Autodesk.DesignScript.Geometry import *
import re

def split_string(source,separators):
    return re.split('[{0}]'.format(re.escape(separators)),source)
OUT = []
# Введенные в этом узле данные сохраняется в виде списка в переменных IN.

for i in IN[0]:
	
	split_list = split_string(i,'|')
	lenn = len(split_list)
	
	if lenn < 4:
		try:
			split_list.pop(2)
		except:
			pass
		strr = ''
		for i in split_list:
			strr+=i+'|'
		strr = strr[:-1]
	else:
		try:
			split_list.pop(8)
		except:
			pass
		strr = ''
		for i in split_list:
			strr+=i+'|'
		strr = strr + "Удалено"
	OUT.Add(strr)
	
	
	
	
# ----------------------------------------
python_script_75 = Python(IN[0]=code_block_109, IN[1]=code_block_39, IN[2]=code_block_121)
# ---------- python_script_75.python (12 lines) ----------
all_new = IN[0]
vrych = IN[1]
elem = IN[2]
strrr = str(vrych)
out1= []
out2= []
for i,el in zip(all_new,elem):
	if i in strrr:
		out1.append(el)
	else:
		out2.append(el)
OUT = [out1, out2]	
# ----------------------------------------
code_block_128 = CodeBlock(x=python_script_75) { x[0]; x[1]; }

# group (continued): Создаем и настраиваем кубики
setParameterByName_18 = Element.SetParameterByName(element=code_block_128.out0, parameterName=code_block_117.out0, value=code_block_117.out2)

python_script_76 = Python(IN[0]=code_block_75, IN[1]=code_block_72, IN[2]=byPointAndLevel)
# ---------- python_script_76.python (12 lines) ----------
all_new = IN[0]
vrych = IN[1]
elem = IN[2]
strrr = str(vrych)
out1= []
out2= []
for i,el in zip(all_new,elem):
	if i in strrr:
		out1.append(el)
	else:
		out2.append(el)
OUT = [out1, out2]			
# ----------------------------------------
code_block_129 = CodeBlock(x=python_script_76) { x[0]; x[1]; }

# group (continued): Создаем и настраиваем кубики
setParameterByName_19 = Element.SetParameterByName(element=code_block_129.out0, parameterName=code_block_83.out0, value=code_block_83.out2)

python_script_77 = Python(IN[0]=getParameterValueByName_17, IN[1]=setDifference_2)  # same code as python_script_60
code_block_130 = CodeBlock { "SD_Версия задания"; }

# group: Задания от версии, которые не актуальны(Удалить)
code_block_131 = CodeBlock(el=python_script_77, str=getParameterValueByName_17)  # unwired: all_pastDSCore; same code as code_block_123
getParameterValueByName_31 = Element.GetParameterValueByName(element=code_block_131, parameterName=code_block_130)

python_script_78 = Python(IN[0]=getParameterValueByName_31)  # same code as python_script_74

# group (continued): Задания от версии, которые не актуальны(Удалить)
setDifference_7 = List.SetDifference(list1=python_script_78, list2=python_script_48)
eq_3 = python_script_78 == setDifference_7  # lacing=CrossProduct
allFalse_4 = List.AllFalse(list=eq_3@L2)
code_block_132 = CodeBlock(x=allFalse_4) { DSCore.List.FilterByBoolMask(el,!x)["in"]; DSCore.List.FilterByBoolMask(el,!x)["out"]; }  # unwired: el

# group: Запись и удаление предупреждений.
code_block_133 = CodeBlock()  # same code as code_block_125
getParameterValueByName_32 = Element.GetParameterValueByName(element=code_block_132.out1, parameterName=code_block_133.out0)
replace_8 = String.Replace(str=getParameterValueByName_32, searchFor=code_block_133.out1, replaceWith=code_block_133.out2)
setParameterByName_20 = Element.SetParameterByName(element=code_block_132.out1, parameterName=code_block_133.out0, value=replace_8)
getParameterValueByName_33 = Element.GetParameterValueByName(element=code_block_132.out0, parameterName=code_block_133.out0)

code_block_134 = CodeBlock(el=code_block_132.out0, str=getParameterValueByName_33, tex=code_block_133.out2) { DSCore.List.FilterByBoolMask(el,DSCore.String.Contains(str,tex))["out"]; }
getParameterValueByName_34 = Element.GetParameterValueByName(element=code_block_134, parameterName=code_block_133.out0)
code_block_135 = CodeBlock(x=getParameterValueByName_34, Предупреждение=code_block_133.out1) { x+Предупреждение; }

# group (continued): Запись и удаление предупреждений.
setParameterByName_21 = Element.SetParameterByName(element=code_block_132.out0, parameterName=code_block_133.out0, value=code_block_135)

обработка_вручную_созданных_2 = Python(IN[0]=getParameterValueByName_33)  # same code as обработка_вручную_созданных
join_10 = List.Join(list0=python_script_51, list1=code_block_72)

# group: Удаление некорректных заданий
setDifference_8 = List.SetDifference(list1=join_10, list2=python_script_49)
eq_4 = python_script_51 == python_script_51  # lacing=CrossProduct
allFalse_5 = List.AllFalse(list=eq_4@L2)
code_block_136 = CodeBlock(el=setDifference_2, x=allFalse_5) { DSCore.List.FilterByBoolMask(el,!x)["in"]; }

code_block_137 = CodeBlock { "SD_Способ создания задания"; }
getParameterValueByName_35 = Element.GetParameterValueByName(element=code_block_136, parameterName=code_block_137)
code_block_138 = CodeBlock { "SD_Версия задания"; }
getParameterValueByName_36 = Element.GetParameterValueByName(element=code_block_136, parameterName=code_block_138)
python_script_79 = Python(IN[0]=getParameterValueByName_35, IN[1]=code_block_136, IN[2]=getParameterValueByName_36)  # same code as python_script_72
code_block_139 = CodeBlock { ":Примечание"; }
getParameterValueByName_37 = Element.GetParameterValueByName(element=python_script_79, parameterName=code_block_139)
python_script_80 = Python(IN[0]=python_script_79, IN[1]=getParameterValueByName_37, IN[2]=code_block_5)  # same code as python_script_73
delete_2 = archilab.Revit.Elements.Elements.Delete(element=python_script_80)  # frozen

# group: объединение векторов
python_script_81 = Python(IN[0]=python_script_56)
# ---------- python_script_81.python (121 lines) ----------
import sys
import clr
clr.AddReference('ProtoGeometry')
clr.AddReference('RevitAPI')
import Autodesk
from Autodesk.Revit.DB import *
from Autodesk.DesignScript.Geometry import *

clr.AddReference('RevitServices')
import RevitServices
from RevitServices.Persistence import DocumentManager
from RevitServices.Transactions import TransactionManager
import math
doc = DocumentManager.Instance.CurrentDBDocument


All_curves = IN[0]

def flatten(l):
	flat_list = []
	for sublist in l:
	    for item in sublist:
	        flat_list.Add(item)
	return flat_list
	
	
def curv_intersect_curve(curve, cur):
	P_start = curve.StartPoint
	P_end = curve.EndPoint
	
	
	cur_start = cur.StartPoint
	cur_end = cur.EndPoint
	
	if str(P_start) == str(cur_start) and str(P_end) == str(cur_end):
		if Line.ByStartPointEndPoint(cur_start, cur_end).Length>=curve.Length:
			line = Line.ByStartPointEndPoint(cur_start, cur_end)
		else:
			line = curve
			
	elif str(P_start) == str(cur_start) and str(P_end) != str(cur_end):
		if Line.ByStartPointEndPoint(P_end, cur_end).Length:
			line = Line.ByStartPointEndPoint(P_end, cur_end)
		else:
			line = curve
			
	elif str(P_start) != str(cur_start) and str(P_end) == str(cur_end):
		if Line.ByStartPointEndPoint(P_start, cur_start).Length>=curve.Length:
			line = Line.ByStartPointEndPoint(P_start, cur_start)
		else:
			line = curve
			
	elif str(P_start) != str(cur_end) and str(P_end) == str(cur_start):
		if Line.ByStartPointEndPoint(P_start, cur_end).Length>=curve.Length:
			line = Line.ByStartPointEndPoint(P_start, cur_end)
		else:
			line = curve
			
	elif str(P_start) == str(cur_end) and str(P_end) != str(cur_start):
		if Line.ByStartPointEndPoint(P_end, cur_start).Length>=curve.Length:
			line = Line.ByStartPointEndPoint(P_end, cur_start)
		else:
			line = curve
		
	else:
		line = curve
	return line

def uppdate_curve(curve,curves):
	for cur in curves:
		curve = curv_intersect_curve(curve,cur)
	return curve


curves = flatten(All_curves)

new_curves_list = []



OUT =uppdate_curve(curves[2],curves)

for list_curvs in All_curves:
	new_curvs = []
	for curv in list_curvs:
		cur = uppdate_curve(curv,curves)
		new_curvs.Add(cur)
	new_curves_list.Add(new_curvs)
	



new_curves_list1 =[]
curves = flatten(All_curves)
for list_curvs in new_curves_list:
	new_curvs = []
	for curv in list_curvs:
		cur = uppdate_curve(curv,curves)
		new_curvs.Add(cur)
	new_curves_list1.Add(new_curvs)

OUT = new_curves_list1

OUT = []
for i in range(len(new_curves_list1)):
	out_cur_list = []
	for cur1, cur2 in zip(new_curves_list[i],new_curves_list1[i]):
		if cur1.Length>=cur2.Length:
			out_cur_list.Add(cur1)
		else:
			out_cur_list.Add(cur2)
		
	OUT.Add(out_cur_list)







OUT = IN[0]
# ----------------------------------------

code_block_140 = CodeBlock { "SD_Способ создания задания"; }
getParameterValueByName_38 = Element.GetParameterValueByName(element=all_elements_of_family_type_2, parameterName=code_block_140)
python_script_82 = Python(IN[0]=all_elements_of_family_type_2, IN[1]=getParameterValueByName_38)
# ---------- python_script_82.python (16 lines) ----------
# Загрузить стандартную библиотеку Python и библиотеку DesignScript
import sys
import clr
clr.AddReference('ProtoGeometry')
from Autodesk.DesignScript.Geometry import *
OUT =[]
script = [] 
vrych = [] 
# Введенные в этом узле данные сохраняется в виде списка в переменных IN.
for el, par in zip(IN[0],IN[1]):
	if par =="СКРИПТ":
		script.Add(el)
	else:
		vrych.Add(el)
		
OUT = [script,vrych]
# ----------------------------------------
code_block_141 = CodeBlock(x=python_script_82) { x[0]; x[1]; }
code_block_142 = CodeBlock { "SD_Способ создания задания"; }
getParameterValueByName_39 = Element.GetParameterValueByName(element=all_elements_of_family_type_4, parameterName=code_block_142)
python_script_83 = Python(IN[0]=all_elements_of_family_type_4, IN[1]=getParameterValueByName_39)  # same code as python_script_82
code_block_143 = CodeBlock(x=python_script_83) { x[0]; x[1]; }
join_11 = List.Join(list0=code_block_141.out1, list1=code_block_143.out1)
вложенные = List.Join(list0=python_script_45, list1=python_script_29)
setDifference_9 = List.SetDifference(list1=join_11, list2=вложенные)
code_block_144 = CodeBlock { "SD_Версия задания"; }
getParameterValueByName_40 = Element.GetParameterValueByName(element=setDifference_9, parameterName=code_block_144)
python_script_84 = Python(IN[0]=setDifference_9, IN[1]=getParameterValueByName_40)
# ---------- python_script_84.python (220 lines) ----------
# Загрузить стандартную библиотеку Python и библиотеку DesignScript
import sys
import clr
clr.AddReference('ProtoGeometry')
clr.AddReference('RevitAPI')
import Autodesk
from Autodesk.Revit.DB import *
from Autodesk.DesignScript.Geometry import *

clr.AddReference('RevitServices')
import RevitServices
from RevitServices.Persistence import DocumentManager
from RevitServices.Transactions import TransactionManager
import math
import re
doc = DocumentManager.Instance.CurrentDBDocument
# Введенные в этом узле данные сохраняется в виде списка в переменных IN.

otvs= IN[0]
otv_rot =[]
otv_loc = []



def angle(angles):
	 
	OUT = []
	list=[]
	OUT1 =[]
	# Разместите код под этой строкой
	for angle in angles:
		if 315<=angle<=360:
			angle-=315
		elif 270<=angle<315:
			angle-=270
		elif 225<=angle<=270:
			angle-=225
		elif 180<=angle<=225:
			angle-=180
			
		elif 135<=angle<=180:
			angle-=135
			
		elif 90<=angle<=135:
			angle-=90
		
		elif 45<=angle<=90:
			angle-=45
			
		elif 45<=angle<=0:
			angle-=0
		else:
			angle=angle
		list.Add(round(angle,2))
		
	for angle in list:
		if angle >= 22.5:
			if angle>=33.4:
				angle = 45-angle
			else:
				angle = angle-22.5		
		elif angle < 22.5:
			angle=angle
		OUT1.Add(angle)
		
	return OUT1


def split_string(source,separators):
    return re.split('[{0}]'.format(re.escape(separators)),source)




# созданные функции

def get_parameters_elements(otvs, strr):	
	out_list1=[]
	out_list=[]
	otv_lenth =[]
	for model in otvs:
		out_list.append(model.Name)
			
	elUnwrap = UnwrapElement(otvs)
	sum=0
	for i in elUnwrap:
		if out_list[sum] == -1:
			out_list1.append(-1)
			sum+=1
		else:
			sum+=1
			Db = i.GetParameters(strr)
			
			for i in Db:
				out_list1.append(i.AsValueString())
				
	for i in out_list1:
		x = round(int(i)/1)*1
		otv_lenth.Add(x)
	return otv_lenth

def get_parameters_elements5_round(otvs, strr):	
	out_list1=[]
	out_list=[]
	otv_lenth =[]
	for model in otvs:
		out_list.append(model.Name)
			
	elUnwrap = UnwrapElement(otvs)
	sum=0
	for i in elUnwrap:
		if out_list[sum] == -1:
			out_list1.append(-1)
			sum+=1
		else:
			sum+=1
			Db = i.GetParameters(strr)
			
			for i in Db:
				out_list1.append(i.AsValueString())
				
	for i in out_list1:
		x = round(int(i)/1)*1
		otv_lenth.Add(x)
	return otv_lenth



for i,otv in enumerate(UnwrapElement(otvs)):
	rot = math.degrees(otv.Location.Rotation)
	#rot = round(rot/10,0)*10
	otv_rot.Add(rot)

for i,otv in enumerate(otvs):
	otv_loc.Add(otv.Location)

otv_rot=(otv_rot)

lenth = get_parameters_elements(otvs, "Ширина")
depth = get_parameters_elements5_round(otvs, "Глубина")
width = get_parameters_elements(otvs, "Высота")

OUT = []
str_list = []
pereneseno =[]
ver_list = []
for i, el in enumerate(otvs):
	if int(otv_rot[i]) == otv_rot[i]:
		rot = int(otv_rot[i])
	else:
		rot = otv_rot[i]
	strrr = str(int(round(float(otv_loc[i].X)/1)*1)) + '|' + str(int(round(float(otv_loc[i].Y)/1)*1)) + '|' + str(int(round(float(otv_loc[i].Z)/1)*1)) + '|' + str(int(lenth[i])) + '|' + str(int(width[i]))+ '|' + str(int(depth[i])) + '|' + str(rot)
	str_list.Add(strrr.replace('.', ','))


for i, sd in enumerate(IN[1]):
	split_list = split_string(sd,'|')
	new_str=''
	if len(sd) == 8:
		ver = split_list.pop(1)
		#for i in split_list:
			#x+=i
		#if x == str_list[i]:
			#pereneseno.Add(0)
		#else:
			#pereneseno.Add(1)
		newver = ver+str_list[i]
		
	if len(sd) == 9:
		ver = split_list.pop(0)
		
		x = ''
		#for i in split_list:
			#x+=i
		#if x == str_list[i]:
			#pereneseno.Add('Не перенесено')
		#else:
			#pereneseno.Add('Перенесено')			
		newver = ver+str_list[i]
		
	else:
		try:
			ver = split_list.pop(0)
			newver = ver+'|'+str_list[i]
		except:
		
			newver = 'V0|'+str_list[i]
		#pereneseno.Add('Не перенесено')
	ver_list.Add(newver)
	
	if str_list[i][:-4]	in sd or sd =='':
		pereneseno.Add('Не перенесено')
	else:
		pereneseno.Add('Перенесено')
		
		


cor_ver = []
for i,j in zip(IN[1],ver_list):
	if 'V' not in i:
		st = 'V0'
	else:
		st = ''
	i= split_string(i,'|')
	try:
		
		cor_ver.append(st+j+'|'+i[8])
	except:
		cor_ver.append(st+j)
	
cor_perenes = []

for i,j in zip(cor_ver,pereneseno):
	if 'V0' in i:
		cor_perenes.append('Не перенесено')
	else:
		cor_perenes.append(j)
	
OUT = [cor_ver, cor_perenes,str_list]	
# ----------------------------------------
code_block_145 = CodeBlock(x=python_script_84) { x[0]; x[1]; }
setParameterByName_22 = Element.SetParameterByName(element=setDifference_9, parameterName=code_block_144, value=code_block_145.out0)
code_block_146 = CodeBlock { "SD_Перенесено задание"; }
code_block_147 = CodeBlock { "SD_Версия задания"; }
getParameterValueByName_41 = Element.GetParameterValueByName(element=code_block_141.out0, parameterName=code_block_147)
python_script_85 = Python(IN[0]=code_block_141.out0, IN[1]=getParameterValueByName_41)
# ---------- python_script_85.python (220 lines) ----------
# Загрузить стандартную библиотеку Python и библиотеку DesignScript
import sys
import clr
clr.AddReference('ProtoGeometry')
clr.AddReference('RevitAPI')
import Autodesk
from Autodesk.Revit.DB import *
from Autodesk.DesignScript.Geometry import *

clr.AddReference('RevitServices')
import RevitServices
from RevitServices.Persistence import DocumentManager
from RevitServices.Transactions import TransactionManager
import math
import re
doc = DocumentManager.Instance.CurrentDBDocument
# Введенные в этом узле данные сохраняется в виде списка в переменных IN.

otvs= IN[0]
otv_rot =[]
otv_loc = []



def angle(angles):
	 
	OUT = []
	list=[]
	OUT1 =[]
	# Разместите код под этой строкой
	for angle in angles:
		if 315<=angle<=360:
			angle-=315
		elif 270<=angle<315:
			angle-=270
		elif 225<=angle<=270:
			angle-=225
		elif 180<=angle<=225:
			angle-=180
			
		elif 135<=angle<=180:
			angle-=135
			
		elif 90<=angle<=135:
			angle-=90
		
		elif 45<=angle<=90:
			angle-=45
			
		elif 45<=angle<=0:
			angle-=0
		else:
			angle=angle
		list.Add(round(angle,2))
		
	for angle in list:
		if angle >= 22.5:
			if angle>=33.4:
				angle = 45-angle
			else:
				angle = angle-22.5		
		elif angle < 22.5:
			angle=angle
		OUT1.Add(angle)
		
	return OUT1


def split_string(source,separators):
    return re.split('[{0}]'.format(re.escape(separators)),source)




# созданные функции

def get_parameters_elements(otvs, strr):	
	out_list1=[]
	out_list=[]
	otv_lenth =[]
	for model in otvs:
		out_list.append(model.Name)
			
	elUnwrap = UnwrapElement(otvs)
	sum=0
	for i in elUnwrap:
		if out_list[sum] == -1:
			out_list1.append(-1)
			sum+=1
		else:
			sum+=1
			Db = i.GetParameters(strr)
			
			for i in Db:
				out_list1.append(i.AsValueString())
				
	for i in out_list1:
		x = round(int(i)/10)*10
		otv_lenth.Add(x)
	return otv_lenth


def get_parameters_elements5_round(otvs, strr):	
	out_list1=[]
	out_list=[]
	otv_lenth =[]
	for model in otvs:
		out_list.append(model.Name)
			
	elUnwrap = UnwrapElement(otvs)
	sum=0
	for i in elUnwrap:
		if out_list[sum] == -1:
			out_list1.append(-1)
			sum+=1
		else:
			sum+=1
			Db = i.GetParameters(strr)
			
			for i in Db:
				out_list1.append(i.AsValueString())
				
	for i in out_list1:
		x = round(int(i)/5)*5
		otv_lenth.Add(x)
	return otv_lenth




for i,otv in enumerate(UnwrapElement(otvs)):
	rot = math.degrees(otv.Location.Rotation)
	#rot = round(rot/10,0)*10
	otv_rot.Add(rot)

for i,otv in enumerate(otvs):
	loc = otv.Location
	otv_loc.Add(loc)

#otv_rot=angle(otv_rot)

lenth = get_parameters_elements(otvs, "Ширина")
depth = get_parameters_elements5_round(otvs, "Глубина")
width = get_parameters_elements(otvs, "Высота")

OUT = []
str_list = []
pereneseno =[]
ver_list = []
for i, el in enumerate(otvs):
	if int(otv_rot[i]) == otv_rot[i]:
		rot = int(otv_rot[i])
	else:
		rot = otv_rot[i]
	strrr = str(int(round(float(otv_loc[i].X)/10)*10)) + '|' + str(int(round(float(otv_loc[i].Y)/10)*10)) + '|' + str(int(round(float(otv_loc[i].Z)/10)*10)) + '|' + str(int(lenth[i])) + '|' + str(int(width[i]))+ '|' + str(int(depth[i])) + '|' + str(rot)
	str_list.Add(strrr.replace('.', ','))


for i, sd in enumerate(IN[1]):
	split_list = split_string(sd,'|')
	new_str=''
	if len(sd) == 8:
		ver = split_list.pop(1)
		#for i in split_list:
			#x+=i
		#if x == str_list[i]:
			#pereneseno.Add(0)
		#else:
			#pereneseno.Add(1)
		newver = ver+str_list[i]
		
	if len(sd) == 9:
		ver = split_list.pop(0)
		
		x = ''
		#for i in split_list:
			#x+=i
		#if x == str_list[i]:
			#pereneseno.Add('Не перенесено')
		#else:
			#pereneseno.Add('Перенесено')			
		newver = ver+str_list[i]
		
	else:
		try:
			ver = split_list.pop(0)
			newver = ver+'|'+str_list[i]
		except:
		
			newver = 'V0|'+str_list[i]
		#pereneseno.Add('Не перенесено')
	ver_list.Add(newver)
	
	if str_list[i][:-4]	in sd or sd =='':
		pereneseno.Add('Не перенесено')
	else:
		pereneseno.Add('Перенесено')
		

cor_ver = []
for i,j in zip(IN[1],ver_list):
	i= split_string(i,'|')
	try:
		
		cor_ver.append(j+'|'+i[8])
	except:
		cor_ver.append(j)

cor_perenes = []

for i,j in zip(cor_ver,pereneseno):
	if 'V0' in i:
		cor_perenes.append('Не перенесено')
	else:
		cor_perenes.append(j)




OUT = [cor_ver, cor_perenes,get_parameters_elements(otvs, "Глубина")]	
# ----------------------------------------
code_block_148 = CodeBlock(x=python_script_85) { x[0]; x[1]; }
setParameterByName_23 = Element.SetParameterByName(element=code_block_141.out0, parameterName=code_block_146, value=code_block_148.out1)
setParameterByName_24 = Element.SetParameterByName(element=setParameterByName_23, parameterName=code_block_147, value=code_block_148.out0)

# group: Заполнение истории перемещения и параметра перемещено
code_block_149 = CodeBlock { "SD_Позиции задания"; }
code_block_150 = CodeBlock { "SD_Версия задания"; }
getParameterValueByName_42 = Element.GetParameterValueByName(element=setParameterByName_24, parameterName=code_block_150)
code_block_151 = CodeBlock { "SD_Позиции задания"; }
getParameterValueByName_43 = Element.GetParameterValueByName(element=setParameterByName_24, parameterName=code_block_151)
python_script_86 = Python(IN[0]=setParameterByName_24, IN[1]=getParameterValueByName_42, IN[2]=getParameterValueByName_43)
# ---------- python_script_86.python (222 lines) ----------
# Загрузить стандартную библиотеку Python и библиотеку DesignScript
import sys
import clr
clr.AddReference('ProtoGeometry')
clr.AddReference('RevitAPI')
import Autodesk
from Autodesk.Revit.DB import *
from Autodesk.DesignScript.Geometry import *

clr.AddReference('RevitServices')
import RevitServices
from RevitServices.Persistence import DocumentManager
from RevitServices.Transactions import TransactionManager
import math
import re
doc = DocumentManager.Instance.CurrentDBDocument
# Введенные в этом узле данные сохраняется в виде списка в переменных IN.




def angle(angles):
	 
	OUT = []
	list=[]
	OUT1 =[]
	# Разместите код под этой строкой
	for angle in angles:
		if 315<=angle<=360:
			angle-=315
		elif 270<=angle<315:
			angle-=270
		elif 225<=angle<=270:
			angle-=225
		elif 180<=angle<=225:
			angle-=180
			
		elif 135<=angle<=180:
			angle-=135
			
		elif 90<=angle<=135:
			angle-=90
		
		elif 45<=angle<=90:
			angle-=45
			
		elif 45<=angle<=0:
			angle-=0
		else:
			angle=angle
		list.Add(round(angle,2))
		
	for angle in list:
		if angle >= 22.5:
			if angle>=33.4:
				angle = 45-angle
			else:
				angle = angle-22.5		
		elif angle < 22.5:
			angle=angle
		OUT1.Add(angle)
		
	return OUT1


def split_string(source,separators):
    return re.split('[{0}]'.format(re.escape(separators)),source)




# созданные функции

def get_parameters_elements(otvs, strr):	
	out_list1=[]
	out_list=[]
	otv_lenth =[]
	for model in otvs:
		out_list.append(model.Name)
			
	elUnwrap = UnwrapElement(otvs)
	sum=0
	for i in elUnwrap:
		if out_list[sum] == -1:
			out_list1.append(-1)
			sum+=1
		else:
			sum+=1
			Db = i.GetParameters(strr)
			
			for i in Db:
				out_list1.append(i.AsValueString())
				
	for i in out_list1:
		i = round(int(i)/10,0)*10
		otv_lenth.Add(i)
	return otv_lenth
	



def get_parameters_elements5_round(otvs, strr):	
	out_list1=[]
	out_list=[]
	otv_lenth =[]
	for model in otvs:
		out_list.append(model.Name)
			
	elUnwrap = UnwrapElement(otvs)
	sum=0
	for i in elUnwrap:
		if out_list[sum] == -1:
			out_list1.append(-1)
			sum+=1
		else:
			sum+=1
			Db = i.GetParameters(strr)
			
			for i in Db:
				out_list1.append(i.AsValueString())
				
	for i in out_list1:
		x = round(int(i)/5)*5
		otv_lenth.Add(x)
	return otv_lenth



	
otvs= IN[0]
otv_rot =[]
otv_ver = IN[1]
otv_loc = []
otv_all_poss = IN[2]
OUT = []
new_loc_list = []
pereneseno =[]
last_loc_list = []



for i,otv in enumerate(UnwrapElement(otvs)):
	rot = math.degrees(otv.Location.Rotation)
	#rot = round(rot/10,0)*10
	otv_rot.Add(rot)

for i,otv in enumerate(otvs):
	otv_loc.Add(otv.Location)

#otv_rot=angle(otv_rot)

lenth = get_parameters_elements(otvs, "Ширина")
depth = get_parameters_elements5_round(otvs, "Глубина")
width = get_parameters_elements(otvs, "Высота")



# нахождение актуального месторасположения
for i, el in enumerate(otvs):
	if int(otv_rot[i]) == otv_rot[i]:
		rot = int(otv_rot[i])
	else:
		rot = otv_rot[i]
	strrr = str(int(round(float(otv_loc[i].X)/10)*10)) + '|' + str(int(round(float(otv_loc[i].Y)/10)*10)) + '|' + str(int(round(float(otv_loc[i].Z)/10)*10)) + '|' + str(int(lenth[i])) + '|' + str(int(width[i]))+ '|' + str(int(depth[i])) + '|' + str(rot)
	new_loc_list.Add(strrr.replace('.', ','))

#  нахождение фактического положения
for ver in otv_ver:
	ver_split = split_string(ver, '|')
	try:
		ver_split.pop(9)
	except:
		pass
	try:
		ver_split.pop(8)
	except:
		pass
	try:
		ver_split.pop(0)
	except:
		pass
	
	last_loc = ''
	for i in ver_split:
		last_loc+= i+ '|'
	last_loc = last_loc[:-1]+ ';'	
	last_loc_list.Add(last_loc)



new_all_possition = []
pereneseno = []


for new_position, last_poss, all_poss in zip(new_loc_list,last_loc_list,otv_all_poss):
	if new_position[:-4] not in all_poss:
		all_poss= new_position+all_poss
	if last_poss[:-4] not in all_poss:
		all_poss+= last_poss

	new_all_possition.Add(all_poss)

new_all_possition_out = []

for i,j,k in zip(IN[1],new_all_possition,new_loc_list):	
	if 'V0' in i:
		st = k
		new_all_possition_out.Add(st)
	else:
		new_all_possition_out.Add(j)


for i in new_all_possition_out:
	x = i.count(';')
	if x>1:
		pereneseno.Add('Перенесено')
	else:
		pereneseno.Add('Не перенесено')

OUT = [new_all_possition,pereneseno,new_loc_list,new_all_possition_out]		
	
#OUT = [new_all_possition,pereneseno]	
# ----------------------------------------
code_block_152 = CodeBlock(x=python_script_86) { x[3]; x[1]; }
setParameterByName_25 = Element.SetParameterByName(element=setParameterByName_24, parameterName=code_block_149, value=code_block_152.out0)
code_block_153 = CodeBlock { "SD_Перенесено задание"; }
setParameterByName_26 = Element.SetParameterByName(element=setParameterByName_24, parameterName=code_block_153, value=code_block_152.out1)

code_block_154 = CodeBlock { "SD_Перенесено задание"; }
setParameterByName_27 = Element.SetParameterByName(element=setDifference_9, parameterName=code_block_154, value=code_block_145.out1)

# group: Заполнение истории перемещения и параметра перемещено
code_block_155 = CodeBlock { "SD_Позиции задания"; }
code_block_156 = CodeBlock { "SD_Версия задания"; }
getParameterValueByName_44 = Element.GetParameterValueByName(element=setParameterByName_27, parameterName=code_block_156)
code_block_157 = CodeBlock { "SD_Позиции задания"; }
getParameterValueByName_45 = Element.GetParameterValueByName(element=setParameterByName_27, parameterName=code_block_157)

python_script_87 = Python(IN[0]=setParameterByName_27, IN[1]=getParameterValueByName_44, IN[2]=getParameterValueByName_45)
# ---------- python_script_87.python (228 lines) ----------
# Загрузить стандартную библиотеку Python и библиотеку DesignScript
import sys
import clr
clr.AddReference('ProtoGeometry')
clr.AddReference('RevitAPI')
import Autodesk
from Autodesk.Revit.DB import *
from Autodesk.DesignScript.Geometry import *

clr.AddReference('RevitServices')
import RevitServices
from RevitServices.Persistence import DocumentManager
from RevitServices.Transactions import TransactionManager
import math
import re
doc = DocumentManager.Instance.CurrentDBDocument
# Введенные в этом узле данные сохраняется в виде списка в переменных IN.




def angle(angles):
	 
	OUT = []
	list=[]
	OUT1 =[]
	# Разместите код под этой строкой
	for angle in angles:
		if 315<=angle<=360:
			angle-=315
		elif 270<=angle<315:
			angle-=270
		elif 225<=angle<=270:
			angle-=225
		elif 180<=angle<=225:
			angle-=180
			
		elif 135<=angle<=180:
			angle-=135
			
		elif 90<=angle<=135:
			angle-=90
		
		elif 45<=angle<=90:
			angle-=45
			
		elif 45<=angle<=0:
			angle-=0
		else:
			angle=angle
		list.Add(round(angle,2))
		
	for angle in list:
		if angle >= 22.5:
			if angle>=33.4:
				angle = 45-angle
			else:
				angle = angle-22.5		
		elif angle < 22.5:
			angle=angle
		OUT1.Add(angle)
		
	return OUT1


def split_string(source,separators):
    return re.split('[{0}]'.format(re.escape(separators)),source)




# созданные функции

def get_parameters_elements(otvs, strr):	
	out_list1=[]
	out_list=[]
	otv_lenth =[]
	for model in otvs:
		out_list.append(model.Name)
			
	elUnwrap = UnwrapElement(otvs)
	sum=0
	for i in elUnwrap:
		if out_list[sum] == -1:
			out_list1.append(-1)
			sum+=1
		else:
			sum+=1
			Db = i.GetParameters(strr)
			
			for i in Db:
				out_list1.append(i.AsValueString())
				
	for i in out_list1:
		i = round(int(i)/1,0)*1
		otv_lenth.Add(i)
	return otv_lenth
	


def get_parameters_elements5_round(otvs, strr):	
	out_list1=[]
	out_list=[]
	otv_lenth =[]
	for model in otvs:
		out_list.append(model.Name)
			
	elUnwrap = UnwrapElement(otvs)
	sum=0
	for i in elUnwrap:
		if out_list[sum] == -1:
			out_list1.append(-1)
			sum+=1
		else:
			sum+=1
			Db = i.GetParameters(strr)
			
			for i in Db:
				out_list1.append(i.AsValueString())
				
	for i in out_list1:
		x = round(int(i)/1)*1
		otv_lenth.Add(x)
	return otv_lenth





	
otvs= IN[0]
otv_rot =[]
otv_ver = IN[1]
otv_loc = []
otv_all_poss = IN[2]
OUT = []
new_loc_list = []
pereneseno =[]
last_loc_list = []



for i,otv in enumerate(UnwrapElement(otvs)):
	rot = math.degrees(otv.Location.Rotation)
	rot = round(rot/1,0)*1
	otv_rot.Add(rot)

for i,otv in enumerate(otvs):
	otv_loc.Add(otv.Location)

#otv_rot=angle(otv_rot)

lenth = get_parameters_elements(otvs, "Ширина")
depth = get_parameters_elements5_round(otvs, "Глубина")
width = get_parameters_elements(otvs, "Высота")



# нахождение актуального месторасположения
for i, el in enumerate(otvs):
	if int(otv_rot[i]) == otv_rot[i]:
		rot = int(otv_rot[i])
	else:
		rot = otv_rot[i]
	strrr = str(int(round(float(otv_loc[i].X)/1)*1)) + '|' + str(int(round(float(otv_loc[i].Y)/1)*1)) + '|' + str(int(round(float(otv_loc[i].Z)/1)*1)) + '|' + str(int(lenth[i])) + '|' + str(int(width[i]))+ '|' + str(int(depth[i])) + '|' + str(rot)
	new_loc_list.Add(strrr.replace('.', ','))

#  нахождение фактического положения
for ver in otv_ver:
	ver_split = split_string(ver, '|')
	try:
		ver_split.pop(9)
	except:
		pass
	try:
		ver_split.pop(8)
	except:
		pass
	try:
		ver_split.pop(0)
	except:
		pass
	
	last_loc = ''
	for i in ver_split:
		last_loc+= i+ '|'
	last_loc = last_loc[:-1]+ ';'	
	last_loc_list.Add(last_loc)



new_all_possition = []
pereneseno = []


for new_position, last_poss, all_poss in zip(new_loc_list,last_loc_list,otv_all_poss):
	if new_position[:-4] not in all_poss:
		all_poss= new_position+all_poss
	if last_poss[:-4] not in all_poss:
		all_poss+= last_poss

	new_all_possition.Add(all_poss)

new_all_possition_out = []

for i,j,k in zip(IN[1],new_all_possition,new_loc_list):	
	if 'V0' in i:
		st = k
		new_all_possition_out.Add(st)
	else:
		new_all_possition_out.Add(j)







for i in new_all_possition:
	x = i.count(';')
	if x>1:
		pereneseno.Add('Перенесено')
	else:
		pereneseno.Add('Не перенесено')

OUT = [new_all_possition,pereneseno,new_loc_list,new_all_possition_out]		
	
#OUT = [new_all_possition,pereneseno]	
# ----------------------------------------
code_block_158 = CodeBlock(x=python_script_87) { x[1]; x[3]; }

# group (continued): Заполнение истории перемещения и параметра перемещено
setParameterByName_28 = Element.SetParameterByName(element=setParameterByName_27, parameterName=code_block_155, value=code_block_158.out1)

code_block_159 = CodeBlock { "SD_Версия задания"; }
getParameterValueByName_46 = Element.GetParameterValueByName(element=code_block_143.out0, parameterName=code_block_159)
python_script_88 = Python(IN[0]=code_block_143.out0, IN[1]=getParameterValueByName_46)
# ---------- python_script_88.python (217 lines) ----------
# Загрузить стандартную библиотеку Python и библиотеку DesignScript
import sys
import clr
clr.AddReference('ProtoGeometry')
clr.AddReference('RevitAPI')
import Autodesk
from Autodesk.Revit.DB import *
from Autodesk.DesignScript.Geometry import *

clr.AddReference('RevitServices')
import RevitServices
from RevitServices.Persistence import DocumentManager
from RevitServices.Transactions import TransactionManager
import math
import re
doc = DocumentManager.Instance.CurrentDBDocument
# Введенные в этом узле данные сохраняется в виде списка в переменных IN.

otvs= IN[0]
otv_rot =[]
otv_loc = []



def angle(angles):
	 
	OUT = []
	list=[]
	OUT1 =[]
	# Разместите код под этой строкой
	for angle in angles:
		if 315<=angle<=360:
			angle-=315
		elif 270<=angle<315:
			angle-=270
		elif 225<=angle<=270:
			angle-=225
		elif 180<=angle<=225:
			angle-=180
			
		elif 135<=angle<=180:
			angle-=135
			
		elif 90<=angle<=135:
			angle-=90
		
		elif 45<=angle<=90:
			angle-=45
			
		elif 45<=angle<=0:
			angle-=0
		else:
			angle=angle
		list.Add(round(angle,2))
		
	for angle in list:
		if angle >= 22.5:
			if angle>=33.4:
				angle = 45-angle
			else:
				angle = angle-22.5		
		elif angle < 22.5:
			angle=angle
		OUT1.Add(angle)
		
	return OUT1


def split_string(source,separators):
    return re.split('[{0}]'.format(re.escape(separators)),source)




# созданные функции

def get_parameters_elements(otvs, strr):	
	out_list1=[]
	out_list=[]
	otv_lenth =[]
	for model in otvs:
		out_list.append(model.Name)
			
	elUnwrap = UnwrapElement(otvs)
	sum=0
	for i in elUnwrap:
		if out_list[sum] == -1:
			out_list1.append(-1)
			sum+=1
		else:
			sum+=1
			Db = i.GetParameters(strr)
			
			for i in Db:
				out_list1.append(i.AsValueString())
				
	for i in out_list1:
		x = round(int(i)/10)*10
		otv_lenth.Add(x)
	return otv_lenth

def get_parameters_elements5_round(otvs, strr):	
	out_list1=[]
	out_list=[]
	otv_lenth =[]
	for model in otvs:
		out_list.append(model.Name)
			
	elUnwrap = UnwrapElement(otvs)
	sum=0
	for i in elUnwrap:
		if out_list[sum] == -1:
			out_list1.append(-1)
			sum+=1
		else:
			sum+=1
			Db = i.GetParameters(strr)
			
			for i in Db:
				out_list1.append(i.AsValueString())
				
	for i in out_list1:
		x = round(int(i)/5)*5
		otv_lenth.Add(x)
	return otv_lenth



for i,otv in enumerate(UnwrapElement(otvs)):
	rot = math.degrees(otv.Location.Rotation)
	#rot = round(rot/10,0)*10
	otv_rot.Add(rot)
	
for i,otv in enumerate(otvs):
	otv_loc.Add(otv.Location)

otv_rot=(otv_rot)

lenth = get_parameters_elements(otvs, "Ширина")
depth = get_parameters_elements5_round(otvs, "Глубина")
width = get_parameters_elements(otvs, "Высота")

OUT = []
str_list = []
pereneseno =[]
ver_list = []
for i, el in enumerate(otvs):
	if int(otv_rot[i]) == otv_rot[i]:
		rot = int(otv_rot[i])
	else:
		rot = otv_rot[i]
	strrr = str(int(round(float(otv_loc[i].X)/10)*10)) + '|' + str(int(round(float(otv_loc[i].Y)/10)*10)) + '|' + str(int(round(float(otv_loc[i].Z)/10)*10)) + '|' + str(int(lenth[i])) + '|' + str(int(width[i]))+ '|' + str(int(depth[i])) + '|' + str(rot)
	str_list.Add(strrr.replace('.', ','))


for i, sd in enumerate(IN[1]):
	split_list = split_string(sd,'|')
	new_str=''
	if len(sd) == 8:
		ver = split_list.pop(1)
		#for i in split_list:
			#x+=i
		#if x == str_list[i]:
			#pereneseno.Add(0)
		#else:
			#pereneseno.Add(1)
		newver = ver+str_list[i]
		
	if len(sd) == 9:
		ver = split_list.pop(0)
		
		x = ''
		#for i in split_list:
			#x+=i
		#if x == str_list[i]:
			#pereneseno.Add('Не перенесено')
		#else:
			#pereneseno.Add('Перенесено')			
		newver = ver+str_list[i]
		
	else:
		try:
			ver = split_list.pop(0)
			newver = ver+'|'+str_list[i]
		except:
		
			newver = 'V0|'+str_list[i]
		#pereneseno.Add('Не перенесено')
	ver_list.Add(newver)
	
	if str_list[i][:-4]	in sd or sd =='':
		pereneseno.Add('Не перенесено')
	else:
		pereneseno.Add('Перенесено')
		

cor_ver = []
for i,j in zip(IN[1],ver_list):
	i= split_string(i,'|')
	try:
		
		cor_ver.append(j+'|'+i[8])
	except:
		cor_ver.append(j)

cor_perenes = []

for i,j in zip(cor_ver,pereneseno):
	if 'V0' in i:
		cor_perenes.append('Не перенесено')
	else:
		cor_perenes.append(j)




OUT = [cor_ver, cor_perenes]	
# ----------------------------------------
code_block_160 = CodeBlock(x=python_script_88) { x[0]; x[1]; }
setParameterByName_29 = Element.SetParameterByName(element=code_block_143.out0, parameterName=code_block_159, value=code_block_160.out0)
code_block_161 = CodeBlock(x=setParameterByName_29) { x; }

# group: Заполнение истории перемещения и параметра перемещено
code_block_162 = CodeBlock { "SD_Позиции задания"; }
code_block_163 = CodeBlock { "SD_Версия задания"; }
getParameterValueByName_47 = Element.GetParameterValueByName(element=code_block_161, parameterName=code_block_163)
code_block_164 = CodeBlock { "SD_Позиции задания"; }
getParameterValueByName_48 = Element.GetParameterValueByName(element=code_block_161, parameterName=code_block_164)

python_script_89 = Python(IN[0]=code_block_161, IN[1]=getParameterValueByName_47, IN[2]=getParameterValueByName_48)
# ---------- python_script_89.python (220 lines) ----------
# Загрузить стандартную библиотеку Python и библиотеку DesignScript
import sys
import clr
clr.AddReference('ProtoGeometry')
clr.AddReference('RevitAPI')
import Autodesk
from Autodesk.Revit.DB import *
from Autodesk.DesignScript.Geometry import *

clr.AddReference('RevitServices')
import RevitServices
from RevitServices.Persistence import DocumentManager
from RevitServices.Transactions import TransactionManager
import math
import re
doc = DocumentManager.Instance.CurrentDBDocument
# Введенные в этом узле данные сохраняется в виде списка в переменных IN.




def angle(angles):
	 
	OUT = []
	list=[]
	OUT1 =[]
	# Разместите код под этой строкой
	for angle in angles:
		if 315<=angle<=360:
			angle-=315
		elif 270<=angle<315:
			angle-=270
		elif 225<=angle<=270:
			angle-=225
		elif 180<=angle<=225:
			angle-=180
			
		elif 135<=angle<=180:
			angle-=135
			
		elif 90<=angle<=135:
			angle-=90
		
		elif 45<=angle<=90:
			angle-=45
			
		elif 45<=angle<=0:
			angle-=0
		else:
			angle=angle
		list.Add(round(angle,2))
		
	for angle in list:
		if angle >= 22.5:
			if angle>=33.4:
				angle = 45-angle
			else:
				angle = angle-22.5		
		elif angle < 22.5:
			angle=angle
		OUT1.Add(angle)
		
	return OUT1


def split_string(source,separators):
    return re.split('[{0}]'.format(re.escape(separators)),source)




# созданные функции

def get_parameters_elements(otvs, strr):	
	out_list1=[]
	out_list=[]
	otv_lenth =[]
	for model in otvs:
		out_list.append(model.Name)
			
	elUnwrap = UnwrapElement(otvs)
	sum=0
	for i in elUnwrap:
		if out_list[sum] == -1:
			out_list1.append(-1)
			sum+=1
		else:
			sum+=1
			Db = i.GetParameters(strr)
			
			for i in Db:
				out_list1.append(i.AsValueString())
				
	for i in out_list1:
		i = round(int(i)/10,0)*10
		otv_lenth.Add(i)
	return otv_lenth
	

def get_parameters_elements5_round(otvs, strr):	
	out_list1=[]
	out_list=[]
	otv_lenth =[]
	for model in otvs:
		out_list.append(model.Name)
			
	elUnwrap = UnwrapElement(otvs)
	sum=0
	for i in elUnwrap:
		if out_list[sum] == -1:
			out_list1.append(-1)
			sum+=1
		else:
			sum+=1
			Db = i.GetParameters(strr)
			
			for i in Db:
				out_list1.append(i.AsValueString())
				
	for i in out_list1:
		x = round(int(i)/5)*5
		otv_lenth.Add(x)
	return otv_lenth



	
otvs= IN[0]
otv_rot =[]
otv_ver = IN[1]
otv_loc = []
otv_all_poss = IN[2]
OUT = []
new_loc_list = []
pereneseno =[]
last_loc_list = []



for i,otv in enumerate(UnwrapElement(otvs)):
	rot = math.degrees(otv.Location.Rotation)
	#rot = round(rot/10,0)*10
	otv_rot.Add(rot)

for i,otv in enumerate(otvs):
	otv_loc.Add(otv.Location)

#otv_rot=angle(otv_rot)

lenth = get_parameters_elements(otvs, "Ширина")
depth = get_parameters_elements5_round(otvs, "Глубина")
width = get_parameters_elements(otvs, "Высота")



# нахождение актуального месторасположения
for i, el in enumerate(otvs):
	if int(otv_rot[i]) == otv_rot[i]:
		rot = int(otv_rot[i])
	else:
		rot = otv_rot[i]
	strrr = str(int(round(float(otv_loc[i].X)/10)*10)) + '|' + str(int(round(float(otv_loc[i].Y)/10)*10)) + '|' + str(int(round(float(otv_loc[i].Z)/10)*10)) + '|' + str(int(lenth[i])) + '|' + str(int(width[i]))+ '|' + str(int(depth[i])) + '|' + str(rot)
	new_loc_list.Add(strrr.replace('.', ','))

#  нахождение фактического положения
for ver in otv_ver:
	ver_split = split_string(ver, '|')
	try:
		ver_split.pop(9)
	except:
		pass
	try:
		ver_split.pop(8)
	except:
		pass
	try:
		ver_split.pop(0)
	except:
		pass
	
	last_loc = ''
	for i in ver_split:
		last_loc+= i+ '|'
	last_loc = last_loc[:-1]+ ';'	
	last_loc_list.Add(last_loc)



new_all_possition = []
pereneseno = []


for new_position, last_poss, all_poss in zip(new_loc_list,last_loc_list,otv_all_poss):
	if new_position[:-4] not in all_poss:
		all_poss= new_position+all_poss
	if last_poss[:-4] not in all_poss:
		all_poss+= last_poss

	new_all_possition.Add(all_poss)

new_all_possition_out = []

for i,j,k in zip(IN[1],new_all_possition,new_loc_list):	
	if 'V0' in i:
		st = k
		new_all_possition_out.Add(st)
	else:
		new_all_possition_out.Add(j)


for i in new_all_possition_out:
	x = i.count(';')
	if x>1:
		pereneseno.Add('Перенесено')
	else:
		pereneseno.Add('Не перенесено')

OUT = [new_all_possition,pereneseno,new_loc_list,new_all_possition_out]		
	
#OUT = [new_all_possition,pereneseno]	
# ----------------------------------------

# group (continued): Заполнение истории перемещения и параметра перемещено
code_block_165 = CodeBlock(x=python_script_89) { x[1]; x[3]; }
setParameterByName_30 = Element.SetParameterByName(element=code_block_161, parameterName=code_block_162, value=code_block_165.out1)

code_block_166 = CodeBlock { "SD_Перенесено задание"; }
setParameterByName_31 = Element.SetParameterByName(element=code_block_161, parameterName=code_block_166, value=code_block_165.out0)
code_block_167 = CodeBlock { "SD_Перенесено задание"; }
setParameterByName_32 = Element.SetParameterByName(element=setParameterByName_27, parameterName=code_block_167, value=code_block_158.out0)
join_12 = List.Join(list0=all_elements_of_family_type_3, list1=all_elements_of_family_type)
code_block_168 = CodeBlock { "SD_Способ создания задания"; }
code_block_169 = CodeBlock { "SD_Версия задания"; }
getParameterValueByName_49 = Element.GetParameterValueByName(element=join_12, parameterName=code_block_169)
getParameterValueByName_50 = Element.GetParameterValueByName(element=join_12, parameterName=code_block_168)
python_script_90 = Python(IN[0]=getParameterValueByName_49, IN[1]=join_12, IN[2]=getParameterValueByName_50)
# ---------- python_script_90.python (33 lines) ----------
# Загрузить стандартную библиотеку Python и библиотеку DesignScript
import sys
import clr
clr.AddReference('ProtoGeometry')
from Autodesk.DesignScript.Geometry import *

# Введенные в этом узле данные сохраняется в виде списка в переменных IN.
import re

def split_string(source,separators):
    return re.split('[{0}]'.format(re.escape(separators)),source)
OUT = []
# Введенные в этом узле данные сохраняется в виде списка в переменных IN.
list1=[]
list2=[]
for i,j in zip(IN[0],IN[2]):
	
	if i =='' or j == "ВРУЧНУЮ" or 'V' not in i:
		list1.Add("ВРУЧНУЮ")
	else:
		list1.Add("СКРИПТ")
		
	
	if 'V' not in i:
		st = 'V0' +i
		list2.Add(st)
	else:
		list2.Add(i)


OUT = [list1,list2]	
	
	
# ----------------------------------------
code_block_170 = CodeBlock(x=python_script_90) { x[0]; x[1]; }
setParameterByName_33 = Element.SetParameterByName(element=join_12, parameterName=code_block_168, value=code_block_170.out0)
setParameterByName_34 = Element.SetParameterByName(element=join_12, parameterName=code_block_169, value=code_block_170.out1)
python_script_91 = Python(IN[0]=getItemAtIndex_7)
# ---------- python_script_91.python (41 lines) ----------
# Загрузить стандартную библиотеку Python и библиотеку DesignScript
import sys
import clr
clr.AddReference('ProtoGeometry')
from Autodesk.DesignScript.Geometry import *

# Введенные в этом узле данные сохраняется в виде списка в переменных IN.


def c2p(s):
	if "," in s:
		return s.replace(",", ".")
	else:
		return s

def num(s):
    try:
    	return float(s)
    except:
    	return s

def toInt(s):
	try:
		if s % 1 == 0:
			return int(s)
		else:
			return s
	except:
		return s
		
def co(s):
	return toInt(num(c2p(s)))
	
def cn(s):
	if (isinstance(s, list)):
		return [cn(i) for i in s]
	else:
		return co(s)

OUT = [cn(i) for i in IN[0]]
# Разместите код под этой строкой
# ----------------------------------------
python_script_поворот_отверстия = Python(IN[0]=byPointAndLevel, IN[1]=python_script_91, IN[2]=byCoordinates)
# ---------- python_script_поворот_отверстия.python (70 lines) ----------
#Alban de Chasteigner 2020
#twitter : @geniusloci_bim
#geniusloci.bim@gmail.com
#https://github.com/albandechasteigner/GeniusLociForDynamo

import clr
clr.AddReference("RevitNodes")
import Revit
clr.ImportExtensions(Revit.GeometryConversion)

clr.AddReference("RevitAPI")
import Autodesk
from Autodesk.Revit.DB import *
import math

clr.AddReference("RevitServices")
import RevitServices
from RevitServices.Persistence import DocumentManager
from RevitServices.Transactions import TransactionManager
doc = DocumentManager.Instance.CurrentDBDocument

elements = UnwrapElement(IN[0]) if isinstance(IN[0],list) else [UnwrapElement(IN[0])]
angles = [i* math.pi/180 for i in IN[1]] if isinstance(IN[1],list) else [IN[1]* math.pi/180]

def GetCropBox(view):
	provider= ParameterValueProvider(ElementId(BuiltInParameter.ID_PARAM))
	rule = FilterElementIdRule(provider, FilterNumericEquals(), view.Id )
	filter= ElementParameterFilter(rule)
	return doc.GetElement(FilteredElementCollector(view.Document).WherePasses(filter).ToElementIds().Find(lambda x: x.IntegerValue != view.Id.IntegerValue))
test_list = []

test_list2 = []
TransactionManager.Instance.EnsureInTransaction(doc)
for angle, element,lloc in zip(angles, elements,IN[2]):
	#if angle>math.pi:
		#angle=abs(angle-2*math.pi)
	#else:angle
	#Get initial Rotation Angle using transform
	#transform=element.GetTransform()
	#vectorTran = transform.OfVector(transform.BasisX)
	#rot = transform.BasisX.AngleOnPlaneTo(vectorTran, transform.BasisZ) 
	#rot = rot * (180 / math.pi)
	if hasattr(element, "Location"):
		loc = element.Location
		if loc:
			test_list2.append("loc")		
			# Annotation symbol, importInstance and linkInstance
			if hasattr(element, "GetTotalTransform"):
				trans=element.GetTotalTransform()
				loca = trans.Origin
				loca = XYZ(lloc.X/304.8,lloc.Y/304.8,lloc.Z/304.8)
				rot = -trans.BasisX.AngleOnPlaneTo(XYZ.BasisX, XYZ.BasisZ)
				

	line = Line.CreateBound(loca, XYZ(loca.X,loca.Y,loca.Z+1))
	#Set Rotation
	Autodesk.Revit.DB.ElementTransformUtils.RotateElement(doc, element.Id, line, angle-rot)
	
	test_list.Add([loca,rot])
TransactionManager.Instance.TransactionTaskDone()

if isinstance(IN[0], list): OUT = elements
else: OUT = elements[0]

ttest = []
for element in elements:
	ttest.append(element.Category.Id)


OUT = [elements,angles,test_list,ttest,IN[2]]
# ----------------------------------------
python_script_92 = Python(IN[0]=getItemAtIndex_15)  # same code as python_script_91
python_script_поворот_отверстия_2 = Python(IN[0]=code_block_121, IN[1]=python_script_92, IN[2]=byCoordinates_2)  # same code as python_script_поворот_отверстия
setParameterByName_35 = Element.SetParameterByName(element=code_block_128.out1, parameterName=code_block_117.out0, value=code_block_117.out1)
setParameterByName_36 = Element.SetParameterByName(element=code_block_129.out1, parameterName=code_block_83.out0, value=code_block_83.out1)
flatten_25 = List.Flatten(list=ofRepeatedItem_2)
flatten_26 = List.Flatten(list=ofRepeatedItem)
flatten_27 = List.Flatten(list=pointAtParameter)
flatten_28 = List.Flatten(list=полная_ширина.out3)
flatten_29 = List.Flatten(list=полная_высота.out1)
flatten_30 = List.Flatten(list=angleWithVector)
python_script_93 = Python(IN[0]=flatten_30)
# ---------- python_script_93.python (49 lines) ----------
# Загрузить стандартную библиотеку Python и библиотеку DesignScript
import sys
import clr
clr.AddReference('ProtoGeometry')
from Autodesk.DesignScript.Geometry import *

# Введенные в этом узле данные сохраняется в виде списка в переменных IN.
angles = IN[0]
OUT = []
list=[]
OUT1 =[]
# Разместите код под этой строкой
for angle in angles:
	if 315<=angle<=360:
		angle-=315
	elif 270<=angle<315:
		angle-=270
	elif 225<=angle<=270:
		angle-=225
	elif 180<=angle<=225:
		angle-=180
		
	elif 135<=angle<=180:
		angle-=135
		
	elif 90<=angle<=135:
		angle-=90
	
	elif 45<=angle<=90:
		angle-=45
		
	elif 45<=angle<=0:
		angle-=0
	else:
		angle=angle
	list.Add(round(angle,2))
	
for angle in list:
	if angle >= 22.5:
		if angle>=33.4:
			angle = 45-angle
		else:
			angle = angle-22.5		
	elif angle < 22.5:
		angle=angle
	OUT1.Add(angle)
	
OUT.Add(OUT1)		
# Назначьте вывод переменной OUT.
# ----------------------------------------
flatten_31 = List.Flatten(list=python_script_9)
flatten_32 = List.Flatten(list=code_block_19)
uniqueItems_3 = List.UniqueItems(list=element_host_5)
setDifference_10 = List.SetDifference(list1=uniqueItems_3, list2=flatten_9)
setDifference_11 = List.SetDifference(list1=flatten_9, list2=uniqueItems_3)

# group: Вводим исходные данные
наименование_типа_семейства_7 = CodeBlock { "(Отв_Задание)_Перекрытия_Прямоугольное"; }

# group: Проверка: семейство загружено в документ?
byName_7 = Family.ByName(name=наименование_типа_семейства_7)
isNull_6 = Object.IsNull(obj=byName_7)
code_block_171 = CodeBlock { "Не загружено семейство "; "ОК"; }
concat = String.Concat(string0=code_block_171.out0, string1=наименование_типа_семейства_7)
if_ = If(test=isNull_6, true=concat, false=code_block_171.out1)

n3_1_проверка_семейства = Watch(if_)  # "3.1 Проверка семейства (Перекрытия):"

# group: Вводим исходные данные
наименование_типа_семейства_8 = CodeBlock { "(Отв_Задание)_Стены_Прямоугольное"; }

# group: Проверка: семейство загружено в документ?
byName_8 = Family.ByName(name=наименование_типа_семейства_8)
isNull_7 = Object.IsNull(obj=byName_8)
code_block_172 = CodeBlock { "Не загружено семейство "; "ОК"; }
concat_2 = String.Concat(string0=code_block_172.out0, string1=наименование_типа_семейства_8)
if_2 = If(test=isNull_7, true=concat_2, false=code_block_172.out1)

n3_2_проверка_семейства_стены = Watch(if_2)  # "3.2 Проверка семейства (Стены):"
string_21 = StringInput("Запускать скрипт с плана, разреза, фасада, 3д вида!!")
напоминание = Watch(string_21)  # graph output

# group: параметр вводной
string_22 = StringInput("1.1 Создано новых заданий (стены)")

string_from_object = FromObject(obj=n1_1_создано_новых_заданий_стены)
python_script_94 = Python(IN[0]=string_22, IN[1]=string_from_object)  # unwired: IN[2]; same code as python_script_2

# group: Вводной параметр
string_23 = StringInput("1.2 Создано новых заданий (перекрытия)")

string_from_object_2 = FromObject(obj=n1_2_создано_новых_заданий)
python_script_95 = Python(IN[0]=string_23, IN[1]=string_from_object_2)  # unwired: IN[2]; same code as python_script_2

# group: Вводной параметр
string_24 = StringInput("2.1 Всего заданий в проекте было (стены)")

byName_9 = FamilyType.ByName(name=наименование_типа_семейства_8)
all_elements_of_family_type_5 = ElementsOfFamilyType(Family_Type=byName_9)
count_6 = List.Count(list=all_elements_of_family_type_5)
n2_2_всего_заданий_в_проекте_было = Watch(count_6)  # "2.2 Всего заданий в проекте было (стены):"; graph output
string_from_object_3 = FromObject(obj=n2_2_всего_заданий_в_проекте_было)
python_script_96 = Python(IN[0]=string_24, IN[1]=string_from_object_3)  # unwired: IN[2]; same code as python_script_2

# group: Вводной параметр
string_25 = StringInput("2.2 Всего заданий в проекте было (перекрытия)")

byName_10 = FamilyType.ByName(name=наименование_типа_семейства_7)
all_elements_of_family_type_6 = ElementsOfFamilyType(Family_Type=byName_10)
count_7 = List.Count(list=all_elements_of_family_type_6)
n2_1_всего_заданий_в_проекте_было = Watch(count_7)  # "2.1 Всего заданий в проекте было (перекрытия):"; graph output
string_from_object_4 = FromObject(obj=n2_1_всего_заданий_в_проекте_было)
python_script_97 = Python(IN[0]=string_25, IN[1]=string_from_object_4)  # unwired: IN[2]; same code as python_script_2

# group: Вводной параметр
string_26 = StringInput("BIM. отверстия в стенах")

join_13 = List.Join(list0=join_2, list1=join_3)
count_8 = List.Count(list=join_13)
bim_отверстия_в_стенах = Watch(count_8)
string_from_object_5 = FromObject(obj=bim_отверстия_в_стенах)
python_script_98 = Python(IN[0]=string_26, IN[1]=string_from_object_5)  # unwired: IN[2]; same code as python_script_2

# group: Вводной параметр
string_27 = StringInput("BIM. отверстий в перекрытиях")

string_from_object_6 = FromObject(obj=bim_отверстия_в_перекрытиях)
python_script_99 = Python(IN[0]=string_27, IN[1]=string_from_object_6)  # unwired: IN[2]; same code as python_script_2

# group: Вводной параметр
string_28 = StringInput("BIM. связанные файлы")

count_9 = List.Count(list=bim_связанные_файлы)
string_from_object_7 = FromObject(obj=count_9)
python_script_100 = Python(IN[0]=string_28, IN[1]=string_from_object_7)  # unwired: IN[2]; same code as python_script_2

# group: Вводной параметр
string_29 = StringInput("BIM. трубы/воздуховоды")

bim_трубы_воздуховоды = Watch(code_block_13)
count_10 = List.Count(list=bim_трубы_воздуховоды)
string_from_object_8 = FromObject(obj=count_10)
python_script_101 = Python(IN[0]=string_29, IN[1]=string_from_object_8)  # unwired: IN[2]; same code as python_script_2
list_create_4 = List.Create(item0=python_script_94, item1=python_script_95, item2=python_script_96, item3=python_script_97, item4=python_script_98, item5=python_script_99, item6=python_script_100, item7=python_script_101)

# group: Интерфейс
string_30 = StringInput("Завершить")
boolean_8 = BoolSelector(true)
string_31 = StringInput("Выходные данные")
string_32 = StringInput("Отмена")
code_block_173 = CodeBlock { 700; 800; 300; }

string_33 = StringInput("Q:\5. Скрипты Автоматизация\430_Отверстия\logo.png")
code_block_174 = CodeBlock { null; }
python_script_102 = Python(IN[0]=list_create_4, IN[1]=string_30, IN[2]=boolean_8, IN[3]=string_31, IN[4]=string_33, IN[5]=code_block_174, IN[6]=string_32, IN[7]=code_block_173.out0, IN[8]=code_block_173.out1, IN[9]=code_block_173.out2)
# ---------- python_script_102.python (2730 lines) ----------
#Copyright (c) Data Shapes,  2020
#Data-Shapes www.data-shapes.io , elayoubi.mostafa@data-shapes.io @data_shapes
	
import clr
import sys
pyt_path = r'C:\Program Files (x86)\IronPython 2.7\Lib'
sys.path.append(pyt_path)
import os
import webbrowser
import unicodedata
import io
import tempfile
import System
	
try:
	clr.AddReference('System.Windows.Forms')
	clr.AddReference('System.Drawing')
	clr.AddReference('System.Windows.Forms.DataVisualization')
	
	from System.Drawing import Point , Size , Graphics, Bitmap, Image, Font, FontStyle, Icon, Color, Region , Rectangle , ContentAlignment , SystemFonts, FontFamily
	from System.Windows.Forms import Application, DockStyle, Button, Form, Label, TrackBar , ToolTip, ColumnHeader, TextBox, CheckBox, FolderBrowserDialog, OpenFileDialog, DialogResult, ComboBox, FormBorderStyle, FormStartPosition, ListView, ListViewItem , SortOrder, Panel, ImageLayout, GroupBox, RadioButton, BorderStyle, PictureBox, PictureBoxSizeMode, LinkLabel, CheckState, ColumnHeaderStyle , ImageList, VScrollBar, DataGridView, DataGridViewSelectionMode, DataGridViewAutoSizeColumnsMode , DataGridViewClipboardCopyMode , TreeView , TreeNode , TreeNodeCollection , AutoScaleMode , Screen, Padding
	from System.Windows.Forms.DataVisualization.Charting import *#Chart , SeriesChartType
	from System.Collections.Generic import *
	from System.Collections.Generic import List as iList
	from System.Windows.Forms import View as vi
	clr.AddReference('System')
	from System import IntPtr , Char
	from System import Type as SType, IO
	from System import Array
	from System.ComponentModel import Container
	clr.AddReference('System.Data')
	from System.Data import DataTable , DataView

	try: #try to import All Revit dependencies
		clr.AddReference('RevitAPIUI')
		from  Autodesk.Revit.UI import Selection , TaskDialog 
		from  Autodesk.Revit.UI.Selection import ISelectionFilter
		clr.AddReference('RevitNodes')
		import Revit
		clr.ImportExtensions(Revit.Elements)
		clr.ImportExtensions(Revit.GeometryConversion)
		
		clr.AddReference('RevitServices')
		from RevitServices.Persistence import DocumentManager
		doc = DocumentManager.Instance.CurrentDBDocument
		uidoc = DocumentManager.Instance.CurrentUIApplication.ActiveUIDocument
	
		clr.AddReference('RevitAPI')
		try:
			from Autodesk.Revit.DB import ImageImportOptions	
		except:
			from Autodesk.Revit.DB import ImageTypeOptions , ImageType, ImagePlacementOptions , ImageInstance
		from Autodesk.Revit.DB import FilteredElementCollector , Transaction, View , ViewType , ViewFamily, ViewDrafting, ViewFamilyType, Element, ElementId , FamilyInstance , Document , XYZ, BoxPlacement, UnitUtils
		
		try:
			from Autodesk.Revit.DB import  UnitType
		except:
			from Autodesk.Revit.DB import SpecTypeId

		dbviews = [v for v in FilteredElementCollector(doc).OfClass(View).ToElements() if (v.ViewType == ViewType.FloorPlan or v.ViewType == ViewType.CeilingPlan or v.ViewType == ViewType.Section or v.ViewType == ViewType.Elevation or v.ViewType == ViewType.ThreeD)]
		viewindex = 0
		try:
			UIunit = Document.GetUnits(doc).GetFormatOptions(UnitType.UT_Length).DisplayUnits
		except:
			UIunit = Document.GetUnits(doc).GetFormatOptions(SpecTypeId.Length).GetUnitTypeId()
			
		class selectionfilter(ISelectionFilter):
			def __init__(self,category):
				self.category = category
			def AllowElement(self,element):
				if element.Category.Name in [c.Name for c in self.category]:
					return True
				else:
					return False
			def AllowReference(reference,point):
				return False


			
	except: #in case we are in the Sandbox, Formit or Civil 3D environment
		pass
	
	importcolorselection = 0
	
	try:
		from  Autodesk.Revit.UI import ColorSelectionDialog
	except:
		importcolorselection = 1
	

	
	clr.AddReference('ProtoGeometry')
	from Autodesk.DesignScript.Geometry import Point as dsPoint

	from System.Reflection import Assembly
	import xml.etree.ElementTree as et
	

	
	import re	
	def regexEndNum(input):
		try:
			return 	re.search('(\d+)$', input).group(0)
		except:
			return ""

	def iterateThroughNodes(collection,li):
		if hasattr(collection,'Nodes'):
			ntest = collection.Nodes
			if len(ntest) > 0:
				for i in ntest:
					iterateThroughNodes(i,li)
			else:
				if collection.Checked:
					li.append(collection.Tag)
		return li
		

	
	class MultiTextBoxForm(Form):
		
	    def __init__(self):
	        self.Text = 'strana development'
	        self.output = []
	        self.values = []
	        self.cancelled = False
	
	    def setclose(self, sender, event):
	    	cbindexread = 0
	    	if sender.Name != "Cancel":
	    		for f in self.output:
	    			if f.GetType() == myTextBox:
	    				if f._isNum :
	    					val = float(f.Text)
	    				else:
	    					val = f.Text
	    				self.values.append(val)
	    			if f.GetType() == CheckBox:
	    				self.values.append(f.Checked)
	    			if f.GetType() == Button:
	    				if isinstance(f.Tag ,list):
	    					try:
	    						self.values.append([e for e in f.Tag if e.__class__.__name__ != "Category"])	    					
	    					except:
	    						self.values.append(f.Tag)	    					
	    				else:
	    					try:	    				
	    						if f.Tag.__class__.__name__ != "Category":
	    							self.values.append(f.Tag)
	    						else:
    								self.values.append([])
	    					except:
	    						self.values.append(f.Tag)	
	    			if f.GetType() == ComboBox:
	    				try:
	    					key = f.Text
	    					self.values.append(f.Tag[key])
	    				except:
	    					self.values.append(None)
	    			if f.GetType() == mylistview:
	    				self.values.append([f.Values[i.Text] for i in f.CheckedItems])
	    			if f.GetType() == mytrackbar:
	    				self.values.append(f.startval+f.Value*f.step)
	    			if f.GetType() == mygroupbox:
	    				try:
	    					key = [j.Text for j in f.Controls if j.Checked == True][0]
	    					self.values.append(f.Tag[key])
	    				except:
	    					self.values.append(None)
	    			if f.GetType() == myDataGridView:
	    				f.EndEdit()
	    				dsrc = f.DataSource
	    				out = []
	    				colcount = f.ColumnCount
	    				rowcount = f.RowCount - 1
	    				if f.Tag:
		    				l = []
	    					for i in range(colcount):	    						
	    						l.append(dsrc.Columns[i].ColumnName)
	    					out.append(l)	    						
		    				for r in range(rowcount):
		    					l = []
		    					for i in range(colcount):
		    						l.append(dsrc.DefaultView[r].Row[i])
		    					out.append(l)
	    				else: 
		    				for r in range(rowcount):
		    					l = []
		    					for i in range(colcount):
		    						l.append(dsrc.DefaultView[r].Row[i])
		    					out.append(l)
	    				self.values.append(out)
	    			if f.GetType() == TreeView:
	    				ls = []
	    				nds = f.Nodes[0]
	    				iterateThroughNodes(nds,ls)
	    				self.values.append(ls)
	    			if f.GetType() == GroupBox:
	    				rb = [c for c in f.Controls if c.GetType() == RadioButton and c.Checked][0]
	    				self.values.append(rb.Text)
	    				f.Controls.Remove(rb)
	    	else:
	    		self.values = None
	    		self.cancelled = True
	    	self.Close()
	
	    def reset(self, sender, event):
			pass
	
	    def openfile(self, sender, event):
			ofd = OpenFileDialog()
			dr = ofd.ShowDialog()
			if dr == DialogResult.OK:
				sender.Text = ofd.FileName
				sender.Tag = ofd.FileName

	    def exportToExcel(self, sender, event):
	    	#importing Excel IronPython libraries
	    	clr.AddReferenceByName('Microsoft.Office.Interop.Excel, Version=11.0.0.0, Culture=neutral, PublicKeyToken=71e9bce111e9429c')
	    	from Microsoft.Office.Interop import Excel
	    	ex = Excel.ApplicationClass()
	    	ex.Visible = sender.Tag[1]
	    	ex.DisplayAlerts = False
	    	fbd = FolderBrowserDialog()
	    	fbd.SelectedPath = sender.Text
	    	parent = sender.Parent
	    	fptextbox = parent.GetChildAtPoint(Point(parent.Location.X,sender.Location.Y+5*yRatio))
	    	dataGrid = parent.GetChildAtPoint(Point(parent.Location.X,parent.Location.Y+23*xRatio))
	    	dataTable = dataGrid.DataSource
	    	fptext = fptextbox.Text
	    	titletext = parent.GetChildAtPoint(Point(0,0)).Text
	    	dr = fbd.ShowDialog()
	    	frstRwTtle = sender.Tag[0]
	    	if frstRwTtle:
	    		_header = Excel.XlYesNoGuess.xlYes
	    	else:
	    		_header = Excel.XlYesNoGuess.xlNo
	    	if dr == DialogResult.OK:
	    		workbk = ex.Workbooks.Add()
	    		worksheet = workbk.Worksheets.Add()
	    		#Writing title and doc info
	    		if sender.Tag[2]:
		    		titleCell = worksheet.Cells[1,1]
		    		worksheet.Cells[2,1].Value2 = sender.Tag[3]
		    		titleCell.Value2 = titletext
		    		titleCell.Font.Size = 18
		    		titleCell.Font.Bold = True
		    		startR = 3
		    		endR = 3
		    	else:
		    		startR = 1
		    		endR = 0	
		    	if frstRwTtle:
		    		for j in range(0,dataTable.Columns.Count):
		    			worksheet.Cells[startR,j+1] = dataTable.Columns[j].ColumnName		    	
		    		for i in range(0,dataTable.Rows.Count):
		    			for j in range(0,dataTable.Columns.Count):
			    			worksheet.Cells[i+startR+1,j+1] = dataTable.DefaultView[i].Row[j].ToString()
		    		xlrange = ex.get_Range(worksheet.Cells[startR,1],worksheet.Cells[dataTable.Rows.Count+endR+1,dataTable.Columns.Count])			    			
		    	else :
		    		for i in range(0,dataTable.Rows.Count):
		    			for j in range(0,dataTable.Columns.Count):
			    			worksheet.Cells[i+startR,j+1] = dataTable.DefaultView[i].Row[j].ToString()		    	
		    		xlrange = ex.get_Range(worksheet.Cells[startR,1],worksheet.Cells[dataTable.Rows.Count+endR,dataTable.Columns.Count])
		    	xlrange.Columns.AutoFit()
		    	worksheet.ListObjects.Add(Excel.XlListObjectSourceType.xlSrcRange, xlrange, SType.Missing, _header, SType.Missing).Name = "DataShapesTable"
		    	worksheet.ListObjects["DataShapesTable"].TableStyle =  "TableStyleMedium16"
	    		workbk.SaveAs(fbd.SelectedPath + "\\" + fptext)
	    		if not sender.Tag[1]:
	    			workbk.Close()
	    			ex.Quit()

	    def startCell(self, sender, event ):
			sender.startcell["X"] = event.ColumnIndex
			sender.startcell["Y"] = event.RowIndex	

	    def endCell(self, sender, event ):
	    	try:
				sender.endcell["X"] = event.ColumnIndex
				sender.endcell["Y"] = event.RowIndex 
				startval = sender.Rows[sender.startcell["Y"]].Cells[sender.startcell["X"]].Value
				endNum = regexEndNum(startval)
				if endNum != "":
					if sender.endcell["Y"] == sender.startcell["Y"]:
						for e,i in enumerate(range(sender.startcell["X"],sender.endcell["X"] + 1)):
							sender.Rows[sender.startcell["Y"]].Cells[i].Value = startval[:-len(endNum)] + str(int(endNum) + e)
					elif sender.endcell["X"] == sender.startcell["X"]:
						for e,i in enumerate(range(sender.startcell["Y"],sender.endcell["Y"] + 1)):
							sender.Rows[i].Cells[sender.endcell["X"]].Value = startval[:-len(endNum)] + str(int(endNum) + e)
				else:				
					if sender.endcell["Y"] == sender.startcell["Y"]:
						for i in range(sender.startcell["X"],sender.endcell["X"] + 1):
							sender.Rows[sender.startcell["Y"]].Cells[i].Value = startval
					elif sender.endcell["X"] == sender.startcell["X"]:
						for i in range(sender.startcell["Y"],sender.endcell["Y"] + 1):
							sender.Rows[i].Cells[sender.endcell["X"]].Value = startval
	    	except:
	    		pass
	    		    	
	    def startRowDrag(self, sender, event ):
	    	shmak
			
	    def opendirectory(self, sender, event):
			fbd = FolderBrowserDialog()
			fbd.SelectedPath = sender.Text
			dr = fbd.ShowDialog()
			if dr == DialogResult.OK:
				sender.Text = fbd.SelectedPath
				sender.Tag = fbd.SelectedPath
	
	    def pickobjects(self, sender, event):   
			for c in self.Controls:
				c.Enabled = False
			try:
				sel = uidoc.Selection.PickObjects(Selection.ObjectType.Element,'')
				selelem = [doc.GetElement(s.ElementId) for s in sel]
				sender.Tag = (selelem)
			except:
				pass
			for c in self.Controls:
				c.Enabled = True
		#THIS METHOD IS FOR CIVIL 3D EVIRONMENT
	    def pickautocadobjects(self, sender, event):   
			selelem = []	
			for c in self.Controls:
				c.Enabled = False
			try:
				acadDoc = System.Runtime.InteropServices.Marshal.GetActiveObject("Autocad.Application").ActiveDocument
				acadDoc.Activate()
				acadUser = acadDoc.GetVariable("users5")	
				acadDoc.SendCommand("(and(princ\042"+ sender.Text + "\042)(setq ss(ssget))(setvar\042users5\042\042LinkDWGUIOK\042)(command\042_.Select\042ss\042\042)) ")
				selection_ = acadDoc.ActiveSelectionSet
				acadDoc.SendCommand("(setq ss nil) ")
				if acadDoc.GetVariable("users5") == "LinkDWGUIOK" and selection_ != None:
					for sel in selection_:				
						selelem.append(sel)		
					acadDoc.SetVariable("users5", acadUser)
				sender.Tag = list(selelem)		
			except:
				pass
			for c in self.Controls:
				c.Enabled = True	

	    def pickautocadobject(self, sender, event):   
			selelem = None	
			for c in self.Controls:
				c.Enabled = False
			try:
				acadDoc = System.Runtime.InteropServices.Marshal.GetActiveObject("Autocad.Application").ActiveDocument
				acadUser = acadDoc.GetVariable("users5")
				acadPickBox = acadDoc.GetVariable("pickbox")
				acadDoc.SetVariable("pickbox", 5)
				acadDoc.Activate()
				acadDoc.SendCommand("(setq obj(car(entsel\042" + sender.Text + "\042))) ")
				acadDoc.SendCommand("(and obj(setvar\042users5\042(cdr(assoc 5(entget obj))))(setq obj nil)) ")		
				selection_ = acadDoc.GetVariable("users5")
				acadDoc.SetVariable("pickbox", acadPickBox)
				acadDoc.SetVariable("users5", acadUser)
				selelem = acadDoc.HandleToObject(selection_)
				sender.Tag = selelem		
			except:
				pass
			for c in self.Controls:
				c.Enabled = True	

	    def pickobjectsordered(self, sender, event):
			for c in self.Controls:
				c.Enabled = False
			output = []
			test = True
			TaskDialog.Show("Data|Shapes", 'Pick elements in order, then hit ESC to exit.')
			while test:
				try:
					sel = doc.GetElement(uidoc.Selection.PickObject(Selection.ObjectType.Element, 'Pick elements in order').ElementId)
					output.append(sel.ToDSType(True))
				except : 
					test = False
				sender.Tag = output
			for c in self.Controls:
				c.Enabled = True
	    
	    def pickobjectsofcatordered(self, sender, event):
			for c in self.Controls:
				c.Enabled = False
			output = []
			test = True
			if isinstance(sender.Tag,list):			
				category = UnwrapElement(sender.Tag)
			else:
				category = [UnwrapElement(sender.Tag)]
			TaskDialog.Show("Data|Shapes", 'Select %s in order, then press ESC to exit.' %(', '.join([c.Name for c in category])))
			while test:
				try:
					selfilt = selectionfilter(category)
					sel = doc.GetElement(uidoc.Selection.PickObject(Selection.ObjectType.Element,selfilt, 'Select %s' %(', '.join([c.Name for c in category]))).ElementId)				
					output.append(sel.ToDSType(True))
				except : 
					test = False
				sender.Tag = (output)
			for c in self.Controls:
				c.Enabled = True
			
	    def picklinkedobjects(self, sender, event):
			#This part was made easier by Dimitar Venkov's work
			for c in self.Controls:
				c.Enabled = False
			try:
				linkref = uidoc.Selection.PickObject(Selection.ObjectType.Element,'Select the link instance.')
				link = doc.GetElement(linkref.ElementId).GetLinkDocument()
				td = TaskDialog.Show('Data-Shapes','Select the linked elements and press Finish.')
				sel = uidoc.Selection.PickObjects(Selection.ObjectType.LinkedElement,'Select the linked elements and press Finish.')
				selelem = [link.GetElement(s.LinkedElementId) for s in sel]
				sender.Tag = (selelem)
			except:
				pass
			for c in self.Controls:
				c.Enabled = True		

	    def pickobject(self, sender, event):
			for c in self.Controls:
				c.Enabled = False
			try:
				sel = uidoc.Selection.PickObject(Selection.ObjectType.Element,'')
				selelem = doc.GetElement(sel.ElementId) 
				sender.Tag = (selelem)
			except:
				pass
			for c in self.Controls:
				c.Enabled = True
			
	    def picklinkedobject(self, sender, event):
			#This part was made easier by Dimitar Venkov's work
			for c in self.Controls:
				c.Enabled = False
			try:
				linkref = uidoc.Selection.PickObject(Selection.ObjectType.Element,'Select the link instance.')
				link = doc.GetElement(linkref.ElementId).GetLinkDocument()
				td = TaskDialog.Show('Data-Shapes','Select the linked element.')
				sel = uidoc.Selection.PickObject(Selection.ObjectType.LinkedElement,'Select the linked element.')
				selelem = link.GetElement(sel.LinkedElementId)
				sender.Tag = (selelem)
			except:
				pass				
			for c in self.Controls:
				c.Enabled = True
			
	    def pickobjectsofcat(self, sender, event):
			for c in self.Controls:
				c.Enabled = False
			if isinstance(sender.Tag,list):	    
				category = UnwrapElement(sender.Tag)
			else:
				category = [UnwrapElement(sender.Tag)]
			try:
				selfilt = selectionfilter(category)
				sel = uidoc.Selection.PickObjects(Selection.ObjectType.Element,selfilt,'Select %s' %(', '.join([c.Name for c in category])))
				selelem = [doc.GetElement(s.ElementId) for s in sel]
				sender.Tag = (selelem)
			except:
				pass
			for c in self.Controls:
				c.Enabled = True

	    def pickobjectofcat(self, sender, event):
			for c in self.Controls:
				c.Enabled = False
			if isinstance(sender.Tag,list):	    
				category = UnwrapElement(sender.Tag)
			else:
				category = [UnwrapElement(sender.Tag)]
			try:
				selfilt = selectionfilter(category)
				sel = uidoc.Selection.PickObject(Selection.ObjectType.Element,selfilt,'Select %s' %(', '.join([c.Name for c in category])))
				selelem = doc.GetElement(sel.ElementId) 
				sender.Tag = (selelem)
			except:
				pass
			for c in self.Controls:
				c.Enabled = True
			
	    def pickfaces(self, sender, event):
			faces = []	    	
			for c in self.Controls:
				c.Enabled = False
			try:
				selface = uidoc.Selection.PickObjects(Selection.ObjectType.Face,'')
				for s in selface:
					f = uidoc.Document.GetElement(s).GetGeometryObjectFromReference(s).ToProtoType(True)
					[i.Tags.AddTag("RevitFaceReference", s) for i in f]
					faces.append(f)
				sender.Tag = [i for j in faces for i in j]
			except:
				pass
			for c in self.Controls:
				c.Enabled = True
				
	    def pickpointsonface(self, sender, event):
			faces = []	    	
			for c in self.Controls:
				c.Enabled = False
			selpoints = uidoc.Selection.PickObjects(Selection.ObjectType.PointOnElement,'')
			points = []
			for s in selpoints:
				pt = s.GlobalPoint
				points.append(dsPoint.ByCoordinates(UnitUtils.ConvertFromInternalUnits(pt.X,UIunit),UnitUtils.ConvertFromInternalUnits(pt.Y,UIunit),UnitUtils.ConvertFromInternalUnits(pt.Z,UIunit)))
			sender.Tag = points
			for c in self.Controls:
				c.Enabled = True
				
	    def pickedges(self, sender, event):
			edges = []
			for c in self.Controls:
				c.Enabled = False	
			try:				
				seledge = uidoc.Selection.PickObjects(Selection.ObjectType.Edge,'')
				for s in seledge:
					e = uidoc.Document.GetElement(s).GetGeometryObjectFromReference(s).AsCurve().ToProtoType(True)
					e.Tags.AddTag("RevitFaceReference", s)
					edges.append(e)
				sender.Tag = edges
			except:
				pass
			for c in self.Controls:
				c.Enabled = True

	    def colorpicker(self, sender, event):
			dialog = ColorSelectionDialog()
			selection = ColorSelectionDialog.Show(dialog)
			selected = dialog.SelectedColor
			sender.Tag = selected
			sender.BackColor = Color.FromArgb(selected.Red,selected.Green,selected.Blue)
			sender.ForeColor = Color.FromArgb(selected.Red,selected.Green,selected.Blue)
	
	    def topmost(self):
			self.TopMost = True
	
	    def lvadd(self, sender, event):
			sender.Tag = [i for i in sender.CheckedItems]
			
	    def scroll(self, sender, event):
			parent = sender.Parent
			child = parent.GetChildAtPoint(Point(0,5*yRatio))
			child.Text = str(sender.startval+sender.Value*sender.step)

	    def openurl(self, sender, event):
			webbrowser.open(sender.Tag)
	
	    def selectall(self, sender, event):
			if sender.Checked:
				parent = sender.Parent
				listview = parent.GetChildAtPoint(Point(0,0))
				for i in listview.Items:
					i.Checked = True
			else:
				pass
				
	    def selectnone(self, sender, event):
			if sender.Checked:
				parent = sender.Parent
				listview = parent.GetChildAtPoint(Point(0,0))
				for i in listview.Items:
					i.Checked = False
			else:
				pass		

	    def updateallnone(self, sender, event):
	    	try:
	    		parent = sender.Parent
	    		rball = parent.GetChildAtPoint(Point(0,sender.Height + 5*yRatio))
	    		rbnone = parent.GetChildAtPoint(Point(80 * xRatio,sender.Height + 5*yRatio))
	    		if sender.CheckedItems.Count == 0 and event.NewValue == CheckState.Unchecked:
	    			rbnone.Checked = False
	    			rball.Checked = False
	    		elif sender.CheckedItems.Count == sender.Items.Count and event.NewValue == CheckState.Unchecked:
	    			rball.Checked = False
	    			rbnone.Checked = False
	    		elif sender.CheckedItems.Count == sender.Items.Count-1 and event.NewValue == CheckState.Checked:
	    			rball.Checked = True
	    			rbnone.Checked = False
	    		elif sender.CheckedItems.Count == 1 and event.NewValue == CheckState.Unchecked:
	    			rball.Checked = False
	    			rbnone.Checked = True	    	
	    		else :
	    			rball.Checked = False
	    			rbnone.Checked = False
	    	except:
	    		pass

	    def zoomcenter(self, sender, event ):
			if event.X > 15:	    
				try:
					element = doc.GetElement(uidoc.Selection.GetElementIds()[0])
					uidoc.ShowElements(element)
				except:
					pass
			else:
				pass
				
			
	    def setviewforelement(self, sender, event ):    
			if event.X > 15*xRatio:	    		
				try:
					item = sender.GetItemAt(event.X,event.Y).Text
					element = UnwrapElement(sender.Values[item])
					try:
						viewsforelement = [v for v in dbviews if (not v.IsTemplate) and (element.Id in [e.Id for e in FilteredElementCollector(doc,v.Id).OfClass(element.__class__).ToElements()])]
					except:
						viewsforelement = [v for v in dbviews if (not v.IsTemplate) and (element.Id in [e.Id for e in FilteredElementCollector(doc,v.Id).OfClass(FamilyInstance).ToElements()])]
					global viewindex
					dbView = viewsforelement[viewindex]
					id = [element.Id]
					icollection = iList[ElementId](id)
					uidoc.Selection.SetElementIds(icollection)
				except:
					pass
			else:	    
				pass


	    def CheckChildren(self, sender, event ):
			evNode = event.Node	    
			checkState = evNode.Checked	
			for n in event.Node.Nodes:	   	
				n.Checked = checkState			
				
	    def ActivateOption(self, sender, event ):
	    	parent = sender.Parent
	    	associatedControls = [p for p in parent.Controls if p.Name == sender.Text and p.GetType() == Panel][0]
	    	restofcontrols = [p for p in parent.Controls if p.Name != sender.Text and p.GetType() == Panel]
	    	if sender.Checked:
	    		associatedControls.Enabled = True
	    		for c in restofcontrols:
	    			c.Enabled = False
	    		parent.Tag = sender.Text
	    		
	    def showtooltip(self, sender, event ):
	    	ttp = ToolTip()
	    	ttp.AutoPopDelay = 10000
	    	ttp.SetToolTip(sender , sender.Tag)	

	    def numsOnly(self, sender, event ):
	    	if Char.IsDigit(event.KeyChar)==False and event.KeyChar != "." and Char.IsControl(event.KeyChar)==False:
	    		event.Handled = True
	    
	    def chart_showLabels(self, sender, event):
			cb = sender
			panelcht = sender.Parent
			chart1 = panelcht.GetChildAtPoint(Point(0,0))
			for s in chart1.Series:
				if s.ChartType == SeriesChartType.Pie:
					if cb.Checked:
						s["PieLabelStyle"] = "Inside"
					else:
						s["PieLabelStyle"] = "Disabled"
				else:
					if cb.Checked:
						s.IsValueShownAsLabel = True
					else:
						s.IsValueShownAsLabel = False
	    		
	    def imageexport(self, sender, event):
	    	import datetime
	    	from datetime import datetime
	    	from RevitServices.Transactions import TransactionManager
	    	#Modify resolution before the render
	    	fontFam = FontFamily("Segoe UI Symbol")
	    	originalFont = Font(fontFam,8)
	    	panelcht = sender.Parent
	    	chart1 = panelcht.GetChildAtPoint(Point(0,0))
	    	originalTitleFont = chart1.Titles[0].Font
	    	originalWidth = chart1.Width
	    	originalHeight = chart1.Height
	    	chart1.Visible = False
	    	chart1.Dock = DockStyle.None
	    	chart1.Width = 2100 * 0.8
	    	chart1.Height = 1500 * 0.8
	    	chart1.ChartAreas[0].AxisX.LabelAutoFitStyle = LabelAutoFitStyles.None
	    	chart1.ChartAreas[0].AxisY.LabelAutoFitStyle = LabelAutoFitStyles.None
	    	chart1.ChartAreas[0].AxisX.LabelStyle.Font = Font(fontFam, 30)
	    	chart1.ChartAreas[0].AxisY.LabelStyle.Font = Font(fontFam, 30)
	    	chart1.ChartAreas[0].AxisX.TitleFont = Font(fontFam, 30)
	    	chart1.ChartAreas[0].AxisY.TitleFont = Font(fontFam, 30)
	    	chart1.TextAntiAliasingQuality = TextAntiAliasingQuality.High
	    	chart1.BackColor = Color.White
	    	chart1.Titles[0].Font = Font(fontFam, 32, FontStyle.Bold)
	    	chart1.ChartAreas[0].BackColor = Color.White
	    	for serie in chart1.Series:
	    		serie.Font = Font(fontFam, 30)
		    	for p in serie.Points:
		    		p.Font = Font(fontFam, 30)
		    		p.MarkerSize = 15
	    	for legend in chart1.Legends:
	    		legend.Font = Font(fontFam, 30)
	    		legend.BackColor = Color.White
	    	chart1.Invalidate()
	    	chart1.SaveImage(tempfile.gettempdir() + "\\chartImage.bmp", ChartImageFormat.Bmp)
	    	#Get back to original settings
	    	chart1.Width = originalWidth
	    	chart1.Height = originalHeight
	    	chart1.BackColor = Color.Transparent
	    	chart1.ChartAreas[0].BackColor = Color.Transparent
	    	chart1.ChartAreas[0].AxisX.LabelStyle.Font = originalFont
	    	chart1.ChartAreas[0].AxisY.LabelStyle.Font = originalFont
	    	chart1.ChartAreas[0].AxisX.TitleFont = originalFont
	    	chart1.ChartAreas[0].AxisY.TitleFont = originalFont
	    	chart1.Titles[0].Font = originalTitleFont
	    	for serie in chart1.Series:
	    		serie.Font = originalFont
	    		for p in serie.Points:
	    			p.Font = originalFont
		    		p.MarkerSize = 8
	    	for legend in chart1.Legends:
	    		legend.Font = originalFont
	    		legend.BackColor = Color.Transparent
	    	chart1.Invalidate()
	    	chart1.Visible = True
	    	#Import the picture in a Drafting View
	    	#Import the picture in a Drafting View // The try catch if for handling the fact that ImageImportOptions was deprecated in 2020 and is obsolete in 2021	    	
	    	try:
	    		importOptions = ImageImportOptions()	
	    		importOptions.Resolution = 72
	    		importOptions.Placement = BoxPlacement.TopLeft	    		
	    	except:
	    		imageTypeOption = ImageTypeOptions()	
	    		imageTypeOption.Resolution = 72

	    	collector = FilteredElementCollector(doc).OfClass(ViewFamilyType)
	    	viewFamilyTypes = []
	    	for c in collector:
	    		if c.ViewFamily == ViewFamily.Drafting:
	    			viewFamilyTypes.append(c)
	    	viewFamilyType = viewFamilyTypes[0]
	    	TransactionManager.Instance.EnsureInTransaction(doc)
	    	draftView = ViewDrafting.Create(doc,viewFamilyType.Id)
	    	draftView.Name = chart1.Titles[0].Text + datetime.now().strftime(" (%m/%d/%Y, %H.%M.%S)")
	    	imagePath = tempfile.gettempdir() + "\\chartImage.bmp"
	    	newElement = clr.StrongBox[Element]()
	    	try:
	    		doc.Import(imagePath,importOptions,draftView,newElement)	    	
	    	except:
	    		imageTypeOption.SetPath(imagePath)
	    		imageType = ImageType.Create(doc,imageTypeOption)
	    		placementOptions = ImagePlacementOptions(XYZ(0,0,0),BoxPlacement.TopLeft)
	    		ImageInstance.Create(doc,draftView,imageType.Id,placementOptions)	    		
	    	TransactionManager.Instance.TransactionTaskDone()
	    		    	
	    def chart_showLegend(self, sender, event ):
	    	cb = sender
	    	panelcht = sender.Parent
	    	chart1 = panelcht.GetChildAtPoint(Point(0,0))
	    	if len(chart1.Legends) <= 1:
	    		for legend in chart1.Legends:
	    			if cb.Checked:
	    				legend.Enabled = True
	    			else:
	    				legend.Enabled = False
	    	else:
	    		if cb.Checked:
	    			chart1.Legends[1].Enabled = True
	    		else:
	    			chart1.Legends[1].Enabled = False
		    		

	class mylistview(ListView):
	
		def __init__(self):
			self.Values = []

	class mytrackbar(TrackBar):
	
		def __init__(self,startval,step):
			self.startval = startval
			self.step = step

	class myDataGridView(DataGridView):
	
		def __init__(self):
			self.startcell = {}
			self.endcell = {}
			
	class mygroupbox(GroupBox):
	
		def __init__(self):
			self.Values = []
			
	class myTextBox(TextBox):
	
		def __init__(self):
			self._isNum = False
	
			
	#Form initialization
	
	form = MultiTextBoxForm()
	xRatio = Screen.PrimaryScreen.Bounds.Width/1920
	if xRatio == 0:
		xRatio = 1
	yRatio = Screen.PrimaryScreen.Bounds.Height/1080
	if yRatio == 0:
		yRatio = 1
	form.topmost()	
	form.ControlBox = True
	xlabel = 25 * xRatio
	xinput = 150 * xRatio
	formy = 10 * yRatio
	if IN[8] * xRatio > (350 * xRatio):	formwidth = IN[8] * xRatio
	else: formwidth = 350 * xRatio
	fields = []
	error = 0
	
	#Description 
	
	if IN[3] != "":
		des = Label()
		des.Location = Point(xlabel,formy)
		des.Font = Font("Arial", 15,FontStyle.Bold)		
		des.AutoSize = True
		des.MaximumSize = Size(formwidth - (2 * xlabel)*xRatio,0)
		des.Text = IN[3]
		form.Controls.Add(des)
		formy = des.Bottom + (15*xRatio)
	formheaderheight = formy
	
	#Input form
	
	# Create a container panel for all inputs
	body = Panel()
	body.Location = Point(0,formy)
	body.Width = formwidth - 15*xRatio
	
	
	# Process form inputs
	if isinstance(IN[0],list):
		inputtypes = IN[0]
	else:
		inputtypes = [IN[0]]
	# This definition is to handle the sorting of special characters
	def remove_accents(input_str):
	    nfkd_form = unicodedata.normalize('NFKD', input_str)
	    only_ascii = nfkd_form.encode('ASCII', 'ignore')
	    return only_ascii	

	#Adding Logo 
	#default logo in case no input	
	def getImageByName(ImName):
		dynamo = Assembly.Load('DynamoCore')
		version = str(dynamo.GetName().Version)[:3]		
		dynPath = os.getenv('APPDATA')+"\\Dynamo\Dynamo Revit\\" + version 
		root = et.parse(dynPath + "\DynamoSettings.xml").getroot()
		logopaths = []
		for child in root:
			if child.tag == "CustomPackageFolders":
				for path in child:
					logopaths.append(path.text + "\packages\Data-Shapes\extra\\" + ImName)
					logopaths.append(path.text + "\Data-Shapes\extra\\" + ImName)
		deflogopath = ""
		for path in logopaths:
			if deflogopath == "":
				if os.path.isfile(path):
					deflogopath = path
					try:
						ima = Image.FromFile(deflogopath)
						bmp = Bitmap.FromFile(deflogopath)
						return ima,bmp
					except: 
						pass
						
	try:
		if IN[4] != '':
			try:
				ima = Image.FromFile(IN[4])
				bmp = Bitmap.FromFile(IN[4])
			except:
				ima = IN[4]
				bmp = IN[4]

		else :
			_ims = getImageByName("a.png")
			ima = _ims[0]
			bmp = _ims[1]
			
		logo = Panel()
		if IN[6] == None:
			xlogo = 20 * xRatio
			ylogo = formy+ 10*yRatio
		else:
			xlogo = 30 * xRatio
			ylogo = formy
		size = 110 * xRatio
		logo = PictureBox()
		ratio = (ima.Height)/(ima.Width)
		h = float(ima.Height)
		w = float(ima.Width)
		ratio = h/w
		logo.Size = Size(size,size*ratio)
		scaledimage = Bitmap(size,size*ratio)
		gr = Graphics.FromImage(scaledimage)
		gr.DrawImage(ima,0,0,size,size*ratio)
		logo.Image = ima
		logo.SizeMode = PictureBoxSizeMode.Zoom
		form.Controls.Add(logo)
		logo.Location = Point(xlogo,ylogo)
		
		
		#Setting icon 
		thumb = bmp.GetThumbnailImage(64, 64, bmp.GetThumbnailImageAbort,IntPtr.Zero)
		thumb.MakeTransparent();
		icon = Icon.FromHandle(thumb.GetHicon())
		form.Icon = icon

	except :
		logo = Panel()
		logo.Width = 110 * xRatio
		logo.Height = 110 * yRatio
	
	def addinput(formbody,inputs,starty,xinput,rightmargin,labelsize,importcolorselection):
		y = starty
		for j in inputs:
			label = Label()
			label.Location = Point(xlabel,y+4*yRatio)
			label.AutoSize = True
			label.MaximumSize = Size(labelsize,0)
			if j.__class__.__name__ == 'listview' and j.element_count > 0:
				label.Text = j.inputname + '\n(' + str(j.element_count) + ' element' + ("s" if j.element_count > 1 else "") + ')'
			else:
				try:
					label.Text = j.inputname
				except:
					pass
			formbody.Controls.Add(label)
	
			if j.__class__.__name__ == 'dropdown':
				cb = ComboBox()
				if j.inputname != "":
					cb.Width = formwidth - rightmargin - xinput
					cb.Location = Point(xinput,y)
				else:
					cb.Width = formwidth - rightmargin - xlabel
					cb.Location = Point(xlabel,y)
				cb.Sorted = j._sorted
				[cb.Items.Add(i) for i in j.keys() if not (i == 'inputname' or i == 'height' or i == 'defaultvalue' or i == 'highlight' or i == '_sorted' )]
				cb.Tag = j
				if j.defaultvalue != None:
					defindex = [i for i in cb.Items].index([i for i in j.keys() if not (i == 'inputname' or i == 'height' or i == 'defaultvalue' or i == 'highlight' or i == '_sorted' )][j.defaultvalue])
					cb.SelectedIndex = defindex
				formbody.Controls.Add(cb)
				form.output.append(cb)
				y = label.Bottom + 25 * yRatio
			#CHARTS 
			if j.__class__.__name__ == 'uipiechart':					
				labels = j.xseries
				inputcolors = j.inputcolors
				pyList = []
				xseries = [j.xseries]
				yseries = [j.yseries]
				nbOfSeries = 1
				if inputcolors is not None:
					colorBool = True
					for color in inputcolors:
						pyList.append(Color.FromArgb(color.Red,color.Green,color.Blue))
					wfColor = Array[Color](pyList)
				else:
					colorBool = False
				#Set a global Font code
				fontFam = FontFamily("Segoe UI Symbol")
				originalFont = Font(fontFam,8)
				#Chart created and Panel to host the chart
				chart1 = Chart()
				panelChart = Panel()
				panelChart.Name = "panelChart"
				#Panels colors
				chart1.BackColor = formbody.BackColor
				panelChart.BackColor = Color.Transparent
				#PanelChart location
				panelChart.Width = formwidth  - rightmargin - xlabel
				panelChart.Location = Point(xlabel,y + 30)
				#Chart colors palette
				chart1.Palette =  ChartColorPalette.None
				if colorBool:
					chart1.PaletteCustomColors = wfColor
				else:
					chart1.Palette =  ChartColorPalette.None
				chart1.Series.Clear()
				#Series created
				label = SmartLabelStyle()
				def createSeries(seriesName,_keys,_values):
					srs = Series()
					srs["PieLabelStyle"] = "Inside"
					srs.Name = seriesName
					srs.ChartType = SeriesChartType.Pie
					srs.ToolTip = "Percent: #PERCENT"
					srs.IsValueShownAsLabel = True
					for i,j in zip(_keys,_values):
						srs.Points.AddXY(i,j)
					return srs
				#Create series
				series = []
				for i in range(0,len(xseries)):
					series.append(createSeries(labels[i],xseries[i],yseries[i]))
				#Add series to chart
				for s in series:
					chart1.Series.Add(s)
				#Legend text of the points
				for s in series:
					for p in s.Points: 
						p.Font = originalFont
				#Refresh the Chart
				chart1.Invalidate()
				#Create a ChartArea and add it to the chart
				chartArea1 = ChartArea()
				chartArea1.BackColor = formbody.BackColor
				chartArea1.Name = "ChartArea1"
				chart1.ChartAreas.Add(chartArea1)				
				#Create a Legend and add it to the chart
				legend1 = Legend()
				legend1.BackColor = formbody.BackColor
				legend1.Font = originalFont
				legend1.Name = "Legend1"
				legend1.IsTextAutoFit = True
				legend1.LegendStyle = LegendStyle.Column
				chart1.Legends.Add(legend1)
				#Initialize the chart and its properties
				chart1.BeginInit()
				chart1.Size = Size(panelChart.Width,panelChart.Width)
				chart1.AntiAliasing = AntiAliasingStyles.All
				fontFam = FontFamily("Segoe UI Symbol")
				titleFont = Font(fontFam,10,FontStyle.Bold)
				title = Title()
				title.Text = j.chartname
				title.Alignment = ContentAlignment.TopLeft
				title.Font = titleFont
				chart1.Titles.Add(title)
				#Add a button to push on view
				bt = Button()
				bt.Tag = "Push the chart on a view in Revit"
				bt.Text = "Push on a draft view"
				bt.Height = 20 * yRatio
				bt.Width = 140 * yRatio				
				panelChart.Controls.Add(bt)
				bt.BringToFront()
				bt.Font = originalFont
				bt.Click += form.imageexport
				#Add a checkBox to show/hide legend
				checkBox1 = CheckBox()
				checkBox1.AutoCheck = True
				checkBox1.Name = "checkBox1"
				checkBox1.Text = "Legend"
				panelChart.Controls.Add(checkBox1)
				checkBox1.BringToFront()
				checkBox1.Checked = True
				checkBox1.Font = originalFont
				checkBox1.AutoSize = True
				checkBox1.Click += form.chart_showLegend
				#Add a checkBox to show/hide labels
				checkBox2 = CheckBox()
				checkBox2.AutoCheck = True
				checkBox2.Name = "checkBox2"
				checkBox2.Text = "Labels"
				panelChart.Controls.Add(checkBox2)
				checkBox2.BringToFront()
				checkBox2.Checked = True
				checkBox2.Font = originalFont
				checkBox2.AutoSize = True
				checkBox2.Click += form.chart_showLabels
				
				panelChart.Size = Size(panelChart.Width, panelChart.Width + checkBox2.Height + 30)
				#Add chart to panel
				panelChart.Controls.Add(chart1)
				chart1.Location = Point(0,0)
				bt.Location = Point(panelChart.Width - bt.Width, panelChart.Width + 15)
				checkBox1.Location = Point(panelChart.Width - bt.Width - 80, panelChart.Width + 15)
				checkBox2.Location = Point(panelChart.Width - bt.Width - 160, panelChart.Width + 15)
				formbody.Controls.Add(panelChart)
				
				y = panelChart.Bottom + 25 * yRatio
				
			elif j.__class__.__name__ == 'uibarchart':
				if isinstance(j.labels,list):
					labels = j.labels
				else:
					labels = [j.labels]
				inputcolors = j.inputcolors
				horizont = j.ishorizontal
				pyList = []
				if isinstance(j.xseries[0],list) and isinstance(j.yseries[0],list):
					nbOfSeries = len(j.xseries)
					xseries = j.xseries
					yseries = j.yseries
				elif isinstance(j.xseries[0],list) == False and isinstance(j.yseries[0],list):
					nbOfSeries = len(j.yseries)
					xseries = []
					i = 1
					while i <= nbOfSeries:
						xseries.append(j.xseries)
						i = i + 1
					yseries = j.yseries
				elif isinstance(j.yseries[0],list) == False and isinstance(j.xseries[0],list):
					nbOfSeries = len(j.xseries)
					yseries = []
					i = 1
					while i <= nbOfSeries:
						yseries.append(j.yseries)
						i = i + 1
					xseries = j.xseries
				else:
					xseries = [j.xseries]
					yseries = [j.yseries]
					nbOfSeries = 1
				if inputcolors is not None:
					colorBool = True
					for color in inputcolors:
						pyList.append(Color.FromArgb(color.Red,color.Green,color.Blue))
					wfColor = Array[Color](pyList)
				else:
					colorBool = False
				#Set a global Font code
				fontFam = FontFamily("Segoe UI Symbol")
				originalFont = Font(fontFam,8)
				#Chart created and Panel to host the chart
				chart1 = Chart()
				panelChart = Panel()
				panelChart.Name = "panelChart"
				#Panels colors
				chart1.BackColor = formbody.BackColor
				panelChart.BackColor = Color.Transparent
				#PanelChart location
				panelChart.Width = formwidth  - rightmargin - xlabel
				panelChart.Location = Point(xlabel,y + 30)				
				#Chart colors palette
				chart1.Palette =  ChartColorPalette.None
				if colorBool:
					chart1.PaletteCustomColors = wfColor
				else:
					chart1.Palette =  ChartColorPalette.None
				chart1.Series.Clear()
				#Series created
				def createSeries(seriesName,_keys,_values,_horizont):
					srs = Series()
					srs.Name = seriesName
					if _horizont:
						srs.ChartType = SeriesChartType.Bar
					else:
						srs.ChartType = SeriesChartType.Column
					srs.ToolTip = "Percent: #PERCENT"
					srs.IsValueShownAsLabel = True
					srs.Font = originalFont
					for i,j in zip(_keys,_values):
						srs.Points.AddXY(i,j)
					return srs
				#Create series
				series = []
				for i in range(0,nbOfSeries):
					series.append(createSeries(labels[i],xseries[i],yseries[i],horizont))
				#Add series to chart
				for s in series:
					chart1.Series.Add(s)
				#Refresh the Chart
				chart1.Invalidate()
				#Create a ChartArea and add it to the chart
				chartArea1 = ChartArea()
				chartArea1.BackColor = formbody.BackColor
				chartArea1.Name = "ChartArea1"
				chartArea1.AxisX.Title = j.xaxislabel
				chartArea1.AxisY.Title = j.yaxislabel
				chart1.ChartAreas.Add(chartArea1)
				#Create a Legend and add it to the chart
				legend1 = Legend()
				legend1.BackColor = formbody.BackColor
				legend1.Font = originalFont
				legend1.Name = "Legend1"
				legend1.Docking = Docking.Right
				chart1.Legends.Add(legend1) 
				#Initialize the chart and its properties
				chart1.BeginInit()
				chart1.Size = Size(panelChart.Width,panelChart.Width)
				chart1.AntiAliasing = AntiAliasingStyles.All
				fontFam = FontFamily("Segoe UI Symbol")
				titleFont = Font(fontFam,10,FontStyle.Bold)
				title = Title()
				title.Text = j.chartname
				title.Alignment = ContentAlignment.TopLeft
				title.Font = titleFont
				chart1.Titles.Add(title)
				#Add a button to push on view
				bt = Button()
				bt.Tag = "Push the chart on a view in Revit"
				bt.Text = "Push on a draft view"
				bt.Height = 20 * yRatio
				bt.Width = 140 * yRatio			
				panelChart.Controls.Add(bt)
				bt.BringToFront()
				bt.Click += form.imageexport
				#Add a checkBox to show/hide legend
				checkBox1 = CheckBox()
				checkBox1.AutoCheck = True
				checkBox1.Name = "checkBox1"
				checkBox1.Text = "Legend"
				panelChart.Controls.Add(checkBox1)
				checkBox1.BringToFront()
				checkBox1.Checked = True
				checkBox1.Font = originalFont
				checkBox1.AutoSize = True
				checkBox1.Click += form.chart_showLegend
				#Add a checkBox to show/hide labels
				checkBox2 = CheckBox()
				checkBox2.AutoCheck = True
				checkBox2.Name = "checkBox2"
				checkBox2.Text = "Labels"
				panelChart.Controls.Add(checkBox2)
				checkBox2.BringToFront()
				checkBox2.Checked = True
				checkBox2.Font = originalFont
				checkBox2.AutoSize = True
				checkBox2.Click += form.chart_showLabels
				
				panelChart.Size = Size(panelChart.Width, panelChart.Width + checkBox2.Height + 20)
				#Add chart to panel
				panelChart.Controls.Add(chart1)
				chart1.Location = Point(0,0)
				bt.Location = Point(panelChart.Width - bt.Width, panelChart.Width + 15)
				checkBox1.Location = Point(panelChart.Width - bt.Width - 80, panelChart.Width + 15)
				checkBox2.Location = Point(panelChart.Width - bt.Width - 160, panelChart.Width + 15)
				formbody.Controls.Add(panelChart)
				
				y = panelChart.Bottom + 25 * yRatio
				
			elif j.__class__.__name__ == 'uiradarchart':
				if isinstance(j.labels,list):
					labels = j.labels
				else:
					labels = [j.labels]
				inputcolors = j.inputcolors
				pyList = []
				if isinstance(j.xseries[0],list) and isinstance(j.yseries[0],list):
					nbOfSeries = len(j.xseries)
					xseries = j.xseries
					yseries = j.yseries
				elif isinstance(j.xseries[0],list) == False and isinstance(j.yseries[0],list):
					nbOfSeries = len(j.yseries)
					xseries = []
					i = 1
					while i <= nbOfSeries:
						xseries.append(j.xseries)
						i = i + 1
					yseries = j.yseries
				elif isinstance(j.yseries[0],list) == False and isinstance(j.xseries[0],list):
					nbOfSeries = len(j.xseries)
					yseries = []
					i = 1
					while i <= nbOfSeries:
						yseries.append(j.yseries)
						i = i + 1
					xseries = j.xseries
				else:
					xseries = [j.xseries]
					yseries = [j.yseries]
					nbOfSeries = 1
				if inputcolors is not None:
					colorBool = True
					for color in inputcolors:
						pyList.append(Color.FromArgb(color.Red,color.Green,color.Blue))
					wfColor = Array[Color](pyList)
				else:
					colorBool = False
				#Set a global Font code
				fontFam = FontFamily("Segoe UI Symbol")
				originalFont = Font(fontFam,8)
				#Chart created and Panel to host the chart
				chart1 = Chart()
				panelChart = Panel()
				panelChart.Name = "panelChart"
				#Create a panel for buttons
				panelCtrls = Panel()
				#Panels colors
				chart1.BackColor = formbody.BackColor
				panelChart.BackColor = Color.Transparent
				panelCtrls.BackColor = Color.Transparent
				#PanelChart location
				panelChart.Width = formwidth  - rightmargin - xlabel
				panelChart.Location = Point(xlabel,y + 30)				
				autoheight = 250 * yRatio			
				panelChart.Height = autoheight + 73 * yRatio
				ratio = (panelChart.Height)/(panelChart.Width)
				h = float(panelChart.Height)
				w = float(panelChart.Width)
				ratio = h/w
				chart_maxsize = formwidth - xlabel - rightmargin
				panelChart.Size = Size(chart_maxsize,chart_maxsize*ratio)				
				#Chart colors palette
				chart1.Palette =  ChartColorPalette.None
				if colorBool:
					chart1.PaletteCustomColors = wfColor
				else:
					chart1.Palette =  ChartColorPalette.None
				chart1.Series.Clear()
				#Series created
				def createSeries(seriesName,_keys,_values):
					srs = Series()
					srs.Name = seriesName
					srs.ChartType = SeriesChartType.Radar
					srs.ToolTip = "Percent: #PERCENT"
					srs.IsValueShownAsLabel = True
					srs.Font = originalFont
					srs.BorderWidth = 4
					for i,j in zip(_keys,_values):
						srs.Points.AddXY(i,j)
					return srs
				#Create series
				series = []
				for i in range(0,nbOfSeries):
					series.append(createSeries(labels[i],xseries[i],yseries[i]))
				#Add series to chart
				for s in series:
					chart1.Series.Add(s)
				#Refresh the Chart
				chart1.Invalidate()
				#Create a ChartArea and add it to the chart
				chartArea1 = ChartArea()
				chartArea1.BackColor = formbody.BackColor
				chartArea1.Name = "ChartArea1"
				chartArea1.AxisX.Title = j.xaxislabel
				chartArea1.AxisY.Title = j.yaxislabel
				chart1.ChartAreas.Add(chartArea1)
				#Create a Legend and add it to the chart
				legend1 = Legend()
				legend1.BackColor = formbody.BackColor
				legend1.Font = originalFont
				legend1.Name = "Legend1"
				chart1.Legends.Add(legend1) 
				#Initialize the chart and its properties
				chart1.BeginInit()
				chart1.Dock = DockStyle.Fill
				chart1.AntiAliasing = AntiAliasingStyles.All
				fontFam = FontFamily("Segoe UI Symbol")
				titleFont = Font(fontFam,10,FontStyle.Bold)
				title = Title()
				title.Text = j.chartname
				title.Alignment = ContentAlignment.TopLeft
				title.Font = titleFont
				chart1.Titles.Add(title)
				#Add a button to push on view
				bt = Button()
				bt.Tag = "Push the chart on a view in Revit"
				bt.Text = "Push on a draft view"
				bt.Height = 20 * yRatio
				bt.Width = 140 * yRatio				
				panelCtrls.Controls.Add(bt)
				bt.BringToFront()
				bt.Click += form.imageexport
				#Add a checkBox to show/hide legend
				checkBox1 = CheckBox()
				checkBox1.AutoCheck = True
				checkBox1.Name = "checkBox1"
				checkBox1.Text = "Show/Hide legend"
				panelCtrls.Controls.Add(checkBox1)
				checkBox1.BringToFront()
				checkBox1.Checked = True
				checkBox1.AutoSize = True
				checkBox1.Click += form.chart_showLegend
				
				#Add a checkBox to show/hide labels
				checkBox2 = CheckBox()
				checkBox2.AutoCheck = True
				checkBox2.Name = "checkBox2"
				checkBox2.Text = "Show/Hide labels"
				panelCtrls.Controls.Add(checkBox2)
				checkBox2.BringToFront()
				checkBox2.Checked = True
				checkBox2.Font = originalFont
				checkBox2.AutoSize = True
				checkBox2.Click += form.chart_showLabels
				
				panelChart.Size = Size(panelChart.Width, panelChart.Width + checkBox2.Height + 20)
				#Add chart to panel
				panelChart.Controls.Add(chart1)
				chart1.Location = Point(0,0)
				bt.Location = Point(panelChart.Width - bt.Width, panelChart.Width + 15)
				checkBox1.Location = Point(panelChart.Width - bt.Width - 80, panelChart.Width + 15)
				checkBox2.Location = Point(panelChart.Width - bt.Width - 160, panelChart.Width + 15)
				formbody.Controls.Add(panelChart)
				
				y = panelChart.Bottom + 25 * yRatio
				
			elif j.__class__.__name__ == 'uipointchart':
				if isinstance(j.labels,list):
					labels = j.labels
				else:
					labels = [j.labels]
				inputcolors = j.inputcolors
				pyList = []
				if isinstance(j.xseries[0],list) and isinstance(j.yseries[0],list):
					nbOfSeries = len(j.xseries)
					xseries = j.xseries
					yseries = j.yseries
				elif isinstance(j.xseries[0],list) == False and isinstance(j.yseries[0],list):
					nbOfSeries = len(j.yseries)
					xseries = []
					i = 1
					while i <= nbOfSeries:
						xseries.append(j.xseries)
						i = i + 1
					yseries = j.yseries
				elif isinstance(j.yseries[0],list) == False and isinstance(j.xseries[0],list):
					nbOfSeries = len(j.xseries)
					yseries = []
					i = 1
					while i <= nbOfSeries:
						yseries.append(j.yseries)
						i = i + 1
					xseries = j.xseries
				else:
					xseries = [j.xseries]
					yseries = [j.yseries]
					nbOfSeries = 1
				if inputcolors is not None:
					colorBool = True
					for color in inputcolors:
						pyList.append(Color.FromArgb(color.Red,color.Green,color.Blue))
					wfColor = Array[Color](pyList)
				else:
					colorBool = False
				#Set a global Font code
				fontFam = FontFamily("Segoe UI Symbol")
				originalFont = Font(fontFam,8)
				#Chart created and Panel to host the chart
				chart1 = Chart()
				panelChart = Panel()
				panelChart.Name = "panelChart"
				#Panels colors
				chart1.BackColor = formbody.BackColor
				panelChart.BackColor = Color.Transparent
				#PanelChart location
				panelChart.Width = formwidth  - rightmargin - xlabel
				panelChart.Location = Point(xlabel,y + 30)				
				#Chart colors palette
				chart1.Palette =  ChartColorPalette.None
				if colorBool:
					chart1.PaletteCustomColors = wfColor
				else:
					chart1.Palette =  ChartColorPalette.None
				chart1.Series.Clear()
				#Series created
				def createSeries(seriesName,_keys,_values):
					srs = Series()
					srs.Name = seriesName
					srs.ChartType = SeriesChartType.Point
					srs.ToolTip = "Percent: #PERCENT"
					srs.IsValueShownAsLabel = True
					srs.Font = originalFont
					for i,j in zip(_keys,_values):
						srs.Points.AddXY(i,j)
					return srs
				#Create series
				series = []
				for i in range(0,nbOfSeries):
					series.append(createSeries(labels[i],xseries[i],yseries[i]))
				#Add series to chart
				for s in series:
					chart1.Series.Add(s)
				#Change marker size
				originalMarkerSize = 8
				for s in series:
					for p in s.Points:
						p.MarkerSize = originalMarkerSize
				#Refresh the Chart
				chart1.Invalidate()
				#Create a ChartArea and add it to the chart
				chartArea1 = ChartArea()
				chartArea1.BackColor = formbody.BackColor
				chartArea1.Name = "ChartArea1"
				chartArea1.AxisX.Title = j.xaxislabel
				chartArea1.AxisY.Title = j.yaxislabel
				chart1.ChartAreas.Add(chartArea1)
				chartArea1 = chart1.ChartAreas[0]
				#Create a Legend and add it to the chart
				legend1 = Legend()
				legend2 = Legend()
				#Add legends to charts
				chart1.Legends.Add(legend1)
				chart1.Legends.Add(legend2)
				#Create Custom legend
				customevent = CustomizeLegendEventArgs(legend2.CustomItems)
				for s in series:
					legend2.CustomItems.Add(LegendItem(s.Name.ToString(),s.Color,""))					
				def chart_CustomizeLegend(sender, customevent ):
					chart1 = sender
					#legend1.Enabled = False
					legend2.Name = "Legend2"
					for s,it in zip(series,legend2.CustomItems):
						it.ImageStyle = LegendImageStyle.Marker
						it.MarkerStyle = s.MarkerStyle
						it.MarkerColor = s.Color
						it.BorderColor = Color.Transparent
						it.MarkerSize *= 1.3
				legend1.Enabled = False
				legend2.Font = originalFont
				legend2.IsTextAutoFit = True
				legend2.BackColor = formbody.BackColor			
				chart1.CustomizeLegend += chart_CustomizeLegend
				#Initialize the chart and its properties
				chart1.BeginInit()
				chart1.Size = Size(panelChart.Width,panelChart.Width)
				chart1.AntiAliasing = AntiAliasingStyles.All
				fontFam = FontFamily("Segoe UI Symbol")
				titleFont = Font(fontFam,10,FontStyle.Bold)
				title = Title()
				title.Text = j.chartname
				title.Alignment = ContentAlignment.TopLeft
				title.Font = titleFont
				chart1.Titles.Add(title)
				#Add a button to push on view
				bt = Button()
				bt.Tag = "Push the chart on a view in Revit"
				bt.Text = "Push on a draft view"
				bt.Height = 20 * yRatio
				bt.Width = 140 * yRatio				
				panelChart.Controls.Add(bt)
				bt.BringToFront()
				bt.Click += form.imageexport
				#Add a checkBox to show/hide legend
				checkBox1 = CheckBox()
				checkBox1.AutoCheck = True
				checkBox1.Name = "checkBox1"
				checkBox1.Text = "Legend"
				panelChart.Controls.Add(checkBox1)
				checkBox1.BringToFront()
				checkBox1.Checked = True
				checkBox1.AutoSize = True
				checkBox1.Click += form.chart_showLegend
				
				#Add a checkBox to show/hide labels
				checkBox2 = CheckBox()
				checkBox2.AutoCheck = True
				checkBox2.Name = "checkBox2"
				checkBox2.Text = "Labels"
				panelChart.Controls.Add(checkBox2)
				checkBox2.BringToFront()
				checkBox2.Checked = True
				checkBox2.Font = originalFont
				checkBox2.AutoSize = True
				checkBox2.Click += form.chart_showLabels
				
				panelChart.Size = Size(panelChart.Width, panelChart.Width + checkBox2.Height + 20)
				#Add chart to panel
				panelChart.Controls.Add(chart1)
				chart1.Location = Point(0,0)
				bt.Location = Point(panelChart.Width - bt.Width, panelChart.Width + 15)
				checkBox1.Location = Point(panelChart.Width - bt.Width - 80, panelChart.Width + 15)
				checkBox2.Location = Point(panelChart.Width - bt.Width - 160, panelChart.Width + 15)
				formbody.Controls.Add(panelChart)
				
				y = panelChart.Bottom + 25 * yRatio
								
			elif j.__class__.__name__ == 'uilinechart':
				if isinstance(j.labels,list):
					labels = j.labels
				else:
					labels = [j.labels]
				inputcolors = j.inputcolors
				pyList = []
				if isinstance(j.xseries[0],list) and isinstance(j.yseries[0],list):
					nbOfSeries = len(j.xseries)
					xseries = j.xseries
					yseries = j.yseries
				elif isinstance(j.xseries[0],list) == False and isinstance(j.yseries[0],list):
					nbOfSeries = len(j.yseries)
					xseries = []
					i = 1
					while i <= nbOfSeries:
						xseries.append(j.xseries)
						i = i + 1
					yseries = j.yseries
				elif isinstance(j.yseries[0],list) == False and isinstance(j.xseries[0],list):
					nbOfSeries = len(j.xseries)
					yseries = []
					i = 1
					while i <= nbOfSeries:
						yseries.append(j.yseries)
						i = i + 1
					xseries = j.xseries
				else:
					xseries = [j.xseries]
					yseries = [j.yseries]
					nbOfSeries = 1
				if inputcolors is not None:
					colorBool = True
					for color in inputcolors:
						pyList.append(Color.FromArgb(color.Red,color.Green,color.Blue))
					wfColor = Array[Color](pyList)
				else:
					colorBool = False
				#Set a global Font code
				fontFam = FontFamily("Segoe UI Symbol")
				originalFont = Font(fontFam,8)
				#Chart created and Panel to host the chart
				chart1 = Chart()
				panelChart = Panel()
				panelChart.Name = "panelChart"
				#Panels colors
				chart1.BackColor = formbody.BackColor
				panelChart.BackColor = Color.Transparent
				#PanelChart location
				panelChart.Width = formwidth  - rightmargin - xlabel
				panelChart.Location = Point(xlabel,y + 30)				
				#Chart colors palette
				chart1.Palette =  ChartColorPalette.None
				if colorBool:
					chart1.PaletteCustomColors = wfColor
				else:
					chart1.Palette =  ChartColorPalette.None
				chart1.Series.Clear()
				#Series created
				def createSeries(seriesName,_keys,_values):
					srs = Series()
					srs.Name = seriesName
					srs.ChartType = SeriesChartType.Line
					srs.ToolTip = "Percent: #PERCENT"
					srs.IsValueShownAsLabel = True
					srs.Font = originalFont
					srs.BorderWidth = 4
					for i,j in zip(_keys,_values):
						srs.Points.AddXY(i,j)
					return srs
				#Create series
				series = []
				for i in range(0,nbOfSeries):
					series.append(createSeries(labels[i],xseries[i],yseries[i]))
				#Add series to chart
				for s in series:
					chart1.Series.Add(s)
				#Refresh the Chart
				chart1.Invalidate()
				#Create a ChartArea and add it to the chart
				chartArea1 = ChartArea()
				chartArea1.BackColor = formbody.BackColor
				chartArea1.Name = "ChartArea1"
				chartArea1.AxisX.Title = j.xaxislabel
				chartArea1.AxisY.Title = j.yaxislabel
				chart1.ChartAreas.Add(chartArea1)
				#Create a Legend and add it to the chart
				legend1 = Legend()
				legend1.BackColor = formbody.BackColor
				legend1.Font = originalFont
				legend1.Name = "Legend1"
				chart1.Legends.Add(legend1) 
				#Initialize the chart and its properties
				chart1.BeginInit()
				chart1.Size = Size(panelChart.Width,panelChart.Width)
				chart1.AntiAliasing = AntiAliasingStyles.All
				fontFam = FontFamily("Segoe UI Symbol")
				titleFont = Font(fontFam,10,FontStyle.Bold)
				title = Title()
				title.Text = j.chartname
				title.Alignment = ContentAlignment.TopLeft
				title.Font = titleFont
				chart1.Titles.Add(title)
				#Add a button to push on view
				bt = Button()
				bt.Tag = "Push the chart on a view in Revit"
				bt.Text = "Push on a draft view"
				bt.Height = 20 * yRatio
				bt.Width = 140 * yRatio				
				panelChart.Controls.Add(bt)
				bt.BringToFront()
				bt.Click += form.imageexport
				#Add a checkBox to show/hide legend
				checkBox1 = CheckBox()
				checkBox1.AutoCheck = True
				checkBox1.Name = "checkBox1"
				checkBox1.Text = "Legend"
				panelChart.Controls.Add(checkBox1)
				checkBox1.BringToFront()
				checkBox1.Checked = True
				checkBox1.AutoSize = True
				checkBox1.Click += form.chart_showLegend
				
				#Add a checkBox to show/hide labels
				checkBox2 = CheckBox()
				checkBox2.AutoCheck = True
				checkBox2.Name = "checkBox2"
				checkBox2.Text = "Labels"
				panelChart.Controls.Add(checkBox2)
				checkBox2.BringToFront()
				checkBox2.Checked = True
				checkBox2.Font = originalFont
				checkBox2.AutoSize = True
				checkBox2.Click += form.chart_showLabels
				
				panelChart.Size = Size(panelChart.Width, panelChart.Width + checkBox2.Height + 20)
				#Add chart to panel
				panelChart.Controls.Add(chart1)
				chart1.Location = Point(0,0)
				bt.Location = Point(panelChart.Width - bt.Width, panelChart.Width + 15)
				checkBox1.Location = Point(panelChart.Width - bt.Width - 80, panelChart.Width + 15)
				checkBox2.Location = Point(panelChart.Width - bt.Width - 160, panelChart.Width + 15)
				formbody.Controls.Add(panelChart)
				
				y = panelChart.Bottom + 25 * yRatio
			
			elif j.__class__.__name__ == 'uisplinechart':
				if isinstance(j.labels,list):
					labels = j.labels
				else:
					labels = [j.labels]
				inputcolors = j.inputcolors
				pyList = []
				if isinstance(j.xseries[0],list) and isinstance(j.yseries[0],list):
					nbOfSeries = len(j.xseries)
					xseries = j.xseries
					yseries = j.yseries
				elif isinstance(j.xseries[0],list) == False and isinstance(j.yseries[0],list):
					nbOfSeries = len(j.yseries)
					xseries = []
					i = 1
					while i <= nbOfSeries:
						xseries.append(j.xseries)
						i = i + 1
					yseries = j.yseries
				elif isinstance(j.yseries[0],list) == False and isinstance(j.xseries[0],list):
					nbOfSeries = len(j.xseries)
					yseries = []
					i = 1
					while i <= nbOfSeries:
						yseries.append(j.yseries)
						i = i + 1
					xseries = j.xseries
				else:
					xseries = [j.xseries]
					yseries = [j.yseries]
					nbOfSeries = 1
				if inputcolors is not None:
					colorBool = True
					for color in inputcolors:
						pyList.append(Color.FromArgb(color.Red,color.Green,color.Blue))
					wfColor = Array[Color](pyList)
				else:
					colorBool = False
				#Set a global Font code
				fontFam = FontFamily("Segoe UI Symbol")
				originalFont = Font(fontFam,8)
				#Chart created and Panel to host the chart
				chart1 = Chart()
				panelChart = Panel()
				panelChart.Name = "panelChart"
				#Panels colors
				chart1.BackColor = formbody.BackColor
				panelChart.BackColor = Color.Transparent
				#PanelChart location
				panelChart.Width = formwidth  - rightmargin - xlabel
				panelChart.Location = Point(xlabel,y + 30)				
				#Chart colors palette
				chart1.Palette =  ChartColorPalette.None
				if colorBool:
					chart1.PaletteCustomColors = wfColor
				else:
					chart1.Palette =  ChartColorPalette.None
				chart1.Series.Clear()
				#Series created
				def createSeries(seriesName,_keys,_values):
					srs = Series()
					srs.Name = seriesName
					srs.ChartType = SeriesChartType.Spline
					srs.ToolTip = "Percent: #PERCENT"
					srs.IsValueShownAsLabel = True
					srs.Font = originalFont
					srs.BorderWidth = 4
					for i,j in zip(_keys,_values):
						srs.Points.AddXY(i,j)
					return srs
				#Create series
				series = []
				for i in range(0,nbOfSeries):
					series.append(createSeries(labels[i],xseries[i],yseries[i]))
				#Add series to chart
				for s in series:
					chart1.Series.Add(s)
				#Refresh the Chart
				chart1.Invalidate()
				#Create a ChartArea and add it to the chart
				chartArea1 = ChartArea()
				chartArea1.BackColor = formbody.BackColor
				chartArea1.Name = "ChartArea1"
				chartArea1.AxisX.Title = j.xaxislabel
				chartArea1.AxisY.Title = j.yaxislabel
				chart1.ChartAreas.Add(chartArea1)
				#Create a Legend and add it to the chart
				legend1 = Legend()
				legend1.BackColor = formbody.BackColor
				legend1.Font = originalFont
				legend1.Name = "Legend1"
				chart1.Legends.Add(legend1) 
				#Initialize the chart and its properties
				chart1.BeginInit()
				chart1.Size = Size(panelChart.Width,panelChart.Width)
				chart1.AntiAliasing = AntiAliasingStyles.All
				fontFam = FontFamily("Segoe UI Symbol")
				titleFont = Font(fontFam,10,FontStyle.Bold)
				title = Title()
				title.Text = j.chartname
				title.Alignment = ContentAlignment.TopLeft
				title.Font = titleFont
				chart1.Titles.Add(title)
				#Add a button to push on view
				bt = Button()
				bt.Tag = "Push the chart on a view in Revit"
				bt.Text = "Push on a draft view"
				bt.Height = 20 * yRatio
				bt.Width = 140 * yRatio			
				panelChart.Controls.Add(bt)
				bt.BringToFront()
				bt.Click += form.imageexport
				#Add a checkBox to show/hide legend
				checkBox1 = CheckBox()
				checkBox1.AutoCheck = True
				checkBox1.Name = "checkBox1"
				checkBox1.Text = "Legend"
				panelChart.Controls.Add(checkBox1)
				checkBox1.BringToFront()
				checkBox1.Checked = True
				checkBox1.AutoSize = True
				checkBox1.Click += form.chart_showLegend
				
				#Add a checkBox to show/hide labels
				checkBox2 = CheckBox()
				checkBox2.AutoCheck = True
				checkBox2.Name = "checkBox2"
				checkBox2.Text = "Labels"
				panelChart.Controls.Add(checkBox2)
				checkBox2.BringToFront()
				checkBox2.Checked = True
				checkBox2.Font = originalFont
				checkBox2.AutoSize = True
				checkBox2.Click += form.chart_showLabels
				
				panelChart.Size = Size(panelChart.Width, panelChart.Width + checkBox2.Height + 20)
				#Add chart to panel
				panelChart.Controls.Add(chart1)
				chart1.Location = Point(0,0)
				bt.Location = Point(panelChart.Width - bt.Width, panelChart.Width + 15)
				checkBox1.Location = Point(panelChart.Width - bt.Width - 80, panelChart.Width + 15)
				checkBox2.Location = Point(panelChart.Width - bt.Width - 160, panelChart.Width + 15)
				formbody.Controls.Add(panelChart)
				
				y = panelChart.Bottom + 25 * yRatio
				
			elif j.__class__.__name__ == 'uibubblechart':
				if isinstance(j.labels,list):
					labels = j.labels
				else:
					labels = [j.labels]
				inputcolors = j.inputcolors
				pyList = []
				if isinstance(j.xseries[0],list) and isinstance(j.yseries[0],list):
					nbOfSeries = len(j.xseries)
					xseries = j.xseries
					yseries = j.yseries
				elif isinstance(j.xseries[0],list) == False and isinstance(j.yseries[0],list):
					nbOfSeries = len(j.yseries)
					xseries = []
					i = 1
					while i <= nbOfSeries:
						xseries.append(j.xseries)
						i = i + 1
					yseries = j.yseries
				elif isinstance(j.yseries[0],list) == False and isinstance(j.xseries[0],list):
					nbOfSeries = len(j.xseries)
					yseries = []
					i = 1
					while i <= nbOfSeries:
						yseries.append(j.yseries)
						i = i + 1
					xseries = j.xseries
				else:
					xseries = [j.xseries]
					yseries = [j.yseries]
					nbOfSeries = 1
				if inputcolors is not None:
					colorBool = True
					for color in inputcolors:
						pyList.append(Color.FromArgb(color.Red,color.Green,color.Blue))
					wfColor = Array[Color](pyList)
				else:
					colorBool = False
				#Set a global Font code
				fontFam = FontFamily("Segoe UI Symbol")
				originalFont = Font(fontFam,8)
				#Chart created and Panel to host the chart
				chart1 = Chart()
				panelChart = Panel()
				#panelChart.Padding = Padding(1) To create a black border
				chart1.BackColor = formbody.BackColor
				panelChart.BackColor = Color.Transparent
				#PanelChart location
				panelChart.Width = formwidth  - rightmargin - xlabel
				panelChart.Location = Point(xlabel,y + 30)				
				autoheight = 250 * yRatio			
				panelChart.Height = autoheight + 73 * yRatio
				ratio = (panelChart.Height)/(panelChart.Width)
				h = float(panelChart.Height)
				w = float(panelChart.Width)
				ratio = h/w
				chart_maxsize = formwidth - xlabel - rightmargin
				panelChart.Size = Size(chart_maxsize,chart_maxsize*ratio)				
				#Chart colors palette
				chart1.Palette =  ChartColorPalette.None
				if colorBool:
					chart1.PaletteCustomColors = wfColor
				else:
					chart1.Palette =  ChartColorPalette.None
				chart1.Series.Clear()
				#Series created
				def createSeries(seriesName,_keys,_values):
					srs = Series()
					srs.Name = seriesName
					srs.ChartType = SeriesChartType.Bubble
					srs.ToolTip = "Percent: #PERCENT"
					srs.Font = originalFont
					for i,j in zip(_keys,_values):
						srs.Points.AddXY(i,j)
					return srs
				#Create series
				series = []
				for i in range(0,nbOfSeries):
					series.append(createSeries(labels[i],xseries[i],yseries[i]))
				#Add series to chart
				for s in series:
					chart1.Series.Add(s)
				#Refresh the Chart
				chart1.Invalidate()
				#Create a ChartArea and add it to the chart
				chartArea1 = ChartArea()
				chartArea1.BackColor = formbody.BackColor
				chartArea1.Name = "ChartArea1"
				chartArea1.AxisX.Title = j.xaxislabel
				chartArea1.AxisY.Title = j.yaxislabel
				chart1.ChartAreas.Add(chartArea1)
				#Create a Legend and add it to the chart
				legend1 = Legend()
				legend1.BackColor = formbody.BackColor
				legend1.Font = originalFont
				legend1.Name = "Legend1"
				chart1.Legends.Add(legend1) 
				#Initialize the chart and its properties
				chart1.BeginInit()
				chart1.Dock = DockStyle.Fill
				chart1.AntiAliasing = AntiAliasingStyles.All
				fontFam = FontFamily("Segoe UI Symbol")
				titleFont = Font(fontFam,10,FontStyle.Bold)
				title = Title()
				title.Text = j.chartname
				title.Alignment = ContentAlignment.TopLeft
				title.Font = titleFont
				chart1.Titles.Add(title)
				#Add a button to push on view
				bt = Button()
				bt.Tag = "Push the chart on a view in Revit"
				bt.Text = "Push on a draft view"
				bt.Height = 20 * yRatio
				bt.Width = 140 * yRatio			
				panelChart.Controls.Add(bt)
				bt.BringToFront()
				bt.Click += form.imageexport
				#Add a checkBox to show/hide legend
				checkBox1 = CheckBox()
				checkBox1.AutoCheck = True
				checkBox1.Name = "checkBox1"
				checkBox1.Text = "Show/Hide legend"
				panelChart.Controls.Add(checkBox1)
				checkBox1.BringToFront()
				checkBox1.Checked = True
				checkBox1.Click += form.chart_showLegend
				#Add chart to panel
				panelChart.Size = Size(panelChart.Width, panelChart.Width + checkBox2.Height + 20)
				#Add chart to panel
				panelChart.Controls.Add(chart1)
				chart1.Location = Point(0,0)
				bt.Location = Point(panelChart.Width - bt.Width, panelChart.Width + 15)
				checkBox1.Location = Point(panelChart.Width - bt.Width - 80, panelChart.Width + 15)
				checkBox2.Location = Point(panelChart.Width - bt.Width - 160, panelChart.Width + 15)
				formbody.Controls.Add(panelChart)
				
				y = panelChart.Bottom + 25 * yRatio

			elif j.__class__.__name__ == 'uitreeview':
				tv = TreeView()
				tv.CheckBoxes = True
				titles = j._hastitles
				if j.inputname != "":
					tv.Width = formwidth - rightmargin - xinput
					tv.Location = Point(xinput,y)
				else:
					tv.Width = formwidth - rightmargin - xlabel
					tv.Location = Point(xlabel,y)
				tv.Height = j._height
				def treeIterationTitle(control, input):
					if isinstance(input,list):
						try:
							currentNode = TreeNode(remove_accents(input[0].ToString()))
							currentNode.Tag = ""
							input.pop(0)
						except:
							currentNode = TreeNode(control.Text +"."+ str(len(control.Nodes)+1))
							currentNode.Tag = ""
						control.Nodes.Add(currentNode)
						for i in input:
							treeIterationTitle(currentNode, i)
					else:
						item = TreeNode(remove_accents(input.ToString()))
						item.Tag = input
						control.Nodes.Add(item)	
				def treeIteration(control, input):
					if isinstance(input,list):
						currentNode = TreeNode(control.Text +"."+ str(len(control.Nodes)+1))
						currentNode.Tag = input
						control.Nodes.Add(currentNode)
						for i in input:
							treeIteration(currentNode, i)
					else:
						item = TreeNode(remove_accents(input.ToString()))
						item.Tag = input
						control.Nodes.Add(item)
				currentNode = TreeNode("List1")
				currentNode.Expand()				
				if titles:
					tv.Nodes.Add(currentNode)								
					for dl in j.datalist:
						treeIterationTitle(currentNode,dl)	
				else:
					tv.Nodes.Add(currentNode)								
					for dl in j.datalist:
						treeIteration(currentNode,dl)
				tv.AfterCheck += form.CheckChildren						
				formbody.Controls.Add(tv)
				form.output.append(tv)
				y = tv.Bottom + 25 * yRatio
			elif j.__class__.__name__ == 'listview':
				lvp = Panel()
				if j.inputname != "":
					lvp.Location = Point(xinput,y)
					lvp.Width = formwidth - rightmargin - xinput				
				elif j.inputname == "" and j.element_count != 0:
					lvp.Location = Point(xlabel,y+35*yRatio)
					lvp.Width = formwidth - rightmargin - xlabel
				else : 
					lvp.Location = Point(xlabel,y)
					lvp.Width = formwidth - rightmargin - xlabel				
				lvp.Height = j.height * yRatio + 25 * yRatio
				#Creating the listview box
				lv = mylistview()
				lv.Scrollable = True
				dummyheader = ColumnHeader()
				dummyheader.Text = ""
				dummyheader.Name = ""
				dummyheader.Width = -2 * xRatio
				lv.HeaderStyle = ColumnHeaderStyle.None
				lv.Columns.Add(dummyheader)
				lv.Values = j
				if not j.display_mode:
					lv.CheckBoxes = True
				lv.View = vi.Details
				lvItems =  [i for i in j.keys() if not (i == 'inputname' or i == 'height' or i == 'highlight' or i == 'display_mode' or i == 'element_count' or i == 'default_values' or i == 'sorted' or i == 'showId')]
				if j.sorted :
					lvItems = sorted(lvItems,key = remove_accents)
				else:
					pass
				[lv.Items.Add(i) for i in lvItems]
				lv.Location = Point(0,0)
				if j.inputname != "" and j.element_count != 0:
					lv.Width = formwidth - rightmargin - xinput
				elif j.inputname != "" and j.element_count == 0:
					lv.Width = formwidth - rightmargin - xinput
				else:
					lv.Width = formwidth - rightmargin - xlabel
				lv.Height = j.height * yRatio
				lv.Scrollable = True
				lv.ItemCheck += form.updateallnone
				for i in j.default_values:
					defInd = lvItems.index([x for x in j.keys() if not (x == 'inputname' or x == 'height' or x == 'highlight' or x == 'display_mode' or x == 'element_count' or x == 'default_values' or x == 'sorted' or x == 'showId')][i])
					lv.Items[defInd].Checked = True
				#Click listview items to hilight and center in appropriate view
				if j.highlight :
					lv.MouseDown += form.setviewforelement
					lv.MouseUp += form.zoomcenter
					items = list(lv.Items)
					lv.FullRowSelect = True
					del items[::2]
					for item in items:
						item.BackColor = Color.FromArgb(230,243,255)
				#Creating select all and select none radiobuttons
				if not j.display_mode:
					rball = RadioButton()
					rball.Location = Point(0,(j.height+5)*yRatio)
					rball.Width = 100 * xRatio
					rball.Height = 20 * yRatio
					rball.Font = SystemFonts.DefaultFont
					rball.Text = "Select all"
					rball.Click += form.selectall
					rbnone = RadioButton()
					rbnone.Location = Point(105 * xRatio,(j.height+5)*yRatio)
					rbnone.Width = 100 * xRatio
					rbnone.Height = 20 * yRatio
					rbnone.Font = SystemFonts.DefaultFont
					rbnone.Text = "Select none"			
					rbnone.Click += form.selectnone			
				#Adding controls to panel
				lvp.Controls.Add(lv)
				if not j.display_mode:
					lvp.Controls.Add(rball)
					lvp.Controls.Add(rbnone)
				formbody.Controls.Add(lvp)
				if not j.display_mode:
					form.output.append(lv)
				y = lvp.Bottom + 25 * yRatio
			elif j.__class__.__name__ == 'uitext':
				tb = myTextBox()
				tb.Text = j.defaultvalue
				if j.inputname != "":
					tb.Width = formwidth  - rightmargin - xinput
					tb.Location = Point(xinput,y)
				else:
					tb.Width = formwidth - rightmargin - xlabel
					tb.Location = Point(xlabel,y)
				if j._isnum:
					tb._isNum = True
					tb.KeyPress += form.numsOnly
				formbody.Controls.Add(tb)
				formbody.Controls.Add(label)
				form.output.append(tb)
				y = label.Bottom + 25 * yRatio
			elif j.__class__.__name__ == 'uimultilinetext':
				tb = myTextBox()
				tb.Text = j.defaultvalue
				tb.Multiline  = True
				tb.Height = j._height * yRatio
				if j.inputname != "":
					tb.Width = formwidth  - rightmargin - xinput
					tb.Location = Point(xinput,y)
				else:
					tb.Width = formwidth - rightmargin - xlabel
					tb.Location = Point(xlabel,y)
				if j._isnum:
					tb._isNum = True
					tb.KeyPress += form.numsOnly
				formbody.Controls.Add(tb)
				formbody.Controls.Add(label)
				form.output.append(tb)
				y = tb.Bottom + 25 * yRatio								
			elif j.__class__.__name__ == 'tableview':
				#Creating grouping panel
				tvp = Panel()
				tvp.Location = Point(xlabel,y)
				tvp.Width = formwidth - rightmargin - xlabel
				if (50 + len(j.dataList) * 15) * yRatio > 800 * yRatio:
					autoheight = 800 * yRatio
				else:
					autoheight = (50 + len(j.dataList) * 15	) * yRatio			
				tvp.Height = autoheight + 73 * yRatio
				#Creating title
				titlep = Label()
				titlep.Text = j._tabletitle
				titlep.Width = formwidth - rightmargin - xlabel
				titlep.BackColor = Color.FromArgb(153,180,209)
				titlep.Font = Font("Arial", 11, FontStyle.Bold)
				titlep.TextAlign = ContentAlignment.MiddleLeft
				titlep.BorderStyle = BorderStyle.FixedSingle
				titlep.Location = Point(0,0)
				tvp.Controls.Add(titlep)
				#Creating data structure
				dg = myDataGridView()
				#dg.SelectionMode = DataGridViewSelectionMode.CellSelect
				dg.EnableHeadersVisualStyles = False				
				dt = DataTable()
				dl = j.dataList
				for i in range(len(dl[0])):
					if j._hasTitle:
						dt.Columns.Add(remove_accents(dl[0][i].ToString()))
						rngstart = 1
					else:
						dt.Columns.Add("Column " + str(i))
						rngstart = 0						
				for rindex in range(rngstart,len(dl)):
					row = dt.NewRow()
					for i in range(len(dl[rindex])):
						row[i] = dl[rindex][i]
					dt.Rows.Add(row)						
				dg.Tag = j._hasTitle				
				dg.DataSource = dt
				dg.ClipboardCopyMode = DataGridViewClipboardCopyMode.EnableWithAutoHeaderText
				dg.AutoSizeColumnsMode = DataGridViewAutoSizeColumnsMode.AllCells
				dg.Width = formwidth - rightmargin - xlabel
				dg.Location = Point(0,23 * yRatio)
				dg.Height = autoheight
				#Creatin Excel like drag copy functionalities
				dg.CellMouseDown += form.startCell
				dg.CellMouseUp += form.endCell
				#dg.MouseDown += form.startRowDrag
				#dg.MouseUp = 			
				tvp.Controls.Add(dg)			
				y = tvp.Bottom + 15 * yRatio
				#Adding export to excel button
				ex = Button()
				ex.Tag = [j._hasTitle , j._openExcel , j._showinfo , j._fileInfo]
				try:
					expImage = getImageByName("exp.png")[0]
					ex.BackgroundImage = expImage
				except:
					ex.Text = "Export"					
				ex.Width = 60 * xRatio
				ex.Height = 30 * yRatio
				ex.Location = Point(formwidth - 125 * xRatio ,dg.Bottom + 15 * yRatio)					
				tvp.Controls.Add(ex)
				ex.Click += form.exportToExcel
				#Adding filepath export textbox
				filepathtb = TextBox()
				filepathtb.Text = "ExportFileName"
				filepathtb.Location = Point(0 ,dg.Bottom + 20 * yRatio)
				filepathtb.Width = formwidth - xlabel - 125 * xRatio
				tvp.Controls.Add(filepathtb)
				#Adding copy to clipboard button
				cb = Button()
				#Adding panel to form
				formbody.Controls.Add(tvp)
				form.output.append(dg)
				y = tvp.Bottom + 25 * yRatio
				form.topmost()
			elif j.__class__.__name__ == 'uitextnote':
				gb = GroupBox()
				gb.Text = j.title
				gb.Parent = form
				gb.SendToBack()
				gb.BackColor = Color.Transparent
				gb.Location = Point(xlabel, y)
				tn = Label()
				tn.Location = Point(xlabel,18 * yRatio)
				tn.AutoSize = True
				tn.MaximumSize = Size(formwidth - rightmargin - 50 * xRatio,0)
				tn.Text = j.textnote
				tn.BringToFront()
				gb.Controls.Add(tn)
				gb.Size = Size(formwidth  - rightmargin - 25 * xRatio, tn.Bottom-tn.Top+25 * yRatio)  
				y = gb.Bottom + 25 * xRatio
				formbody.Controls.Add(gb)
			elif j.__class__.__name__ == 'uibool':
				yn = CheckBox()
				yn.Width = formwidth - xinput - rightmargin + 10 * xRatio
				yn.Location = Point(xinput,y)
				yn.Text = j.booltext
				g = yn.CreateGraphics()
				sizetext = g.MeasureString(yn.Text,yn.Font, formwidth - xinput - rightmargin -20 * xRatio)
				heighttext = sizetext.Height
				yn.Height = heighttext + 15 * yRatio
				yn.Checked = j.defaultvalue
				formbody.Controls.Add(yn)
				form.output.append(yn)
				y = yn.Bottom + 25 * yRatio
			elif j.__class__.__name__ == 'uiradio':
				yrb = 20 * yRatio
				rbs = []
				rbgroup = mygroupbox()
				if j.inputname != "":
					rbgroup.Width = formwidth - xinput - rightmargin
					rbgroup.Location = Point(xinput,y)
				else:
					rbgroup.Width = formwidth - xlabel - rightmargin
					rbgroup.Location = Point(xlabel,y)					
				rbgroup.Tag = j
				rbcounter = 0
				for key in j.keys():
					if key != 'inputname' and key != 'defaultvalue':
						rb = RadioButton()
						rb.Text = key 
						if j.inputname != "":
							rb.Width = formwidth - xinput - rightmargin - 35 * xRatio
						else:
							rb.Width = formwidth - xlabel - rightmargin - 35 * xRatio
						rb.Location = Point(20 * xRatio,yrb)
						if rbcounter == j.defaultvalue:
							rb.Checked = True
						rbgroup.Controls.Add(rb)
						g = rb.CreateGraphics()
						sizetext = g.MeasureString(key,rb.Font, formwidth - xinput - 90*xRatio)
						heighttext = sizetext.Height
						rb.Height = heighttext + 15 * yRatio
						ybot = rb.Bottom
						yrb += heighttext + 12 * yRatio
						rbcounter += 1
					else:
						pass
				rbgroup.Height = ybot + 20 * yRatio
				[rbgroup.Controls.Add(rb) for rb in rbs]
				formbody.Controls.Add(rbgroup)
				form.output.append(rbgroup)
				y = rbgroup.Bottom + 25 * yRatio
			elif j.__class__.__name__  == 'uifilepath':
				fp = Button()
				if j.inputname != "":
					fp.Width = formwidth - xinput - rightmargin
					fp.Location = Point(xinput,y)
				else:
					fp.Width = formwidth - xlabel - rightmargin		
					fp.Location = Point(xlabel,y)					
				fp.Tag = j.defaultvalue
				if not j.defaultvalue == "FilePath":
					fp.Tag = j.defaultvalue
					fp.MouseHover += form.showtooltip	
				fp.Text = j.buttontext
				fp.Height = 20 * yRatio				
				formbody.Controls.Add(fp)
				fp.Click += form.openfile
				form.output.append(fp)
				y = label.Bottom + 25 * yRatio
			elif j.__class__.__name__ == 'uidirectorypath':
				dp = Button()
				if j.inputname != "":
					dp.Width = formwidth - xinput - rightmargin
					dp.Location = Point(xinput,y)
				else:
					dp.Width = formwidth - xlabel - rightmargin		
					dp.Location = Point(xlabel,y)				
				dp.Tag = j.defaultvalue
				dp.Text = j.buttontext
				if not j.defaultvalue == "DirectoryPath":
					dp.Tag = j.defaultvalue
					dp.MouseHover += form.showtooltip
				dp.Text = j.buttontext	
				dp.Height = 20 * yRatio				
				formbody.Controls.Add(dp)
				dp.Click += form.opendirectory
				form.output.append(dp)
				y = label.Bottom + 25 * yRatio
			elif j.__class__.__name__ == 'uiselectelements':
				se = Button()
				if j.inputname != "":
					se.Width = formwidth - xinput - rightmargin
					se.Location = Point(xinput,y)
				else:
					se.Width = formwidth - xlabel - rightmargin		
					se.Location = Point(xlabel,y)
				se.Text = j.buttontext
				se.Height = 20 * yRatio
				formbody.Controls.Add(se)
				if j.multi == False:
					se.Click += form.pickobjects
				else:
					se.Click  += form.pickobject
				form.output.append(se)
				y = label.Bottom + 25 * yRatio
			elif j.__class__.__name__ == 'uiselectautocadelements':
				se = Button()
				if j.inputname != "":
					se.Width = formwidth - xinput - rightmargin
					se.Location = Point(xinput,y)
				else:
					se.Width = formwidth - xlabel - rightmargin		
					se.Location = Point(xlabel,y)
				se.Text = j.buttontext
				se.Height = 20 * yRatio
				formbody.Controls.Add(se)
				if j.multi == False:
					se.Click += form.pickautocadobjects
				else:
					se.Click += form.pickautocadobject								
				form.output.append(se)
				y = label.Bottom + 25 * yRatio				
			elif j.__class__.__name__ == 'uiselectOrderedelements':
				se = Button()
				if j.inputname != "":
					se.Width = formwidth - xinput - rightmargin
					se.Location = Point(xinput,y)
				else:
					se.Width = formwidth - xlabel - rightmargin		
					se.Location = Point(xlabel,y)
				se.Text = j.buttontext
				se.Height = 20 * yRatio				
				formbody.Controls.Add(se)
				se.Click  += form.pickobjectsordered
				form.output.append(se)
				y = label.Bottom + 25 * yRatio
			elif j.__class__.__name__ == 'uiselectlinkedelements':
				se = Button()
				if j.inputname != "":
					se.Width = formwidth - xinput - rightmargin
					se.Location = Point(xinput,y)
				else:
					se.Width = formwidth - xlabel - rightmargin		
					se.Location = Point(xlabel,y)
				se.Text = j.buttontext
				se.Height = 20 * yRatio				
				formbody.Controls.Add(se)
				if j.multi == False:
					se.Click += form.picklinkedobjects
				else:
					se.Click  += form.picklinkedobject
				form.output.append(se)

				y = label.Bottom + 25 * yRatio
			elif j.__class__.__name__ == 'uiselectlinkedelementsofcat':
				sec = Button()
				if j.inputname != "":
					sec.Width = formwidth - xinput - rightmargin
					sec.Location = Point(xinput,y)
				else:
					sec.Width = formwidth - xlabel - rightmargin		
					sec.Location = Point(xlabel,y)
				sec.Text = j.buttontext
				sec.Tag = j.category
				sec.Height = 20 * yRatio
				formbody.Controls.Add(sec)
				if j.multi == False:
					sec.Click += form.picklinkedobjectsofcat
				else:
					sec.Click += form.picklinkedobjectofcat
				form.output.append(sec)
				y = label.Bottom + 25 * yRatio
			elif j.__class__.__name__ == 'uiselectelementsofcat':
				sec = Button()
				if j.inputname != "":
					sec.Width = formwidth - xinput - rightmargin
					sec.Location = Point(xinput,y)
				else:
					sec.Width = formwidth - xlabel - rightmargin		
					sec.Location = Point(xlabel,y)
				sec.Text = j.buttontext
				sec.Tag = j.category
				sec.Height = 20 * yRatio
				formbody.Controls.Add(sec)
				if j.multi == False:
					sec.Click += form.pickobjectsofcat
				else:
					sec.Click += form.pickobjectofcat
				form.output.append(sec)
				y = label.Bottom + 25 * yRatio
			elif j.__class__.__name__ == 'uiselectOrderedelementsofcat':
				sec = Button()
				if j.inputname != "":
					sec.Width = formwidth - xinput - rightmargin
					sec.Location = Point(xinput,y)
				else:
					sec.Width = formwidth - xlabel - rightmargin		
					sec.Location = Point(xlabel,y)
				sec.Text = j.buttontext
				sec.Tag = j.category
				sec.Height = 20 * yRatio
				formbody.Controls.Add(sec)
				sec.Click += form.pickobjectsofcatordered
				form.output.append(sec)
				y = label.Bottom + 25 * yRatio
			elif j.__class__.__name__ == 'uiselectfaces':
				sf = Button()
				if j.inputname != "":
					sf.Width = formwidth - xinput - rightmargin
					sf.Location = Point(xinput,y)
				else:
					sf.Width = formwidth - xlabel - rightmargin		
					sf.Location = Point(xlabel,y)
				sf.Text = j.buttontext
				sf.Height = 20 * yRatio
				formbody.Controls.Add(sf)
				sf.Click += form.pickfaces
				form.output.append(sf)
				y = label.Bottom + 25 * yRatio
			elif j.__class__.__name__ == 'uiselectpointsonface':
				spf = Button()
				if j.inputname != "":
					spf.Width = formwidth - xinput - rightmargin
					spf.Location = Point(xinput,y)
				else:
					spf.Width = formwidth - xlabel - rightmargin		
					spf.Location = Point(xlabel,y)
				spf.Text = j.buttontext
				spf.Height = 20 * yRatio
				formbody.Controls.Add(spf)
				spf.Click += form.pickpointsonface
				form.output.append(spf)
				y = label.Bottom + 25 * yRatio
			elif j.__class__.__name__ == 'uiselectedges':
				sed = Button()
				if j.inputname != "":
					sed.Width = formwidth - xinput - rightmargin
					sed.Location = Point(xinput,y)
				else:
					sed.Width = formwidth - xlabel - rightmargin		
					sed.Location = Point(xlabel,y)
				sed.Text = j.buttontext
				sed.Height = 20 * yRatio
				formbody.Controls.Add(sed)
				sed.Click += form.pickedges
				form.output.append(sed)
				y = label.Bottom + 25 * yRatio
				
			elif j.__class__.__name__ == 'uislider':
				gb = Panel()
				if j.defaultvalue == '':
					defval = j.minimum
				else:
					defval = j.defaultvalue
				sl = mytrackbar(j.minimum,j.step)
				if j.inputname != "":
					gb.Width = formwidth - xinput - rightmargin
					gb.Location = Point(xinput,y)
				else:
					gb.Width = formwidth - xlabel - rightmargin		
					gb.Location = Point(xlabel,y)
				gb.Height = 40 * yRatio
				sl.Minimum = 0
				sl.Maximum = (j.maximum-j.minimum)/j.step
				sl.Value = (defval - j.minimum) / j.step
				sl.TickFrequency = (j.maximum-j.minimum)/j.step/10
				sl.Location = Point(40 * xRatio,0)
				if j.inputname != "":
					sl.Width = formwidth - xinput - rightmargin - 35 * xRatio
				else:
					sl.Width = formwidth - xlabel -rightmargin - 35 * xRatio
				gb.Controls.Add(sl)
				form.output.append(sl)
				displabel = Label()
				displabel.Width = 50 * xRatio
				displabel.Location = Point(0,5 * yRatio)
				displabel.Text = str(defval)
				displabel.Height = 30 * yRatio
				displabel.BringToFront()
				gb.Controls.Add(displabel)	
				formbody.Controls.Add(gb)			
				sl.Scroll += form.scroll
				y = label.Bottom + 25 * yRatio
			elif j.__class__.__name__ == 'uiimage':
				pic = Image.FromFile(j.image)
				im = PictureBox()
				if j.showborder:
					im.BorderStyle = BorderStyle.Fixed3D
				else:
					im.BorderStyle = BorderStyle.None
				ratio = (pic.Height)/(pic.Width)
				h = float(pic.Height)
				w = float(pic.Width)
				ratio = h/w
				image_maxsize = formwidth - xlabel - rightmargin
				im.Size = Size(image_maxsize,image_maxsize*ratio)
				scaledimage = Bitmap(image_maxsize,image_maxsize*ratio)
				gr = Graphics.FromImage(scaledimage)
				gr.DrawImage(pic,0,0,image_maxsize,image_maxsize*ratio)
				im.Image = pic
				im.SizeMode = PictureBoxSizeMode.Zoom
				formbody.Controls.Add(im)
				im.Location = Point(25 * xRatio,y+25*yRatio)
				y = im.Bottom + 25 * yRatio
		
			elif j.__class__.__name__ == 'uicolorpick' and importcolorselection == 0:
				cp = Button()
				if j.inputname != "":
					cp.Width = formwidth - xinput - rightmargin
					cp.Location = Point(xinput,y)
				else:
					cp.Width = formwidth - xlabel - rightmargin		
					cp.Location = Point(xlabel,y)
				cp.Text = j.buttontext
				cp.Height = 30 * yRatio
				formbody.Controls.Add(cp)
				cp.Click += form.colorpicker
				form.output.append(cp)
				y = label.Bottom + 25 * yRatio	
			elif j.__class__.__name__ == 'uicolorpick' and importcolorselection == 1:
				importcolorselection = 2
			elif j.__class__.__name__ == 'uigroup':
				grouppanel = GroupBox()
				grouppanel.Text = j.groupname
				grouppanel.Location = Point(xlabel,y)
				grouppanel.Width = formwidth - 65 * xRatio
				#recursive implementation of the definition to process grouped inputs
				addinput(grouppanel,j.inputgroup,25*yRatio,xinput-25*xRatio,80 * xRatio,90 * xRatio,importcolorselection)
				formbody.Controls.Add(grouppanel)
				y = grouppanel.Bottom + 25 * yRatio
			elif j.__class__.__name__ == 'uiconditional':
				grouppanelcond = GroupBox()
				grouppanelcond.Location = Point(xlabel,y)
				grouppanelcond.Width = formwidth - 65 * xRatio	
				form.output.append(grouppanelcond)				
				#recursive implementation of the definition to process conditional groups of inputs
				panlist = []
				rblist = []
				yp = 25 * yRatio
				xrb = 25 * xRatio
				for i,d in zip(j._Conditions,j._GroupedInputs):	
					rb = RadioButton()
					rb.CheckedChanged += form.ActivateOption
					rb.Text = i
					rb.Location	= Point(xrb,10*yRatio)
					rb.Width = 95 * xRatio
					rblist.append(rb)					
					grouppanelcond.Controls.Add(rb)				
					condition_pannel = Panel()
					condition_pannel.Name = i
					condition_pannel.Top = yp
					condition_pannel.Width = formwidth - 65 * xRatio
					condition_pannel.BackColor = Color.Transparent
					condition_pannel.BringToFront()					
					addinput(condition_pannel,d,25*yRatio,xinput-25*xRatio,80*xRatio,90*xRatio,importcolorselection)
					panlist.append(condition_pannel)
					yp = condition_pannel.Bottom - 25*yRatio
					xrb += 100 * xRatio
				for pan in panlist:
					grouppanelcond.Controls.Add(pan)
				for e,pan in enumerate(panlist):
					if e != j._defaultOptionIndex:
						pan.Enabled = False
					else:
						continue
				rblist[j._defaultOptionIndex].Checked = True
				grouppanelcond.Height = sum([p.Height for p in panlist]) - (len(panlist)-2)*25 * yRatio
				grouppanelcond.BackColor = Color.Transparent				
				formbody.Controls.Add(grouppanelcond)
				form.output.append([grouppanelcond.Tag])				
				y = grouppanelcond.Bottom + 25*yRatio
			formbody.Height = y


	# process input lists 
	addinput(body,inputtypes,0,IN[9],40 * xRatio ,IN[9] * xRatio,importcolorselection)
	
	#add the formbody panel to the form
	form.Controls.Add(body)		
	

	if IN[6] != None:
		if IN[8] > 400 * yRatio:
			formy += 50 * yRatio
			xinput = 270 * yRatio
		else:
			formy = logo.Bottom + 20 * yRatio
	else:
		formy += 50 * yRatio



	#Adding validation button
	
	button = Button()
	button.Text = IN[1]
	button.Width = formwidth - xinput - 40 * xRatio
	button.Height = 20 * yRatio
	button.Location = Point (xinput,formy)
	button.Click += form.setclose
	form.Controls.Add(button)
	form.MaximizeBox = False
	form.MinimizeBox = False
	form.FormBorderStyle = FormBorderStyle.FixedSingle
	
	#Adding Cancel button
	if IN[6] != None:
		cancelbutton = Button()
		cancelbutton.Text = IN[6]
		cancelbutton.Width = 120 * xRatio
		cancelbutton.Height = 20 * xRatio
		cancelbutton.Name = "Cancel"
		cancelbutton.Location = Point (xinput -120 * xRatio ,formy)
		cancelbutton.Click += form.setclose
		form.Controls.Add(cancelbutton)
		form.CancelButton = cancelbutton
	
	#Adding link to help
	
	if IN[5] != None :
		helplink = LinkLabel()
		helplink.Text = "Help"
		helplink.Tag = IN[5]
		helplink.Click += form.openurl
		helplink.Location = Point(formwidth - 65 * xRatio ,formy+30 * yRatio)
		form.Controls.Add(helplink)
	else:
		pass	
			
	form.ShowIcon = True
	form.Width = formwidth
	form.Height = formy + 120 * yRatio
	formfooterheight = form.Height - formheaderheight
	
	# Make formbody scrollable
	
	# if the form is longer than its maximum height, do the following:
	# modify the form height
	# make the formbody panel scrollable
	if form.Height + body.Height > IN[7] * yRatio and IN[7] * yRatio > 0:
		formbody_calculatedheight = IN[7] * yRatio - form.Height
		# make sure the formbody is at least 100 px high
		if formbody_calculatedheight < 100 * yRatio: formbody_calculatedheight = 100 * yRatio
		body.Height = formbody_calculatedheight
		form.Height = form.Height + formbody_calculatedheight
		# this (and apparently only this) will implement a vertical AutoScroll *only*
		# http://stackoverflow.com/a/28583501
		body.HorizontalScroll.Maximum = 0
		body.AutoScroll = False
		body.VerticalScroll.Visible = False
		body.AutoScroll = True
		body.BorderStyle = BorderStyle.Fixed3D
	else:
		form.Height = form.Height + body.Height
	# Move footer elements
	logo.Location = Point(logo.Location.X, logo.Location.Y + body.Height)
	button.Location = Point(button.Location.X, button.Location.Y + body.Height)
	if IN[6] != None: cancelbutton.Location = Point(cancelbutton.Location.X, cancelbutton.Location.Y + body.Height)
	if IN[5] != None: helplink.Location = Point(helplink.Location.X, helplink.Location.Y + body.Height)

	#Positionning the form at top left of current view
	#In The revit environment
	try:
		uiviews = uidoc.GetOpenUIViews()
		if doc.ActiveView.IsValidType(doc.ActiveView.GetTypeId()):
			activeviewid = doc.ActiveView.Id
			activeUIView = [v for v in uiviews if v.ViewId == activeviewid][0]
		else:
			activeUIView = uiviews[0]
		rect = activeUIView.GetWindowRectangle()
		form.StartPosition = FormStartPosition.Manual
		form.Location = Point(rect.Left-7 * xRatio,rect.Top)
	except:
		pass
	
		
	if IN[2]:
		if importcolorselection != 2:
			Application.Run(form)
			result = form.values
			OUT = result,True, form.cancelled 
		else:
			OUT = ['ColorSelection input is only available With Revit 2017'] , False, False
	else :
		OUT = ['Set toggle to true!'] , False, False
except:
	import traceback
	OUT = traceback.format_exc() , "error", "error"
# ----------------------------------------
