# Dynamo graph script.dyn "430_2.1_Заполнение отметок" (Dynamo 2.6.1.8786)

наименование_типа_семейства = CodeBlock { "(Отв_Задание)_Стены_Прямоугольное"; }
byName = FamilyType.ByName(name=наименование_типа_семейства)
all_elements_of_family_type = ElementsOfFamilyType(Family_Type=byName)
code_block = CodeBlock(x=all_elements_of_family_type) { x; }
string = StringInput("сохранить ли отметки этажей")
getParameterValueByName = Element.GetParameterValueByName(element=code_block, parameterName=string)
python_script = Python(IN[0]=code_block, IN[1]=getParameterValueByName)
# ---------- python_script.python (6 lines) ----------
OUT = []


for bool, elem in zip(IN[1],IN[0]):
	if not bool:
		OUT.append(elem)
# ----------------------------------------

# group: создание линий
code_block_2 = CodeBlock(x=python_script) { x; }
string_2 = StringInput("Отметка от уровня")
getParameterValueByName_2 = Element.GetParameterValueByName(element=code_block_2, parameterName=string_2)
string_3 = StringInput("Уровень")
getParameterValueByName_3 = Element.GetParameterValueByName(element=code_block_2, parameterName=string_3)
categories = Categories("OST_Levels")
all_elements_of_category = ElementsOfCategory(Category=categories)
python_script_2 = Python(IN[0]=all_elements_of_category)
# ---------- python_script_2.python (23 lines) ----------
levels = IN[0]

elevation_list = []
OUT = []


for lvl in levels:
	elevation_list.append(lvl.Elevation)
	
sort_elevation_list = list(elevation_list)
sort_elevation_list.sort()

out_levels = []
index_list = []
for last_elevation, new_elevation,lvl in zip(elevation_list,sort_elevation_list,levels):
	index = elevation_list.index(new_elevation)
	index_list.append(index)


for i,indx in enumerate(index_list):
	elevation_list[i] = levels[indx]

OUT = elevation_list
# ----------------------------------------
string_4 = StringInput("Высота")
getParameterValueByName_4 = Element.GetParameterValueByName(element=code_block_2, parameterName=string_4)
python_script_3 = Python(IN[0]=code_block_2, IN[1]=getParameterValueByName_2, IN[2]=getParameterValueByName_3, IN[3]=python_script_2, IN[4]=getParameterValueByName_4)
# ---------- python_script_3.python (56 lines) ----------
OUT = []
elements = IN[0]
el_hight_by_levels = IN[1]
el_lvls = IN[2]
model_lvls = IN[3]
el_higths =IN[4]
max_lvl_hight = model_lvls[0].Elevation
min_lvl_hight = model_lvls[-1].Elevation

def find_higers(lvl, levels):
	id = levels.index(lvl)
	try:
		return levels[id+1]
	except:
		return levels[id]

upper_levels = []
for el_lvl in el_lvls:
	upper_levels.append(find_higers(el_lvl, model_lvls))

lvl_down_otm = []
lvl_up_otm = []
for down_lvl,up_lvl in zip(el_lvls, upper_levels):
	lvl_down_otm.append(down_lvl.Elevation)
	lvl_up_otm.append(up_lvl.Elevation)

absolute_otm = []

for otm_down, otm_by_lvl,el_hight in zip(lvl_down_otm,el_hight_by_levels,el_higths):
	absolute_otm.append(otm_down+otm_by_lvl-el_hight/2)




lvl_up_otm_correct = []
lvl_down_otm_correct = []
for lvl_up, lvl_down, otm in zip(lvl_up_otm,lvl_down_otm,absolute_otm):
	if lvl_down <otm< lvl_up:
		lvl_up_otm_correct.append(lvl_up)
		lvl_down_otm_correct.append(lvl_down)
		
	elif otm>lvl_up and otm>0:
		lvl_up_otm_correct.append(round(otm+2000,1000))
		lvl_down_otm_correct.append(lvl_down)
		
	elif otm<lvl_down and otm<0:
		lvl_up_otm_correct.append(lvl_down)
		lvl_down_otm_correct.append(round(otm-2000,1000))
	
		
	
		
		
OUT = [lvl_up_otm_correct,lvl_down_otm_correct,absolute_otm]

	
# ----------------------------------------
code_block_3 = CodeBlock(x=python_script_3) { "Отметка этажа над заданием"; x[0]; "Отметка этажа под заданием"; x[1]; "ADSK_Отверстие_Отметка от нуля"; x[2]; }
setParameterByName = Element.SetParameterByName(element=code_block_2, parameterName=code_block_3.out4, value=code_block_3.out5)
setParameterByName_2 = Element.SetParameterByName(element=code_block_2, parameterName=code_block_3.out0, value=code_block_3.out1)
setParameterByName_3 = Element.SetParameterByName(element=code_block_2, parameterName=code_block_3.out2, value=code_block_3.out3)
watch = Watch(code_block_3.out1)
watch_2 = Watch(code_block_3.out3)
watch_3 = Watch(code_block_3.out5)
