# Dynamo graph script.dyn "430_3_Сохранить версию задания" (Dynamo 2.6.1.8786)

наименование_типа_семейства = CodeBlock()
# ---------- наименование_типа_семейства.designscript (2 lines) ----------
["(Отв_Задание)_Перекрытия_Прямоугольное",
"(Отв_Задание)_Стены_Прямоугольное"];
# ----------------------------------------
byName = FamilyType.ByName(name=наименование_типа_семейства)

# group: Создание версии задания Все текущие задания присвоить порядковый номер !=V0
all_elements_of_family_type = ElementsOfFamilyType(Family_Type=byName)
code_block = CodeBlock { "SD_Версия задания"; }
code_block_2 = CodeBlock {  }

flatten = List.Flatten(list=all_elements_of_family_type)

# group: IF
создать_версию_задания = BoolSelector(true)
code_block_3 = CodeBlock(t=создать_версию_задания, elem=flatten) { x=t?elem:null; }

# group (continued): Создание версии задания Все текущие задания присвоить порядковый номер !=V0
flatten_2 = List.Flatten(list=code_block_3)
getParameterValueByName = Element.GetParameterValueByName(element=flatten_2, parameterName=code_block)

code_block_4 = CodeBlock { 1; }
substring = String.Substring(str=getParameterValueByName, startIndex=code_block_4, length=code_block_4)
code_block_5 = CodeBlock { 1; }
remove = String.Remove(str=getParameterValueByName, startIndex=code_block_5, count=code_block_5)
python_script = Python(IN[0]=getParameterValueByName)
# ---------- python_script.python (25 lines) ----------
import sys
import clr
clr.AddReference('ProtoGeometry')
from Autodesk.DesignScript.Geometry import *
import re

def split_string(source,separators):
    return re.split('[{0}]'.format(re.escape(separators)),source)
OUT = []
# Введенные в этом узле данные сохраняется в виде списка в переменных IN.

for i in IN[0]:
	
	split_list = split_string(i,'|')
	lenn = len(split_list)
		
	x = split_list.pop(0)[1:]
	if x !='':
	
		OUT.Add(x)
	else:
		OUT.Add('0')
	
	
	
# ----------------------------------------
toNumber = String.ToNumber(str=python_script)
sortByKey = List.SortByKey(list=toNumber, keys=toNumber)
code_block_6 = CodeBlock(x=sortByKey.sorted_list) { DSCore.List.Count(x)-1; }
getItemAtIndex = List.GetItemAtIndex(list=sortByKey.sorted_list, index=code_block_6)
code_block_7 = CodeBlock(t=toNumber, MaxNum=getItemAtIndex) { t==0?MaxNum+1:t; }
code_block_8 = CodeBlock(x=code_block_7) { x+""; }
insert = String.Insert(str=remove, index=code_block_5, toInsert=code_block_8)
code_block_9 = CodeBlock { "SD_Версия задания"; }
python_script_2 = Python(IN[0]=getParameterValueByName, IN[1]=code_block_8)
# ---------- python_script_2.python (29 lines) ----------
import sys
import clr
clr.AddReference('ProtoGeometry')
from Autodesk.DesignScript.Geometry import *
import re

def split_string(source,separators):
    return re.split('[{0}]'.format(re.escape(separators)),source)
OUT = []
# Введенные в этом узле данные сохраняется в виде списка в переменных IN.

for i,ver in enumerate(IN[0]):
	
	split_list = split_string(ver,'|')
	lenn = len(split_list)
		
	x = split_list.pop(0)[1:]
	t='V'+ IN[1][i]
	split_list.Insert(0,t)
	strr = ''
	for i in split_list:
		strr+=i+'|'
	strr = strr[:-1]
	
	OUT.Add(strr)
	
	
	
	
# ----------------------------------------
setParameterByName = Element.SetParameterByName(element=flatten_2, parameterName=code_block_9, value=python_script_2)
code_block_10 = CodeBlock(x=flatten) { x; }
code_block_11 = CodeBlock()
# ---------- code_block_11.designscript (2 lines) ----------
//Параметр;
"SD_Версия задания";
# ----------------------------------------
getParameterValueByName_2 = Element.GetParameterValueByName(element=code_block_10, parameterName=code_block_11)
python_script_3 = Python(IN[0]=getParameterValueByName_2)  # same code as python_script
code_block_12 = CodeBlock(el=code_block_10, str=python_script_3) { DSCore.List.FilterByBoolMask(el,DSCore.String.ToNumber(str)==0)["in"]; }
code_block_13 = CodeBlock()  # same code as code_block_11
getParameterValueByName_3 = Element.GetParameterValueByName(element=code_block_12, parameterName=code_block_13)

# group: Удаление начала и конца в параметре
code_block_14 = CodeBlock(x=getParameterValueByName_3) { x; }
code_block_15 = CodeBlock { "|"; }
lastIndexOf = String.LastIndexOf(str=code_block_14, searchFor=code_block_15)
length = String.Length(str=code_block_14)
code_block_16 = CodeBlock(x=length, y=lastIndexOf) { x-y; }
remove_2 = String.Remove(str=code_block_14, startIndex=lastIndexOf, count=code_block_16)
indexOf = String.IndexOf(str=remove_2, searchFor=code_block_15)
code_block_17 = CodeBlock(x=indexOf) { 0; x+1; }
remove_3 = String.Remove(str=remove_2, startIndex=code_block_17.out0, count=code_block_17.out1)

code_block_18 = CodeBlock(el=code_block_10, str=python_script_3) { DSCore.List.FilterByBoolMask(el,DSCore.String.ToNumber(str)==0)["out"]; }
getLocation = Element.GetLocation(element=code_block_18)
code_block_19 = CodeBlock()
# ---------- code_block_19.designscript (4 lines) ----------
//Параметр;
"Ширина";
"Высота";
"Глубина";
# ----------------------------------------
getParameterValueByName_4 = Element.GetParameterValueByName(element=code_block_18, parameterName=code_block_19.out0)
getParameterValueByName_5 = Element.GetParameterValueByName(element=code_block_18, parameterName=code_block_19.out1)
getParameterValueByName_6 = Element.GetParameterValueByName(element=code_block_18, parameterName=code_block_19.out2)

# group: Создание строки описывающей отверстия
точность_выставления_задания_по = CodeBlock { 10; }  # "Точность выставления задания по координатам, мм"
разделитель = CodeBlock { "|"; ",000000"; ""; }
code_block_20 = CodeBlock(tochnoct=точность_выставления_задания_по, razdelitel=разделитель.out0, x=getLocation, Shirina=getParameterValueByName_4, Visota=getParameterValueByName_5, Glubina=getParameterValueByName_6)
# ---------- code_block_20.designscript (10 lines) ----------
a=tochnoct;
r=razdelitel;


Math.Round(x.X/a)*a+r+
Math.Round(x.Y/a)*a+r+
Math.Round(x.Z/a)*a+r+
Shirina+r+
Visota+r+
Glubina;
# ----------------------------------------
flatten_3 = List.Flatten(list=code_block_20.out2)
replace = String.Replace(str=flatten_3, searchFor=разделитель.out1, replaceWith=разделитель.out2)

eq = remove_3 == replace  # lacing=CrossProduct
allFalse = List.AllFalse(list=eq@L2)
code_block_21 = CodeBlock(el=code_block_12, x=allFalse) { DSCore.List.FilterByBoolMask(el,x)["out"]; }
delete = Element.Delete(element=code_block_21)
eq_2 = replace == remove_3  # lacing=CrossProduct
allFalse_2 = List.AllFalse(list=eq_2@L2)
code_block_22 = CodeBlock(el=code_block_18, x=allFalse_2) { DSCore.List.FilterByBoolMask(el,x)["out"]; }
code_block_23 = CodeBlock { "SD_Версия задания"; }
code_block_24 = CodeBlock()  # same code as code_block_11
getParameterValueByName_7 = Element.GetParameterValueByName(element=code_block_22, parameterName=code_block_24)
code_block_25 = CodeBlock { "|"; }
allIndicesOf = String.AllIndicesOf(str=getParameterValueByName_7, searchFor=code_block_25)
code_block_26 = CodeBlock { 0; 6; }
getItemAtIndex_2 = List.GetItemAtIndex(list=allIndicesOf@L2, index=code_block_26.out0)
code_block_27 = CodeBlock(x=getItemAtIndex_2) { x+1; }
getItemAtIndex_3 = List.GetItemAtIndex(list=allIndicesOf@L2, index=code_block_26.out1)
code_block_28 = CodeBlock(x=getItemAtIndex_3, y=getItemAtIndex_2) { x-y-1; }
substring_2 = String.Substring(str=getParameterValueByName_7, startIndex=code_block_27, length=code_block_28)
code_block_29 = CodeBlock(el=replace, x=allFalse_2) { DSCore.List.FilterByBoolMask(el,x)["out"]; }
replace_2 = String.Replace(str=getParameterValueByName_7, searchFor=substring_2, replaceWith=code_block_29)
code_block_30 = CodeBlock { "|Удалено"; "|Перемещено"; }
replace_3 = String.Replace(str=replace_2, searchFor=code_block_30.out0, replaceWith=code_block_30.out1)
setParameterByName_2 = Element.SetParameterByName(element=code_block_22, parameterName=code_block_23, value=replace_3)
code_block_31 = CodeBlock(x=getItemAtIndex) { y=x+1; }
code_block_32 = CodeBlock(x=code_block_31) { "Номер созданного задания - №"+x; }
watch = Watch(code_block_32)
наименование_типа_семейства_2 = CodeBlock { "(Отв_Задание)_Стены_Прямоугольное"; }
byName_2 = FamilyType.ByName(name=наименование_типа_семейства_2)
all_elements_of_family_type_2 = ElementsOfFamilyType(Family_Type=byName_2)
code_block_33 = CodeBlock(x=all_elements_of_family_type_2) { x; }
string = StringInput("сохранить ли отметки этажей")
getParameterValueByName_8 = Element.GetParameterValueByName(element=code_block_33, parameterName=string)
python_script_4 = Python(IN[0]=code_block_33, IN[1]=getParameterValueByName_8)
# ---------- python_script_4.python (6 lines) ----------
OUT = []


for bool, elem in zip(IN[1],IN[0]):
	if not bool:
		OUT.append(elem)
# ----------------------------------------

# group: создание линий
code_block_34 = CodeBlock(x=python_script_4) { x; }
string_2 = StringInput("Отметка от уровня")
getParameterValueByName_9 = Element.GetParameterValueByName(element=code_block_34, parameterName=string_2)
string_3 = StringInput("Уровень")
getParameterValueByName_10 = Element.GetParameterValueByName(element=code_block_34, parameterName=string_3)
categories = Categories("OST_Levels")
all_elements_of_category = ElementsOfCategory(Category=categories)
python_script_5 = Python(IN[0]=all_elements_of_category)
# ---------- python_script_5.python (23 lines) ----------
levels = IN[0]

elevation_list = []
OUT = []


for lvl in levels:
	elevation_list.append(lvl.Elevation)
	
sort_elevation_list = list(elevation_list)
sort_elevation_list.sort()

out_levels = []
index_list = []
for last_elevation, new_elevation,lvl in zip(elevation_list,sort_elevation_list,levels):
	index = elevation_list.index(new_elevation)
	index_list.append(index)


for i,indx in enumerate(index_list):
	elevation_list[i] = levels[indx]

OUT = elevation_list
# ----------------------------------------
string_4 = StringInput("Высота")
getParameterValueByName_11 = Element.GetParameterValueByName(element=code_block_34, parameterName=string_4)
python_script_6 = Python(IN[0]=code_block_34, IN[1]=getParameterValueByName_9, IN[2]=getParameterValueByName_10, IN[3]=python_script_5, IN[4]=getParameterValueByName_11)
# ---------- python_script_6.python (56 lines) ----------
OUT = []
elements = IN[0]
el_hight_by_levels = IN[1]
el_lvls = IN[2]
model_lvls = IN[3]
el_higths =IN[4]
max_lvl_hight = model_lvls[0].Elevation
min_lvl_hight = model_lvls[-1].Elevation

def find_higers(lvl, levels):
	id = levels.index(lvl)
	try:
		return levels[id+1]
	except:
		return levels[id]

upper_levels = []
for el_lvl in el_lvls:
	upper_levels.append(find_higers(el_lvl, model_lvls))

lvl_down_otm = []
lvl_up_otm = []
for down_lvl,up_lvl in zip(el_lvls, upper_levels):
	lvl_down_otm.append(down_lvl.Elevation)
	lvl_up_otm.append(up_lvl.Elevation)

absolute_otm = []

for otm_down, otm_by_lvl,el_hight in zip(lvl_down_otm,el_hight_by_levels,el_higths):
	absolute_otm.append(otm_down+otm_by_lvl-el_hight/2)




lvl_up_otm_correct = []
lvl_down_otm_correct = []
for lvl_up, lvl_down, otm in zip(lvl_up_otm,lvl_down_otm,absolute_otm):
	if lvl_down <otm< lvl_up:
		lvl_up_otm_correct.append(lvl_up)
		lvl_down_otm_correct.append(lvl_down)
		
	elif otm>lvl_up and otm>0:
		lvl_up_otm_correct.append(round(otm+2000,1000))
		lvl_down_otm_correct.append(lvl_down)
		
	elif otm<lvl_down and otm<0:
		lvl_up_otm_correct.append(lvl_down)
		lvl_down_otm_correct.append(round(otm-2000,1000))
	
		
	
		
		
OUT = [lvl_up_otm_correct,lvl_down_otm_correct,absolute_otm]

	
# ----------------------------------------
code_block_35 = CodeBlock(x=python_script_6) { "Отметка этажа над заданием"; x[0]; "Отметка этажа под заданием"; x[1]; "ADSK_Отверстие_Отметка от нуля"; x[2]; }
setParameterByName_3 = Element.SetParameterByName(element=code_block_34, parameterName=code_block_35.out0, value=code_block_35.out1)
setParameterByName_4 = Element.SetParameterByName(element=code_block_34, parameterName=code_block_35.out2, value=code_block_35.out3)
setParameterByName_5 = Element.SetParameterByName(element=code_block_34, parameterName=code_block_35.out4, value=code_block_35.out5)
watch_2 = Watch(code_block_35.out1)
watch_3 = Watch(code_block_35.out3)
watch_4 = Watch(code_block_35.out5)
